# Grasshopper definition nakagin-capsule-tower.gh (Grasshopper 1.0.8)
# Copyright: GNU Lesser General Public License Version 3
# plug-ins: RhinoCodePluginGH, semio

panel = Panel("""_slanted
_twisted
_dancing_axonometry_explosion""")
variant = Slider(2, range=0..3)
save_diagram = BooleanToggle(False)
icon_export = BooleanToggle(False)
panel_2 = Panel("""Slanted
Twisted
Dancing""")
save = BooleanToggle(False)
load_kit = BooleanToggle(False)
sep = Separator()  # -> S; same code as sep
dir = Directory()  # -> D
# ---------- dir: C# ----------
#region Usings
using System;
using System.Linq;
using System.Collections;
using System.Collections.Generic;
using System.Drawing;
using System.IO;

using Rhino;
using Rhino.Geometry;

using Grasshopper;
using Grasshopper.Kernel;
using Grasshopper.Kernel.Data;
using Grasshopper.Kernel.Types;
#endregion

public class Script_Instance : GH_ScriptInstance
{
    private void RunScript(ref object D)
    {
        D = Path.GetDirectoryName(this.GrasshopperDocument.FilePath);
    }
}
# ---------- end dir ----------
and = GateAnd(A=save, B=save_diagram)
and_2 = GateAnd(A=save, B=icon_export)
loop_slider = PythonScript(SliderToModify=variant, Min="0", Max="3", stepSize="1", Delay=Slider(0, range=0..1), Run=Toggle(False), Reset=Button())  # inputs Run: Boolean, Reset: Boolean
# ---------- loop_slider: Python ----------
import time

def updateSliderInput(inputName,min,max,value,decimalPlace=2):
    for input in ghenv.Component.Params.Input:
        for source in input.Sources:
            if input.Name == str(inputName):
                source.Slider.DecimalPlaces = decimalPlace
                source.Slider.Minimum = min
                source.Slider.Maximum = max
                source.Slider.Value = value
                source.ExpireSolution(True)

def countDecimal(number):
    string= str(number)
    return string[::-1].find('.')

if Run == True:
    if SliderToModify < Max:
        time.sleep(Delay)
        updateSliderInput("SliderToModify",Min,Max,SliderToModify+stepSize,countDecimal(stepSize))
if Reset == True:
    updateSliderInput("SliderToModify",Min,Max,Min)
# ---------- end loop_slider ----------
# ^                                    ^
#    |                                     |
# <-- Constants    Preview -->
# Parameters    External    Local -->
# <-- Meta               |
#      |                       v
#      v
par = ParentDirectory(D=dir)  # -> P; inputs D: String
# ---------- par: C# ----------
#region Usings
using System;
using System.Linq;
using System.Collections;
using System.Collections.Generic;
using System.Drawing;
using System.IO;

using Rhino;
using Rhino.Geometry;

using Grasshopper;
using Grasshopper.Kernel;
using Grasshopper.Kernel.Data;
using Grasshopper.Kernel.Types;
#endregion

public class Script_Instance : GH_ScriptInstance
{
    private void RunScript(string D, ref object P)
    {
        P = new DirectoryInfo(D).Parent;
    }
}
# ---------- end par ----------
kit = CacheKit(uri=par, R=load_kit)  # -> ty_2, ur_2, objects_2, urpa_2, urpalc_2, urpare_2
item = ListItem(List=panel_2, Index=variant, Wrap=True)
panel_3 = Panel(item)
item_2 = ListItem(List="Explosion Axonometry", Index=variant, Wrap=True)
ty = Type([null x45])
objects = Data(Tree({0;0;0}: [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], {0;0;1}: [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], {0;0;2}: [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], {0;0;3}: [], {0;0;4}: [], {0;0;5}: [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]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))
xy = XYPlane(Origin=Point(0, 0, 0))
item_3 = ListItem(List="Explosion Axonometry", Index=0, Wrap=True)  # -> Item, Item1, Item2, Item3
item_4 = ListItem(List=panel_2, Index=0, Wrap=True)  # -> Item, Item1, Item2, Item3
item_5 = ListItem(List=panel, Index=0, Wrap=True)  # -> Item, Item1, Item2, Item3
variant_2 = GetString(item, AtLeast=0, AtMost=1, TreeAccess=False)
view = GetString(item_2, AtLeast=0, AtMost=1, TreeAccess=False)
list = ValueList({"1to500", "1to200", "collider"}, selected="1to500")
concat = Concatenate(FragmentC="icons", FragmentB=sep, FragmentA="nakagin-capsule-tower", FragmentF=item_5.Item, FragmentG=".svg")
concat_2 = Concatenate(FragmentC="icons", FragmentB=sep, FragmentA="nakagin-capsule-tower", FragmentF=item_5.Item1, FragmentG=".svg")
concat_3 = Concatenate(FragmentC="icons", FragmentB=sep, FragmentA="nakagin-capsule-tower", FragmentF=item_5.Item2, FragmentG=".svg")
concat_4 = Concatenate(FragmentC="icons", FragmentB=sep, FragmentA="nakagin-capsule-tower", FragmentF=item_5.Item3, FragmentG=".svg")
concat_5 = Concatenate(FragmentC="images", FragmentB=sep, FragmentA="nakagin-capsule-tower", FragmentF=item_5.Item, FragmentG=".png")
concat_6 = Concatenate(FragmentC="images", FragmentB=sep, FragmentA="nakagin-capsule-tower", FragmentF=item_5.Item1, FragmentG=".png")
concat_7 = Concatenate(FragmentC="images", FragmentB=sep, FragmentA="nakagin-capsule-tower", FragmentF=item_5.Item2, FragmentG=".png")
concat_8 = Concatenate(FragmentC="images", FragmentB=sep, FragmentA="nakagin-capsule-tower", FragmentF=item_5.Item3, FragmentG=".png")

genes = GenePool(Decimals=0, Maximum=8, Minimum=0, Value=[8, 8, 8, 8, 8, 8, 8, 8, 8, 8, 8])
genes_2 = GenePool(Decimals=0, Maximum=8, Minimum=0, Value=[6, 0, 0, 6, 0, 3, 6, 6, 0])
genes_3 = GenePool(Decimals=0, Maximum=8, Minimum=0, Value=[6, 6, 6, 6, 6, 6, 6, 7, 7])
genes_4 = GenePool(Decimals=0, Maximum=8, Minimum=0, Value=[6, 0, 0, 0, 6, 6, 0, 6, 0, 6, 3])

itemindex = ItemIndex(L=panel_2, I=variant_2)  # -> i; inputs L: list; same code as itemindex
zoom = Button()
bbox = BoundingBox(Plane=PlaneXY(0, 0, 0), UnionBox=True)  # -> Box, Box_2
item_6 = ListItem(List=panel, Index=itemindex, Wrap=True)
zoom2bb = ZoomToBoundingBox(N=["Top", "Front", "Right", "Perspective", "Parallel"], BB=bbox.Box, S=0, R=zoom)  # -> F, SBB; inputs BB: Box, R: Boolean
# ---------- zoom2bb: Python ----------
#Component Information
#--------------------------------------------------------------------------------------------
if ghenv.Component.RunCount<2:
    #General
    #--------------------------------------------------------------------------------------------
    __author__ = "Ueli Saluz"
    __version__ = "2022.05.21"
    
    ghenv.Component.Name = "ZoomToBoundingBox"
    ghenv.Component.NickName = "Zoom2BB"
    ghenv.Component.Description = "Zoom the view of a Rhino viewport to a bounding box."
    ghenv.Component.Message = "VER 1.1"
    ghenv.Component.Category = "Display"
    ghenv.Component.SubCategory = "Camera"
    
     #Inputs
    #--------------------------------------------------------------------------------------------
    inputIndex=0
    
    ghenv.Component.Params.Input[inputIndex].Name = "Name"
    ghenv.Component.Params.Input[inputIndex].NickName = "N"
    ghenv.Component.Params.Input[inputIndex].Description = "Name of the viewport"
    ghenv.Component.Params.Input[inputIndex].Optional = False
    inputIndex+=1
    
    ghenv.Component.Params.Input[inputIndex].Name = "BoundingBox"
    ghenv.Component.Params.Input[inputIndex].NickName = "BB"
    ghenv.Component.Params.Input[inputIndex].Description = ""
    ghenv.Component.Params.Input[inputIndex].Optional = False
    inputIndex+=1
    
    ghenv.Component.Params.Input[inputIndex].Name = "ScaleFactor"
    ghenv.Component.Params.Input[inputIndex].NickName = "S"
    ghenv.Component.Params.Input[inputIndex].Description = "A factor for the extension of the bounding box." \
    +"0 means 0 extension, a positive number makes the bounding box larger a negative smaller. The amount is proportional to the length."
    ghenv.Component.Params.Input[inputIndex].Optional = False
    inputIndex+=1
   
    
    ghenv.Component.Params.Input[inputIndex].Name = "Run"
    ghenv.Component.Params.Input[inputIndex].NickName = "R"
    ghenv.Component.Params.Input[inputIndex].Description = "Zoom to the given bounding box."
    ghenv.Component.Params.Input[inputIndex].Optional = False
    inputIndex+=1
    
    #Outputs
    #--------------------------------------------------------------------------------------------
    outputIndex=0
    
    ghenv.Component.Params.Output[outputIndex].Name = "Finished"
    ghenv.Component.Params.Output[outputIndex].NickName = "F"
    ghenv.Component.Params.Output[outputIndex].Description = "Sends True when finished. Just to trigger other depending components."
    outputIndex+=1
    
    ghenv.Component.Params.Output[outputIndex].Name = "ScaledBoundingBox"
    ghenv.Component.Params.Output[outputIndex].NickName = "SBB"
    ghenv.Component.Params.Output[outputIndex].Description = "The scaled bounding box."
    outputIndex+=1


#Imports
#--------------------------------------------------------------------------------------------
from Rhino import RhinoDoc
from Rhino.Geometry import Box

#Solver - Run with trees to enhance performance drastically
#--------------------------------------------------------------------------------------------
if __name__ == "__main__":
    try:
        vp = RhinoDoc.ActiveDoc.Views.Find(N, False).ActiveViewport
        if R:
            box = BB
            bb = BB.BoundingBox
            bb.Inflate(S*box.X.Length,S*box.Y.Length,S*box.Z.Length)
            vp.ZoomBoundingBox(bb)
            SBB = bb
        F = True
    except:
        pass
# ---------- end zoom2bb ----------

energy_global_warming_potential_kgco2e_k = ValueList({"Natural Gas": 0.201, "Heating Oil": 0.216, "Electricity Non-Renewable": 0.5, "Electricity Renewable": 0}, selected="Natural Gas")  # "Energy Global Warming Potential [kgCO2e/kWh]"
energy_global_warming_potential_kgco2e_k_2 = ValueList({"Natural Gas": 0.201, "Heating Oil": 0.216, "Electricity Non-Renewable": 0.5, "Electricity Renewable": 0}, selected="Electricity Non-Renewable")  # "Energy Global Warming Potential [kgCO2e/kWh]"
energy_price_kwh = ValueList({"Natural Gas": 0.095, "Heating Oil": 0.10, "Electricity Non-Renewable": 0.25, "Electrictiy Renewable": 0.35}, selected="Natural Gas")
energy_price_kwh_2 = ValueList({"Natural Gas": 0.095, "Heating Oil": 0.10, "Electricity Non-Renewable": 0.25, "Electrictiy Renewable": 0.35}, selected="Electricity Non-Renewable")

heating_energy_price_cent_kwh = Number(energy_price_kwh)
heating_global_warming_potential_kgco2e = Number(energy_global_warming_potential_kgco2e_k)  # "Heating Global Warming Potential [kgCO2e/kWh]"
electrictiy_global_warming_potential_kgc = Number(energy_global_warming_potential_kgco2e_k_2)  # "Electrictiy Global Warming Potential [kgCO2e/kWh]"
heating_efficiency_factor = Number(Slider(0.9, range=0.5..4))
cooling_energy_price_cent_kwh = Number(energy_price_kwh_2)
cooling_efficiency_factor = Number(Slider(0.9, range=0.5..4))
cooling_global_warming_potential_kgco2e = Number(energy_global_warming_potential_kgco2e_k_2)  # "Cooling Global Warming Potential [kgCO2e/kWh]"
electrictiy_energy_price_cent_kwh = Number(energy_price_kwh_2)

bridge_gap = Slider(0, range=-10..10)
bridge_shift = Slider(-0.8, range=-10..10)
bridge_raise = Slider(0, range=-10..10)
bridge_turn = Slider(0, range=-360..360)
bridge_rotation = Slider(0, range=-360..360)
bridge_tilt = Slider(0, range=-360..360)
diagram_force = Slider(0.6, range=0.6..1.4)
shaft_shift = Slider(0, range=-10..10)
shaft_gap = Slider(0, range=-10..10)
shaft_raise = Slider(0, range=-10..10)
shaft_rotation = Slider(0, range=-360..360)
shaft_turn = Slider(0, range=-360..360)
shaft_tilt = Slider(0, range=-360..360)
tambour_gap = Slider(0, range=-10..10)
tambour_shift = Slider(0, range=-10..10)
tambour_raise = Slider(0, range=-10..10)
tambour_rotation = Slider(0, range=-360..360)
tambour_turn = Slider(0, range=-360..360)
tambour_tilt = Slider(0, range=-360..360)
capsule_gap = Slider(0, range=-10..10)
capsule_shift = Slider(0, range=-10..10)
capsule_raise = Slider(0, range=-10..10)
capsule_rotation = Slider(0, range=-360..360)
capsule_turn = Slider(0, range=-360..360)
capsule_tilt = Slider(0, range=-360..360)
capital_gap = Slider(0, range=-10..10)
capital_shift = Slider(0, range=-10..10)
capital_raise = Slider(0, range=-10..10)
capital_rotation = Slider(0, range=-360..360)
capital_turn = Slider(0, range=-360..360)
capital_tilt = Slider(0, range=-360..360)
list_2 = ValueList({"Box": 0, "Balcony": 1, "Ellipsoid": 2, "Trapezoid": 3}, selected="Box")
panel_4 = Panel("The digital shadow of the former Nakagin Capsule Tower which was a mixed-use residential and office tower designed by architect Kisho Kurokawa and located in Shimbashi, Tokyo, Japan. Completed in 1972, the building was a rare remaining example of Japanese Metabolism, an architectural movement emblematic of Japan's postwar cultural resurgence.")
con = ModelConnection(
    Gap=capsule_gap,
    Shift=capsule_shift,
    Raise=capsule_raise,
    Rotation=capsule_rotation,
    Turn=capsule_turn,
    Tilt=capsule_tilt)  # -> Connection, Valid, ConnectedPieceId, ConnectedPieceTypePortId, ConnectingPieceId, ConnectingPieceTypePortId, Description, Gap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
con_2 = ModelConnection(Gap=shaft_gap, Shift=shaft_shift, Raise=shaft_raise, Rotation=shaft_rotation, Turn=shaft_turn, Tilt=shaft_tilt)  # -> Connection, Valid, ConnectedPieceId, ConnectedPieceTypePortId, ConnectingPieceId, ConnectingPieceTypePortId, Description, Gap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
con_3 = ModelConnection(
    Gap=capital_gap,
    Shift=capital_shift,
    Raise=capital_raise,
    Rotation=capital_rotation,
    Turn=capital_turn,
    Tilt=capital_tilt)  # -> Connection, Valid, ConnectedPieceId, ConnectedPieceTypePortId, ConnectingPieceId, ConnectingPieceTypePortId, Description, Gap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
con_4 = ModelConnection(
    Gap=tambour_gap,
    Shift=tambour_shift,
    Raise=tambour_raise,
    Rotation=tambour_rotation,
    Turn=tambour_turn,
    Tilt=tambour_tilt)  # -> Connection, Valid, ConnectedPieceId, ConnectedPieceTypePortId, ConnectingPieceId, ConnectingPieceTypePortId, Description, Gap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
con_5 = ModelConnection(Gap=bridge_gap, Shift=bridge_shift, Raise=bridge_raise, Rotation=bridge_rotation, Turn=bridge_turn, Tilt=bridge_tilt)  # -> Connection, Valid, ConnectedPieceId, ConnectedPieceTypePortId, ConnectingPieceId, ConnectingPieceTypePortId, Description, Gap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
base_with_twin_capsule_towers_with_capit = BaseWithTwinCapsuleTowersWithCapital(
    ty=ty,
    name="Nakagin Capsule Tower",
    description=panel_4,
    icon=concat,
    image=concat_5,
    variant=item_4.Item,
    view=item_3.Item,
    capsule_type=list_2,
    capsule_corner_ne=genes_2,
    capsule_corner_se=genes_3,
    capsule_corner_sw=genes,
    capsule_corner_nw=genes_4,
    shaftco=con_2.Connection,
    tambourco=con_4.Connection,
    capsuleco=con.Connection,
    capitalco=con_3.Connection,
    bridgeco=con_5.Connection,
    diagram_force=diagram_force,
    heating_energy_price_kwh=heating_energy_price_cent_kwh,
    heating_efficiency_factor=heating_efficiency_factor,
    heating_global_warming_potential_kgco2e=heating_global_warming_potential_kgco2e,
    cooling_energy_price_kwh=cooling_energy_price_cent_kwh,
    cooling_efficiency_factor=cooling_efficiency_factor,
    cooling_global_warming_potential_kgco2e=cooling_global_warming_potential_kgco2e,
    electrictiy_energy_price_cent_kwh=electrictiy_energy_price_cent_kwh,
    electrictiy_global_warming_potential_kgc=electrictiy_global_warming_potential_kgc)  # -> dn, effective_floor_area_m²_2, specific_operational_global_warming_pote_2, construction_cost_mio_2, return_a_2, construction_global_warming_potential_tc_2, operational_cost_mio_a_2, operational_global_warming_potential_tco_2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; "Base with Twin Capsule Towers with Capital"

panel_5 = Panel("The expolsion axonometry of a futuristic variant of the Nakagin Capsule Tower where two towers are dancing with each other. The capsules are ellipsoids around a round shaft and a blob base.")
tambour_rotation_2 = Slider(15, range=-360..360)
tambour_shift_2 = Slider(-0.5, range=-10..10)
tambour_tilt_2 = Slider(-2, range=-360..360)
capsule_gap_2 = Slider(2.5, range=-10..10)
capsule_shift_2 = Slider(0.5, range=-10..10)
shaft_rotation_2 = Slider(10, range=-360..360)
shaft_tilt_2 = Slider(5, range=-360..360)
capsule_rotation_2 = Slider(3, range=-360..360)
capsule_tilt_2 = Slider(2, range=-360..360)
capital_rotation_2 = Slider(0, range=-360..360)
capital_tilt_2 = Slider(0, range=-360..360)
capital_gap_2 = Slider(5, range=-10..10)
# Outputs   ->
#                 |
#                 v
capital_shift_2 = Slider(0, range=-10..10)
shaft_shift_2 = Slider(5, range=-10..10)
tambour_gap_2 = Slider(7.5, range=-10..10)
shaft_gap_2 = Slider(5, range=-10..10)
list_3 = ValueList({"Box": 0, "Balcony": 1, "Ellipsoid": 2, "Trapezoid": 3}, selected="Ellipsoid")
con_6 = ModelConnection(Connection=con_2.Connection, Gap=shaft_gap_2, Shift=shaft_shift_2, Rotation=shaft_rotation_2, Tilt=shaft_tilt_2)  # -> Connection, Valid, ConnectedPieceId, ConnectedPieceTypePortId, ConnectingPieceId, ConnectingPieceTypePortId, Description, Gap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
con_7 = ModelConnection(Connection=con.Connection, Gap=capsule_gap_2, Shift=capsule_shift_2, Rotation=capsule_rotation_2, Tilt=capsule_tilt_2)  # -> Connection, Valid, ConnectedPieceId, ConnectedPieceTypePortId, ConnectingPieceId, ConnectingPieceTypePortId, Description, Gap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
con_8 = ModelConnection(Connection=con_3.Connection)  # -> Connection, Valid, ConnectedPieceId, ConnectedPieceTypePortId, ConnectingPieceId, ConnectingPieceTypePortId, Description, Gap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
con_9 = ModelConnection(Connection=con_4.Connection, Gap=capital_gap_2, Shift=capital_shift_2, Rotation=capital_rotation_2, Tilt=capital_tilt_2)  # -> Connection, Valid, ConnectedPieceId, ConnectedPieceTypePortId, ConnectingPieceId, ConnectingPieceTypePortId, Description, Gap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
con_10 = ModelConnection(Connection=con_5.Connection)  # -> Connection, Valid, ConnectedPieceId, ConnectedPieceTypePortId, ConnectingPieceId, ConnectingPieceTypePortId, Description, Gap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
base_with_twin_capsule_towers_with_capit_2 = BaseWithTwinCapsuleTowersWithCapital(
    ty=ty,
    name="Nakagin Capsule Tower",
    description=panel_5,
    icon=concat_4,
    image=concat_8,
    variant=item_4.Item3,
    view=item_3.Item3,
    capsule_type=list_3,
    capsule_corner_ne=genes_2,
    capsule_corner_se=genes_3,
    capsule_corner_sw=genes,
    capsule_corner_nw=genes_4,
    shaftco=con_6.Connection,
    tambourco=con_7.Connection,
    capsuleco=con_9.Connection,
    capitalco=con_8.Connection,
    bridgeco=con_10.Connection,
    diagram_force=diagram_force,
    heating_energy_price_kwh=heating_energy_price_cent_kwh,
    heating_efficiency_factor=heating_efficiency_factor,
    heating_global_warming_potential_kgco2e=heating_global_warming_potential_kgco2e,
    cooling_energy_price_kwh=cooling_efficiency_factor,
    cooling_efficiency_factor=cooling_efficiency_factor,
    cooling_global_warming_potential_kgco2e=cooling_global_warming_potential_kgco2e,
    electrictiy_energy_price_cent_kwh=electrictiy_energy_price_cent_kwh,
    electrictiy_global_warming_potential_kgc=electrictiy_global_warming_potential_kgc)  # -> dn, effective_floor_area_m²_2, specific_operational_global_warming_pote_2, construction_cost_mio_2, return_a_2, construction_global_warming_potential_tc_2, operational_cost_mio_a_2, operational_global_warming_potential_tco_2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; "Base with Twin Capsule Towers with Capital"

panel_6 = Panel("A twisted variant of the Nakagin Capsule Tower where the capsules are trapezoids and towers are round with the floors twisting in one direction.")
tambour_rotation_3 = Slider(3, range=-360..360)
shaft_shift_3 = Slider(-1, range=-10..10)
list_4 = ValueList({"Box": 0, "Balcony": 1, "Ellipsoid": 2, "Trapezoid": 3}, selected="Trapezoid")
neg = Negative(Value=tambour_rotation_3)
con_11 = ModelConnection(Shift=shaft_shift_3, Rotation=neg)  # -> Connection, Valid, ConnectedPieceId, ConnectedPieceTypePortId, ConnectingPieceId, ConnectingPieceTypePortId, Description, Gap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
con_12 = ModelConnection(Connection=con_4.Connection, Rotation=tambour_rotation_3)  # -> Connection, Valid, ConnectedPieceId, ConnectedPieceTypePortId, ConnectingPieceId, ConnectingPieceTypePortId, Description, Gap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
base_with_twin_capsule_towers_with_capit_3 = BaseWithTwinCapsuleTowersWithCapital(
    ty=ty,
    name="Nakagin Capsule Tower",
    description=panel_6,
    icon=concat_3,
    image=concat_7,
    variant=item_4.Item2,
    view=item_3.Item2,
    capsule_type=list_4,
    capsule_corner_ne=genes_2,
    capsule_corner_se=genes_3,
    capsule_corner_sw=genes,
    capsule_corner_nw=genes_4,
    shaftco=con_11.Connection,
    tambourco=con_12.Connection,
    capsuleco=con.Connection,
    capitalco=con_3.Connection,
    bridgeco=con_5.Connection,
    diagram_force=diagram_force,
    heating_energy_price_kwh=heating_energy_price_cent_kwh,
    heating_efficiency_factor=heating_efficiency_factor,
    heating_global_warming_potential_kgco2e=heating_global_warming_potential_kgco2e,
    cooling_energy_price_kwh=cooling_energy_price_cent_kwh,
    cooling_efficiency_factor=cooling_efficiency_factor,
    cooling_global_warming_potential_kgco2e=cooling_global_warming_potential_kgco2e,
    electrictiy_energy_price_cent_kwh=electrictiy_energy_price_cent_kwh,
    electrictiy_global_warming_potential_kgc=electrictiy_global_warming_potential_kgc)  # -> dn, effective_floor_area_m²_2, specific_operational_global_warming_pote_2, construction_cost_mio_2, return_a_2, construction_global_warming_potential_tc_2, operational_cost_mio_a_2, operational_global_warming_potential_tco_2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; "Base with Twin Capsule Towers with Capital"

panel_7 = Panel("A sloped variant of the Nakagin Capsule Tower where the capsules have balconies and the towers are graduated in opposing directions. Each tower has a direction and every floor is stepped in this direction.")
tambour_shift_3 = Slider(0.5, range=-10..10)
capsule_gap_3 = Slider(0.15, range=0..1)
capsule_shift_3 = Slider(0.2, range=-1..1)
genes_5 = GenePool(Decimals=0, Maximum=8, Minimum=0, Value=[7, 7, 7, 7, 7, 7, 7, 7, 7, 7, 7])
list_5 = ValueList({"Box": 0, "Balcony": 1, "Ellipsoid": 2, "Trapezoid": 3}, selected="Balcony")
con_13 = ModelConnection(Connection=con_4.Connection, Shift=tambour_shift_3)  # -> Connection, Valid, ConnectedPieceId, ConnectedPieceTypePortId, ConnectingPieceId, ConnectingPieceTypePortId, Description, Gap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
con_14 = ModelConnection(Connection=con.Connection, Gap=capsule_gap_3, Shift=capsule_shift_3)  # -> Connection, Valid, ConnectedPieceId, ConnectedPieceTypePortId, ConnectingPieceId, ConnectingPieceTypePortId, Description, Gap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
base_with_twin_capsule_towers_with_capit_4 = BaseWithTwinCapsuleTowersWithCapital(
    ty=ty,
    name="Nakagin Capsule Tower",
    description=panel_7,
    icon=concat_2,
    image=concat_6,
    variant=item_4.Item1,
    view=item_3.Item1,
    capsule_type=list_5,
    capsule_corner_ne=genes_2,
    capsule_corner_se=genes_3,
    capsule_corner_sw=genes_5,
    capsule_corner_nw=genes_4,
    shaftco=con_2.Connection,
    tambourco=con_13.Connection,
    capsuleco=con_14.Connection,
    capitalco=con_3.Connection,
    bridgeco=con_5.Connection,
    diagram_force=diagram_force,
    heating_energy_price_kwh=heating_energy_price_cent_kwh,
    heating_efficiency_factor=heating_efficiency_factor,
    heating_global_warming_potential_kgco2e=heating_global_warming_potential_kgco2e,
    cooling_energy_price_kwh=cooling_energy_price_cent_kwh,
    cooling_efficiency_factor=cooling_efficiency_factor,
    cooling_global_warming_potential_kgco2e=cooling_global_warming_potential_kgco2e,
    electrictiy_energy_price_cent_kwh=electrictiy_energy_price_cent_kwh,
    electrictiy_global_warming_potential_kgc=electrictiy_global_warming_potential_kgc)  # -> dn, effective_floor_area_m²_2, specific_operational_global_warming_pote_2, construction_cost_mio_2, return_a_2, construction_global_warming_potential_tc_2, operational_cost_mio_a_2, operational_global_warming_potential_tco_2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; "Base with Twin Capsule Towers with Capital"

merge = Merge(
    Data1=base_with_twin_capsule_towers_with_capit.dn,
    Data2=base_with_twin_capsule_towers_with_capit_4.dn,
    Data3=base_with_twin_capsule_towers_with_capit_3.dn,
    Data4=base_with_twin_capsule_towers_with_capit_2.dn)

return_a = Panel(base_with_twin_capsule_towers_with_capit.return_a_2)
operational_cost_mio_a = Panel(base_with_twin_capsule_towers_with_capit.operational_cost_mio_a_2)
effective_floor_area_m² = Panel(base_with_twin_capsule_towers_with_capit.effective_floor_area_m²_2)
construction_cost_mio = Panel(base_with_twin_capsule_towers_with_capit.construction_cost_mio_2)
income_mio_a = Panel(base_with_twin_capsule_towers_with_capit.income_mio_a_2)
operational_energy_cost_a = Panel(base_with_twin_capsule_towers_with_capit.operational_energy_cost_a_2)
maintenance_expenses_mio_a = Panel(base_with_twin_capsule_towers_with_capit.maintenance_expenses_mio_a_2)
specific_operational_global_warming_pote = Panel(base_with_twin_capsule_towers_with_capit.specific_operational_global_warming_pote_2)  # "Specific Operational Global Warming Potential [kgCO2e/m²a]"
construction_global_warming_potential_tc = Panel(base_with_twin_capsule_towers_with_capit.construction_global_warming_potential_tc_2)  # "Construction Global Warming Potential [tCO2e]"
operational_global_warming_potential_tco = Panel(base_with_twin_capsule_towers_with_capit.operational_global_warming_potential_tco_2)  # "Operational Global Warming Potential [tCO2e/a]"
specific_energy_demand_kwh_m²a = Panel(base_with_twin_capsule_towers_with_capit.specific_energy_demand_kwh_m²a_2)
heating_energy_demand_mwh_a = Panel(base_with_twin_capsule_towers_with_capit.heating_energy_demand_mwh_a_2)
cooling_energy_demand_mwh_a = Panel(base_with_twin_capsule_towers_with_capit.cooling_energy_demand_mwh_a_2)
technical_equipment_energy_demand_mwh_a = Panel(base_with_twin_capsule_towers_with_capit.technical_equipment_energy_demand_mwh_a_2)

effective_floor_area_m²_2 = Panel(base_with_twin_capsule_towers_with_capit_4.effective_floor_area_m²_2)
construction_cost_mio_2 = Panel(base_with_twin_capsule_towers_with_capit_4.construction_cost_mio_2)
return_a_2 = Panel(base_with_twin_capsule_towers_with_capit_4.return_a_2)
income_mio_a_2 = Panel(base_with_twin_capsule_towers_with_capit_4.income_mio_a_2)
operational_cost_mio_a_2 = Panel(base_with_twin_capsule_towers_with_capit_4.operational_cost_mio_a_2)
operational_energy_cost_a_2 = Panel(base_with_twin_capsule_towers_with_capit_4.operational_energy_cost_a_2)
maintenance_expenses_mio_a_2 = Panel(base_with_twin_capsule_towers_with_capit_4.maintenance_expenses_mio_a_2)
construction_global_warming_potential_tc_2 = Panel(base_with_twin_capsule_towers_with_capit_4.construction_global_warming_potential_tc_2)  # "Construction Global Warming Potential [tCO2e]"
operational_global_warming_potential_tco_2 = Panel(base_with_twin_capsule_towers_with_capit_4.operational_global_warming_potential_tco_2)  # "Operational Global Warming Potential [tCO2e/a]"
heating_energy_demand_mwh_a_2 = Panel(base_with_twin_capsule_towers_with_capit_4.heating_energy_demand_mwh_a_2)
cooling_energy_demand_mwh_a_2 = Panel(base_with_twin_capsule_towers_with_capit_4.cooling_energy_demand_mwh_a_2)
technical_equipment_energy_demand_mwh_a_2 = Panel(base_with_twin_capsule_towers_with_capit_4.technical_equipment_energy_demand_mwh_a_2)
specific_operational_global_warming_pote_2 = Panel(base_with_twin_capsule_towers_with_capit_4.specific_operational_global_warming_pote_2)  # "Specific Operational Global Warming Potential [kgCO2e/m²a]"
specific_energy_demand_kwh_m²a_2 = Panel(base_with_twin_capsule_towers_with_capit_4.specific_energy_demand_kwh_m²a_2)

item_7 = ListItem(List=merge, Index=itemindex, Wrap=True)
dsn = ModelDesign(Design=base_with_twin_capsule_towers_with_capit.dn, Validate=Toggle(True))  # -> Design, Valid, Name, Description, Icon, Image, Variant, View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
dn = Design(item_7)
dsn_2 = PreviewDesign(dn=dn, ty=ty, ob=objects, tags=list, sc=1)
dsn_3 = SerializeDesign(Design=dn)
txt = EncodeText(Text=dsn_3, Mode=0)

# ----
# Evaluate metrics
panel_8 = Panel(".svg")
dgm = DrawDiagram(Design=dn, Types=ty, Uri=par, Run=and)
concat_9 = Concatenate(
    FragmentA=par,
    FragmentB=sep,
    FragmentC="diagrams",
    FragmentD=sep,
    FragmentE="nakagin-capsule-tower",
    FragmentF=item_6,
    FragmentG=panel_8)
write = Write(T=dgm, P=concat_9, R=and)  # -> S; inputs T: String, P: String, R: Boolean
# ---------- write: C# ----------
#region Usings
using System;
using System.Linq;
using System.Collections;
using System.Collections.Generic;
using System.Drawing;
using System.IO;

using Rhino;
using Rhino.Geometry;

using Grasshopper;
using Grasshopper.Kernel;
using Grasshopper.Kernel.Data;
using Grasshopper.Kernel.Types;
#endregion

public class Script_Instance : GH_ScriptInstance
{
    private void RunScript(string T, string P, bool R, ref object S)
    {
        if (R==true){
            File.WriteAllText(P, T);
            S = true;
        }
        S = false;
    }
}
# ---------- end write ----------

dsn_4 = PutDesign(Design=dn, Uri=par, Run=save)
context_bake = ContextBake(Content=txt)

return_a_3 = Panel(base_with_twin_capsule_towers_with_capit_2.return_a_2)
operational_cost_mio_a_3 = Panel(base_with_twin_capsule_towers_with_capit_2.operational_cost_mio_a_2)
effective_floor_area_m²_3 = Panel(base_with_twin_capsule_towers_with_capit_2.effective_floor_area_m²_2)
construction_cost_mio_3 = Panel(base_with_twin_capsule_towers_with_capit_2.construction_cost_mio_2)
income_mio_a_3 = Panel(base_with_twin_capsule_towers_with_capit_2.income_mio_a_2)
operational_energy_cost_a_3 = Panel(base_with_twin_capsule_towers_with_capit_2.operational_energy_cost_a_2)
maintenance_expenses_mio_a_3 = Panel(base_with_twin_capsule_towers_with_capit_2.maintenance_expenses_mio_a_2)
operational_global_warming_potential_tco_3 = Panel(base_with_twin_capsule_towers_with_capit_2.operational_global_warming_potential_tco_2)  # "Operational Global Warming Potential [tCO2e/a]"
technical_equipment_energy_demand_mwh_a_3 = Panel(base_with_twin_capsule_towers_with_capit_2.technical_equipment_energy_demand_mwh_a_2)
specific_operational_global_warming_pote_3 = Panel(base_with_twin_capsule_towers_with_capit_2.specific_operational_global_warming_pote_2)  # "Specific Operational Global Warming Potential [kgCO2e/m²a]"
construction_global_warming_potential_tc_3 = Panel(base_with_twin_capsule_towers_with_capit_2.construction_global_warming_potential_tc_2)  # "Construction Global Warming Potential [tCO2e]"
specific_energy_demand_kwh_m²a_3 = Panel(base_with_twin_capsule_towers_with_capit_2.specific_energy_demand_kwh_m²a_2)
heating_energy_demand_mwh_a_3 = Panel(base_with_twin_capsule_towers_with_capit_2.heating_energy_demand_mwh_a_2)
cooling_energy_demand_mwh_a_3 = Panel(base_with_twin_capsule_towers_with_capit_2.cooling_energy_demand_mwh_a_2)

return_a_4 = Panel(base_with_twin_capsule_towers_with_capit_3.return_a_2)
operational_cost_mio_a_4 = Panel(base_with_twin_capsule_towers_with_capit_3.operational_cost_mio_a_2)
effective_floor_area_m²_4 = Panel(base_with_twin_capsule_towers_with_capit_3.effective_floor_area_m²_2)
construction_cost_mio_4 = Panel(base_with_twin_capsule_towers_with_capit_3.construction_cost_mio_2)
income_mio_a_4 = Panel(base_with_twin_capsule_towers_with_capit_3.income_mio_a_2)
operational_energy_cost_a_4 = Panel(base_with_twin_capsule_towers_with_capit_3.operational_energy_cost_a_2)
maintenance_expenses_mio_a_4 = Panel(base_with_twin_capsule_towers_with_capit_3.maintenance_expenses_mio_a_2)
specific_operational_global_warming_pote_4 = Panel(base_with_twin_capsule_towers_with_capit_3.specific_operational_global_warming_pote_2)  # "Specific Operational Global Warming Potential [kgCO2e/m²a]"
construction_global_warming_potential_tc_4 = Panel(base_with_twin_capsule_towers_with_capit_3.construction_global_warming_potential_tc_2)  # "Construction Global Warming Potential [tCO2e]"
operational_global_warming_potential_tco_4 = Panel(base_with_twin_capsule_towers_with_capit_3.operational_global_warming_potential_tco_2)  # "Operational Global Warming Potential [tCO2e/a]"
specific_energy_demand_kwh_m²a_4 = Panel(base_with_twin_capsule_towers_with_capit_3.specific_energy_demand_kwh_m²a_2)
heating_energy_demand_mwh_a_4 = Panel(base_with_twin_capsule_towers_with_capit_3.heating_energy_demand_mwh_a_2)
cooling_energy_demand_mwh_a_4 = Panel(base_with_twin_capsule_towers_with_capit_3.cooling_energy_demand_mwh_a_2)
technical_equipment_energy_demand_mwh_a_4 = Panel(base_with_twin_capsule_towers_with_capit_3.technical_equipment_energy_demand_mwh_a_2)

# ==== cluster BaseWithTwinCapsuleTowersWithCapital
diagram_force = ClusterInput()
capsule_type = ClusterInput()

electrictiy_global_warming_potential_kgc = ClusterInput()  # "Electrictiy Global Warming Potential [kgCO2e/kWh]"
heating_energy_price_kwh = ClusterInput()
heating_efficiency_factor = ClusterInput()
cooling_efficiency_factor = ClusterInput()
cooling_global_warming_potential_kgco2e = ClusterInput()  # "Cooling Global Warming Potential [kgCO2e/kWh]"
heating_global_warming_potential_kgco2e = ClusterInput()  # "Heating Global Warming Potential [kgCO2e/kWh]"
cooling_energy_price_kwh = ClusterInput()
electrictiy_energy_price_cent_kwh = ClusterInput()
electrictiy_global_warming_potential_kgc_2 = Number(electrictiy_global_warming_potential_kgc)  # "Electrictiy Global Warming Potential [kgCO2e/kWh]"
heating_energy_price_kwh_2 = Number(heating_energy_price_kwh)
heating_efficiency_factor_2 = Number(heating_efficiency_factor)
cooling_efficiency_factor_2 = Number(cooling_efficiency_factor)
cooling_global_warming_potential_kgco2e_2 = Number(cooling_global_warming_potential_kgco2e)  # "Cooling Global Warming Potential [kgCO2e/kWh]"
heating_global_warming_potential_kgco2e_2 = Number(heating_global_warming_potential_kgco2e)  # "Heating Global Warming Potential [kgCO2e/kWh]"
cooling_energy_price_kwh_2 = Number(cooling_energy_price_kwh)
electrictiy_energy_price_cent_kwh_2 = Number(electrictiy_energy_price_cent_kwh)

description = ClusterInput()
icon = ClusterInput()
image = ClusterInput()
variant = ClusterInput()
name = ClusterInput()
view = ClusterInput()
variant_2 = Text(variant)
description_2 = Description(description)
icon_2 = Icon(icon)
image_2 = Image(image)
view_2 = View(view)
name_2 = Text(name)

capsule_corner_ne = ClusterInput()
capsule_corner_se = ClusterInput()
capsule_corner_sw = ClusterInput()
capsule_corner_nw = ClusterInput()
capsule_corner_nw_2 = Integer(capsule_corner_nw)
capsule_corner_ne_2 = Integer(capsule_corner_ne)
capsule_corner_se_2 = Integer(capsule_corner_se)
capsule_corner_sw_2 = Integer(capsule_corner_sw)

shaftco = ClusterInput()
tambourco = ClusterInput()
capsuleco = ClusterInput()
capitalco = ClusterInput()
bridgeco = ClusterInput()
shaftco_2 = Connection(shaftco)
tambourco_2 = Connection(tambourco)
capsuleco_2 = Connection(capsuleco)
capitalco_2 = Connection(capitalco)
bridgeco_2 = Connection(bridgeco)

ty = ClusterInput()
ty_2 = Type(ty)
capsule_type_2 = Integer(capsule_type)
diagram_force_2 = Number(diagram_force)
expression = Expression(x=diagram_force_2, Expression="1+x")
expression_2 = Expression(x=diagram_force_2, Expression="x*2")
expression_3 = Expression(x=diagram_force_2, Expression="x-((1-x)*0.3)")
neg = Negative(Value=expression_2)

lng = ListLength(List=capsule_corner_sw_2)
lng_2 = ListLength(List=capsule_corner_ne_2)
dup = DuplicateData(Data="0", Number=lng_2, Order=True)
dup_2 = DuplicateData(Data="6", Number=lng_2, Order=True)
dup_3 = DuplicateData(Data="0", Number=lng, Order=True)
dup_4 = DuplicateData(Data="6", Number=lng, Order=True)
trim = TrimTree(Tree=dup, Depth=1)
trim_2 = TrimTree(Tree=dup_2, Depth=1)
trim_3 = TrimTree(Tree=dup_3, Depth=1)
trim_4 = TrimTree(Tree=dup_4, Depth=1)

con = ModelConnection(Connection=bridgeco_2, X=expression_3)  # -> Connection, Valid, ConnectedPieceId, ConnectedPieceTypePortId, ConnectingPieceId, ConnectingPieceTypePortId, Description, Gap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

# ----
# Model the initial design
panel = Panel("-90")
neg_2 = Negative(Value=panel)
neg_3 = Negative(Value="-9")
addition = Addition(A=panel, B=neg_3)
addition_2 = Addition(A=panel, B=neg_3)
filter = StreamFilter(Gate=capsule_type_2, Stream0=panel, Stream1=panel, Stream2=addition, Stream3=panel)
filter_2 = StreamFilter(Gate=capsule_type_2, Stream0=panel, Stream1=panel, Stream2=addition_2, Stream3=panel)
neg_4 = Negative(Value=filter_2)
concat = Concatenate(FragmentA="c", FragmentC="1")
concat_2 = Concatenate(FragmentA="c", FragmentC="0")
aut = ModelAuthor(Name="Ueli Saluz", Email="ueli@semio-tech.org")  # -> Author, Valid, Name, Email
genes = GenePool(Decimals=0, Maximum=10, Minimum=0, Value=[3, 6, 9])

dpt = ModelDiagramPoint()  # -> DiagramPoint, Valid, X, Y
xy = XYPlane(Origin=Point(0, 0, 0))
pce = ModelPiece(Id="b", TypeName="Base", Plane=xy, Center=dpt.DiagramPoint)  # -> Piece, Valid, Id, Description, TypeName, TypeVariant, Plane, Center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
addition_3 = Addition(A=neg_2)
addition_4 = Addition(A=panel)
addition_5 = Addition(A=neg_4)
addition_6 = Addition(B=filter)

concat_3 = Concatenate(FragmentA="b", FragmentB="_", FragmentC=concat_2)
tower = Tower(
    shaftpieceid=concat_3,
    capsulepatternnorthwest=trim_2,
    capsulepatternsoutheast=capsule_corner_ne_2,
    capsulepatternsouthwest=capsule_corner_se_2,
    capsulepatternnortheast=trim,
    tambourco=tambourco_2,
    capsuleco=capsuleco_2,
    rotation=addition_6,
    diagram_force=diagram_force_2)  # -> pc_2, co_2, tambour_co_2, tambour_pc_2, first_tambour_id_2, last_tambour_id_2, capsule_pc_2, caspule_co_2

concat_4 = Concatenate(FragmentA="b", FragmentB="_", FragmentC=concat)
tower_2 = Tower(
    shaftpieceid=concat_4,
    capsulepatternnorthwest=trim_4,
    capsulepatternsoutheast=capsule_corner_sw_2,
    capsulepatternsouthwest=capsule_corner_nw_2,
    capsulepatternnortheast=trim_3,
    tambourco=tambourco_2,
    capsuleco=capsuleco_2,
    rotation=addition_3,
    diagram_force=diagram_force_2)  # -> pc_2, co_2, tambour_co_2, tambour_pc_2, first_tambour_id_2, last_tambour_id_2, capsule_pc_2, caspule_co_2

concat_5 = Concatenate(FragmentD="ci", FragmentC="_", FragmentB=tower_2.last_tambour_id_2)
concat_6 = Concatenate(FragmentD="ci", FragmentC="_", FragmentB=tower.last_tambour_id_2)
merge = Merge(Data1=tower.pc_2, Data2=tower_2.pc_2)
merge_2 = Merge(Data1=tower.co_2, Data2=tower_2.co_2)

pce_2 = ModelPiece(Id=concat_6, TypeName="Capital")  # -> Piece, Valid, Id, Description, TypeName, TypeVariant, Plane, Center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
pce_3 = ModelPiece(Id=concat_5, TypeName="Capital")  # -> Piece, Valid, Id, Description, TypeName, TypeVariant, Plane, Center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
con_2 = ModelConnection(
    Connection=shaftco_2,
    ConnectedPieceId=pce.Id,
    ConnectedPieceTypePortId=concat_2,
    ConnectingPieceId=tower.first_tambour_id_2,
    ConnectingPieceTypePortId="b",
    Rotation=addition_6,
    X=neg,
    Y=expression_2)  # -> Connection, Valid, ConnectedPieceId, ConnectedPieceTypePortId, ConnectingPieceId, ConnectingPieceTypePortId, Description, Gap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
con_3 = ModelConnection(
    Connection=shaftco_2,
    ConnectedPieceId=pce.Id,
    ConnectedPieceTypePortId=concat,
    ConnectingPieceId=tower_2.first_tambour_id_2,
    ConnectingPieceTypePortId="b",
    Rotation=addition_3,
    X=expression_2,
    Y=expression_2)  # -> Connection, Valid, ConnectedPieceId, ConnectedPieceTypePortId, ConnectingPieceId, ConnectingPieceTypePortId, Description, Gap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
con_4 = ModelConnection(
    Connection=capitalco_2,
    ConnectedPieceId=tower.last_tambour_id_2,
    ConnectedPieceTypePortId="t",
    ConnectingPieceId=pce_2.Id,
    Rotation=addition_5,
    Y=expression)  # -> Connection, Valid, ConnectedPieceId, ConnectedPieceTypePortId, ConnectingPieceId, ConnectingPieceTypePortId, Description, Gap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
con_5 = ModelConnection(
    Connection=capitalco_2,
    ConnectedPieceId=tower_2.last_tambour_id_2,
    ConnectedPieceTypePortId="t",
    ConnectingPieceId=pce_3.Id,
    Rotation=addition_4,
    Y=expression)  # -> Connection, Valid, ConnectedPieceId, ConnectedPieceTypePortId, ConnectingPieceId, ConnectingPieceTypePortId, Description, Gap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

merge_3 = Merge(Data1=pce.Piece, Data2=pce_2.Piece, Data3=pce_3.Piece)
merge_4 = Merge(Data1=con_2.Connection, Data2=con_3.Connection, Data3=con_4.Connection, Data4=con_5.Connection)
merge_5 = Merge(Data1=merge_4, Data2=merge_2)
merge_6 = Merge(Data1=merge_3, Data2=merge)
dsn = ModelDesign(
    Name=name_2,
    Description=description_2,
    Icon=icon_2,
    Image=image_2,
    Variant=variant_2,
    View=view_2,
    Unit="m",
    Pieces=merge_6,
    Connections=merge_5,
    Authors=aut.Author)  # -> Design, Valid, Name, Description, Icon, Image, Variant, View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
addbridges = AddBridges(dn=dsn.Design, bridgeco=con.Connection, levels=genes)

# ----
# Change the design later
panel_2 = Panel("Base")
typ = VaryTypes(dn=addbridges, na=panel_2, new_vn="Blob")
rpltyp = ReplaceType(dn=typ, old_na="Capsule", new_na="Ellipsoid Capsule")
rpltyp_2 = ReplaceType(dn=addbridges, old_na="Capsule", new_na="Trapezoid Capsule")
rpltyp_3 = ReplaceType(dn=addbridges, old_na="Capsule", new_na="Capsule with Balcony")
rpltyp_4 = ReplaceType(dn=rpltyp, old_na="Tambour", new_na="Cylindric Tambour")
rpltyp_5 = ReplaceType(dn=rpltyp_2, old_na="Tambour", new_na="Cylindric Tambour")
rpltyp_6 = ReplaceType(dn=rpltyp_4, old_na="Capital", new_na="Cylindric Capital")
rpltyp_7 = ReplaceType(dn=rpltyp_5, old_na="Capital", new_na="Cylindric Capital")
filter_3 = StreamFilter(Gate=capsule_type_2, Stream0=dsn.Design, Stream1=rpltyp_3, Stream2=rpltyp_6, Stream3=rpltyp_7)

# ----
# Do some calculations based on metadata
prf = AssessPerformance(
    dn=filter_3,
    ty=ty_2,
    heating_efficiency_factor=heating_efficiency_factor_2,
    heating_energy_price_kwh=heating_energy_price_kwh_2,
    heating_global_warming_potential_kgco2e=heating_global_warming_potential_kgco2e_2,
    cooling_efficiency_factor=cooling_efficiency_factor_2,
    cooling_global_warming_potential_kgco2e=cooling_global_warming_potential_kgco2e_2,
    cooling_energy_price_kwh=cooling_energy_price_kwh_2,
    electrictiy_global_warming_potential_kgc=electrictiy_global_warming_potential_kgc_2,
    electrictiy_energy_price_kwh=electrictiy_energy_price_cent_kwh_2)  # -> dn_3, interest_2, area_efficiency_eff_m²_m²_2, area_comfort_m²_person_2, income_a_3, expenses_a_3, energy_expenses_a_3, effective_floor_area_m²_12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
expression_4 = Expression(x=prf.construction_cost_5, Expression="x/1000000")
expression_5 = Expression(x=prf.energy_expenses_a_3, Expression="x/1000000")
expression_6 = Expression(Expression="x/1000000")
expression_7 = Expression(x=prf.income_a_3, Expression="x/1000000")
expression_8 = Expression(Expression="x/1000000")
expression_9 = Expression(Expression="x/1000000")
expression_10 = Expression(x=prf.construction_global_warming_potential_kg_2, Expression="x/1000")
expression_11 = Expression(Expression="x/1000")
expression_12 = Expression(x=prf.heating_energy_demand_kwh_a_5, Expression="x/1000")
expression_13 = Expression(x=prf.cooling_energy_demand_kwh_a_5, Expression="x/1000")
expression_14 = Expression(Expression="x/1000")
roundmult = RoundToMultiple(N=expression_7, M="0.05")  # -> R; inputs N: tree, M: tree
# ---------- roundmult: Python ----------
#Component Information
#--------------------------------------------------------------------------------------------
if ghenv.Component.RunCount<2:
    #General
    #--------------------------------------------------------------------------------------------
    __author__ = "YOUR NAME"
    __version__ = "2000.00.00"
    
    ghenv.Component.Name = "Round to Multiple"
    ghenv.Component.NickName = "RoundMult"
    ghenv.Component.Description = "Rounds a number to the nearest specified multiple."
    ghenv.Component.Message = "VER 1.0"
    ghenv.Component.Category = "Math"
    ghenv.Component.SubCategory = "Arithmetic"
    
     #Inputs
    #--------------------------------------------------------------------------------------------
    inputIndex=0
    
    ghenv.Component.Params.Input[inputIndex].Name = "Number"
    ghenv.Component.Params.Input[inputIndex].NickName = "N"
    ghenv.Component.Params.Input[inputIndex].Description = "Number to round."
    ghenv.Component.Params.Input[inputIndex].Optional = False
    inputIndex+=1
    
    ghenv.Component.Params.Input[inputIndex].Name = "Multiple"
    ghenv.Component.Params.Input[inputIndex].NickName = "M"
    ghenv.Component.Params.Input[inputIndex].Description = "Multiple to round to."
    ghenv.Component.Params.Input[inputIndex].Optional = False
    inputIndex+=1
    
    #Outputs
    #--------------------------------------------------------------------------------------------
    outputIndex=0
    
    ghenv.Component.Params.Output[outputIndex].Name = "Rounded"
    ghenv.Component.Params.Output[outputIndex].NickName = "R"
    ghenv.Component.Params.Output[outputIndex].Description = "Number rounded to the nearest specified multiple."
    outputIndex+=1


#Imports
#--------------------------------------------------------------------------------------------
from System import Object
from Grasshopper import DataTree
import math


#The Component function - Business logic only (e.g. working without trees)
#--------------------------------------------------------------------------------------------
"""Function that this component is computing.
    Inputs:
        number: The number to round.
        multiple: The multiple to round to.
    Output:
        rounded: The number rounded to the nearest specified multiple."""
def RoundToMultiple(number, multiple):
    rounded = math.ceil(number / multiple) * multiple
    return rounded

#Solver - Run with trees to enhance performance drastically
#--------------------------------------------------------------------------------------------
if __name__ == "__main__":
    
    #Initialize trees
    #--------------------------------------------------------------------------------------------
    RoundedTree = DataTree[Object]()
    
    #Data matching
    #--------------------------------------------------------------------------------------------
    for path in N.Paths:
        numberBranch = N.Branch(path)
        for i, number in enumerate(numberBranch):
            multiple = M.Branch(path)[i]
            rounded = RoundToMultiple(number, multiple)
            RoundedTree.Add(rounded, path)
    
     #Assign trees to output
    #--------------------------------------------------------------------------------------------
    R = RoundedTree
# ---------- end roundmult ----------
roundmult_2 = RoundToMultiple(N=expression_6, M="0.05")  # -> R; inputs N: tree, M: tree; same code as roundmult
roundmult_3 = RoundToMultiple(M="2.5")  # -> R; inputs N: tree, M: tree; same code as roundmult
roundmult_4 = RoundToMultiple(N=expression_9, M="0.05")  # -> R; inputs N: tree, M: tree; same code as roundmult
roundmult_5 = RoundToMultiple(N=expression_12, M=1)  # -> R; inputs N: tree, M: tree; same code as roundmult
roundmult_6 = RoundToMultiple(N=expression_13, M=1)  # -> R; inputs N: tree, M: tree; same code as roundmult
roundmult_7 = RoundToMultiple(N=expression_14, M=1)  # -> R; inputs N: tree, M: tree; same code as roundmult
roundmult_8 = RoundToMultiple(N=prf.effective_floor_area_m²_12, M="25")  # -> R; inputs N: tree, M: tree; same code as roundmult
roundmult_9 = RoundToMultiple(N=prf.construction_global_warming_potential_pe_2, M=1)  # -> R; inputs N: tree, M: tree; same code as roundmult
roundmult_10 = RoundToMultiple(N=expression_4, M="0.05")  # -> R; inputs N: tree, M: tree; same code as roundmult
roundmult_11 = RoundToMultiple(N=expression_8, M="0.05")  # -> R; inputs N: tree, M: tree; same code as roundmult
roundmult_12 = RoundToMultiple(N=expression_10, M="25")  # -> R; inputs N: tree, M: tree; same code as roundmult
roundmult_13 = RoundToMultiple(N=expression_5, M="0.05")  # -> R; inputs N: tree, M: tree; same code as roundmult
roundmult_14 = RoundToMultiple(N=expression_11, M="5")  # -> R; inputs N: tree, M: tree; same code as roundmult
effective_floor_area_m² = Number(roundmult_8)
operational_cost_mio_a = Number(roundmult_13)
specific_operational_global_warming_pote = Number(roundmult_9)  # "Specific Operational Global Warming Potential [kgCO2e/m²a]"
construction_cost_mio = Number(roundmult_10)
return_a = Number(roundmult_11)
construction_global_warming_potential_tc = Number(roundmult_12)  # "Construction Global Warming Potential [tCO2e]"
operational_global_warming_potential_tco = Number(roundmult_14)  # "Operational Global Warming Potential [tCO2e/a]"
income_mio_a = Number(roundmult)
maintenance_expenses_mio_a = Number(roundmult_2)
specific_energy_demand_kwh_m²a = Number(roundmult_3)
operational_energy_cost_a = Number(roundmult_4)
heating_energy_demand_mwh_a = Number(roundmult_5)
cooling_energy_demand_mwh_a = Number(roundmult_6)
technical_equipment_energy_demand_mwh_a = Number(roundmult_7)

dn = ClusterOutput(filter_3)
effective_floor_area_m²_2 = ClusterOutput(effective_floor_area_m²)
specific_operational_global_warming_pote_2 = ClusterOutput(specific_operational_global_warming_pote)  # "Specific Operational Global Warming Potential [kgCO2e/m²a]"
construction_cost_mio_2 = ClusterOutput(construction_cost_mio)
return_a_2 = ClusterOutput(return_a)
construction_global_warming_potential_tc_2 = ClusterOutput(construction_global_warming_potential_tc)  # "Construction Global Warming Potential [tCO2e]"
operational_cost_mio_a_2 = ClusterOutput(operational_cost_mio_a)
operational_global_warming_potential_tco_2 = ClusterOutput(operational_global_warming_potential_tco)  # "Operational Global Warming Potential [tCO2e/a]"
income_mio_a_2 = ClusterOutput(income_mio_a)
maintenance_expenses_mio_a_2 = ClusterOutput(maintenance_expenses_mio_a)
specific_energy_demand_kwh_m²a_2 = ClusterOutput(specific_energy_demand_kwh_m²a)
operational_energy_cost_a_2 = ClusterOutput(operational_energy_cost_a)
heating_energy_demand_mwh_a_2 = ClusterOutput(heating_energy_demand_mwh_a)
cooling_energy_demand_mwh_a_2 = ClusterOutput(cooling_energy_demand_mwh_a)
technical_equipment_energy_demand_mwh_a_2 = ClusterOutput(technical_equipment_energy_demand_mwh_a)

# ==== cluster PreviewDesign: Preview the pieces and connections of a design.
dn = ClusterInput()
ty = ClusterInput()
ob = ClusterInput()
sc = ClusterInput()
tags = ClusterInput()
dn_2 = Design(dn)
ty_2 = Type(ty)
ob_2 = Data(ob)
tags_2 = Tags(tags)
sc_2 = Number(sc)
dn_3 = Design(graft(dn_2))
ty_3 = Type(ty_2)
lng = ListLength(List=ty_3)
ob_3 = Data(ob_2)
tstat = TreeStatistics(Tree=ob_3)  # -> Paths, Length, Count
trim = TrimTree(Tree=ob_3, Depth=1)
item = ListItem(List=tstat.Length, Index=0, Wrap=True)
lng_2 = ListLength(List=tstat.Paths)
lng_3 = ListLength(List=trim)
lng_4 = ListLength(List=trim)
sc_3 = Number(sc_2)
tags_3 = Tags(tags_2)
trim_2 = TrimTree(Tree=lng_4, Depth=1)
null = NullItem(Item=trim_2)  # -> NullFlags, InvalidFlags, Description
fltdsn = FlattenDesign(Design=dn_3, Type=ty_3)
item_2 = ListItem(List=null.NullFlags, Index=0, Wrap=True)
item_3 = ListItem(List=trim_2, Index=0, Wrap=True)
dsn = ModelDesign(Design=fltdsn)  # -> Design, Valid, Name, Description, Icon, Image, Variant, View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
trim_3 = TrimTree(Tree=dsn.Pieces, Depth=1)
filter = StreamFilter(Gate=item_2, Stream0=item_3, Stream1=lng_3)
null_2 = NullItem(Item=filter)  # -> NullFlags, InvalidFlags, Description
typ = SelectTypeByPiece(ty=ty_3, pc=trim_3)  # -> ty_4, i_2
typ_2 = ModelType(Type=typ.ty_4)  # -> Type, Valid, Name, Description, Icon, Image, Variant, Stock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
object = ModelObject(Object=ob_3)  # -> Object, Geometry, Name, Layer, Visibility, Display, Drafting, Render
filter_2 = StreamFilter(Gate=null_2.NullFlags, Stream0=filter, Stream1=lng)
expression = Expression(x=lng_2, y=item, z=lng, u=filter_2, Expression="If((x=1)and(y=1)and(z=1),0,If((x=1)and(y=z),1,If((x=z)and(u=z),2,3)))")
lng_5 = ListLength(List=typ_2.Representations)
rep = SelectRepresentation(rp=typ_2.Representations, tags=tags_3)  # -> rp_4, i_2
group = Group(Geometry=object.Geometry)
expression_2 = Expression(x="0", y=typ.ty_4, Expression="x")
trim_4 = TrimTree(Tree=lng_5, Depth=1)
merge = Merge(Data1=graft(expression_2), Data2=graft(rep.i_2))
trim_5 = TrimTree(Tree=group, Depth=1)
group_2 = Group(Geometry=trim_5)
trim_6 = TrimTree(Tree=group_2, Depth=1)
expression_3 = Expression(x=trim_4, Expression="x=0")
filter_3 = StreamFilter(Gate=expression, Stream0=ob_3, Stream1=object.Geometry, Stream2=trim_5, Stream3=trim_6)
item_4 = ListItem(List=filter_3, Index=typ.i_2, Wrap=True)
ungroup = Ungroup(Group=item_4)
filter_4 = StreamFilter(Gate=expression, Stream0=item_4, Stream1=ungroup, Stream2=ungroup, Stream3=ungroup)
bool = Boolean(invert(graft(expression_3)))
item_5 = ListItem(List=merge, Index=bool, Wrap=True)
i = Integer(item_5)
pce = ModelPiece(Piece=dsn.Pieces)  # -> Piece, Valid, Id, Description, TypeName, TypeVariant, Plane, Center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
item_6 = ListItem(List=filter_4, Index=i, Wrap=True)
trim_7 = TrimTree(Tree=item_6, Depth=1)
orient = Orient(Geometry=trim_7, Source=PlaneXY(0, 0, 0), Target=pce.Plane)  # -> Geometry, Transform
geo = PreviewGeometry(geo=orient.Geometry, sc=sc_3)
con = PreviewConnections(dn=dn_2, ty=ty_2, sc=sc_2)

# ==== cluster CacheKit: Cache a kit by downloading the remote kit with all remote representations.
uri = ClusterInput()
R = ClusterInput()
R_2 = Run(R)
uri_2 = Uri(uri)
kit = LoadKit(Uri=uri_2, Run=R_2)  # -> Success, Kit, LocalDirectory
sep = Separator()  # -> S
# ---------- sep: C# ----------
#region Usings
using System;
using System.Linq;
using System.Collections;
using System.Collections.Generic;
using System.Drawing;
using System.IO;

using Rhino;
using Rhino.Geometry;

using Grasshopper;
using Grasshopper.Kernel;
using Grasshopper.Kernel.Data;
using Grasshopper.Kernel.Types;
#endregion

public class Script_Instance : GH_ScriptInstance
{
    private void RunScript(ref object S)
    {
        S = Path.DirectorySeparatorChar;
    }
}
# ---------- end sep ----------
kit_2 = ModelKit(Kit=kit.Kit)  # -> Kit, Valid, Name, Description, Icon, Image, Preview, Version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
trim = TrimTree(Tree=kit_2.Types, Depth=1)
typ = ModelType(Type=trim)  # -> Type, Valid, Name, Description, Icon, Image, Variant, Stock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
rep = ModelRepresentation(Representation=typ.Representations)  # -> Representation, Valid, Url, Description, Tags, Qualities
tmatch = MatchText(Text=rep.Url, Pattern="http*", Case=True)
dispatch = Dispatch(List=rep.Url, DispatchPattern=tmatch)  # -> ListA, ListB
rep_2 = ReplaceText(Text=dispatch.ListB, Find="/", Replace=sep, RecursiveReplace=False)
rep_3 = CacheRepresentation(Url=dispatch.ListA, Run=R_2)  # -> Path, Success
concat = Concatenate(FragmentA=kit.LocalDirectory, FragmentB=sep, FragmentC=rep_2)
weave = Weave(Pattern=tmatch, Stream0=concat, Stream1=rep_3.Path, NullGaps=False)
import = ImportContent(FilePath=weave, Import=R_2)  # -> ModelTransform, Objects, Layers, Linetypes, HatchPatterns, AnnotationStyles, Materials, BlockDefinitions
objects = Data(import.Objects)
ur = Url(rep.Url)
urpa = Url(weave)
urpalc = Url(concat)
urpare = Url(rep_3.Path)
ty = Type(trim)
objects_2 = ClusterOutput(objects)
urpa_2 = ClusterOutput(urpa)
urpalc_2 = ClusterOutput(urpalc)
urpare_2 = ClusterOutput(urpare)
ty_2 = ClusterOutput(ty)
ur_2 = ClusterOutput(ur)

# ==== cluster Tower
shaftpieceid = ClusterInput()
capsulepatternnorthwest = ClusterInput()
capsulepatternsoutheast = ClusterInput()
capsulepatternsouthwest = ClusterInput()
capsulepatternnortheast = ClusterInput()
tambourco = ClusterInput()
capsuleco = ClusterInput()
rotation = ClusterInput()
diagram_force = ClusterInput()
floor = Panel("f")
panel = Panel("""0
0
1
0
1
0
2
3
3""")
panel_2 = Panel("""2
3
3
0
0
1
0
0
1""")
split_level = Panel("sl")
merge = Merge(Data1="\", Data2="q", Data3="J", Data4="s")
merge_2 = Merge(Data1="/", Data2="p", Data3="L", Data4="z")
door = Panel("d")
shaftpieceid_2 = Text(shaftpieceid)
capsulepatternnorthwest_2 = Integer(capsulepatternnorthwest)
item = ListItem(List=panel, Index=capsulepatternnorthwest_2, Wrap=True)
item_2 = ListItem(List=panel_2, Index=capsulepatternnorthwest_2, Wrap=True)
item_3 = ListItem(List=merge, Index=item, Wrap=True)
item_4 = ListItem(List=merge_2, Index=item_2, Wrap=True)
capsulepatternsoutheast_2 = Integer(capsulepatternsoutheast)
item_5 = ListItem(List=panel_2, Index=capsulepatternsoutheast_2, Wrap=True)
item_6 = ListItem(List=panel, Index=capsulepatternsoutheast_2, Wrap=True)
item_7 = ListItem(List=merge, Index=item_6, Wrap=True)
item_8 = ListItem(List=merge_2, Index=item_5, Wrap=True)
capsulepatternsouthwest_2 = Integer(capsulepatternsouthwest)
item_9 = ListItem(List=panel, Index=capsulepatternsouthwest_2, Wrap=True)
item_10 = ListItem(List=panel_2, Index=capsulepatternsouthwest_2, Wrap=True)
item_11 = ListItem(List=merge, Index=item_9, Wrap=True)
item_12 = ListItem(List=merge_2, Index=item_10, Wrap=True)
capsulepatternnortheast_2 = Integer(capsulepatternnortheast)
item_13 = ListItem(List=panel, Index=capsulepatternnortheast_2, Wrap=True)
item_14 = ListItem(List=panel_2, Index=capsulepatternnortheast_2, Wrap=True)
item_15 = ListItem(List=merge_2, Index=item_14, Wrap=True)
item_16 = ListItem(List=merge, Index=item_13, Wrap=True)
tambourco_2 = Connection(tambourco)
capsuleco_2 = Connection(capsuleco)
rotation_2 = Number(rotation)
diagram_force_2 = Number(diagram_force)

multiplication = Multiplication(A=diagram_force_2, B=Slider(0.3, range=0..1))
multiplication_2 = Multiplication(A=diagram_force_2, B=Slider(0.75, range=0..10))
num = Number(multiplication)
num_2 = Number(multiplication_2)
neg = Negative(Value=num_2)
neg_2 = Negative(Value=num)
dpt = ModelDiagramPoint(X=neg_2, Y=num_2)  # -> DiagramPoint, Valid, X, Y
dpt_2 = ModelDiagramPoint(X=num, Y=num_2)  # -> DiagramPoint, Valid, X, Y
dpt_3 = ModelDiagramPoint(X=num_2, Y=num)  # -> DiagramPoint, Valid, X, Y
dpt_4 = ModelDiagramPoint(X=num_2, Y=neg_2)  # -> DiagramPoint, Valid, X, Y
dpt_5 = ModelDiagramPoint(X=num, Y=neg)  # -> DiagramPoint, Valid, X, Y
dpt_6 = ModelDiagramPoint(X=neg_2, Y=neg)  # -> DiagramPoint, Valid, X, Y
dpt_7 = ModelDiagramPoint(X=neg, Y=neg_2)  # -> DiagramPoint, Valid, X, Y
dpt_8 = ModelDiagramPoint(X=neg, Y=num)  # -> DiagramPoint, Valid, X, Y
nw = DiagramPoint(dpt.DiagramPoint)
wn = DiagramPoint(dpt_8.DiagramPoint)
ne = DiagramPoint(dpt_2.DiagramPoint)
en = DiagramPoint(dpt_3.DiagramPoint)
es = DiagramPoint(dpt_4.DiagramPoint)
se = DiagramPoint(dpt_5.DiagramPoint)
sw = DiagramPoint(dpt_6.DiagramPoint)
ws = DiagramPoint(dpt_7.DiagramPoint)
merge_3 = Merge(Data1=nw, Data2=ne, Data3=en, Data4=es, Data5=se, Data6=sw, Data7=ws, Data8=wn)
pt = Point(merge_3)
rotate = Rotate(Geometry=pt, Angle=degrees(rotation_2), Plane=PlaneXY(0, 0, 0))  # -> Geometry, Transform
item_17 = ListItem(List=rotate.Geometry, Index=0, Wrap=True)  # -> Item, Item1, Item2, Item3, Item4, Item5, Item6, Item7
sl1d0 = DiagramPoint(item_17.Item6)
sl0d2 = DiagramPoint(item_17.Item)
sl0d1 = DiagramPoint(item_17.Item1)
sl0d0 = DiagramPoint(item_17.Item2)
sl2d1 = DiagramPoint(item_17.Item3)
sl2d0 = DiagramPoint(item_17.Item4)
sl1d1 = DiagramPoint(item_17.Item5)
sl0d3 = DiagramPoint(item_17.Item7)

points = PointList(Points=rotate.Geometry, Size=Slider(0.2, range=0..1))
bottom = Panel("b")
capsulevariantsouthright = Text(item_12)
capsulevariantwestright = Text(item_4)
capsulevariantnorthleft = Text(item_3)
capsulevariantwestleft = Text(item_11)
capsulevariantsouthleft = Text(item_7)
capsulevariantnorthright = Text(item_15)
capsulevarianteastright = Text(item_8)
capsulevarianteastleft = Text(item_16)
top = Panel("t")
lng = ListLength(List=capsulepatternnorthwest_2)
number_of_floors = Integer(lng)

series = Series(Start=0, Step=1, Count=number_of_floors)
trim = TrimTree(Tree=series, Depth=1)
concat = Concatenate(FragmentA=floor, FragmentB=trim)
concat_2 = Concatenate(FragmentD="t", FragmentE="_", FragmentA=concat, FragmentF="_", FragmentG=shaftpieceid_2)
lito3p = ListInto3Parts(ListToSlice=concat_2, StartIndex="1", EndIndex="-1")  # -> FilteredList, ItemsBefore, ItemsAfter; inputs ListToSlice: tree, StartIndex: tree of Int32, EndIndex: tree of Int32
# ---------- lito3p: Python ----------
if ghenv.Component.RunCount<2:
    __author__ = "Ueli Saluz"
    __version__ = "2020.05.28"
    
    ghenv.Component.Name = "ListInto3Parts"
    ghenv.Component.NickName = "LiTo3P"
    ghenv.Component.Description = "Slice list into 3 parts. All lists are sliced with the same indices. End index = 0 = length(list)."
    ghenv.Component.Message = "VER 1.6"

from System import Object
from Grasshopper import DataTree

def filterList(listToFilter,startIndex,endIndex):
    # Return: FilteredList, Before, After
    if (((startIndex == 0) or (startIndex is None)) and ((endIndex == 0) or (endIndex is None))) or (endIndex <= startIndex and endIndex > 0):
        return (listToFilter,None,None)
    elif (startIndex == 0) or (startIndex is None):
        return (listToFilter[:endIndex],None,listToFilter[endIndex:])
    elif (endIndex == 0) or (endIndex is None):
        print 1
        return (listToFilter[:startIndex],listToFilter[startIndex:],None)
    else:
        return (listToFilter[startIndex:endIndex],listToFilter[:startIndex],listToFilter[endIndex:])

if __name__ == "__main__":
    FilteredList = DataTree[Object]()
    ItemsBefore = DataTree[Object]()
    ItemsAfter = DataTree[Object]()
    
    for path in ListToSlice.Paths:
        listBranch = ListToSlice.Branch(path)
        pyList = list(listBranch)   #Convert .Net List to Python
        try: #terrible way of writing code but if I set the list to list access the performance decreases massivly due to many calls
            startIndex = StartIndex.Branch(path)
            startIndex = startIndex[0]
        except Exception:
            try:
                startIndex = StartIndex.Branch(0)
                startIndex = startIndex[0]
            except Exception:
                startIndex = 0
        try:
            endIndex = EndIndex.Branch(path)
            endIndex = endIndex[0]
        except Exception:
            try:
                endIndex = EndIndex.Branch(0)
                endIndex = endIndex[0]
            except Exception:
                endIndex = len(pyList)
        filtList=filterList(pyList,startIndex,endIndex)
        if filtList[0]:
            FilteredList.AddRange(filtList[0],path)
        if filtList[1]:
            ItemsBefore.AddRange(filtList[1],path)
        if filtList[2]:
            ItemsAfter.AddRange(filtList[2],path)
# ---------- end lito3p ----------
pce = ModelPiece(Id=lito3p.FilteredList, TypeName="Tambour")  # -> Piece, Valid, Id, Description, TypeName, TypeVariant, Plane, Center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
pce_2 = ModelPiece(Id=lito3p.ItemsBefore, TypeName="Tambour", TypeVariant="First Storey")  # -> Piece, Valid, Id, Description, TypeName, TypeVariant, Plane, Center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
pce_3 = ModelPiece(Id=lito3p.ItemsAfter, TypeName="Tambour", TypeVariant="Last Storey")  # -> Piece, Valid, Id, Description, TypeName, TypeVariant, Plane, Center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
expression = Expression(x=number_of_floors, Expression="x=1")
merge_4 = Merge(Data1=pce_2.Piece, Data2=pce.Piece, Data3=pce_3.Piece)
pce_4 = ModelPiece(Id=concat_2, TypeName="Tambour")  # -> Piece, Valid, Id, Description, TypeName, TypeVariant, Plane, Center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
filter = StreamFilter(Gate=expression, Stream0=merge_4, Stream1=pce_4.Piece)
pce_5 = ModelPiece(Piece=filter, TypeName="Tambour")  # -> Piece, Valid, Id, Description, TypeName, TypeVariant, Plane, Center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
tambour_pc = Piece(pce_5.Piece)

concat_3 = Concatenate(FragmentA=split_level, FragmentB="0")
concat_4 = Concatenate(FragmentA=door, FragmentB="0")
concat_5 = Concatenate(FragmentA=concat_3, FragmentC="_", FragmentB=concat_4)
concat_6 = Concatenate(FragmentF="cs", FragmentA="_", FragmentD=concat_5, FragmentB="_", FragmentC=concat_2)
dpt_9 = ModelDiagramPoint(DiagramPoint=sl0d0)  # -> DiagramPoint, Valid, X, Y
pce_6 = ModelPiece(Id=concat_6, TypeName="Capsule", TypeVariant=capsulevarianteastleft)  # -> Piece, Valid, Id, Description, TypeName, TypeVariant, Plane, Center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
con = ModelConnection(
    Connection=capsuleco_2,
    ConnectedPieceId=pce_5.Id,
    ConnectedPieceTypePortId=concat_5,
    ConnectingPieceId=pce_6.Id,
    X=dpt_9.X,
    Y=dpt_9.Y)  # -> Connection, Valid, ConnectedPieceId, ConnectedPieceTypePortId, ConnectingPieceId, ConnectingPieceTypePortId, Description, Gap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

concat_7 = Concatenate(FragmentA=door, FragmentB="1")
concat_8 = Concatenate(FragmentA=split_level, FragmentB="0")
concat_9 = Concatenate(FragmentA=concat_8, FragmentC="_", FragmentB=concat_7)
concat_10 = Concatenate(FragmentF="cs", FragmentA="_", FragmentD=concat_9, FragmentB="_", FragmentC=concat_2)
pce_7 = ModelPiece(Id=concat_10, TypeName="Capsule", TypeVariant=capsulevariantnorthright)  # -> Piece, Valid, Id, Description, TypeName, TypeVariant, Plane, Center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
dpt_10 = ModelDiagramPoint(DiagramPoint=sl0d1)  # -> DiagramPoint, Valid, X, Y
con_2 = ModelConnection(ConnectedPieceId=pce_5.Id, ConnectedPieceTypePortId=concat_9, ConnectingPieceId=pce_7.Id, X=dpt_10.X, Y=dpt_10.Y)  # -> Connection, Valid, ConnectedPieceId, ConnectedPieceTypePortId, ConnectingPieceId, ConnectingPieceTypePortId, Description, Gap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

concat_11 = Concatenate(FragmentA=split_level, FragmentB="0")
concat_12 = Concatenate(FragmentA=door, FragmentB="2")
concat_13 = Concatenate(FragmentA=concat_11, FragmentC="_", FragmentB=concat_12)
concat_14 = Concatenate(FragmentF="cs", FragmentA="_", FragmentD=concat_13, FragmentB="_", FragmentC=concat_2)
pce_8 = ModelPiece(Id=concat_14, TypeName="Capsule", TypeVariant=capsulevariantnorthleft)  # -> Piece, Valid, Id, Description, TypeName, TypeVariant, Plane, Center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
dpt_11 = ModelDiagramPoint(DiagramPoint=sl0d2)  # -> DiagramPoint, Valid, X, Y
con_3 = ModelConnection(
    Connection=capsuleco_2,
    ConnectedPieceId=pce_5.Id,
    ConnectedPieceTypePortId=concat_13,
    ConnectingPieceId=pce_8.Id,
    X=dpt_11.X,
    Y=dpt_11.Y)  # -> Connection, Valid, ConnectedPieceId, ConnectedPieceTypePortId, ConnectingPieceId, ConnectingPieceTypePortId, Description, Gap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

concat_15 = Concatenate(FragmentA=door, FragmentB="3")
concat_16 = Concatenate(FragmentA=split_level, FragmentB="0")
concat_17 = Concatenate(FragmentA=concat_16, FragmentC="_", FragmentB=concat_15)
concat_18 = Concatenate(FragmentF="cs", FragmentA="_", FragmentD=concat_17, FragmentB="_", FragmentC=concat_2)
pce_9 = ModelPiece(Id=concat_18, TypeName="Capsule", TypeVariant=capsulevariantwestright)  # -> Piece, Valid, Id, Description, TypeName, TypeVariant, Plane, Center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
dpt_12 = ModelDiagramPoint(DiagramPoint=sl0d3)  # -> DiagramPoint, Valid, X, Y
con_4 = ModelConnection(
    Connection=capsuleco_2,
    ConnectedPieceId=pce_5.Id,
    ConnectedPieceTypePortId=concat_17,
    ConnectingPieceId=pce_9.Id,
    X=dpt_12.X,
    Y=dpt_12.Y)  # -> Connection, Valid, ConnectedPieceId, ConnectedPieceTypePortId, ConnectingPieceId, ConnectingPieceTypePortId, Description, Gap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

concat_19 = Concatenate(FragmentA=split_level, FragmentB="1")
concat_20 = Concatenate(FragmentA=door, FragmentB="0")
concat_21 = Concatenate(FragmentA=concat_19, FragmentC="_", FragmentB=concat_20)
concat_22 = Concatenate(FragmentF="cs", FragmentA="_", FragmentD=concat_21, FragmentB="_", FragmentC=concat_2)
pce_10 = ModelPiece(Id=concat_22, TypeName="Capsule", TypeVariant=capsulevariantwestleft)  # -> Piece, Valid, Id, Description, TypeName, TypeVariant, Plane, Center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
dpt_13 = ModelDiagramPoint(DiagramPoint=sl1d0)  # -> DiagramPoint, Valid, X, Y
con_5 = ModelConnection(Connection=capsuleco_2, ConnectedPieceId=pce_5.Id, ConnectedPieceTypePortId=concat_21, ConnectingPieceId=pce_10.Id)  # -> Connection, Valid, ConnectedPieceId, ConnectedPieceTypePortId, ConnectingPieceId, ConnectingPieceTypePortId, Description, Gap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

concat_23 = Concatenate(FragmentA=door, FragmentB="1")
concat_24 = Concatenate(FragmentA=split_level, FragmentB="1")
concat_25 = Concatenate(FragmentA=concat_24, FragmentC="_", FragmentB=concat_23)
concat_26 = Concatenate(FragmentF="cs", FragmentA="_", FragmentD=concat_25, FragmentB="_", FragmentC=concat_2)
pce_11 = ModelPiece(Id=concat_26, Description="Capsule", TypeName="Capsule", TypeVariant=capsulevariantsouthright)  # -> Piece, Valid, Id, Description, TypeName, TypeVariant, Plane, Center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
dpt_14 = ModelDiagramPoint(DiagramPoint=sl1d1)  # -> DiagramPoint, Valid, X, Y
con_6 = ModelConnection(
    Connection=capsuleco_2,
    ConnectedPieceId=pce_5.Id,
    ConnectedPieceTypePortId=concat_25,
    ConnectingPieceId=pce_11.Id,
    X=dpt_14.X,
    Y=dpt_14.Y)  # -> Connection, Valid, ConnectedPieceId, ConnectedPieceTypePortId, ConnectingPieceId, ConnectingPieceTypePortId, Description, Gap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

tambour_pc_2 = ClusterOutput(tambour_pc)
expression_2 = Expression(x=diagram_force_2, Expression="2+(x+0.5)^2-0.25")

concat_27 = Concatenate(FragmentA=split_level, FragmentB="2")
concat_28 = Concatenate(FragmentA=door, FragmentB="0")
concat_29 = Concatenate(FragmentA=concat_27, FragmentC="_", FragmentB=concat_28)
concat_30 = Concatenate(FragmentF="cs", FragmentA="_", FragmentD=concat_29, FragmentB="_", FragmentC=concat_2)
pce_12 = ModelPiece(Id=concat_30, TypeName="Capsule", TypeVariant=capsulevariantsouthleft)  # -> Piece, Valid, Id, Description, TypeName, TypeVariant, Plane, Center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
dpt_15 = ModelDiagramPoint(DiagramPoint=sl2d0)  # -> DiagramPoint, Valid, X, Y
con_7 = ModelConnection(
    Connection=capsuleco_2,
    ConnectedPieceId=pce_5.Id,
    ConnectedPieceTypePortId=concat_29,
    ConnectingPieceId=pce_12.Id,
    X=dpt_15.X,
    Y=dpt_15.Y)  # -> Connection, Valid, ConnectedPieceId, ConnectedPieceTypePortId, ConnectingPieceId, ConnectingPieceTypePortId, Description, Gap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

item_18 = ListItem(List=tambour_pc, Index=0, Wrap=True)  # -> Item1, Item

concat_31 = Concatenate(FragmentA=split_level, FragmentB="2")
concat_32 = Concatenate(FragmentA=door, FragmentB="1")
concat_33 = Concatenate(FragmentA=concat_31, FragmentC="_", FragmentB=concat_32)
concat_34 = Concatenate(FragmentF="cs", FragmentA="_", FragmentD=concat_33, FragmentB="_", FragmentC=concat_2)
pce_13 = ModelPiece(Id=concat_34, TypeName="Capsule", TypeVariant=capsulevarianteastright)  # -> Piece, Valid, Id, Description, TypeName, TypeVariant, Plane, Center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
dpt_16 = ModelDiagramPoint(DiagramPoint=sl2d1)  # -> DiagramPoint, Valid, X, Y
con_8 = ModelConnection(
    Connection=capsuleco_2,
    ConnectedPieceId=pce_5.Id,
    ConnectedPieceTypePortId=concat_33,
    ConnectingPieceId=pce_13.Id,
    X=dpt_16.X,
    Y=dpt_16.Y)  # -> Connection, Valid, ConnectedPieceId, ConnectedPieceTypePortId, ConnectingPieceId, ConnectingPieceTypePortId, Description, Gap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

merge_5 = Merge(
    Data1=pce_6.Piece,
    Data2=pce_7.Piece,
    Data3=pce_8.Piece,
    Data4=pce_9.Piece,
    Data5=pce_10.Piece,
    Data6=pce_11.Piece,
    Data7=pce_12.Piece,
    Data8=pce_13.Piece)
merge_6 = Merge(
    Data1=con.Connection,
    Data2=con_2.Connection,
    Data3=con_3.Connection,
    Data4=con_4.Connection,
    Data5=con_5.Connection,
    Data6=con_6.Connection,
    Data7=con_7.Connection,
    Data8=con_8.Connection)
capsule_pc = Piece(merge_5)
caspule_co = Connection(merge_6)
merge_7 = Merge(Data1=tambour_pc, Data2=capsule_pc)
pc = Piece(merge_7)
pc_2 = ClusterOutput(pc)
capsule_pc_2 = ClusterOutput(capsule_pc)
caspule_co_2 = ClusterOutput(caspule_co)
pce_14 = ModelPiece(Piece=item_18.Item)  # -> Piece, Valid, Id, Description, TypeName, TypeVariant, Plane, Center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
con_9 = ModelConnection(Connection=tambourco_2, ConnectedPieceTypePortId=top, ConnectingPieceTypePortId=bottom, Y=expression_2)  # -> Connection, Valid, ConnectedPieceId, ConnectedPieceTypePortId, ConnectingPieceId, ConnectingPieceTypePortId, Description, Gap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
pce_15 = ModelPiece(Piece=item_18.Item1)  # -> Piece, Valid, Id, Description, TypeName, TypeVariant, Plane, Center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
first_tambour_id = Text(pce_14.Id)
first_tambour_id_2 = ClusterOutput(first_tambour_id)
last_tambour_id = Text(pce_15.Id)
last_tambour_id_2 = ClusterOutput(last_tambour_id)
lincons = LinearConnections(pc=tambour_pc, co=con_9.Connection)
filter_2 = StreamFilter(Gate=expression, Stream0=lincons)
tambour_co = Connection(filter_2)
merge_8 = Merge(Data1=tambour_co, Data2=caspule_co)
co = Connection(merge_8)
co_2 = ClusterOutput(co)
tambour_co_2 = ClusterOutput(tambour_co)

# ==== cluster AddBridges
dn = ClusterInput()
bridgeco = ClusterInput()
levels = ClusterInput()
dn_2 = Design(graft(dn))
bridgeco_2 = Connection(bridgeco)
levels_2 = Integer(levels)
expression = Expression(x=levels_2, Expression="x-1")
concat = Concatenate(
    FragmentA="cs_",
    FragmentD="sl",
    FragmentH="0",
    FragmentI="_d",
    FragmentJ="1",
    FragmentB="_t_f",
    FragmentC=expression,
    FragmentE="_b_c",
    FragmentF="1")
concat_2 = Concatenate(
    FragmentA="cs_",
    FragmentD="sl",
    FragmentH="0",
    FragmentI="_d",
    FragmentJ="2",
    FragmentB="_t_f",
    FragmentC=expression,
    FragmentE="_b_c",
    FragmentF="0")
merge = Merge(Data1=concat_2, Data2=concat)
rmvpces = RemovePieces(dn=dn_2, ids=merge)  # -> dn_4, pc_2, co_2
dsn = ModelDesign(Design=rmvpces.dn_4)  # -> Design, Valid, Name, Description, Icon, Image, Variant, View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
lng = ListLength(List=levels_2)
split = SplitList(List=rmvpces.pc_2, Index=lng)  # -> ListA, ListB
split_2 = SplitList(List=rmvpces.co_2, Index=lng)  # -> ListA, ListB
trim = TrimTree(Tree=dsn.Pieces, Depth=1)
trim_2 = TrimTree(Tree=dsn.Connections, Depth=1)
concat_3 = Concatenate(
    FragmentA="br_",
    FragmentD="sl",
    FragmentH="0",
    FragmentI="_d",
    FragmentJ="2",
    FragmentB="_t_f",
    FragmentC=expression,
    FragmentE="_b_c",
    FragmentF="0")
trim_3 = TrimTree(Tree=split.ListA, Depth=1)
trim_4 = TrimTree(Tree=split_2.ListA, Depth=1)
pce = ModelPiece(Piece=trim_3, Id=concat_3, TypeName="Bridge")  # -> Piece, Valid, Id, Description, TypeName, TypeVariant, Plane, Center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
con = ModelConnection(Connection=trim_4)  # -> Connection, Valid, ConnectedPieceId, ConnectedPieceTypePortId, ConnectingPieceId, ConnectingPieceTypePortId, Description, Gap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
addition = Addition(A=con.X)
con_2 = ModelConnection(
    Connection=bridgeco_2,
    ConnectedPieceId=con.ConnectedPieceId,
    ConnectedPieceTypePortId=graft(con.ConnectedPieceTypePortId),
    ConnectingPieceId=graft(pce.Id),
    ConnectingPieceTypePortId="e",
    Description=con.Description,
    X=graft(addition),
    Y=con.Y,
    Qualities=con.Qualities)  # -> Connection, Valid, ConnectedPieceId, ConnectedPieceTypePortId, ConnectingPieceId, ConnectingPieceTypePortId, Description, Gap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
trim_5 = TrimTree(Tree=con_2.Connection, Depth=1)
merge_2 = Merge(Data1=trim_2, Data2=trim_5)
merge_3 = Merge(Data1=trim, Data2=pce.Piece)
dsn_2 = ModelDesign(Design=dsn.Design, Pieces=merge_3, Connections=merge_2)  # -> Design, Valid, Name, Description, Icon, Image, Variant, View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
dn_3 = Design(dsn_2.Design)
dn_4 = ClusterOutput(dn_3)

# ==== cluster AssessPerformance: Simple performance assement based on the following qualities of the types (No unit conversion is applied for now, so make sure that all your types have the values with the same unit.): floor area, effective floor area, residents, workspaces, construction cost, maintenance expenses, income, transmission heat loss, ventilation heat loss, cooling energy demand, technical equipment energy demand,construction global warming potential, heating load, cooling load, ventilation air flow volume
dn = ClusterInput()
ty = ClusterInput()
technical_equipment_cost = ClusterInput()
technical_equipment_gwp_kgco2e = ClusterInput()
ventilation_heat_recovery_factor = ClusterInput()
heating_efficiency_factor = ClusterInput()
heating_primary_energy_factor = ClusterInput()
heating_energy_price_kwh = ClusterInput()
heating_global_warming_potential_kgco2e = ClusterInput()  # "Heating Global Warming Potential [kgCO2e/kWh]"
cooling_efficiency_factor = ClusterInput()
cooling_primary_energy_factor = ClusterInput()
cooling_global_warming_potential_kgco2e = ClusterInput()  # "Cooling Global Warming Potential [kgCO2e/kWh]"
cooling_energy_price_kwh = ClusterInput()
electrictiy_primary_energy_factor = ClusterInput()
electrictiy_global_warming_potential_kgc = ClusterInput()  # "Electrictiy Global Warming Potential [kgCO2e/kWh]"
electrictiy_energy_price_kwh = ClusterInput()
co2_price_tco2e = ClusterInput()
life_cycle_a = ClusterInput()
electrictiy_energy_price_kwh_2 = Number(electrictiy_energy_price_kwh)
heating_primary_energy_factor_2 = Number(heating_primary_energy_factor)
heating_energy_price_kwh_2 = Number(heating_energy_price_kwh)
heating_global_warming_potential_kgco2e_2 = Number(heating_global_warming_potential_kgco2e)  # "Heating Global Warming Potential [kgCO2e/kWh]"
cooling_energy_price_kwh_2 = Number(cooling_energy_price_kwh)
electrictiy_primary_energy_factor_2 = Number(electrictiy_primary_energy_factor)
ventilation_heat_recovery_factor_2 = Number(ventilation_heat_recovery_factor)
heating_efficiency_factor_2 = Number(heating_efficiency_factor)
cooling_efficiency_factor_2 = Number(cooling_efficiency_factor)
cooling_primary_energy_factor_2 = Number(cooling_primary_energy_factor)
cooling_global_warming_potential_kgco2e_2 = Number(cooling_global_warming_potential_kgco2e)  # "Cooling Global Warming Potential [kgCO2e/kWh]"
electrictiy_global_warming_potential_kgc_2 = Number(electrictiy_global_warming_potential_kgc)  # "Electrictiy Global Warming Potential [kgCO2e/kWh]"
co2_price_tco2e_2 = Number(co2_price_tco2e)
life_cycle_a_2 = Number(life_cycle_a)
dn_2 = Design(dn)
ty_2 = Type(ty)
technical_equipment_cost_2 = Number(technical_equipment_cost)
technical_equipment_gwp_kgco2e_2 = Number(technical_equipment_gwp_kgco2e)
expression = Expression(x=co2_price_tco2e_2, Expression="x/1000")
co2_price_kgco2e = Number(expression)
qal = SumQualities(dn=dn_2, ty=ty_2, na="floor area")  # -> num_2, ql_2
qal_2 = SumQualities(dn=dn_2, ty=ty_2, na="effective floor area")  # -> num_2, ql_2
qal_3 = SumQualities(dn=dn_2, ty=ty_2, na="residents")  # -> num_2, ql_2
qal_4 = SumQualities(dn=dn_2, ty=ty_2, na="workspaces")  # -> num_2, ql_2
qal_5 = SumQualities(dn=dn_2, ty=ty_2, na="construction cost")  # -> num_2, ql_2
qal_6 = SumQualities(dn=dn_2, ty=ty_2, na="maintenance expenses")  # -> num_2, ql_2
qal_7 = SumQualities(dn=dn_2, ty=ty_2, na="income")  # -> num_2, ql_2
qal_8 = SumQualities(dn=dn_2, ty=ty_2, na="transmission heat demand")  # -> num_2, ql_2
qal_9 = SumQualities(dn=dn_2, ty=ty_2, na="ventilation heat demand")  # -> num_2, ql_2
qal_10 = SumQualities(dn=dn_2, ty=ty_2, na="cooling energy demand")  # -> num_2, ql_2
qal_11 = SumQualities(dn=dn_2, ty=ty_2, na="technical equipment energy demand")  # -> num_2, ql_2
qal_12 = SumQualities(dn=dn_2, ty=ty_2, na="construction global warming potential")  # -> num_2, ql_2
qal_13 = SumQualities(dn=dn_2, ty=ty_2, na="heating load")  # -> num_2, ql_2
qal_14 = SumQualities(dn=dn_2, ty=ty_2, na="cooling load")  # -> num_2, ql_2
qal_15 = SumQualities(dn=dn_2, ty=ty_2, na="ventilation air flow volume")  # -> num_2, ql_2
addition = Addition(A=qal_3.num_2, B=qal_4.num_2)
ventilation_heat_recovery_factor_3 = Number(ventilation_heat_recovery_factor_2)
users_person = Number(addition)
ventiation_heat_loss_kwh_a = Number(qal_9.num_2)
transmission_heat_loss_kwh_a = Number(qal_8.num_2)
expression_2 = Expression(x=ventilation_heat_recovery_factor_3, Expression="1-x")
multiplication = Multiplication(A=ventiation_heat_loss_kwh_a, B=expression_2)
heating_global_warming_potential_kgco2e_3 = Number(heating_global_warming_potential_kgco2e_2)  # "Heating Global Warming Potential [kgCO2e/kWh]"
electrictiy_global_warming_potential_kgc_3 = Number(electrictiy_global_warming_potential_kgc_2)  # "Electrictiy Global Warming Potential [kgCO2e/kWh]"
cooling_global_warming_potential_kgco2e_3 = Number(cooling_global_warming_potential_kgco2e_2)  # "Cooling Global Warming Potential [kgCO2e/kWh]"
addition_2 = Addition(A=transmission_heat_loss_kwh_a, B=multiplication)
heating_energy_demand_kwh_a = Number(addition_2)
cooling_energy_demand_kwh_a = Number(qal_10.num_2)
heating_efficiency_factor_3 = Number(heating_efficiency_factor_2)
cooling_efficiency_factor_3 = Number(cooling_efficiency_factor_2)
technical_equipment_energy_demand_kwh_a = Number(qal_11.num_2)
electricity_energy_demand_kwh_a = Number(technical_equipment_energy_demand_kwh_a)
multiplication_2 = Multiplication(A=electricity_energy_demand_kwh_a, B=electrictiy_global_warming_potential_kgc_3)
multiplication_3 = Multiplication(A=heating_energy_demand_kwh_a, B=heating_efficiency_factor_3)
final_heating_energy_demand_kwh_a = Number(multiplication_3)
multiplication_4 = Multiplication(A=final_heating_energy_demand_kwh_a, B=heating_global_warming_potential_kgco2e_3)
multiplication_5 = Multiplication(A=cooling_energy_demand_kwh_a, B=cooling_efficiency_factor_3)
final_cooling_energy_demand_kwh_a = Number(multiplication_5)
multiplication_6 = Multiplication(A=final_cooling_energy_demand_kwh_a, B=cooling_global_warming_potential_kgco2e_3)
heating_global_warming_potential_kgco2e_4 = Number(multiplication_4)  # "Heating Global Warming Potential [kgCO2e/a]"
cooling_global_warming_potential_kgco2e_4 = Number(multiplication_6)  # "Cooling Global Warming Potential [kgCO2e/a]"
electricity_global_warming_potential_kgc = Number(multiplication_2)  # "Electricity Global Warming Potential [kgCO2e/a]"
final_heating_energy_demand_kwh_a_2 = Number(multiplication_3)
final_cooling_energy_demand_kwh_a_2 = Number(multiplication_5)
electricity_energy_demand_kwh_a_2 = Number(technical_equipment_energy_demand_kwh_a)
electrictiy_energy_price_kwh_3 = Number(electrictiy_energy_price_kwh_2)
heating_energy_price_kwh_3 = Number(heating_energy_price_kwh_2)
cooling_energy_price_kwh_3 = Number(cooling_energy_price_kwh_2)
co2_price_kgco2e_2 = Number(co2_price_kgco2e)
co2_price_kgco2e_3 = Number(co2_price_kgco2e)
co2_price_kgco2e_4 = Number(co2_price_kgco2e)
multiplication_7 = Multiplication(A=final_heating_energy_demand_kwh_a_2, B=heating_energy_price_kwh_3)
multiplication_8 = Multiplication(A=electricity_energy_demand_kwh_a_2, B=electrictiy_energy_price_kwh_3)
multiplication_9 = Multiplication(A=final_cooling_energy_demand_kwh_a_2, B=cooling_energy_price_kwh_3)
multiplication_10 = Multiplication(A=heating_global_warming_potential_kgco2e_4, B=co2_price_kgco2e_2)
multiplication_11 = Multiplication(A=cooling_global_warming_potential_kgco2e_4, B=co2_price_kgco2e_3)
multiplication_12 = Multiplication(A=electricity_global_warming_potential_kgc, B=co2_price_kgco2e_4)
electricity_global_warming_potential_kgc_2 = Number(electricity_global_warming_potential_kgc)  # "Electricity Global Warming Potential [kgCO2e/a]"
heating_global_warming_potential_kgco2e_5 = Number(heating_global_warming_potential_kgco2e_4)  # "Heating Global Warming Potential [kgCO2e/a]"
cooling_global_warming_potential_kgco2e_5 = Number(cooling_global_warming_potential_kgco2e_4)  # "Cooling Global Warming Potential [kgCO2e/a]"
heating_energy_price_a = Number(multiplication_7)
cooling_energy_price_a = Number(multiplication_8)
heating_co2_price_a = Number(multiplication_10)
cooling_co2_price_a = Number(multiplication_11)
cooling_energy_price_a_2 = Number(multiplication_9)
electricity_co2_price_a = Number(multiplication_12)
final_heating_energy_demand_kwh_a_3 = Number(final_heating_energy_demand_kwh_a_2)
final_cooling_energy_demand_kwh_a_3 = Number(final_cooling_energy_demand_kwh_a_2)
electricity_energy_demand_kwh_a_3 = Number(electricity_energy_demand_kwh_a_2)
electricity_energy_demand_kwh_a_4 = Number(electricity_energy_demand_kwh_a_2)
electrictiy_primary_energy_factor_3 = Number(electrictiy_primary_energy_factor_2)
heating_primary_energy_factor_3 = Number(heating_primary_energy_factor_2)
final_cooling_energy_demand_kwh_a_4 = Number(final_cooling_energy_demand_kwh_a_2)
cooling_primary_energy_factor_3 = Number(cooling_primary_energy_factor_2)
final_heating_energy_demand_kwh_a_4 = Number(final_heating_energy_demand_kwh_a_2)
building_construction_gwp_kgco2e = Number(qal_12.num_2)
technical_equipment_gwp_kgco2e_3 = Number(technical_equipment_gwp_kgco2e_2)
addition_3 = Addition(A=cooling_energy_price_a_2, B=cooling_co2_price_a)
addition_4 = Addition(A=heating_energy_price_a, B=heating_co2_price_a)
addition_5 = Addition(A=cooling_energy_price_a, B=electricity_co2_price_a)
addition_6 = Addition(
    A=heating_global_warming_potential_kgco2e_5,
    B=cooling_global_warming_potential_kgco2e_5,
    C=electricity_global_warming_potential_kgc_2)
addition_7 = Addition(A=final_heating_energy_demand_kwh_a_3, B=final_cooling_energy_demand_kwh_a_3, C=electricity_energy_demand_kwh_a_4)
multiplication_13 = Multiplication(A=electricity_energy_demand_kwh_a_3, B=electrictiy_primary_energy_factor_3)
multiplication_14 = Multiplication(A=final_heating_energy_demand_kwh_a_4, B=heating_primary_energy_factor_3)
multiplication_15 = Multiplication(A=final_cooling_energy_demand_kwh_a_4, B=cooling_primary_energy_factor_3)
electricity_expenses_a = Number(addition_5)
heating_expenses_a = Number(addition_4)
cooling_expenses_a = Number(addition_3)
energy_global_warming_potential_kgco2e_a = Number(addition_6)
final_energy_demand_kwh_a = Number(addition_7)
primary_heating_energy_demand_kwh_a = Number(multiplication_14)
primary_cooling_energy_demand_kwh_a = Number(multiplication_15)
primary_electricity_energy_demand_kwh_a = Number(multiplication_13)
addition_8 = Addition(A=building_construction_gwp_kgco2e, B=technical_equipment_gwp_kgco2e_3)
addition_9 = Addition(A=heating_expenses_a, B=cooling_expenses_a, C=electricity_expenses_a)
life_cycle_a_3 = Number(life_cycle_a_2)
construction_gwp_kgco2e = Number(addition_8)
maintenance_expenses_a = Number(qal_6.num_2)
energy_expenses_a = Number(addition_9)
multiplication_16 = Multiplication(A=energy_global_warming_potential_kgco2e_a, B=life_cycle_a_3)
addition_10 = Addition(A=primary_heating_energy_demand_kwh_a, B=primary_cooling_energy_demand_kwh_a, C=primary_electricity_energy_demand_kwh_a)
addition_11 = Addition(A=multiplication_16, B=construction_gwp_kgco2e)
addition_12 = Addition(A=maintenance_expenses_a, B=energy_expenses_a)
primary_energy_demand_kwh_a = Number(addition_10)
building_construction_cost = Number(qal_5.num_2)
technical_equipment_cost_3 = Number(technical_equipment_cost_2)
life_cycle_gwp_kgco2e = Number(addition_11)
expenses_a = Number(addition_12)
life_cycle_a_4 = Number(life_cycle_a_2)
multiplication_17 = Multiplication(A=expenses_a, B=life_cycle_a_4)
addition_13 = Addition(A=building_construction_cost, B=technical_equipment_cost_3)
life_cycle_expenses = Number(multiplication_17)
construction_cost = Number(addition_13)
income_a = Number(qal_7.num_2)
life_cycle_a_5 = Number(life_cycle_a_2)
addition_14 = Addition(A=construction_cost, B=life_cycle_expenses)
multiplication_18 = Multiplication(A=income_a, B=life_cycle_a_5)
cooling_energy_demand_kwh_a_2 = Number(cooling_energy_demand_kwh_a)
heating_energy_demand_kwh_a_2 = Number(heating_energy_demand_kwh_a)
heating_energy_demand_kwh_a_3 = Number(heating_energy_demand_kwh_a)
cooling_energy_demand_kwh_a_3 = Number(cooling_energy_demand_kwh_a)
primary_energy_demand_kwh_a_2 = Number(primary_energy_demand_kwh_a)
primary_energy_demand_kwh_a_3 = Number(primary_energy_demand_kwh_a)
final_energy_demand_kwh_a_2 = Number(final_energy_demand_kwh_a)
final_energy_demand_kwh_a_3 = Number(final_energy_demand_kwh_a)
construction_gwp_kgco2e_2 = Number(construction_gwp_kgco2e)
construction_gwp_kgco2e_3 = Number(construction_gwp_kgco2e)
life_cycle_gwp_kgco2e_2 = Number(life_cycle_gwp_kgco2e)
life_cycle_gwp_kgco2e_3 = Number(life_cycle_gwp_kgco2e)
effective_floor_area_m² = Number(qal_2.num_2)
effective_floor_area_m²_2 = Number(qal_2.num_2)
effective_floor_area_m²_3 = Number(qal_2.num_2)
effective_floor_area_m²_4 = Number(qal_2.num_2)
effective_floor_area_m²_5 = Number(qal_2.num_2)
effective_floor_area_m²_6 = Number(qal_2.num_2)
effective_floor_area_m²_7 = Number(qal_2.num_2)
effective_floor_area_m²_8 = Number(qal_2.num_2)
effective_floor_area_m²_9 = Number(qal_2.num_2)
effective_floor_area_m²_10 = Number(qal_2.num_2)
construction_cost_2 = Number(addition_13)
life_cycle_income = Number(multiplication_18)
construction_cost_3 = Number(addition_13)
life_cycle_cost = Number(addition_14)
life_cycle_cost_2 = Number(addition_14)
life_cycle_cost_3 = Number(addition_14)
floor_area_m² = Number(qal.num_2)
users_person_2 = Number(users_person)
users_person_3 = Number(users_person)
users_person_4 = Number(users_person)
users_person_5 = Number(users_person)
users_person_6 = Number(users_person)
users_person_7 = Number(users_person)
users_person_8 = Number(users_person)
users_person_9 = Number(users_person)
users_person_10 = Number(users_person)
division = Division(A=effective_floor_area_m², B=floor_area_m²)
division_2 = Division(A=effective_floor_area_m²_5, B=users_person_5)
division_3 = Division(A=construction_cost_2, B=effective_floor_area_m²_2)
division_4 = Division(A=construction_cost_3, B=users_person_6)
division_5 = Division(A=life_cycle_cost_2, B=effective_floor_area_m²_3)
division_6 = Division(A=life_cycle_cost_3, B=users_person_7)
division_7 = Division(A=construction_gwp_kgco2e_2, B=effective_floor_area_m²_6)
division_8 = Division(A=construction_gwp_kgco2e_3, B=users_person_8)
division_9 = Division(A=life_cycle_gwp_kgco2e_2, B=effective_floor_area_m²_4)
division_10 = Division(A=life_cycle_gwp_kgco2e_3, B=users_person_9)
division_11 = Division(A=primary_energy_demand_kwh_a_2, B=effective_floor_area_m²_7)
division_12 = Division(A=primary_energy_demand_kwh_a_3, B=users_person_10)
division_13 = Division(A=final_energy_demand_kwh_a_2, B=effective_floor_area_m²_8)
division_14 = Division(A=final_energy_demand_kwh_a_3, B=users_person_2)
division_15 = Division(A=heating_energy_demand_kwh_a_2, B=effective_floor_area_m²_9)
division_16 = Division(A=heating_energy_demand_kwh_a_3, B=users_person_3)
division_17 = Division(A=cooling_energy_demand_kwh_a_2, B=effective_floor_area_m²_10)
division_18 = Division(A=cooling_energy_demand_kwh_a_3, B=users_person_4)
expression_3 = Expression(Start=construction_cost, End=life_cycle_income, Expression="((End-Start)/Start)*100")
area_comfort_m²_person = Number(division_2)
life_cycle_cost_4 = Number(life_cycle_cost)
specific_life_cycle_cost_m² = Number(division_5)
construction_global_warming_potential_pe = Number(division_8)  # "Construction Global Warming Potential per User [kgCO2e/Person]"
specific_life_cycle_global_warming_poten = Number(division_9)  # "Specific Life Cycle Global Warming Potential [kgCO2e/m²]"
life_cycle_global_warming_potential_per = Number(division_10)  # "Life Cycle Global Warming Potential per User [kgCO2e/Person]"
primary_energy_demand_kwh_a_4 = Number(primary_energy_demand_kwh_a)
primary_energy_demand_per_user_kwh_perso = Number(division_12)  # "Primary Energy Demand per User [kWh/Person a]"
final_energy_demand_kwh_a_4 = Number(final_energy_demand_kwh_a)
specific_final_energy_demand_kwh_m²a = Number(division_13)
ventilation_air_flow_volume_m³_s = Number(qal_15.num_2)
area_efficiency_eff_m²_m² = Number(division)
income_a_2 = Number(qal_7.num_2)
expenses_a_2 = Number(addition_12)
energy_expenses_a_2 = Number(addition_9)
effective_floor_area_m²_11 = Number(qal_2.num_2)
floor_area_m²_2 = Number(qal.num_2)
users_person_11 = Number(users_person)
construction_cost_4 = Number(addition_13)
specific_construction_cost_m² = Number(division_3)
construction_cost_per_user_person = Number(division_4)
life_cycle_cost_per_user_person = Number(division_6)
construction_global_warming_potential_kg = Number(construction_gwp_kgco2e)  # "Construction Global Warming Potential [kgCO2e]"
specific_construction_global_warming_pot = Number(division_7)  # "Specific Construction Global Warming Potential [kgCO2e/m²]"
life_cycle_global_warming_potential_kgco = Number(life_cycle_gwp_kgco2e)  # "Life Cycle Global Warming Potential [kgCO2e]"
specific_primary_energy_demand_kwh_m²a = Number(division_11)
final_energy_demand_per_user_kwh_person = Number(division_14)  # "Final Energy Demand per User [kWh/Person a]"
heating_load_kw = Number(qal_13.num_2)
heating_energy_demand_kwh_a_4 = Number(heating_energy_demand_kwh_a)
specific_heating_energy_demand_kwh_m²a = Number(division_15)
heating_energy_demand_per_user_kwh_perso = Number(division_16)  # "Heating Energy Demand per User [kWh/Person a]"
cooling_load_kw = Number(qal_14.num_2)
cooling_energy_demand_kwh_a_4 = Number(cooling_energy_demand_kwh_a)
specific_cooling_energy_demand_kwh_m²a = Number(division_17)
cooling_energy_demand_per_user_kwh_perso = Number(division_18)  # "Cooling Energy Demand per User [kWh/Person a]"
interest = Number(expression_3)
panel = Panel("""interest
area efficiency 
area comfort 
income
expenses 
energy expenses 
effective floor area 
floor area 
users 
construction cost 
specific construction cost 
construction cost per user 
life cycle cost 
specific life cycle cost 
life cycle cost per user 
construction global warming potential 
specific construction global warming potential 
construction global warming potential per user 
life cycle global warming potential 
specific life cycle global warming potential 
life cycle global warming potential per user 
primary energy demand 
specific primary energy demand 
primary energy demand per user 
final energy demand 
specific final energy demand 
final energy demand per user 
heating load 
heating energy demand 
specific heating energy demand 
heating energy demand per user 
cooling load 
cooling energy demand 
specific cooling energy demand 
cooling energy demand per user 
ventilation air flow volume  """)
merge = Merge(
    Data1=interest,
    Data2=area_efficiency_eff_m²_m²,
    Data3=area_comfort_m²_person,
    Data4=income_a_2,
    Data5=expenses_a_2,
    Data6=energy_expenses_a_2,
    Data7=effective_floor_area_m²_11,
    Data8=floor_area_m²_2,
    Data9=users_person_11,
    Data10=construction_cost_4,
    Data11=specific_construction_cost_m²,
    Data12=construction_cost_per_user_person,
    Data13=life_cycle_cost_4,
    Data14=specific_life_cycle_cost_m²,
    Data15=life_cycle_cost_per_user_person,
    Data16=construction_global_warming_potential_kg,
    Data17=specific_construction_global_warming_pot,
    Data18=construction_global_warming_potential_pe,
    Data19=life_cycle_global_warming_potential_kgco,
    Data20=specific_life_cycle_global_warming_poten,
    Data21=life_cycle_global_warming_potential_per,
    Data22=primary_energy_demand_kwh_a_4,
    Data23=specific_primary_energy_demand_kwh_m²a,
    Data24=primary_energy_demand_per_user_kwh_perso,
    Data25=final_energy_demand_kwh_a_4,
    Data26=specific_final_energy_demand_kwh_m²a,
    Data27=final_energy_demand_per_user_kwh_person,
    Data28=heating_load_kw,
    Data29=heating_energy_demand_kwh_a_4,
    Data30=specific_heating_energy_demand_kwh_m²a,
    Data31=heating_energy_demand_per_user_kwh_perso,
    Data32=cooling_load_kw,
    Data33=cooling_energy_demand_kwh_a_4,
    Data34=specific_cooling_energy_demand_kwh_m²a,
    Data35=cooling_energy_demand_per_user_kwh_perso,
    Data36=ventilation_air_flow_volume_m³_s)
dsn = ModelDesign(Design=dn_2)  # -> Design, Valid, Name, Description, Icon, Image, Variant, View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
panel_2 = Panel(merge)
trim = TrimTree(Tree=dsn.Qualities, Depth=1)
panel_3 = Panel("""%
eff. m²/m²
m²/Person
€/a
€/a
€/a
m²
m²
Person
€
€/m²
€/Person
€
€/m²
€/Person
kgCO2e
kgCO2e/m²
kgCO2e/Person
kgCO2e
kgCO2e/m²
kgCO2e/Person
kWh/a
kWh/m²a
kWh/Person a
kWh/a
kWh/m²a
kWh/Person a
kW
kWh/a
kWh/m²a
kWh/Person a
kW
kWh/a
kWh/m²a
kWh/Person a
m³/s""")
qal_16 = ModelQuality(Name=panel, Value=merge, Unit=panel_3)  # -> Quality, Valid, Name, Value, Unit, Definition
merge_2 = Merge(Data1=trim, Data2=qal_16.Quality)
dsn_2 = ModelDesign(Design=dsn.Design, Qualities=merge_2)  # -> Design, Valid, Name, Description, Icon, Image, Variant, View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
dn_3 = ClusterOutput(dsn_2.Design)
interest_2 = ClusterOutput(interest)
area_efficiency_eff_m²_m²_2 = ClusterOutput(area_efficiency_eff_m²_m²)
area_comfort_m²_person_2 = ClusterOutput(area_comfort_m²_person)
income_a_3 = ClusterOutput(income_a_2)
expenses_a_3 = ClusterOutput(expenses_a_2)
energy_expenses_a_3 = ClusterOutput(energy_expenses_a_2)
effective_floor_area_m²_12 = ClusterOutput(effective_floor_area_m²_11)
floor_area_m²_3 = ClusterOutput(floor_area_m²_2)
users_person_12 = ClusterOutput(users_person_11)
construction_cost_5 = ClusterOutput(construction_cost_4)
specific_construction_cost_m²_2 = ClusterOutput(specific_construction_cost_m²)
construction_cost_per_user_person_2 = ClusterOutput(construction_cost_per_user_person)
life_cycle_cost_5 = ClusterOutput(life_cycle_cost_4)
specific_life_cycle_cost_m²_2 = ClusterOutput(specific_life_cycle_cost_m²)
life_cycle_cost_per_user_person_2 = ClusterOutput(life_cycle_cost_per_user_person)
construction_global_warming_potential_kg_2 = ClusterOutput(construction_global_warming_potential_kg)  # "Construction Global Warming Potential [kgCO2e]"
specific_construction_global_warming_pot_2 = ClusterOutput(specific_construction_global_warming_pot)  # "Specific Construction Global Warming Potential [kgCO2e/m²]"
construction_global_warming_potential_pe_2 = ClusterOutput(construction_global_warming_potential_pe)  # "Construction Global Warming Potential per User [kgCO2e/Person]"
life_cycle_global_warming_potential_kgco_2 = ClusterOutput(life_cycle_global_warming_potential_kgco)  # "Life Cycle Global Warming Potential [kgCO2e]"
specific_life_cycle_global_warming_poten_2 = ClusterOutput(specific_life_cycle_global_warming_poten)  # "Specific Life Cycle Global Warming Potential [kgCO2e/m²]"
life_cycle_global_warming_potential_per_2 = ClusterOutput(life_cycle_global_warming_potential_per)  # "Life Cycle Global Warming Potential per User [kgCO2e/Person]"
primary_energy_demand_kwh_a_5 = ClusterOutput(primary_energy_demand_kwh_a_4)
specific_primary_energy_demand_kwh_m²a_2 = ClusterOutput(specific_primary_energy_demand_kwh_m²a)
primary_energy_demand_per_user_kwh_perso_2 = ClusterOutput(primary_energy_demand_per_user_kwh_perso)  # "Primary Energy Demand per User [kWh/Person a]"
final_energy_demand_kwh_a_5 = ClusterOutput(final_energy_demand_kwh_a_4)
specific_final_energy_demand_kwh_m²a_2 = ClusterOutput(specific_final_energy_demand_kwh_m²a)
final_energy_demand_per_user_kwh_person_2 = ClusterOutput(final_energy_demand_per_user_kwh_person)  # "Final Energy Demand per User [kWh/Person a]"
heating_load_kw_2 = ClusterOutput(heating_load_kw)
heating_energy_demand_kwh_a_5 = ClusterOutput(heating_energy_demand_kwh_a_4)
specific_heating_energy_demand_kwh_m²a_2 = ClusterOutput(specific_heating_energy_demand_kwh_m²a)
heating_energy_demand_per_user_kwh_perso_2 = ClusterOutput(heating_energy_demand_per_user_kwh_perso)  # "Heating Energy Demand per User [kWh/Person a]"
cooling_load_kw_2 = ClusterOutput(cooling_load_kw)
cooling_energy_demand_kwh_a_5 = ClusterOutput(cooling_energy_demand_kwh_a_4)
specific_cooling_energy_demand_kwh_m²a_2 = ClusterOutput(specific_cooling_energy_demand_kwh_m²a)
cooling_energy_demand_per_user_kwh_perso_2 = ClusterOutput(cooling_energy_demand_per_user_kwh_perso)  # "Cooling Energy Demand per User [kWh/Person a]"
ventilation_air_flow_volume_m³_s_2 = ClusterOutput(ventilation_air_flow_volume_m³_s)

# ==== cluster VaryTypes: Change a variant (name) from one type to another variant of the same type for all pieces of a design.
dn = ClusterInput()
na = ClusterInput()
old_vn = ClusterInput()
new_vn = ClusterInput()
dn_2 = Design(dn)
na_2 = TypeName(na)
old_vn_2 = TypeVariant(old_vn)
new_vn_2 = TypeVariant(new_vn)
dsn = ModelDesign(Design=dn_2)  # -> Design, Valid, Name, Description, Icon, Image, Variant, View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
trim = TrimTree(Tree=dsn.Pieces, Depth=1)
pce = ModelPiece(Piece=trim)  # -> Piece, Valid, Id, Description, TypeName, TypeVariant, Plane, Center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
lng = ListLength(List=trim)
expression = Expression(x=pce.TypeName, y=na_2, Expression="x=y")
expression_2 = Expression(x=pce.TypeVariant, y=old_vn_2, Expression="x=y")
series = Series(Start=0, Step=1, Count=lng)
trim_2 = TrimTree(Tree=series, Depth=1)
and = GateAnd(A=expression, B=expression_2)
dispatch = Dispatch(List=trim_2, DispatchPattern=and)  # -> ListA, ListB
dispatch_2 = Dispatch(List=pce.Piece, DispatchPattern=and)  # -> ListA, ListB
pce_2 = ModelPiece(Piece=dispatch_2.ListA, TypeVariant=new_vn_2)  # -> Piece, Valid, Id, Description, TypeName, TypeVariant, Plane, Center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
replace = ReplaceItems(List=trim, Item=pce_2.Piece, Indices=dispatch.ListA, Wrap=False)
trim_3 = TrimTree(Tree=replace, Depth=1)
dsn_2 = ModelDesign(Design=dsn.Design, Pieces=trim_3)  # -> Design, Valid, Name, Description, Icon, Image, Variant, View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
dn_3 = Design(dsn_2.Design)
dn_4 = ClusterOutput(dn_3)

# ==== cluster ReplaceType: Replace a type (name) in a design. All variants stay the same and must exist in the new type.
dn = ClusterInput()
old_na = ClusterInput()
new_na = ClusterInput()
dn_2 = Design(dn)
old_na_2 = Text(old_na)
new_na_2 = Text(new_na)
dsn = ModelDesign(Design=dn_2)  # -> Design, Valid, Name, Description, Icon, Image, Variant, View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
trim = TrimTree(Tree=dsn.Pieces, Depth=1)
lng = ListLength(List=trim)
pce = ModelPiece(Piece=trim)  # -> Piece, Valid, Id, Description, TypeName, TypeVariant, Plane, Center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
series = Series(Start=0, Step=1, Count=lng)
expression = Expression(x=pce.TypeName, y=old_na_2, Expression="x=y")
trim_2 = TrimTree(Tree=series, Depth=1)
dispatch = Dispatch(List=pce.Piece, DispatchPattern=expression)  # -> ListA, ListB
dispatch_2 = Dispatch(List=trim_2, DispatchPattern=expression)  # -> ListA, ListB
pce_2 = ModelPiece(Piece=dispatch.ListA, TypeName=new_na_2)  # -> Piece, Valid, Id, Description, TypeName, TypeVariant, Plane, Center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
replace = ReplaceItems(List=trim, Item=pce_2.Piece, Indices=dispatch_2.ListA, Wrap=False)
trim_3 = TrimTree(Tree=replace, Depth=1)
dsn_2 = ModelDesign(Design=dsn.Design, Pieces=trim_3)  # -> Design, Valid, Name, Description, Icon, Image, Variant, View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
dn_3 = Design(dsn_2.Design)
dn_4 = ClusterOutput(dn_3)

# ==== cluster PreviewConnections: Preview all connections of a design by visualizing the ports of the types and the connection parameters.
dn = ClusterInput()
ty = ClusterInput()
sc = ClusterInput()
sc_2 = Number(sc)
dn_2 = Design(dn)
ty_2 = Type(ty)
fltdsn = FlattenDesign(Design=dn_2, Types=ty_2)
dsn = ModelDesign(Design=dn_2)  # -> Design, Valid, Name, Description, Icon, Image, Variant, View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
dsn_2 = ModelDesign(Design=fltdsn)  # -> Design, Valid, Name, Description, Icon, Image, Variant, View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
trim = TrimTree(Tree=dsn_2.Pieces, Depth=1)
trim_2 = TrimTree(Tree=dsn.Connections, Depth=1)
trim_3 = TrimTree(Tree=dsn.Pieces, Depth=1)
roo = SelectRoot(pc=trim_3)  # -> ro_2, i_2
null = NullItem(Item=roo.i_2)  # -> NullFlags, InvalidFlags, Description
filter = StreamFilter(Gate=null.NullFlags, Stream0=roo.i_2, Stream1="0")
cull_i = CullIndex(List=trim, Indices=filter, Wrap=True)
pce = ModelPiece(Piece=cull_i)  # -> Piece, Valid, Id, Description, TypeName, TypeVariant, Plane, Center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
panel = Panel("semio.parent")
qal = ModelQuality(Quality=pce.Qualities)  # -> Quality, Valid, Name, Value, Unit, Definition
trim_4 = TrimTree(Tree=qal.Value, Depth=1)
pce_2 = SelectPiece(pc=trim, id=trim_4)  # -> pc_4, i_2
con = SelectConnection(co=trim_2, cdpc=trim_4, cgpc=pce.Id)  # -> co_4, i_2, fl_2
co = Connection(con.co_4)
parent = Piece(pce_2.pc_4)
child = Piece(cull_i)
con_2 = ModelConnection(Connection=co)  # -> Connection, Valid, ConnectedPieceId, ConnectedPieceTypePortId, ConnectingPieceId, ConnectingPieceTypePortId, Description, Gap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
pce_3 = ModelPiece(Piece=parent)  # -> Piece, Valid, Id, Description, TypeName, TypeVariant, Plane, Center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
pce_4 = ModelPiece(Piece=child)  # -> Piece, Valid, Id, Description, TypeName, TypeVariant, Plane, Center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
typ = SelectTypeByPiece(ty=ty_2, pc=pce_3.Piece)  # -> ty_4, i_2
typ_2 = SelectTypeByPiece(ty=ty_2, pc=pce_4.Piece)  # -> ty_4, i_2
merge = Merge(Data1=graft(con_2.ConnectedPieceTypePortId), Data2=graft(con_2.ConnectingPieceTypePortId))
merge_2 = Merge(Data1=graft(con_2.ConnectingPieceTypePortId), Data2=graft(con_2.ConnectedPieceTypePortId))
typ_3 = ModelType(Type=typ.ty_4)  # -> Type, Valid, Name, Description, Icon, Image, Variant, Stock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
typ_4 = ModelType(Type=typ_2.ty_4)  # -> Type, Valid, Name, Description, Icon, Image, Variant, Stock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
item = ListItem(List=merge, Index=graft(con.fl_2), Wrap=True)
item_2 = ListItem(List=merge_2, Index=graft(con.fl_2), Wrap=True)
por = SelectPort(po=typ_3.Ports, id=item)  # -> po_4, i_2
por_2 = SelectPort(po=typ_4.Ports, id=item_2)  # -> po_4, i_2
deplane = DeconstructPlane(Plane=pce_4.Plane)  # -> Origin, XAxis, YAxis, ZAxis
orient = Orient(Source=PlaneXY(0, 0, 0), Target=pce_4.Plane)  # -> Geometry, Transform
orient_2 = Orient(Source=PlaneXY(0, 0, 0), Target=pce_3.Plane)  # -> Geometry, Transform
trim_5 = TrimTree(Tree=por.po_4, Depth=1)
trim_6 = TrimTree(Tree=por_2.po_4, Depth=1)
Y = UnitY(Factor=1)
c_script = CSharpScript(X=orient.Transform)  # -> T, R, I; inputs X: Transform
# ---------- c_script: C# ----------
// Grasshopper Script Instance
#region Usings
using System;
using System.Linq;
using System.Collections;
using System.Collections.Generic;
using System.Drawing;

using Rhino;
using Rhino.Geometry;

using Grasshopper;
using Grasshopper.Kernel;
using Grasshopper.Kernel.Data;
using Grasshopper.Kernel.Types;
#endregion

public class Script_Instance : GH_ScriptInstance
{
    #region Notes
    /* 
      Members:
        RhinoDoc RhinoDocument
        GH_Document GrasshopperDocument
        IGH_Component Component
        int Iteration

      Methods (Virtual & overridable):
        Print(string text)
        Print(string format, params object[] args)
        Reflect(object obj)
        Reflect(object obj, string method_name)
    */
    #endregion

    private void RunScript(Transform X, ref object T, ref object R, ref object I)
    {
        var i = new Transform();
        T = X.TryGetInverse(out i);
        var translation = new Vector3d();
        var rotation = new Transform();
        var orthogonal = new Transform();
        var diagonal = new Vector3d();
        X.DecomposeAffine(out translation, out rotation, out orthogonal,out diagonal);
        T = translation;
        R = rotation;
        I = i;
    }
}
# ---------- end c_script ----------
c_script_2 = CSharpScript(X=orient_2.Transform)  # -> T, R, I; inputs X: Transform; same code as c_script
Z = UnitZ(Factor=1)
rotate = RotateDirection(Center=Point(0, 0, 0), From=Y, To=deplane.YAxis)  # -> Geometry, Transform
parent_po = Port(trim_5)
child_po = Port(trim_6)
por_3 = ModelPort(Port=parent_po)  # -> Port, Valid, Id, Description, Mandatory, Family, CompatibleFamilies, Point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
por_4 = ModelPort(Port=child_po)  # -> Port, Valid, Id, Description, Mandatory, Family, CompatibleFamilies, Point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
deplane_2 = DeconstructPlane(Plane=pce_3.Plane)  # -> Origin, XAxis, YAxis, ZAxis
transform = Transform(Geometry=por_3.Direction, Transform=c_script_2.R)
transform_2 = Transform(Geometry=por_3.Point, Transform=orient_2.Transform)
transform_3 = Transform(Geometry=por_4.Point, Transform=orient.Transform)
transform_4 = Transform(Geometry=por_4.Direction, Transform=c_script.R)
Y_2 = UnitY(Factor=1)
por_5 = ModelPort(Port=por_3.Port, Point=transform_2, Direction=transform)  # -> Port, Valid, Id, Description, Mandatory, Family, CompatibleFamilies, Point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
por_6 = ModelPort(Port=por_4.Port, Point=transform_3, Direction=transform_4)  # -> Port, Valid, Id, Description, Mandatory, Family, CompatibleFamilies, Point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
transform_5 = Transform(Geometry=Z, Transform=c_script_2.R)
transform_6 = Transform(Geometry=Y_2, Transform=c_script_2.R)
expression = Expression(x=transform_6, Expression="x")
prv = PreviewPort(po=por_5.Port, sc=sc_2)
prv_2 = PreviewPort(po=por_6.Port, sc=sc_2)
ln = Line(EndPoint=por_6.Point)
merge_3 = Merge(Data1=graft(transform_5), Data2=graft(expression))
expression_2 = Expression(x=transform, Expression="x=y")
preview = CustomPreview(Geometry=ln, Material=ColourSwatch(SwatchColor=RGB(250, 149, 0)))
pl = ConstructPlane(Origin=Point(0, 0, 0), XAxis=Z, YAxis=Vector(0, 1, 0))
item_3 = ListItem(List=merge_3, Index=graft(expression_2), Wrap=True)
log = Logarithm(Value=sc_2)
expression_3 = Expression(x=con_2.Raise, Expression="x≠0")
expression_4 = Expression(x=con_2.Shift, Expression="x≠0")
expression_5 = Expression(x=con_2.Gap, Expression="x≠0")
deplane_3 = DeconstructPlane(Plane=pl)  # -> Origin, XAxis, YAxis, ZAxis
rev = Reverse(Vector=deplane_3.ZAxis)
pl_2 = ConstructPlane(Origin=por_6.Point, XAxis=rev, YAxis=deplane_3.XAxis)
rev_2 = Reverse(Vector=deplane_3.ZAxis)
expression_6 = Expression(x=sc_2, Expression="x/2")
prot = RotatePlane(Plane=pl_2, Angle=degrees(con_2.Rotation))
deplane_4 = DeconstructPlane(Plane=prot)  # -> Origin, XAxis, YAxis, ZAxis
rev_3 = Reverse(Vector=deplane_4.ZAxis)
pl_3 = ConstructPlane(Origin=deplane_4.Origin, XAxis=deplane_4.XAxis, YAxis=rev_3)
prot_2 = RotatePlane(Plane=pl_3, Angle=degrees(con_2.Turn))
deplane_5 = DeconstructPlane(Plane=prot_2)  # -> Origin, XAxis, YAxis, ZAxis
rev_4 = Reverse(Vector=deplane_5.ZAxis)
pl_4 = ConstructPlane(Origin=deplane_5.Origin, XAxis=deplane_5.YAxis, YAxis=deplane_5.ZAxis)
multiplication = Multiplication(A=log, B=Slider(2, range=0..10))
trim_7 = TrimTree(Tree=item_3, Depth=1)
amp = Amplitude(Vector=rev_2, Amplitude=con_2.Shift)
amp_2 = Amplitude(Vector=deplane_3.XAxis, Amplitude=con_2.Raise)
amp_3 = Amplitude(Amplitude=con_2.Gap)
move = Move(Motion=amp_3)  # -> Geometry, Transform
move_2 = Move(Geometry=move.Geometry, Motion=amp)  # -> Geometry, Transform
swatch = ColourSwatch(SwatchColor=RGB(219, 190, 161))
swatch_2 = ColourSwatch(SwatchColor=RGB(0, 0, 0))
swatch_3 = ColourSwatch(SwatchColor=RGB(252, 207, 5))
swatch_4 = ColourSwatch(SwatchColor=RGB(126, 183, 127))
rotate_2 = Rotate(Angle=degrees(con_2.Turn), Plane=PlaneXY(0, 0, 0))  # -> Geometry, Transform
cull = CullPattern(List=move_2.Geometry, CullPattern=expression_3)
cull_2 = CullPattern(CullPattern=expression_5)
cull_3 = CullPattern(List=amp_3, CullPattern=expression_5)
cull_4 = CullPattern(List=amp, CullPattern=expression_4)
cull_5 = CullPattern(List=amp_2, CullPattern=expression_3)
cull_6 = CullPattern(List=move.Geometry, CullPattern=expression_4)
cir = Circle(Plane=pl_2, Radius=expression_6)
remap = RemapNumbers(Value=con_2.Rotation, Source="360", Target=Domain(0, 1))  # -> Mapped, Clipped
cir_2 = Circle(Plane=pl_3, Radius=expression_6)
cir_3 = Circle(Plane=pl_4, Radius=expression_6)
remap_2 = RemapNumbers(Value=con_2.Turn, Source="360", Target=Domain(0, 1))  # -> Mapped, Clipped
remap_3 = RemapNumbers(Value=con_2.Tilt, Source="360", Target=Domain(0, 1))  # -> Mapped, Clipped
vdisex = VectorDisplayEx(Point=cull_2, Vector=cull_3, Colour=swatch_3, Width=multiplication)
vdisex_2 = VectorDisplayEx(Point=cull_6, Vector=cull_4, Colour=swatch_4, Width=multiplication)
vdisex_3 = VectorDisplayEx(Point=cull, Vector=cull_5, Colour=swatch, Width=multiplication)
expression_7 = Expression(x=con_2.Rotation, Expression="x≠0")
eval = EvaluateCurve(Curve=reparameterize(cir), Parameter="0")  # -> Point, Tangent, Angle
eval_2 = EvaluateCurve(Curve=reparameterize(cir), Parameter=remap.Mapped)  # -> Point, Tangent, Angle
expression_8 = Expression(x=con_2.Turn, Expression="x≠0")
expression_9 = Expression(x=con_2.Tilt, Expression="x≠0")
eval_3 = EvaluateCurve(Curve=reparameterize(cir_2), Parameter="0")  # -> Point, Tangent, Angle
eval_4 = EvaluateCurve(Curve=reparameterize(cir_3), Parameter="0")  # -> Point, Tangent, Angle
eval_5 = EvaluateCurve(Curve=reparameterize(cir_2), Parameter=remap_2.Mapped)  # -> Point, Tangent, Angle
eval_6 = EvaluateCurve(Curve=reparameterize(cir_3), Parameter=remap_3.Mapped)  # -> Point, Tangent, Angle
expression_10 = Expression(x=amp_3, Expression="x/2")
expression_11 = Expression(x=amp, Expression="x/2")
expression_12 = Expression(x=amp_2, Expression="x/2")
cull_7 = CullPattern(List=cir, CullPattern=expression_7)
cull_8 = CullPattern(List=eval.Point, CullPattern=expression_7)
cull_9 = CullPattern(List=eval_2.Point, CullPattern=expression_7)
cull_10 = CullPattern(List=cir_2, CullPattern=expression_8)
cull_11 = CullPattern(List=cir_3, CullPattern=expression_9)
cull_12 = CullPattern(List=eval_3.Point, CullPattern=expression_8)
cull_13 = CullPattern(List=eval_4.Point, CullPattern=expression_9)
cull_14 = CullPattern(List=eval_5.Point, CullPattern=expression_8)
cull_15 = CullPattern(List=eval_6.Point, CullPattern=expression_9)
move_3 = Move(Motion=expression_10)  # -> Geometry, Transform
move_4 = Move(Geometry=move.Geometry, Motion=expression_11)  # -> Geometry, Transform
move_5 = Move(Geometry=move_2.Geometry, Motion=expression_12)  # -> Geometry, Transform
concat = Concatenate(FragmentA=con_2.Gap, FragmentC=" ", FragmentB=dsn.Unit)
concat_2 = Concatenate(FragmentA=con_2.Gap, FragmentC=" ", FragmentB=dsn.Unit)
concat_3 = Concatenate(FragmentA=con_2.Raise, FragmentC=" ", FragmentB=dsn.Unit)
circledim = CircularDimension(Circle=cull_7, PointA=cull_8, PointB=cull_9, Text="{0:0}°", Size=sc_2)
circledim_2 = CircularDimension(Circle=cull_10, PointA=cull_12, PointB=cull_14, Text="{0:0}°", Size=sc_2)
circledim_3 = CircularDimension(Circle=cull_11, PointA=cull_13, PointB=cull_15, Text="{0:0}°", Size=sc_2)
cull_16 = CullPattern(List=move_3.Geometry, CullPattern=expression_5)
cull_17 = CullPattern(List=concat, CullPattern=expression_5)
cull_18 = CullPattern(List=move_4.Geometry, CullPattern=expression_5)
cull_19 = CullPattern(List=concat_2, CullPattern=expression_5)
cull_20 = CullPattern(List=move_5.Geometry, CullPattern=expression_3)
cull_21 = CullPattern(List=concat_3, CullPattern=expression_3)
tag = TextTag(Location=cull_16, Text=cull_17, Colour=swatch_3)
tag_2 = TextTag(Location=cull_18, Text=cull_19, Colour=swatch_4)
tag_3 = TextTag(Location=cull_20, Text=cull_21, Colour=swatch)

# ==== cluster SelectRepresentation: Select exactly one representation based on tags. The tag matching is based on the highest Jaccard index (|∩|/|∪|).
rp = ClusterInput()
tags = ClusterInput()
rp_2 = Representation(rp)
tags_2 = Tags(tags)
rep = ModelRepresentation(Representation=rp_2)  # -> Representation, Valid, Url, Description, Tags, Qualities
jac = JaccardIndex(set1=tags_2, set2=rep.Tags)
trim = TrimTree(Tree=jac, Depth=1)
minmax = MinimumMaximum(L=trim)  # -> Max, MaxI, Min, MinI; inputs L: list
# ---------- minmax: Python ----------
#Component Information
#--------------------------------------------------------------------------------------------
if ghenv.Component.RunCount<2:
    #General
    #--------------------------------------------------------------------------------------------
    __author__ = "Ueli Saluz"
    __version__ = "2022.04.22"
    
    ghenv.Component.Name = "MinimumMaximum"
    ghenv.Component.NickName = "MinMax"
    ghenv.Component.Description = "Returns the maximum and mininum of a list and their corresponding index."
    ghenv.Component.Message = "VER 1.0"
    ghenv.Component.Category = "Maths"
    ghenv.Component.SubCategory = "Util"
    
     #Inputs
    #--------------------------------------------------------------------------------------------
    inputIndex=0
    
    ghenv.Component.Params.Input[inputIndex].Name = "L"
    ghenv.Component.Params.Input[inputIndex].NickName = "L"
    ghenv.Component.Params.Input[inputIndex].Description = "A list of numbers."
    ghenv.Component.Params.Input[inputIndex].Optional = False
    inputIndex+=1
    
    
    #Outputs
    #--------------------------------------------------------------------------------------------
    outputIndex=0
    
    ghenv.Component.Params.Output[outputIndex].Name = "Max"
    ghenv.Component.Params.Output[outputIndex].NickName = "Max"
    ghenv.Component.Params.Output[outputIndex].Description = "Maximum of the list"
    outputIndex+=1
    
    ghenv.Component.Params.Output[outputIndex].Name = "MaxI"
    ghenv.Component.Params.Output[outputIndex].NickName = "MaxI"
    ghenv.Component.Params.Output[outputIndex].Description = "Index of the maximum of the list"
    outputIndex+=1
    
    ghenv.Component.Params.Output[outputIndex].Name = "Min"
    ghenv.Component.Params.Output[outputIndex].NickName = "Min"
    ghenv.Component.Params.Output[outputIndex].Description = "Minimum of the list"
    outputIndex+=1
    
    ghenv.Component.Params.Output[outputIndex].Name = "MinI"
    ghenv.Component.Params.Output[outputIndex].NickName = "MinI"
    ghenv.Component.Params.Output[outputIndex].Description = "Index of the minimum of the list"
    outputIndex+=1


#Solver - Run with trees to enhance performance drastically
#--------------------------------------------------------------------------------------------
if __name__ == "__main__":
    
    maximum = max(L)
    MaxI = L.index(maximum)
    Max = maximum
    
    minimum = min(L)
    MinI = L.index(minimum)
    Min = minimum
# ---------- end minmax ----------
txt = Text(rp_2)
item = ListItem(List=rep.Representation, Index=minmax.MaxI, Wrap=True)
txt_2 = Text(item)
itemindex = ItemIndex(L=txt, I=txt_2)  # -> i; inputs L: list
# ---------- itemindex: Python ----------
#Component Information
#--------------------------------------------------------------------------------------------
if ghenv.Component.RunCount<2:
    #General
    #--------------------------------------------------------------------------------------------
    __author__ = "Ueli Saluz"
    __version__ = "2022.11.18"
    
    ghenv.Component.Name = "ItemIndex"
    ghenv.Component.NickName = "ItemIndex"
    ghenv.Component.Description = "A better IdemIndex"
    ghenv.Component.Message = "VER 1.0"
    ghenv.Component.Category = "Set"
    ghenv.Component.SubCategory = "List"
    
     #Inputs
    #--------------------------------------------------------------------------------------------
    inputIndex=0
    
    ghenv.Component.Params.Input[inputIndex].Name = "List"
    ghenv.Component.Params.Input[inputIndex].NickName = "L"
    ghenv.Component.Params.Input[inputIndex].Description = "Input1 is..."
    ghenv.Component.Params.Input[inputIndex].Optional = False
    inputIndex+=1
    
    ghenv.Component.Params.Input[inputIndex].Name = "Item"
    ghenv.Component.Params.Input[inputIndex].NickName = "I"
    ghenv.Component.Params.Input[inputIndex].Description = "Input2 is..."
    ghenv.Component.Params.Input[inputIndex].Optional = False
    inputIndex+=1
    
    #Outputs
    #--------------------------------------------------------------------------------------------
    outputIndex=0
    
    ghenv.Component.Params.Output[outputIndex].Name = "Index"
    ghenv.Component.Params.Output[outputIndex].NickName = "i"
    ghenv.Component.Params.Output[outputIndex].Description = "Output1 is..."
    outputIndex+=1

i = L.index(I)
# ---------- end itemindex ----------
trim_2 = TrimTree(Tree=itemindex, Depth=1)
trim_3 = TrimTree(Tree=item, Depth=1)
i = Integer(trim_2)
rp_3 = Representation(trim_3)
i_2 = ClusterOutput(i)
rp_4 = ClusterOutput(rp_3)

# ==== cluster PreviewGeometry: Preview geometry by ungrouping everything, showing light surfaces and dark edges.
sc = ClusterInput()
geo = ClusterInput()
geo_2 = Geometry(flatten(geo))
sc_2 = Number(sc)
expression = Expression(x=sc_2, Expression="x+1")
swatch = ColourSwatch(SwatchColor=RGB(0, 0, 0))
swatch_2 = ColourSwatch(SwatchColor=RGB(255, 255, 255))
ungroup = Ungroup(Group=geo_2)
ungroup_2 = Ungroup(Group=ungroup)
ungroup_3 = Ungroup(Group=ungroup_2)
ungroup_4 = Ungroup(Group=ungroup_3)
log = Logarithm(Value=expression)
clean = CleanTree(RemoveNulls=True, RemoveInvalid=True, RemoveEmpty=invert(False), Tree=ungroup_4)  # -> flatten(Tree)
multiplication = Multiplication(A=log, B=Slider(0.05, range=0..1))
linetype = ModelLinetype(Name="semio", Width=multiplication)  # -> ModelLinetype, Name, Segments, CapStyle, JoinStyle, Width, WidthUnits, TaperWidths, TaperPositions
dispatch = CSharpScript(D=clean)  # -> P, C, B, M, R
# ---------- dispatch: C# ----------
// Grasshopper Script Instance
#region Usings
using System;
using System.Linq;
using System.Collections;
using System.Collections.Generic;
using System.Drawing;

using Rhino;
using Rhino.Geometry;

using Grasshopper;
using Grasshopper.Kernel;
using Grasshopper.Kernel.Data;
using Grasshopper.Kernel.Types;
#endregion

public class Script_Instance : GH_ScriptInstance
{
    #region Notes
    /* 
      Members:
        RhinoDoc RhinoDocument
        GH_Document GrasshopperDocument
        IGH_Component Component
        int Iteration

      Methods (Virtual & overridable):
        Print(string text)
        Print(string format, params object[] args)
        Reflect(object obj)
        Reflect(object obj, string method_name)
    */
    #endregion

    private void RunScript(
	object D,
	ref object P,
	ref object C,
	ref object B,
	ref object M,
	ref object R)
    {
        if (D is Curve) C = D; // Curve
        else if (
            D is Rhino.Geometry.Point ||
            D is PointCloud
            )
            P = D; // Point
        else if ( D is Mesh) M = D; // Mesh
        else if (
            D is Surface ||
            D is Extrusion ||
            D is SubD ||
            D is Brep
            )
            B = D; // Brep
        else R = D; // Rest
            
    }
}
# ---------- end dispatch ----------
clean_2 = CleanTree(RemoveNulls=True, RemoveInvalid=True, RemoveEmpty=False, Tree=dispatch.M)
clean_3 = CleanTree(RemoveNulls=True, RemoveInvalid=True, RemoveEmpty=False, Tree=dispatch.R)
clean_4 = CleanTree(RemoveNulls=True, RemoveInvalid=True, RemoveEmpty=False, Tree=dispatch.B)
clean_5 = CleanTree(RemoveNulls=True, RemoveInvalid=True, RemoveEmpty=False, Tree=dispatch.P)
clean_6 = CleanTree(RemoveNulls=True, RemoveInvalid=True, RemoveEmpty=False, Tree=dispatch.C)
debrep = DeconstructBrep(Brep=clean_4)  # -> Faces, Edges, Vertices
preview = CustomPreview(Geometry=flatten(clean_5), Material=swatch)
preview_2 = CustomPreview(Geometry=flatten(debrep.Faces), Material=swatch_2)
preview_3 = CustomPreview(Geometry=flatten(clean_2), Material=swatch_2)
preview_4 = CustomPreview(Geometry=flatten(clean_3), Material=swatch)
curve_preview = CustomCurvePreview(Curve=clean_6, Linetype=linetype.ModelLinetype, Colour=swatch)
curve_preview_2 = CustomCurvePreview(Curve=debrep.Edges, Linetype=linetype.ModelLinetype, Colour=swatch)

# ==== cluster LinearConnections: Create an array of linear connections (for n pieces this creates n-1 connections) where every piece is connected with the next piece. The spacing units are connections.
pc = ClusterInput()
co = ClusterInput()
co_2 = Connection(co)
pc_2 = Piece(pc)
shift = ShiftList(List=pc_2, Shift=1, Wrap=invert(True))
shift_2 = ShiftList(List=pc_2, Shift="-1", Wrap=invert(True))
trim = TrimTree(Tree=shift, Depth=1)
trim_2 = TrimTree(Tree=shift_2, Depth=1)
pce = ModelPiece(Piece=trim_2)  # -> Piece, Valid, Id, Description, TypeName, TypeVariant, Plane, Center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
pce_2 = ModelPiece(Piece=trim)  # -> Piece, Valid, Id, Description, TypeName, TypeVariant, Plane, Center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
con = ModelConnection(Connection=co_2, ConnectedPieceId=pce.Id, ConnectingPieceId=pce_2.Id)  # -> Connection, Valid, ConnectedPieceId, ConnectedPieceTypePortId, ConnectingPieceId, ConnectingPieceTypePortId, Description, Gap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
co_3 = Connection(con.Connection)
co_4 = ClusterOutput(co_3)

# ==== cluster RemovePieces: Remove all pieces (and all associated connections) from a design.
dn = ClusterInput()
ids = ClusterInput()
ids_2 = Text(ids)
dn_2 = Design(dn)
dsn = ModelDesign(Design=dn_2)  # -> Design, Valid, Name, Description, Icon, Image, Variant, View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

trim = TrimTree(Tree=dsn.Connections, Depth=1)
con = ModelConnection(Connection=trim)  # -> Connection, Valid, ConnectedPieceId, ConnectedPieceTypePortId, ConnectingPieceId, ConnectingPieceTypePortId, Description, Gap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
expression = Expression(x=graft(con.ConnectingPieceId), y=ids_2, Expression="x=y")
expression_2 = Expression(x=graft(con.ConnectedPieceId), y=ids_2, Expression="x=y")
ma = MassAddition(Input=expression)  # -> Result, PartialResults
ma_2 = MassAddition(Input=expression_2)  # -> Result, PartialResults
or = GateOr(A=ma_2.Result, B=ma.Result)
trim_2 = TrimTree(Tree=or, Depth=1)
dispatch = Dispatch(List=trim, DispatchPattern=trim_2)  # -> ListA, ListB

trim_3 = TrimTree(Tree=dsn.Pieces, Depth=1)
pce = ModelPiece(Piece=trim_3)  # -> Piece, Valid, Id, Description, TypeName, TypeVariant, Plane, Center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
expression_3 = Expression(x=graft(pce.Id), y=ids_2, Expression="x=y")
ma_3 = MassAddition(Input=expression_3)  # -> Result, PartialResults
trim_4 = TrimTree(Tree=ma_3.Result, Depth=1)
dispatch_2 = Dispatch(List=trim_3, DispatchPattern=trim_4)  # -> ListA, ListB

dsn_2 = ModelDesign(Design=dsn.Design, Pieces=dispatch_2.ListB, Connections=dispatch.ListB)  # -> Design, Valid, Name, Description, Icon, Image, Variant, View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
dn_3 = Design(dsn_2.Design)
pc = Piece(dispatch_2.ListA)
co = Connection(dispatch.ListA)
dn_4 = ClusterOutput(dn_3)
pc_2 = ClusterOutput(pc)
co_2 = ClusterOutput(co)

# ==== cluster SumQualities: Sum up the qualities of a type for each piece with this type in a design.
dn = ClusterInput()
ty = ClusterInput()
na = ClusterInput()
dn_2 = Design(dn)
ty_2 = Type(ty)
na_2 = Name(na)
dsn = ModelDesign(Design=dn_2)  # -> Design, Valid, Name, Description, Icon, Image, Variant, View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
typ = ModelType(Type=ty_2)  # -> Type, Valid, Name, Description, Icon, Image, Variant, Stock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
qal = ModelQuality(Quality=typ.Qualities)  # -> Quality, Valid, Name, Value, Unit, Definition
trim = TrimTree(Tree=dsn.Pieces, Depth=1)
pce = ModelPiece(Piece=trim)  # -> Piece, Valid, Id, Description, TypeName, TypeVariant, Plane, Center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
expression = Expression(x=graft(pce.TypeName), y=typ.Name, Expression="x=y")
expression_2 = Expression(x=graft(pce.TypeVariant), y=typ.Variant, Expression="x=y")
expression_3 = Expression(x=na_2, y=qal.Name, Expression="x=y")
and = GateAnd(A=expression, B=expression_2)
cull = CullPattern(List=typ.Qualities, CullPattern=expression_3)
cull_2 = CullPattern(List=ty_2, CullPattern=and)
qal_2 = ModelQuality(Quality=cull)  # -> Quality, Valid, Name, flatten(Value), Unit, Definition
lng = ListLength(List=ty_2)
txt = Text(cull_2)
txt_2 = Text(ty_2)
series = Series(Start=0, Step=1, Count=lng)
expression_4 = Expression(x=txt, y=txt_2, Expression="x=y")
trim_2 = TrimTree(Tree=series, Depth=1)
cull_3 = CullPattern(List=trim_2, CullPattern=expression_4)
trim_3 = TrimTree(Tree=cull_3, Depth=1)
item = ListItem(List=qal_2.Value, Index=trim_3, Wrap=True)
clean = CleanTree(RemoveNulls=True, RemoveInvalid=True, RemoveEmpty=False, Tree=item)
ma = MassAddition(Input=clean)  # -> Result, PartialResults
num = Number(ma.Result)
ql = Quality(qal_2.Quality)
num_2 = ClusterOutput(num)
ql_2 = ClusterOutput(ql)

# ==== cluster SelectRoot: Select a root piece. A piece is a root when it has a plane (and a center).
pc = ClusterInput()
pc_2 = Piece(pc)
lng = ListLength(List=pc_2)
pce = ModelPiece(Piece=pc_2)  # -> Piece, Valid, Id, Description, TypeName, TypeVariant, Plane, Center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
series = Series(Start=0, Step=1, Count=lng)
trim = TrimTree(Tree=series, Depth=1)
null = NullItem(Item=pce.Plane)  # -> NullFlags, InvalidFlags, Description
dispatch = Dispatch(List=pc_2, DispatchPattern=null.NullFlags)  # -> ListA, ListB
dispatch_2 = Dispatch(List=trim, DispatchPattern=null.NullFlags)  # -> ListA, ListB
ro = Piece(dispatch.ListB)
i = Integer(dispatch_2.ListB)
ro_2 = ClusterOutput(ro)
i_2 = ClusterOutput(i)

# ==== cluster SelectPort: Select a port with the id. If no port matches, null is returned.
po = ClusterInput()
id = ClusterInput()
id_2 = Id(graft(id))
po_2 = Port(po)
lng = ListLength(List=po_2)
por = ModelPort(Port=po_2)  # -> Port, Valid, Id, Description, Mandatory, Family, CompatibleFamilies, Point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
series = Series(Start=0, Step=1, Count=lng)
expression = Expression(x=por.Id, y=id_2, Expression="x=y")
trim = TrimTree(Tree=series, Depth=1)
cull = CullPattern(List=po_2, CullPattern=expression)
cull_2 = CullPattern(List=trim, CullPattern=expression)
nulltobranch = AddNullToEmptyBranch(D=cull_2)  # -> R; inputs D: tree
# ---------- nulltobranch: C# ----------
#region Usings
using System;
using System.Linq;
using System.Collections;
using System.Collections.Generic;
using System.Drawing;

using Rhino;
using Rhino.Geometry;

using Grasshopper;
using Grasshopper.Kernel;
using Grasshopper.Kernel.Data;
using Grasshopper.Kernel.Types;
#endregion

public class Script_Instance : GH_ScriptInstance
{

    private void RunScript(DataTree<object> D, ref object R)
    {
        foreach (GH_Path path in D.Paths)
            if (D.Branch(path).Count == 0)
                D.Add(null, path);

        R = D;
    }
}
# ---------- end nulltobranch ----------
nulltobranch_2 = AddNullToEmptyBranch(D=cull)  # -> R; inputs D: tree; same code as nulltobranch
trim_2 = TrimTree(Tree=nulltobranch, Depth=1)
trim_3 = TrimTree(Tree=nulltobranch_2, Depth=1)
i = Integer(trim_2)
po_3 = Port(trim_3)
i_2 = ClusterOutput(i)
po_4 = ClusterOutput(po_3)

# ==== cluster SelectConnection: Select a connection with the connected id and the connecting id. The connections are symetric, so if the conected is the connecting and vice versa it will still selct them.
co = ClusterInput()
cdpc = ClusterInput()
cgpc = ClusterInput()
cdpc_2 = ConnectedPieceId(graft(cdpc))
cgpc_2 = ConnectingPieceId(graft(cgpc))
co_2 = Connection(co)
con = ModelConnection(Connection=co_2)  # -> Connection, Valid, ConnectedPieceId, ConnectedPieceTypePortId, ConnectingPieceId, ConnectingPieceTypePortId, Description, Gap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
expression = Expression(x=con.ConnectedPieceId, y=cdpc_2, Expression="x=y")
expression_2 = Expression(x=con.ConnectedPieceId, y=cgpc_2, Expression="x=y")
expression_3 = Expression(x=con.ConnectingPieceId, y=cgpc_2, Expression="x=y")
expression_4 = Expression(x=con.ConnectingPieceId, y=cdpc_2, Expression="x=y")
lng = ListLength(List=co_2)
series = Series(Start=0, Step=1, Count=lng)
and = GateAnd(A=expression, B=expression_3)
and_2 = GateAnd(A=expression_2, B=expression_4)
trim = TrimTree(Tree=series, Depth=1)
or = GateOr(A=and, B=and_2)
not = GateNot(A=and)
cull = CullPattern(List=con.Connection, CullPattern=or)
and_3 = GateAnd(A=not, B=and_2)
cull_2 = CullPattern(List=trim, CullPattern=or)
nulltobranch = AddNullToEmptyBranch(D=cull)  # -> R; inputs D: tree; same code as nulltobranch
nulltobranch_2 = AddNullToEmptyBranch(D=cull_2)  # -> R; inputs D: tree; same code as nulltobranch
ma = MassAddition(Input=and_3)  # -> Result, PartialResults
trim_2 = TrimTree(Tree=nulltobranch, Depth=1)
trim_3 = TrimTree(Tree=nulltobranch_2, Depth=1)
trim_4 = TrimTree(Tree=ma.Result, Depth=1)
co_3 = Connection(trim_2)
fl = Boolean(trim_4)
i = Integer(trim_3)
co_4 = ClusterOutput(co_3)
fl_2 = ClusterOutput(fl)
i_2 = ClusterOutput(i)

# ==== cluster PreviewPort: Preview a port by showing the point and direction and if exists: id, family and compatible families.
po = ClusterInput()
sc = ClusterInput()
sc_2 = Number(sc)
po_2 = Port(po)
por = ModelPort(Port=po_2)  # -> Port, Valid, Id, Description, Mandatory, Family, CompatibleFamilies, Point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
swatch = ColourSwatch(SwatchColor=RGB(235, 52, 79))
swatch_2 = ColourSwatch(SwatchColor=RGB(250, 149, 0))
amp = Amplitude(Vector=por.Direction, Amplitude=sc_2)
lng = ListLength(List=por.CompatibleFamilies)
expression = Expression(x=por.Family, Expression="x=\"\"")
cull = CullPattern(List=por.Point, CullPattern=expression)
expression_2 = Expression(x=lng, Expression="x=0")
join = TextJoin(Text=por.CompatibleFamilies, Join=",")
merge = Merge(Data1=":")
trim = TrimTree(Tree=join, Depth=1)
trim_2 = TrimTree(Tree=expression_2, Depth=1)
item = ListItem(List=merge, Index=expression, Wrap=invert(True))
log = Logarithm(Value=sc_2)
concat = Concatenate(FragmentA="[", FragmentB=trim, FragmentC="]")
expression_3 = Expression(y=trim_2, Expression="x")
merge_2 = Merge(Data1=graft(concat), Data2=graft(expression_3))
item_2 = ListItem(List=merge_2, Index=graft(expression), Wrap=invert(True))
multiplication = Multiplication(A=log, B=Slider(2, range=0..10))
trim_3 = TrimTree(Tree=item_2, Depth=1)
concat_2 = Concatenate(FragmentA=por.Id, FragmentB=item, FragmentC=por.Family, FragmentD=trim_3)
preview = CustomPreview(Geometry=cull, Material=swatch)
tag = TextTag(Location=por.Point, Text=concat_2, Colour=swatch)
vdisex = VectorDisplayEx(Point=por.Point, Vector=amp, Colour=ColourSwatch(SwatchColor=RGB(0, 166, 157)), Width=multiplication)

# ==== cluster SelectPiece: Select a piece with the id.
pc = ClusterInput()
id = ClusterInput()
id_2 = Id(graft(id))
pc_2 = Piece(pc)
lng = ListLength(List=pc_2)
pce = ModelPiece(Piece=pc_2)  # -> Piece, Valid, Id, Description, TypeName, TypeVariant, Plane, Center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
series = Series(Start=0, Step=1, Count=lng)
trim = TrimTree(Tree=series, Depth=1)
expression = Expression(x=pce.Id, y=id_2, Expression="x=y")
cull = CullPattern(List=pce.Piece, CullPattern=expression)
cull_2 = CullPattern(List=trim, CullPattern=expression)
trim_2 = TrimTree(Tree=cull_2, Depth=1)
trim_3 = TrimTree(Tree=cull, Depth=1)
pc_3 = Piece(trim_3)
i = Integer(trim_2)
pc_4 = ClusterOutput(pc_3)
i_2 = ClusterOutput(i)

# ==== cluster SelectTypeByPiece: Select the type of a piece.
ty = ClusterInput()
pc = ClusterInput()
pc_2 = Piece(graft(pc))
ty_2 = Type(ty)
pce = ModelPiece(Piece=pc_2)  # -> Piece, Valid, Id, Description, TypeName, TypeVariant, Plane, Center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
typ = SelectType(ty=ty_2, na=pce.TypeName, variant=pce.TypeVariant)  # -> ty_4, i_2
trim = TrimTree(Tree=typ.ty_4, Depth=1)
trim_2 = TrimTree(Tree=typ.i_2, Depth=1)
ty_3 = Type(trim)
i = Integer(trim_2)
ty_4 = ClusterOutput(ty_3)
i_2 = ClusterOutput(i)

# ==== cluster JaccardIndex: Compute the Jaccard Index of two sets.
set1 = ClusterInput()
set2 = ClusterInput()
set1_2 = Data(set1)
set2_2 = Data(set2)
cset = CreateSet(List=set2_2)  # -> Set, Map
cset_2 = CreateSet(List=set1_2)  # -> Set, Map
lng = ListLength(List=set1_2)
lng_2 = ListLength(List=set2_2)
intersection = SetIntersection(SetA=cset_2.Set, SetB=cset.Set)
expression = Expression(x=lng, Expression="x=0")
expression_2 = Expression(x=lng_2, Expression="x=0")
sunion = SetUnion(SetA=cset_2.Set, SetB=cset.Set)
null = NullItem(Item=lng)  # -> NullFlags, InvalidFlags, Description
null_2 = NullItem(Item=lng_2)  # -> NullFlags, InvalidFlags, Description
lng_3 = ListLength(List=sunion)
lng_4 = ListLength(List=intersection)
or = GateOr(A=null.NullFlags, B=expression)
or_2 = GateOr(A=null_2.NullFlags, B=expression_2)
division = Division(A=lng_4, B=lng_3)
int = Integer(or)
int_2 = Integer(or_2)
concat = Concatenate(FragmentA=int, FragmentB=int_2)
b2d = BinaryToDecimal(Binary=concat)  # -> Decimal
# ---------- b2d: Python ----------
if ghenv.Component.RunCount<2:
    __author__ = "Ueli Saluz"
    __version__ = "2021.11.14"
    
    ghenv.Component.Name = "BinaryToDecimal"
    ghenv.Component.NickName = "B2D"
    ghenv.Component.Description = "Converts a number in binary representation to a number in decimal representation."
    ghenv.Component.Message = "VER 1.0"
    
    ghenv.Component.Params.Input[0].NickName = "Binary"
    
    ghenv.Component.Params.Input[0].Description = "Binary representation of a number."
    
    ghenv.Component.Params.Output[0].NickName = "Decimal"
    
    ghenv.Component.Params.Output[0].Description = "Converted decimal representation of the same number."

if __name__ == "__main__":
    Decimal = int(Binary,2)
# ---------- end b2d ----------
expression_3 = Expression(c=b2d, x=division, Expression="If(c=0,x,If(c=3,1,0))")
N = Number(expression_3)
N_2 = ClusterOutput(N)

# ==== cluster SelectType: Select a type with a name and an optional variant. If no variant is provided it will select all variants. If you want to select the default type then use the empty text.
ty = ClusterInput()
na = ClusterInput()
variant = ClusterInput()
na_2 = Name(na)
variant_2 = Variant(variant)
ty_2 = Type(ty)
typ = ModelType(Type=ty_2)  # -> Type, Valid, Name, Description, Icon, Image, Variant, Stock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
expression = Expression(x=typ.Name, y=na_2, Expression="x=y")
cull = CullPattern(List=typ.Type, CullPattern=expression)
typ_2 = ModelType(Type=cull)  # -> Type, Valid, Name, Description, Icon, Image, Variant, Stock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
expression_2 = Expression(x=typ_2.Variant, y=variant_2, Expression="x=y")
txt = Text(ty_2)
cull_2 = CullPattern(List=typ_2.Type, CullPattern=expression_2)
null = NullItem(Item=variant_2)  # -> NullFlags, InvalidFlags, Description
filter = StreamFilter(Gate=null.NullFlags, Stream0=cull_2, Stream1=cull)
txt_2 = Text(filter)
mindex = MemberIndex(Set=txt, Member=txt_2)  # -> Index, Count
trim = TrimTree(Tree=mindex.Index, Depth=1)
ty_3 = Type(filter)
i = Integer(trim)
ty_4 = ClusterOutput(ty_3)
i_2 = ClusterOutput(i)
