# Grasshopper definition ladybug.gh (Grasshopper 1.0.8)
# Copyright: GNU Lesser General Public License Version 3
# Copyright: GNU Lesser General Public License v3.0 or later
# plug-ins: RhinoCodePluginGH, semio

load_kit = BooleanToggle(True)
sep = Separator()  # -> S; same code as sep
dir = Directory()  # -> D
# ---------- dir: C# ----------
#region Usings
using System;
using System.Linq;
using System.Collections;
using System.Collections.Generic;
using System.Drawing;
using System.IO;

using Rhino;
using Rhino.Geometry;

using Grasshopper;
using Grasshopper.Kernel;
using Grasshopper.Kernel.Data;
using Grasshopper.Kernel.Types;
#endregion

public class Script_Instance : GH_ScriptInstance
{
    private void RunScript(ref object D)
    {
        D = Path.GetDirectoryName(this.GrasshopperDocument.FilePath);
    }
}
# ---------- end dir ----------
# ^                                    ^
#    |                                     |
# <-- Constants    Preview -->
# Parameters    External    Local -->
# <-- Meta               |
#      |                       v
#      v
par = ParentDirectory(D=dir)  # -> P; inputs D: String
# ---------- par: C# ----------
#region Usings
using System;
using System.Linq;
using System.Collections;
using System.Collections.Generic;
using System.Drawing;
using System.IO;

using Rhino;
using Rhino.Geometry;

using Grasshopper;
using Grasshopper.Kernel;
using Grasshopper.Kernel.Data;
using Grasshopper.Kernel.Types;
#endregion

public class Script_Instance : GH_ScriptInstance
{
    private void RunScript(string D, ref object P)
    {
        P = new DirectoryInfo(D).Parent;
    }
}
# ---------- end par ----------
kit = CacheKit(uri=par, R=load_kit)  # -> kt_2, ty_2, dn_2, rp_2, po_2, ur_2, ob_2, urpa_2, urpalc_2, urpare_2
# Ein Zeichen, du wirst gehört
ty = Type([null x45])
dn = Design([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])
po = Port(Tree({0;0}: ["{\"id_\":\"c0\",\"description\":\"\",\"family\":\"\",\"compatibleFamilies\":[],\"point\":{\"x\":-7.5,\"y\":-7.7,\"z\":7.5},\"direction\":{\"x\":0.0,\"y\":0.0,\"z\":1.0},\"t\":0.0,\"qualities\":[]}", "{\"id_\":\"c1\",\"description\":\"\",\"family\":\"\",\"compatibleFamilies\":[],\"point\":{\"x\":-18.6,\"y\":-7.7,\"z\":7.5},\"direction\":{\"x\":0.0,\"y\":0.0,\"z\":1.0},\"t\":0.0,\"qualities\":[]}"], {0;1}: ["{\"id_\":\"c0\",\"description\":\"\",\"family\":\"\",\"compatibleFamilies\":[],\"point\":{\"x\":-6.75,\"y\":-7.75,\"z\":7.5},\"direction\":{\"x\":0.0,\"y\":0.0,\"z\":1.0},\"t\":0.0,\"qualities\":[]}", "{\"id_\":\"c1\",\"description\":\"\",\"family\":\"\",\"compatibleFamilies\":[],\"point\":{\"x\":-18.85,\"y\":-7.75,\"z\":7.5},\"direction\":{\"x\":0.0,\"y\":0.0,\"z\":1.0},\"t\":0.0,\"qualities\":[]}"], {0;2}: ["{\"id_\":\"e\",\"description\":\"\",\"family\":\"\",\"compatibleFamilies\":[],\"point\":{\"x\":5.6,\"y\":-1.3,\"z\":0.0},\"direction\":{\"x\":1.0,\"y\":0.0,\"z\":0.0},\"t\":0.0,\"qualities\":[]}", "{\"id_\":\"w\",\"description\":\"\",\"family\":\"\",\"compatibleFamilies\":[],\"point\":{\"x\":0.0,\"y\":-1.3,\"z\":0.0},\"direction\":{\"x\":-1.0,\"y\":0.0,\"z\":0.0},\"t\":0.0,\"qualities\":[]}"], {0;3}: ["{\"id_\":\"\",\"description\":\"\",\"family\":\"\",\"compatibleFamilies\":[],\"point\":{\"x\":0.0,\"y\":0.0,\"z\":0.0},\"direction\":{\"x\":0.0,\"y\":0.0,\"z\":-1.0},\"t\":0.0,\"qualities\":[]}"], {0;4}: ["{\"id_\":\"\",\"description\":\"\",\"family\":\"\",\"compatibleFamilies\":[],\"point\":{\"x\":0.0,\"y\":0.0,\"z\":0.0},\"direction\":{\"x\":0.0,\"y\":0.0,\"z\":-1.0},\"t\":0.0,\"qualities\":[]}"], {0;5}: ["{\"id_\":\"\",\"description\":\"\",\"family\":\"\",\"compatibleFamilies\":[],\"point\":{\"x\":0.45,\"y\":-2.1,\"z\":2.7755576E-17},\"direction\":{\"x\":0.0,\"y\":-1.0,\"z\":0.0},\"t\":0.0,\"qualities\":[]}"]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))
ob = Data(Tree({0;0;0}: [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], {0;0;1}: [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], {0;0;2}: [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], {0;0;3}: [], {0;0;4}: [], {0;0;5}: [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]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))
list = ValueList({"Typ(Base)": 0, "Typ(Base,Blob)": 1, "Typ(Bridge)": 2, "Typ(Capital)": 3, "Typ(Cylindric Capital)": 4, "Typ(Capsule,\)": 5, "Typ(Capsule,/)": 6, "Typ(Capsule,q)": 7, "Typ(Capsule,p)": 8, "Typ(Capsule,J)": 9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}, selected="Typ(Capsule,\)")
item = ListItem(List=ty, Index=list, Wrap=True)
typ = ModelType(Type=item)  # -> Type, Valid, Name, Description, Icon, Image, Variant, Unit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
qal = SelectQuality(ql=typ.Qualities, na="ladybug program")
item_2 = ListItem(List=dn, Index=0, Wrap=True)
cluster = Cluster(path=par, ty=ty, ob=ob)
cluster_2 = Cluster_2(dn=item_2, ty=ty, room=cluster)
model = Data(cluster_2)
simcontrol = HBSimulationControl()  # -> sim_control; plug-in component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
shadowcalc = HBShadowCalculation()  # -> shadow_calc; plug-in component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
concat = Concatenate(FragmentA=par, FragmentB=sep, FragmentC="weather", FragmentD=sep, FragmentE="tokyo.ddy")
sizingpar = HBSizingParameter(ddy_file=concat)  # -> sizing; plug-in component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
panel = Panel("2")
concat_2 = Concatenate(FragmentA=par, FragmentB=sep, FragmentC="weather", FragmentD=sep, FragmentE="tokyo.epw")
simpar = HBSimulationParameter(timestep="1", sim_control=simcontrol, sizing=sizingpar)  # -> sim_par; plug-in component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
modeltoosm = HBModelToOSM(model=model, epw_file=concat_2, sim_par=simpar, write=Toggle(False))  # -> report, jsons, osw, osm, idf, sql, zsz, rdd, html; plug-in component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
panel_2 = Panel(concat_2)
panel_3 = Panel(modeltoosm.osm)
vizbytype = HBVisualizeByType(hb_objs=model)  # -> walls, interior_walls, roofs, ceilings, exterior_floors, interior_floors, air_walls, apertures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; plug-in component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

# ==== cluster CacheKit: Cache a kit by downloading the remote kit with all remote representations.
uri = ClusterInput()
R = ClusterInput()
R_2 = Run(R)
uri_2 = Uri(uri)
kit = LoadKit(Uri=uri_2, Run=R_2)  # -> Success, Kit, LocalDirectory
sep = Separator()  # -> S
# ---------- sep: C# ----------
#region Usings
using System;
using System.Linq;
using System.Collections;
using System.Collections.Generic;
using System.Drawing;
using System.IO;

using Rhino;
using Rhino.Geometry;

using Grasshopper;
using Grasshopper.Kernel;
using Grasshopper.Kernel.Data;
using Grasshopper.Kernel.Types;
#endregion

public class Script_Instance : GH_ScriptInstance
{
    private void RunScript(ref object S)
    {
        S = Path.DirectorySeparatorChar;
    }
}
# ---------- end sep ----------
kit_2 = ModelKit(Kit=kit.Kit)  # -> Kit, Valid, Name, Description, Icon, Image, Preview, Version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
trim = TrimTree(Tree=kit_2.Types, Depth=1)
trim_2 = TrimTree(Tree=kit_2.Designs, Depth=1)
typ = ModelType(Type=trim)  # -> Type, Valid, Name, Description, Icon, Image, Variant, Unit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
rep = ModelRepresentation(Representation=typ.Representations)  # -> Representation, Valid, Url, Mime, Tags, Qualities, Qualities_2
tmatch = MatchText(Text=rep.Url, Pattern="http*", Case=True)
dispatch = Dispatch(List=rep.Url, DispatchPattern=tmatch)  # -> ListA, ListB
rep_2 = ReplaceText(Text=dispatch.ListB, Find="/", Replace=sep, RecursiveReplace=False)
rep_3 = CacheRepresentation(Url=dispatch.ListA, Run=R_2)  # -> Path, Success
concat = Concatenate(FragmentA=kit.LocalDirectory, FragmentB=sep, FragmentC=rep_2)
weave = Weave(Pattern=tmatch, Stream0=concat, Stream1=rep_3.Path, NullGaps=False)
import = ImportContent(FilePath=weave, Import=R_2)  # -> ModelTransform, Objects, Layers, Linetypes, HatchPatterns, AnnotationStyles, Materials, BlockDefinitions
ty = Type(trim)
kt = Kit(kit.Kit)
dn = Design()
rp = Representation(typ.Representations)
po = Port(typ.Ports)
ur = Url(rep.Url)
ob = Data(import.Objects)
urpa = Url(weave)
urpalc = Url(concat)
urpare = Url(rep_3.Path)
kt_2 = ClusterOutput(kt)
ty_2 = ClusterOutput(ty)
dn_2 = ClusterOutput(dn)
rp_2 = ClusterOutput(rp)
po_2 = ClusterOutput(po)
ur_2 = ClusterOutput(ur)
ob_2 = ClusterOutput(ob)
urpa_2 = ClusterOutput(urpa)
urpalc_2 = ClusterOutput(urpalc)
urpare_2 = ClusterOutput(urpare)

# ==== cluster SelectQuality: Select a quality by its name.
ql = ClusterInput()
na = ClusterInput()
na_2 = Name(graft(na))
ql_2 = Quality(ql)
panel = Panel(ql_2)
qal = ModelQuality(
    Quality=ql_2,
    Name=["interest", "area efficiency ", "area comfort ", "income", "expenses ", "energy expenses ", "effective floor area ", "floor area ", "users ", "construction cost ", "specific construction cost ", "construction cost per user ", "life cycle cost ", "specific life cycle cost ", "life cycle cost per user ", "construction global warming potential ", "specific construction global warming potential ", "construction global warming potential per user ", "life cycle global warming potential ", "specific life cycle global warming potential ", "life cycle global warming potential per user ", "primary energy demand ", "specific primary energy demand ", "primary energy demand per user ", "final energy demand ", "specific final energy demand ", "final energy demand per user ", "heating load ", "heating energy demand ", "specific heating energy demand ", "heating energy demand per user ", "cooling load ", "cooling energy demand ", "specific cooling energy demand ", "cooling energy demand per user ", "ventilation air flow volume  "])  # -> Quality, Valid, Name, Value, Unit, Definition
panel_2 = Panel(qal.Quality)
expression = Expression(x=qal.Name, y=na_2, Expression="x=y")
flatten = FlattenTree(Tree=ql_2, Path="{0}")
flatten_2 = FlattenTree(Tree=qal.Quality, Path="{0}")
viewer = ParamViewer(flatten)
viewer_2 = ParamViewer(flatten_2)
cull = CullPattern(List=qal.Quality, CullPattern=expression)
trim = TrimTree(Tree=cull, Depth=1)
ql_3 = Quality(trim)
ql_4 = ClusterOutput(ql_3)

# ==== cluster Cluster
bldgprograms = HBBuildingPrograms({"LargeOffice", "MediumOffice", "SmallOffice", "MidriseApartment", "HighriseApartment", "Retail", "StripMall", "PrimarySchool", "SecondarySchool", "SmallHotel", "LargeHotel", "Hospital", "Outpatient", "Laboratory", "Warehouse", "SuperMarket", "FullServiceRestaurant", "QuickServiceRestaurant", "Courthouse", "College", "LargeDataCenterHighITE", "LargeDataCenterLowITE", "SmallDataCenterHighITE", "SmallDataCenterLowITE"}, selected="LargeOffice")
panel = Panel("C:\git\semio\examples\metabolism\representations\capsule_backslash_energy.3dm")
path = ClusterInput()
ty = ClusterInput()
ob = ClusterInput()
path_2 = FilePath(path)
panel_2 = Panel(path_2)
ty_2 = Type(ty)
ob_2 = Data(ob)
panel_3 = Panel("Medium")
lng = ListLength(List=ty_2)
concat = Concatenate()
searchprog = HBSearchPrograms(keywords="office")  # -> room_prog; plug-in component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
import = ImportContent(
    FilePath=panel,
    Name="*",
    Layer="*",
    Linetype="*",
    HatchPattern="*",
    AnnotationStyles="*",
    Materials="*",
    BlockDefinitions="*",
    Import=invert(False))  # -> ModelTransform, Objects, Layers, Linetypes, HatchPatterns, AnnotationStyles, Materials, BlockDefinitions
trim = TrimTree(Tree=import.Objects, Depth=1)
dup = DuplicateData(Data=graft(trim), Number=lng, Order=True)
merge = Merge(Data1="2019")
trim_2 = TrimTree(Tree=dup, Depth=1)
bang = ExplodeTree(Data=trim_2)  # -> graft(Branch0), Branch1, Branch2
entwine = Entwine(Branch00=bang.Branch1, FlattenInputs=True)  # -> graft(Result)
entwine_2 = Entwine(Branch00=bang.Branch2, FlattenInputs=True)  # -> graft(Result)
merge_2 = Merge(Data1=bang.Branch0, Data2=entwine, Data3=entwine_2)
path_mapper = PathMapper(merge_2, source="{A;B;C}", target="{A;C}")
object = ModelObject(Object=path_mapper)  # -> Object, Geometry, Name, Layer, Visibility, Display, Drafting, Render
layer = ModelLayer(Layer=object.Layer)  # -> Layer, Name, Hidden, Locked, DisplayColour, Material, Linetype
expression = Expression(x=layer.Name, y="volume", Expression="x=y")
expression_2 = Expression(x=layer.Name, y="doors", Expression="x=y")
expression_3 = Expression(x=layer.Name, y="windows", Expression="x=y")
cull = CullPattern(List=object.Object, CullPattern=expression_2)
cull_2 = CullPattern(List=object.Object, CullPattern=expression)
cull_3 = CullPattern(List=object.Object, CullPattern=expression_3)

# ----
# Temporary replace for
# Tambour Type (index=37)
doors_0 = Data([{Plane=Plane(origin=(2.75, 0.9, 0.6583333333), x=(0, -1, 0), y=(0, 0, 1)), Size=Domain2(u=-0.4..0.4, v=0..2)}, {Plane=PlaneXZ(0.9, 2.75, 0.6583333333), Size=Domain2(u=-0.4..0.4, v=0..2)}, {Plane=PlaneXZ(-0.9, 2.75, 0.6583333333), Size=Domain2(u=-0.4..0.4, v=0..2)}, {Plane=PlaneYZ(-2.75, 0.9, 0.6583333333), Size=Domain2(u=-0.4..0.4, v=0..2)}, {Plane=PlaneYZ(-2.75, -0.9, 1.116666667), Size=Domain2(u=-0.4..0.4, v=0..2)}, {Plane=Plane(origin=(-0.9, -2.75, 1.116666667), x=(-1, 0, 0), y=(0, 0, 1)), Size=Domain2(u=-0.4..0.4, v=0..2)}, {Plane=Plane(origin=(0.9, -2.75, 2.033333333), x=(-1, 0, 0), y=(0, 0, 1)), Size=Domain2(u=-0.4..0.4, v=0..2)}, {Plane=Plane(origin=(2.75, -0.9, 2.033333333), x=(0, -1, 0), y=(0, 0, 1)), Size=Domain2(u=-0.4..0.4, v=0..2)}])
zone_0 = Data(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)
srf = Surface(doors_0)
tstat = TreeStatistics(Tree=cull_3)  # -> Paths, Length, Count
cull_i = CullIndex(List=tstat.Paths, Indices="37", Wrap=True)
itms = ReplaceItems(T=cull, b_i="37", l_i="0", I=srf)
itms_2 = ReplaceItems(T=cull_2, b_i="37", l_i="0", I=zone_0)
branch = TreeBranch(Tree=cull_3, Path=cull_i, MaintainPaths=True)

txt = Text(graft(ty_2))
windows = Geometry(branch)
zone = Geometry(itms_2)
doors = Geometry(itms)
aperture = HBAperture(geo=windows)  # -> report, apertures; plug-in component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
roomsolid = HBRoomFromSolid(geo=zone, name=txt, conditioned=True)  # -> report, rooms; plug-in component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
door = HBDoor(geo=doors)  # -> report, doors; plug-in component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
merge_3 = Merge(Data1=door.doors, Data2=aperture.apertures)
addsubface = HBAddSubface(hb_obj=roomsolid.rooms, sub_faces=merge_3)  # -> hb_obj; plug-in component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
room = Data(flatten(addsubface))
room_2 = ClusterOutput(room)

# ==== cluster Cluster_2
dn = ClusterInput()
ty = ClusterInput()
room = ClusterInput()
dn_2 = Design(dn)
ty_2 = Type(ty)
room_2 = Data(room)
fltdsn = FlattenDesign(Design=dn_2, Types=ty_2)
dsn = ModelDesign(Design=fltdsn)  # -> Design, Valid, Name, Description, Icon, Image, Variant, View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
trim = TrimTree(Tree=dsn.Pieces, Depth=1)
pce = ModelPiece(Piece=trim)  # -> Piece, Valid, Id, Description, TypeName, TypeVariant, Plane, Center, Qualities
deplane = DeconstructPlane(Plane=pce.Plane)  # -> Origin, XAxis, YAxis, ZAxis
typ = SelectType(ty=ty_2, na=graft(pce.TypeName), variant=graft(pce.TypeVariant))  # -> ty_4, i_2
X = UnitX(Factor=1)
vec = Vector(deplane.XAxis)
item = ListItem(List=room_2, Index=typ.i_2, Wrap=True)
angle = Angle(VectorA=X, VectorB=vec)  # -> Angle, Reflex
trim_2 = TrimTree(Tree=item, Depth=1)
deg = Degrees(Radians=angle.Angle)
rotate = HBRotate(hb_objs=graft(trim_2), angle=graft(deg))  # -> hb_objs; plug-in component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
trim_3 = TrimTree(Tree=rotate, Depth=1)
vec_2 = Vector(deplane.Origin)
move = HBMove(hb_objs=graft(trim_3), vector=graft(vec_2), prefix=graft(pce.Id))  # -> hb_objs; plug-in component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
trim_4 = TrimTree(Tree=move, Depth=1)
trim_5 = TrimTree(Tree=trim_4, Depth=1)
txt = Text(dn_2)
model = HBModel(rooms=flatten(trim_5), name=txt)  # -> report, model; plug-in component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
model_2 = Data(model.model)
model_3 = ClusterOutput(model_2)

# ==== cluster ReplaceItems: Replace items by branch index and list index. If no list index is provided all elements are replaced by the items.
T = ClusterInput()
b_i = ClusterInput()
I = ClusterInput()
l_i = ClusterInput()
l_i_2 = Integer(l_i)
b_i_2 = Integer(b_i)
T_2 = Data(T)
I_2 = Data(I)
tstat = TreeStatistics(Tree=T_2)  # -> Paths, Length, Count
item = ListItem(List=tstat.Paths, Index=b_i_2, Wrap=True)
dsptchpths = DispatchBranchesWithPaths(Data=T_2, Paths=item)  # -> SelectedData, OtherData, SelectedPaths, AdditionalGen; inputs Data: tree, Paths: list, Ancestor: Boolean
# ---------- dsptchpths: Python ----------
__author__ = "Ueli Saluz"
__version__ = "2022.04.19"

ghenv.Component.Name = "DispatchBranchesWithPaths"
ghenv.Component.NickName = "DsptchPths"
ghenv.Component.Description = "Select paths from a data tree and dispatch automatically. Optionally check if path is ancestor."
ghenv.Component.Message = "VER 1.1"

ghenv.Component.Params.Input[3].Optional = True

from Grasshopper import DataTree
from System import Object
from Grasshopper.Kernel.Data import GH_Path

if __name__ == "__main__":
    SelectedData = DataTree[Object]()
    OtherData = DataTree[Object]()
    SelectedPaths = []
    AdditionalGen = []
    
    dummy = 0
    for pathToCheck in Data.Paths:
        isInside = False;
        for path in Paths:
            checkAncestor = pathToCheck.IsAncestor(path,dummy)
            if Generations!=None:
                if Generations<checkAncestor[1]:
                    continue
            if pathToCheck==path or (Ancestor and checkAncestor[0]):
                AdditionalGen.append(checkAncestor[1])
                SelectedData.AddRange(Data.Branch(pathToCheck),pathToCheck)
                SelectedPaths.append(pathToCheck)
                isInside=True
                break
        if not isInside:
            OtherData.AddRange(Data.Branch(pathToCheck),pathToCheck)
# ---------- end dsptchpths ----------
replace = ReplaceItems(List=dsptchpths.SelectedData, Item=I_2, Indices=l_i_2, Wrap=False)
lng = ListLength(List=l_i_2)
c_script = CSharpScript(x=I_2, y=dsptchpths.SelectedData)  # -> a
# ---------- c_script: C# ----------
// Grasshopper Script Instance
#region Usings
using System;
using System.Linq;
using System.Collections;
using System.Collections.Generic;
using System.Drawing;

using Rhino;
using Rhino.Geometry;

using Grasshopper;
using Grasshopper.Kernel;
using Grasshopper.Kernel.Data;
using Grasshopper.Kernel.Types;
#endregion

public class Script_Instance : GH_ScriptInstance
{
    #region Notes
    /* 
      Members:
        RhinoDoc RhinoDocument
        GH_Document GrasshopperDocument
        IGH_Component Component
        int Iteration

      Methods (Virtual & overridable):
        Print(string text)
        Print(string format, params object[] args)
        Reflect(object obj)
        Reflect(object obj, string method_name)
    */
    #endregion

    private void RunScript(object x, object y, ref object a)
    {
        // Write your logic here
        a = x;
    }
}
# ---------- end c_script ----------
trim = TrimTree(Tree=replace, Depth=1)
null = NullItem(Item=lng)  # -> NullFlags, InvalidFlags, Description
expression = Expression(x=lng, Expression="x=0")
merge = Merge(Data1=graft(trim), Data2=graft(c_script))
or = GateOr(A=expression, B=null.NullFlags)
item_2 = ListItem(List=merge, Index=or, Wrap=True)
trim_2 = TrimTree(Tree=item_2, Depth=1)
merge_2 = Merge(Data1=trim_2, Data2=dsptchpths.OtherData)
R = Data(merge_2)
R_2 = ClusterOutput(R)

# ==== cluster SelectType: Select a type with a name and an optional variant. If no variant is provided it will select all variants. If you want to select the default type then use the empty text.
ty = ClusterInput()
na = ClusterInput()
variant = ClusterInput()
na_2 = Name(na)
variant_2 = Variant(variant)
ty_2 = Type(ty)
typ = ModelType(Type=ty_2)  # -> Type, Valid, Name, Description, Icon, Image, Variant, Unit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
expression = Expression(x=typ.Name, y=na_2, Expression="x=y")
cull = CullPattern(List=typ.Type, CullPattern=expression)
typ_2 = ModelType(Type=cull)  # -> Type, Valid, Name, Description, Icon, Image, Variant, Unit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
expression_2 = Expression(x=typ_2.Variant, y=variant_2, Expression="x=y")
txt = Text(ty_2)
cull_2 = CullPattern(List=typ_2.Type, CullPattern=expression_2)
null = NullItem(Item=variant_2)  # -> NullFlags, InvalidFlags, Description
filter = StreamFilter(Gate=null.NullFlags, Stream0=cull_2, Stream1=cull)
txt_2 = Text(filter)
mindex = MemberIndex(Set=txt, Member=txt_2)  # -> Index, Count
trim = TrimTree(Tree=mindex.Index, Depth=1)
ty_3 = Type(filter)
i = Integer(trim)
ty_4 = ClusterOutput(ty_3)
i_2 = ClusterOutput(i)
