# Grasshopper definition kit.gh (Grasshopper 1.0.8)
# Copyright: GNU Lesser General Public License Version 3
# plug-ins: RhinoCodePluginGH, Hops, semio

hops = Hops(
    CacheResultsInMemory=True,
    CacheSolveResults=True,
    RemoteSolveVersion=(0, 1, 0),
    ShowInput_Enabled=False,
    ShowInput_Path=True,
    SynchronousSolve=True)
toggle = BooleanToggle(False)

dir = Directory()  # -> D
# ---------- dir: C# ----------
#region Usings
using System;
using System.Linq;
using System.Collections;
using System.Collections.Generic;
using System.Drawing;
using System.IO;

using Rhino;
using Rhino.Geometry;

using Grasshopper;
using Grasshopper.Kernel;
using Grasshopper.Kernel.Data;
using Grasshopper.Kernel.Types;
#endregion

public class Script_Instance : GH_ScriptInstance
{
    private void RunScript(ref object D)
    {
        D = Path.GetDirectoryName(this.GrasshopperDocument.FilePath);
    }
}
# ---------- end dir ----------
sep = Separator()  # -> S
# ---------- sep: C# ----------
#region Usings
using System;
using System.Linq;
using System.Collections;
using System.Collections.Generic;
using System.Drawing;
using System.IO;

using Rhino;
using Rhino.Geometry;

using Grasshopper;
using Grasshopper.Kernel;
using Grasshopper.Kernel.Data;
using Grasshopper.Kernel.Types;
#endregion

public class Script_Instance : GH_ScriptInstance
{
    private void RunScript(ref object S)
    {
        S = Path.DirectorySeparatorChar;
    }
}
# ---------- end sep ----------

txt = EncodeText(Text=dir, Mode=0)

panel = Panel("""nakagin-capsule-tower
capsule-dream""")
concat = Concatenate(FragmentA=dir, FragmentB=sep, FragmentC="designs")
concat_2 = Concatenate(FragmentA=concat, FragmentB=sep, FragmentC=panel, FragmentD=".gh")
item = ListItem(List=concat_2, Index=0, Wrap=True)  # -> Item, Item1
run = Boolean(toggle)
hops_2 = Hops(
    _Path=item.Item,
    _Enabled=run,
    CacheResultsInMemory=True,
    CacheSolveResults=True,
    RemoteDefinitionLocation="C:\git\semio.tech\semio\examples\metabolism\designs\nakagin-capsule-tower.gh",
    RemoteSolveVersion=(0, 1, 0),
    ShowInput_Enabled=True,
    ShowInput_Path=True,
    SynchronousSolve=False)
hops_3 = Hops(
    _Path=item.Item,
    _Enabled=run,
    Variant="Slanted",
    CacheResultsInMemory=True,
    CacheSolveResults=True,
    RemoteDefinitionLocation="C:\git\semio.tech\semio\examples\metabolism\designs\nakagin-capsule-tower.gh",
    RemoteSolveVersion=(0, 1, 0),
    ShowInput_Enabled=True,
    ShowInput_Path=True,
    SynchronousSolve=False)
hops_4 = Hops(
    _Path=item.Item1,
    _Enabled=run,
    CacheResultsInMemory=True,
    CacheSolveResults=True,
    RemoteDefinitionLocation="C:\git\semio.tech\semio\examples\metabolism\designs\capsule-dream.gh",
    RemoteSolveVersion=(0, 1, 0),
    ShowInput_Enabled=True,
    ShowInput_Path=True,
    SynchronousSolve=False)
hops_5 = Hops(
    _Path=item.Item,
    _Enabled=run,
    Variant="Twisted",
    CacheResultsInMemory=True,
    CacheSolveResults=True,
    RemoteDefinitionLocation="C:\git\semio.tech\semio\examples\metabolism\designs\nakagin-capsule-tower.gh",
    RemoteSolveVersion=(0, 1, 0),
    ShowInput_Enabled=True,
    ShowInput_Path=True,
    SynchronousSolve=False)
hops_6 = Hops(
    _Path=item.Item,
    _Enabled=run,
    Variant="Dancing",
    View="Explosion Axonometry",
    CacheResultsInMemory=True,
    CacheSolveResults=True,
    RemoteDefinitionLocation="C:\git\semio.tech\semio\examples\metabolism\designs\nakagin-capsule-tower.gh",
    RemoteSolveVersion=(0, 1, 0),
    ShowInput_Enabled=True,
    ShowInput_Path=True,
    SynchronousSolve=False)
merge = Merge(Data1=hops_2, Data2=hops_3, Data3=hops_5, Data4=hops_6)
merge_2 = Merge(Data1=merge, Data2=hops_4)
txt_2 = DecodeText(EncodedText=merge_2, Mode=0)
dsn = DeserializeDesign(Text=txt_2)
dn = Design(dsn)
list = ValueList({"Dsn(Nakagin Capsule Tower)": 0, "Dsn(Nakagin Capsule Tower,Slanted)": 1, "Dsn(Nakagin Capsule Tower,Twisted)": 2, "Dsn(Nakagin Capsule Tower,Dancing,Explosion Axonometry)": 3}, selected="Dsn(Nakagin Capsule Tower)")
dn_2 = Design([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])
lng = ListLength(List=dn_2)
series = Series(Start=0, Step=1, Count=lng)
concat_3 = Concatenate(FragmentA=dn_2, FragmentC="=", FragmentB=series)
panel_2 = Panel(concat_3)

panel_3 = Panel(txt)
dsn_2 = ModelDesign(Design=dn_2)  # -> Design, Valid, Name, Description, Icon, Image, Variant, View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
panel_4 = Panel(dsn_2.Design)
panel_5 = Panel(dsn_2.Description)
kt = Kit("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")
kit = SerializeKit(Kit=kt)
txt_3 = EncodeText(Text=kit, Mode=0)
context_bake = ContextBake(Content=txt_3)

panel_6 = Panel("""base
blob-base
bridge
capital
capsule-with-balcony
capsule
cylindric-capital
cylindric-tambour
ellipsoid-capsule
tambour
trapezoid-capsule""")
concat_4 = Concatenate(FragmentA=dir, FragmentB=sep, FragmentC="types")
concat_5 = Concatenate(FragmentA=concat_4, FragmentB=sep, FragmentC=panel_6, FragmentD=".gh")
item_2 = ListItem(List=concat_5, Index=0, Wrap=True)  # -> Item, Item1, Item2, Item3, Item4, Item5, Item6, Item7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
run_2 = Boolean(toggle)
hops_7 = Hops(
    _Path=item_2.Item5,
    _Enabled=run_2,
    Variant="\",
    CacheResultsInMemory=True,
    CacheSolveResults=True,
    RemoteDefinitionLocation="C:\git\semio.tech\semio\examples\metabolism\types\capsule.gh",
    RemoteSolveVersion=(0, 1, 0),
    ShowInput_Enabled=True,
    ShowInput_Path=True,
    SynchronousSolve=False)
hops_8 = Hops(
    _Path=item_2.Item8,
    _Enabled=run_2,
    Variant="\",
    CacheResultsInMemory=True,
    CacheSolveResults=True,
    RemoteDefinitionLocation="C:\git\semio.tech\semio\examples\metabolism\types\ellipsoid-capsule.gh",
    RemoteSolveVersion=(0, 1, 0),
    ShowInput_Enabled=True,
    ShowInput_Path=True,
    SynchronousSolve=False)
hops_9 = Hops(
    _Path=item_2.Item10,
    _Enabled=run_2,
    Variant="\",
    CacheResultsInMemory=True,
    CacheSolveResults=True,
    RemoteDefinitionLocation="C:\git\semio.tech\semio\examples\metabolism\types\trapezoid-capsule.gh",
    RemoteSolveVersion=(0, 1, 0),
    ShowInput_Enabled=True,
    ShowInput_Path=True,
    SynchronousSolve=False)
hops_10 = Hops(
    _Path=item_2.Item4,
    _Enabled=run_2,
    Variant="\",
    CacheResultsInMemory=True,
    CacheSolveResults=True,
    RemoteDefinitionLocation="C:\git\semio.tech\semio\examples\metabolism\types\capsule-with-balcony.gh",
    RemoteSolveVersion=(0, 1, 0),
    ShowInput_Enabled=True,
    ShowInput_Path=True,
    SynchronousSolve=False)
hops_11 = Hops(
    _Path=item_2.Item9,
    _Enabled=run_2,
    CacheResultsInMemory=True,
    CacheSolveResults=True,
    RemoteDefinitionLocation="C:\git\semio.tech\semio\examples\metabolism\types\tambour.gh",
    RemoteSolveVersion=(0, 1, 0),
    ShowInput_Enabled=True,
    ShowInput_Path=True,
    SynchronousSolve=False)
hops_12 = Hops(
    _Path=item_2.Item7,
    _Enabled=run_2,
    CacheResultsInMemory=True,
    CacheSolveResults=True,
    RemoteDefinitionLocation="C:\git\semio.tech\semio\examples\metabolism\types\cylindric-tambour.gh",
    RemoteSolveVersion=(0, 1, 0),
    ShowInput_Enabled=True,
    ShowInput_Path=True,
    SynchronousSolve=False)
hops_13 = Hops(
    _Path=item_2.Item9,
    _Enabled=run_2,
    Variant="First Storey",
    CacheResultsInMemory=True,
    CacheSolveResults=True,
    RemoteDefinitionLocation="C:\git\semio.tech\semio\examples\metabolism\types\tambour.gh",
    RemoteSolveVersion=(0, 1, 0),
    ShowInput_Enabled=True,
    ShowInput_Path=True,
    SynchronousSolve=False)
hops_14 = Hops(
    _Path=item_2.Item7,
    _Enabled=run_2,
    Variant="First Storey",
    CacheResultsInMemory=True,
    CacheSolveResults=True,
    RemoteDefinitionLocation="C:\git\semio.tech\semio\examples\metabolism\types\cylindric-tambour.gh",
    RemoteSolveVersion=(0, 1, 0),
    ShowInput_Enabled=True,
    ShowInput_Path=True,
    SynchronousSolve=False)
hops_15 = Hops(
    _Path=item_2.Item4,
    _Enabled=run_2,
    Variant="/",
    CacheResultsInMemory=True,
    CacheSolveResults=True,
    RemoteDefinitionLocation="C:\git\semio.tech\semio\examples\metabolism\types\capsule-with-balcony.gh",
    RemoteSolveVersion=(0, 1, 0),
    ShowInput_Enabled=True,
    ShowInput_Path=True,
    SynchronousSolve=False)
hops_16 = Hops(
    _Path=item_2.Item5,
    _Enabled=run_2,
    Variant="/",
    CacheResultsInMemory=True,
    CacheSolveResults=True,
    RemoteDefinitionLocation="C:\git\semio.tech\semio\examples\metabolism\types\capsule.gh",
    RemoteSolveVersion=(0, 1, 0),
    ShowInput_Enabled=True,
    ShowInput_Path=True,
    SynchronousSolve=False)
hops_17 = Hops(
    _Path=item_2.Item8,
    _Enabled=run_2,
    Variant="/",
    CacheResultsInMemory=True,
    CacheSolveResults=True,
    RemoteDefinitionLocation="C:\git\semio.tech\semio\examples\metabolism\types\ellipsoid-capsule.gh",
    RemoteSolveVersion=(0, 1, 0),
    ShowInput_Enabled=True,
    ShowInput_Path=True,
    SynchronousSolve=False)
hops_18 = Hops(
    _Path=item_2.Item10,
    _Enabled=run_2,
    Variant="/",
    CacheResultsInMemory=True,
    CacheSolveResults=True,
    RemoteDefinitionLocation="C:\git\semio.tech\semio\examples\metabolism\types\trapezoid-capsule.gh",
    RemoteSolveVersion=(0, 1, 0),
    ShowInput_Enabled=True,
    ShowInput_Path=True,
    SynchronousSolve=False)
hops_19 = Hops(
    _Path=item_2.Item9,
    _Enabled=run_2,
    Variant="Last Storey",
    CacheResultsInMemory=True,
    CacheSolveResults=True,
    RemoteDefinitionLocation="C:\git\semio.tech\semio\examples\metabolism\types\tambour.gh",
    RemoteSolveVersion=(0, 1, 0),
    ShowInput_Enabled=True,
    ShowInput_Path=True,
    SynchronousSolve=False)
hops_20 = Hops(
    _Path=item_2.Item4,
    _Enabled=run_2,
    Variant="q",
    CacheResultsInMemory=True,
    CacheSolveResults=True,
    RemoteDefinitionLocation="C:\git\semio.tech\semio\examples\metabolism\types\capsule-with-balcony.gh",
    RemoteSolveVersion=(0, 1, 0),
    ShowInput_Enabled=True,
    ShowInput_Path=True,
    SynchronousSolve=False)
hops_21 = Hops(
    _Path=item_2.Item7,
    _Enabled=run_2,
    Variant="Last Storey",
    CacheResultsInMemory=True,
    CacheSolveResults=True,
    RemoteDefinitionLocation="C:\git\semio.tech\semio\examples\metabolism\types\cylindric-tambour.gh",
    RemoteSolveVersion=(0, 1, 0),
    ShowInput_Enabled=True,
    ShowInput_Path=True,
    SynchronousSolve=False)
hops_22 = Hops(
    _Path=item_2.Item5,
    _Enabled=run_2,
    Variant="q",
    CacheResultsInMemory=True,
    CacheSolveResults=True,
    RemoteDefinitionLocation="C:\git\semio.tech\semio\examples\metabolism\types\capsule.gh",
    RemoteSolveVersion=(0, 1, 0),
    ShowInput_Enabled=True,
    ShowInput_Path=True,
    SynchronousSolve=False)
hops_23 = Hops(
    _Path=item_2.Item8,
    _Enabled=run_2,
    Variant="q",
    CacheResultsInMemory=True,
    CacheSolveResults=True,
    RemoteDefinitionLocation="C:\git\semio.tech\semio\examples\metabolism\types\ellipsoid-capsule.gh",
    RemoteSolveVersion=(0, 1, 0),
    ShowInput_Enabled=True,
    ShowInput_Path=True,
    SynchronousSolve=False)
hops_24 = Hops(
    _Path=item_2.Item10,
    _Enabled=run_2,
    Variant="q",
    CacheResultsInMemory=True,
    CacheSolveResults=True,
    RemoteDefinitionLocation="C:\git\semio.tech\semio\examples\metabolism\types\trapezoid-capsule.gh",
    RemoteSolveVersion=(0, 1, 0),
    ShowInput_Enabled=True,
    ShowInput_Path=True,
    SynchronousSolve=False)
hops_25 = Hops(
    _Path=item_2.Item,
    _Enabled=run_2,
    CacheResultsInMemory=True,
    CacheSolveResults=True,
    RemoteDefinitionLocation="C:\git\semio.tech\semio\examples\metabolism\types\base.gh",
    RemoteSolveVersion=(0, 1, 0),
    ShowInput_Enabled=True,
    ShowInput_Path=True,
    SynchronousSolve=True)
hops_26 = Hops(
    _Path=item_2.Item2,
    _Enabled=run_2,
    CacheResultsInMemory=True,
    CacheSolveResults=True,
    RemoteDefinitionLocation="C:\git\semio.tech\semio\examples\metabolism\types\bridge.gh",
    RemoteSolveVersion=(0, 1, 0),
    ShowInput_Enabled=True,
    ShowInput_Path=True,
    SynchronousSolve=False)
hops_27 = Hops(
    _Path=item_2.Item3,
    _Enabled=run_2,
    CacheResultsInMemory=True,
    CacheSolveResults=True,
    RemoteDefinitionLocation="C:\git\semio.tech\semio\examples\metabolism\types\capital.gh",
    RemoteSolveVersion=(0, 1, 0),
    ShowInput_Enabled=True,
    ShowInput_Path=True,
    SynchronousSolve=False)
hops_28 = Hops(
    _Path=item_2.Item6,
    _Enabled=run_2,
    CacheResultsInMemory=True,
    CacheSolveResults=True,
    RemoteDefinitionLocation="C:\git\semio.tech\semio\examples\metabolism\types\cylindric-capital.gh",
    RemoteSolveVersion=(0, 1, 0),
    ShowInput_Enabled=True,
    ShowInput_Path=True,
    SynchronousSolve=False)
hops_29 = Hops(
    _Path=item_2.Item4,
    _Enabled=run_2,
    Variant="p",
    CacheResultsInMemory=True,
    CacheSolveResults=True,
    RemoteDefinitionLocation="C:\git\semio.tech\semio\examples\metabolism\types\capsule-with-balcony.gh",
    RemoteSolveVersion=(0, 1, 0),
    ShowInput_Enabled=True,
    ShowInput_Path=True,
    SynchronousSolve=False)
hops_30 = Hops(
    _Path=item_2.Item5,
    _Enabled=run_2,
    Variant="p",
    CacheResultsInMemory=True,
    CacheSolveResults=True,
    RemoteDefinitionLocation="C:\git\semio.tech\semio\examples\metabolism\types\capsule.gh",
    RemoteSolveVersion=(0, 1, 0),
    ShowInput_Enabled=True,
    ShowInput_Path=True,
    SynchronousSolve=False)
hops_31 = Hops(
    _Path=item_2.Item8,
    _Enabled=run_2,
    Variant="p",
    CacheResultsInMemory=True,
    CacheSolveResults=True,
    RemoteDefinitionLocation="C:\git\semio.tech\semio\examples\metabolism\types\ellipsoid-capsule.gh",
    RemoteSolveVersion=(0, 1, 0),
    ShowInput_Enabled=True,
    ShowInput_Path=True,
    SynchronousSolve=False)
hops_32 = Hops(
    _Path=item_2.Item10,
    _Enabled=run_2,
    Variant="p",
    CacheResultsInMemory=True,
    CacheSolveResults=True,
    RemoteDefinitionLocation="C:\git\semio.tech\semio\examples\metabolism\types\trapezoid-capsule.gh",
    RemoteSolveVersion=(0, 1, 0),
    ShowInput_Enabled=True,
    ShowInput_Path=True,
    SynchronousSolve=False)
hops_33 = Hops(
    _Path=item_2.Item9,
    _Enabled=run_2,
    Variant="Single Storey",
    CacheResultsInMemory=True,
    CacheSolveResults=True,
    RemoteDefinitionLocation="C:\git\semio.tech\semio\examples\metabolism\types\tambour.gh",
    RemoteSolveVersion=(0, 1, 0),
    ShowInput_Enabled=True,
    ShowInput_Path=True,
    SynchronousSolve=False)
hops_34 = Hops(
    _Path=item_2.Item7,
    _Enabled=run_2,
    Variant="Single Storey",
    CacheResultsInMemory=True,
    CacheSolveResults=True,
    RemoteDefinitionLocation="C:\git\semio.tech\semio\examples\metabolism\types\cylindric-tambour.gh",
    RemoteSolveVersion=(0, 1, 0),
    ShowInput_Enabled=True,
    ShowInput_Path=True,
    SynchronousSolve=False)
hops_35 = Hops(
    _Path=item_2.Item5,
    _Enabled=run_2,
    Variant="J",
    CacheResultsInMemory=True,
    CacheSolveResults=True,
    RemoteDefinitionLocation="C:\git\semio.tech\semio\examples\metabolism\types\capsule.gh",
    RemoteSolveVersion=(0, 1, 0),
    ShowInput_Enabled=True,
    ShowInput_Path=True,
    SynchronousSolve=False)
merge_3 = Merge(Data1=hops_11, Data2=hops_13, Data3=hops_19, Data4=hops_33)
hops_36 = Hops(
    _Path=item_2.Item4,
    _Enabled=run_2,
    Variant="J",
    CacheResultsInMemory=True,
    CacheSolveResults=True,
    RemoteDefinitionLocation="C:\git\semio.tech\semio\examples\metabolism\types\capsule-with-balcony.gh",
    RemoteSolveVersion=(0, 1, 0),
    ShowInput_Enabled=True,
    ShowInput_Path=True,
    SynchronousSolve=False)
hops_37 = Hops(
    _Path=item_2.Item8,
    _Enabled=run_2,
    Variant="J",
    CacheResultsInMemory=True,
    CacheSolveResults=True,
    RemoteDefinitionLocation="C:\git\semio.tech\semio\examples\metabolism\types\ellipsoid-capsule.gh",
    RemoteSolveVersion=(0, 1, 0),
    ShowInput_Enabled=True,
    ShowInput_Path=True,
    SynchronousSolve=False)
hops_38 = Hops(
    _Path=item_2.Item10,
    _Enabled=run_2,
    Variant="J",
    CacheResultsInMemory=True,
    CacheSolveResults=True,
    RemoteDefinitionLocation="C:\git\semio.tech\semio\examples\metabolism\types\trapezoid-capsule.gh",
    RemoteSolveVersion=(0, 1, 0),
    ShowInput_Enabled=True,
    ShowInput_Path=True,
    SynchronousSolve=False)
merge_4 = Merge(Data1=hops_12, Data2=hops_14, Data3=hops_21, Data4=hops_34)
hops_39 = Hops(
    _Path=item_2.Item8,
    _Enabled=run_2,
    Variant="L",
    CacheResultsInMemory=True,
    CacheSolveResults=True,
    RemoteDefinitionLocation="C:\git\semio.tech\semio\examples\metabolism\types\ellipsoid-capsule.gh",
    RemoteSolveVersion=(0, 1, 0),
    ShowInput_Enabled=True,
    ShowInput_Path=True,
    SynchronousSolve=False)
hops_40 = Hops(
    _Path=item_2.Item5,
    _Enabled=run_2,
    Variant="L",
    CacheResultsInMemory=True,
    CacheSolveResults=True,
    RemoteDefinitionLocation="C:\git\semio.tech\semio\examples\metabolism\types\capsule.gh",
    RemoteSolveVersion=(0, 1, 0),
    ShowInput_Enabled=True,
    ShowInput_Path=True,
    SynchronousSolve=False)
hops_41 = Hops(
    _Path=item_2.Item4,
    _Enabled=run_2,
    Variant="L",
    CacheResultsInMemory=True,
    CacheSolveResults=True,
    RemoteDefinitionLocation="C:\git\semio.tech\semio\examples\metabolism\types\capsule-with-balcony.gh",
    RemoteSolveVersion=(0, 1, 0),
    ShowInput_Enabled=True,
    ShowInput_Path=True,
    SynchronousSolve=False)
hops_42 = Hops(
    _Path=item_2.Item10,
    _Enabled=run_2,
    Variant="L",
    CacheResultsInMemory=True,
    CacheSolveResults=True,
    RemoteDefinitionLocation="C:\git\semio.tech\semio\examples\metabolism\types\trapezoid-capsule.gh",
    RemoteSolveVersion=(0, 1, 0),
    ShowInput_Enabled=True,
    ShowInput_Path=True,
    SynchronousSolve=False)
hops_43 = Hops(
    _Path=item_2.Item4,
    _Enabled=run_2,
    Variant="s",
    CacheResultsInMemory=True,
    CacheSolveResults=True,
    RemoteDefinitionLocation="C:\git\semio.tech\semio\examples\metabolism\types\capsule-with-balcony.gh",
    RemoteSolveVersion=(0, 1, 0),
    ShowInput_Enabled=True,
    ShowInput_Path=True,
    SynchronousSolve=False)
hops_44 = Hops(
    _Path=item_2.Item5,
    _Enabled=run_2,
    Variant="s",
    CacheResultsInMemory=True,
    CacheSolveResults=True,
    RemoteDefinitionLocation="C:\git\semio.tech\semio\examples\metabolism\types\capsule.gh",
    RemoteSolveVersion=(0, 1, 0),
    ShowInput_Enabled=True,
    ShowInput_Path=True,
    SynchronousSolve=False)
hops_45 = Hops(
    _Path=item_2.Item8,
    _Enabled=run_2,
    Variant="s",
    CacheResultsInMemory=True,
    CacheSolveResults=True,
    RemoteDefinitionLocation="C:\git\semio.tech\semio\examples\metabolism\types\ellipsoid-capsule.gh",
    RemoteSolveVersion=(0, 1, 0),
    ShowInput_Enabled=True,
    ShowInput_Path=True,
    SynchronousSolve=False)
hops_46 = Hops(
    _Path=item_2.Item10,
    _Enabled=run_2,
    Variant="s",
    CacheResultsInMemory=True,
    CacheSolveResults=True,
    RemoteDefinitionLocation="C:\git\semio.tech\semio\examples\metabolism\types\trapezoid-capsule.gh",
    RemoteSolveVersion=(0, 1, 0),
    ShowInput_Enabled=True,
    ShowInput_Path=True,
    SynchronousSolve=False)
list_2 = ValueList({"Typ(Base)": 0, "Typ(Base,Blob)": 1, "Typ(Bridge)": 2, "Typ(Capital)": 3, "Typ(Cylindric Capital)": 4, "Typ(Capsule,\)": 5, "Typ(Capsule,/)": 6, "Typ(Capsule,q)": 7, "Typ(Capsule,p)": 8, "Typ(Capsule,J)": 9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}, selected=["Typ(Capsule,z)": 12, "Typ(Capsule with Balcony,\)": 13, "Typ(Capsule with Balcony,/)": 14, "Typ(Capsule with Balcony,q)": 15, "Typ(Capsule with Balcony,p)": 16, "Typ(Capsule with Balcony,J)": 17, "Typ(Capsule with Balcony,L)": 18, "Typ(Capsule with Balcony,s)": 19, "Typ(Trapezoid Capsule,J)": 33])
hops_47 = Hops(
    _Path=item_2.Item4,
    _Enabled=run_2,
    Variant="z",
    CacheResultsInMemory=True,
    CacheSolveResults=True,
    RemoteDefinitionLocation="C:\git\semio.tech\semio\examples\metabolism\types\capsule-with-balcony.gh",
    RemoteSolveVersion=(0, 1, 0),
    ShowInput_Enabled=True,
    ShowInput_Path=True,
    SynchronousSolve=False)
hops_48 = Hops(
    _Path=item_2.Item10,
    _Enabled=run_2,
    Variant="z",
    CacheResultsInMemory=True,
    CacheSolveResults=True,
    RemoteDefinitionLocation="C:\git\semio.tech\semio\examples\metabolism\types\trapezoid-capsule.gh",
    RemoteSolveVersion=(0, 1, 0),
    ShowInput_Enabled=True,
    ShowInput_Path=True,
    SynchronousSolve=False)
hops_49 = Hops(
    _Path=item_2.Item5,
    _Enabled=run_2,
    Variant="z",
    CacheResultsInMemory=True,
    CacheSolveResults=True,
    RemoteDefinitionLocation="C:\git\semio.tech\semio\examples\metabolism\types\capsule.gh",
    RemoteSolveVersion=(0, 1, 0),
    ShowInput_Enabled=True,
    ShowInput_Path=True,
    SynchronousSolve=False)
hops_50 = Hops(
    _Path=item_2.Item8,
    _Enabled=run_2,
    Variant="z",
    CacheResultsInMemory=True,
    CacheSolveResults=True,
    RemoteDefinitionLocation="C:\git\semio.tech\semio\examples\metabolism\types\ellipsoid-capsule.gh",
    RemoteSolveVersion=(0, 1, 0),
    ShowInput_Enabled=True,
    ShowInput_Path=True,
    SynchronousSolve=False)
ty = Type([null x45])
lng_2 = ListLength(List=ty)
series_2 = Series(Start=0, Step=1, Count=lng_2)
concat_6 = Concatenate(FragmentA=ty, FragmentC="=", FragmentB=series_2)
panel_7 = Panel(concat_6)
merge_5 = Merge(Data1=hops_7, Data2=hops_16, Data3=hops_22, Data4=hops_30, Data5=hops_35, Data6=hops_40, Data7=hops_44, Data8=hops_49)
merge_6 = Merge(Data1=hops_10, Data2=hops_15, Data3=hops_20, Data4=hops_29, Data5=hops_36, Data6=hops_41, Data7=hops_43, Data8=hops_47)
merge_7 = Merge(Data1=hops_9, Data2=hops_18, Data3=hops_24, Data4=hops_32, Data5=hops_38, Data6=hops_42, Data7=hops_46, Data8=hops_48)
merge_8 = Merge(Data1=hops_8, Data2=hops_17, Data3=hops_23, Data4=hops_31, Data5=hops_37, Data6=hops_39, Data7=hops_45, Data8=hops_50)

hops_51 = Hops(
    _Enabled=run_2,
    CacheResultsInMemory=True,
    CacheSolveResults=True,
    RemoteDefinitionLocation="C:\git\semio.tech\semio\examples\metabolism\types\bridge.gh",
    RemoteSolveVersion=(0, 1, 0),
    ShowInput_Enabled=True,
    ShowInput_Path=True,
    SynchronousSolve=False)
hops_52 = Hops(
    _Path=item_2.Item2,
    Variant="\"\"",
    CacheResultsInMemory=True,
    CacheSolveResults=True,
    RemoteDefinitionLocation="C:\git\semio.tech\semio\examples\metabolism\types\bridge.gh",
    RemoteSolveVersion=(0, 1, 0),
    ShowInput_Enabled=False,
    ShowInput_Path=True,
    SynchronousSolve=True)
hops_53 = Hops(
    _Path=item_2.Item5,
    Variant="\"\\\\\"",
    CacheResultsInMemory=True,
    CacheSolveResults=True,
    RemoteDefinitionLocation="C:\git\semio.tech\semio\examples\metabolism\types\capsule.gh",
    RemoteSolveVersion=(0, 1, 0),
    ShowInput_Enabled=True,
    ShowInput_Path=True,
    SynchronousSolve=True)
typ = ModelType(Type=ty)  # -> Type, Valid, Name, Description, Icon, Image, flatten(Variant), Stock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
txt_4 = DecodeText(EncodedText=hops_12, Mode=0)
typ_2 = DeserializeType(Text=txt_4)
panel_8 = Panel(ty)
hops_54 = Hops(
    _Path=item_2.Item5,
    _Enabled=run_2,
    Variant="\",
    CacheResultsInMemory=True,
    CacheSolveResults=True,
    RemoteDefinitionLocation="C:\git\semio.tech\semio\examples\metabolism\types\capsule.gh",
    RemoteSolveVersion=(0, 1, 0),
    ShowInput_Enabled=True,
    ShowInput_Path=True,
    SynchronousSolve=False)
ty_2 = Type(typ_2)
typ_3 = ModelType(Type=ty_2, Validate=Toggle(False))  # -> Type, Valid, Name, Description, Icon, Image, Variant, Stock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
por = ModelPort(Port=typ_3.Ports)  # -> Port, Valid, Id, Description, Mandatory, graft(Family), CompatibleFamilies, Point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
rep = ModelRepresentation(Representation=typ_3.Representations)  # -> Representation, Valid, Url, Description, Tags, Qualities
panel_9 = Panel(typ.Description)
panel_10 = Panel(por.Family)
hops_55 = Hops(
    _Path=item_2.Item1,
    _Enabled=run_2,
    Variant="Blob",
    CacheResultsInMemory=True,
    CacheSolveResults=True,
    RemoteDefinitionLocation="C:\git\semio.tech\semio\examples\metabolism\types\blob-base.gh",
    RemoteSolveVersion=(0, 1, 0),
    ShowInput_Enabled=True,
    ShowInput_Path=True,
    SynchronousSolve=False)

merge_9 = Merge(
    Data1=hops_25,
    Data2=hops_55,
    Data3=hops_26,
    Data4=hops_27,
    Data5=hops_28,
    Data6=merge_5,
    Data7=merge_6,
    Data8=merge_8,
    Data9=merge_7,
    Data10=merge_3,
    Data11=merge_4)
txt_5 = DecodeText(EncodedText=merge_9, Mode=0)
typ_4 = DeserializeType(Text=txt_5)
ty_3 = Type(typ_4)

panel_11 = Panel(por.CompatibleFamilies)

validate = BooleanToggle(False)
ghbkit = GitHubKit(domain="github.com", account="usalu", repo="metabolism", tag="r25.07-1")  # -> remote_2, homepage_2
ty_4 = Type(ty)
dn_3 = Design(dn_2)
kit_2 = ModelKit(
    Validate=validate,
    Name="Metabolism",
    Description="Everything for metabolistic architecture.",
    Icon="icons/metabolism.svg",
    Image="images/metabolism.png",
    Preview="docs/preview.png",
    Version="r25.07-1",
    Remote=ghbkit.remote_2,
    Homepage=ghbkit.homepage_2,
    Types=ty_4,
    Designs=dn_3)  # -> Kit, Valid, Name, Description, Icon, Image, Preview, Version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
delete_kit = BooleanToggle(False)
create_kit = BooleanToggle(False)
load_kit = BooleanToggle(False)
kit_3 = DeleteKit(Uri=dir, Run=delete_kit)
kit_4 = CreateKit(Kit=kit_2.Kit, Uri=dir, Run=create_kit)
kit_5 = LoadKit(Uri=dir, Run=load_kit)  # -> Success, Kit, LocalDirectory

panel_13 = Panel(kit_5.Kit)
kt_2 = Kit(kit_2.Kit)
kt_3 = Kit(kit_5.Kit)

# ==== cluster GitHubKit: Get the uri and the homepage of the remote kit of a specific version (either a branch name, a tag name or a commit sha) for a kit hosted as a repository on GitHub.
domain = ClusterInput()
account = ClusterInput()
repo = ClusterInput()
branch = ClusterInput()
tag = ClusterInput()
commit = ClusterInput()
commit_2 = Text(commit)
domain_2 = Text(domain)
account_2 = Text(account)
repo_2 = Text(repo)
branch_2 = Text(branch)
tag_2 = Text(tag)
null = NullItem(Item=domain_2)  # -> NullFlags, InvalidFlags, Description

null_2 = NullItem(Item=tag_2)  # -> NullFlags, InvalidFlags, Description
null_3 = NullItem(Item=commit_2)  # -> NullFlags, InvalidFlags, Description
null_4 = NullItem(Item=branch_2)  # -> NullFlags, InvalidFlags, Description
not = GateNot(A=null_2.NullFlags)
not_2 = GateNot(A=null_3.NullFlags)
not_3 = GateNot(A=null_4.NullFlags)
merge = Merge(Data1=not_3, Data2=not, Data3=not_2)
int = Integer(merge)
ma = MassAddition(Input=int)  # -> Result, PartialResults
expression = Expression(x=ma.Result, Expression="x≠1")
null_5 = NullItem(Item=account_2)  # -> NullFlags, InvalidFlags, Description
null_6 = NullItem(Item=repo_2)  # -> NullFlags, InvalidFlags, Description
or = GateOr(A=expression, D=null.NullFlags, B=null_5.NullFlags, C=null_6.NullFlags)

filter = StreamFilter(Gate=null_4.NullFlags, Stream0="heads", Stream1="tags")
filter_2 = StreamFilter(Gate=null_4.NullFlags, Stream0=branch_2, Stream1=tag_2)
concat = Concatenate(FragmentA="https://", FragmentE=domain_2, FragmentF="/", FragmentB=account_2, FragmentC="/", FragmentD=repo_2)
concat_2 = Concatenate(FragmentA="refs/", FragmentB=filter, FragmentC="/")
filter_3 = StreamFilter(Gate=null_3.NullFlags, Stream1=concat_2)
filter_4 = StreamFilter(Gate=null_3.NullFlags, Stream0=commit_2, Stream1=filter_2)
concat_3 = Concatenate(FragmentA=concat, FragmentE="/archive/", FragmentC=filter_3, FragmentF=filter_4, FragmentG=".zip")
concat_4 = Concatenate(
    FragmentA=concat,
    FragmentB="/",
    FragmentC="tree",
    FragmentF="/",
    FragmentD=branch_2,
    FragmentE=tag_2,
    FragmentG=commit_2)

filter_5 = StreamFilter(Gate=or, Stream0=concat_3)
filter_6 = StreamFilter(Gate=or, Stream0=concat_4)
remote = Remote(filter_5)
homepage = Homepage(filter_6)
remote_2 = ClusterOutput(remote)
homepage_2 = ClusterOutput(homepage)
