# Grasshopper definition base.gh (Grasshopper 1.0.8)
# Copyright: GNU Lesser General Public License Version 3
# Copyright: GNU Lesser General Public License v3.0 or later
# plug-ins: RhinoCodePluginGH, semio

save_representation = BooleanToggle(False)
icon_export = BooleanToggle(False)
validate = BooleanToggle(False)
save = BooleanToggle(False)
sep = Separator()  # -> S; same code as sep
dir = Directory()  # -> D
# ---------- dir: C# ----------
#region Usings
using System;
using System.Linq;
using System.Collections;
using System.Collections.Generic;
using System.Drawing;
using System.IO;

using Rhino;
using Rhino.Geometry;

using Grasshopper;
using Grasshopper.Kernel;
using Grasshopper.Kernel.Data;
using Grasshopper.Kernel.Types;
#endregion

public class Script_Instance : GH_ScriptInstance
{
    private void RunScript(ref object D)
    {
        D = Path.GetDirectoryName(this.GrasshopperDocument.FilePath);
    }
}
# ---------- end dir ----------
# ^                                    ^
#    |                                     |
# <-- Constants    Preview -->
# Parameters    External    Local -->
# <-- Meta               |
#      |                       v
#      v
par = ParentDirectory(D=dir)  # -> P; inputs D: String
# ---------- par: C# ----------
#region Usings
using System;
using System.Linq;
using System.Collections;
using System.Collections.Generic;
using System.Drawing;
using System.IO;

using Rhino;
using Rhino.Geometry;

using Grasshopper;
using Grasshopper.Kernel;
using Grasshopper.Kernel.Data;
using Grasshopper.Kernel.Types;
#endregion

public class Script_Instance : GH_ScriptInstance
{
    private void RunScript(string D, ref object P)
    {
        P = new DirectoryInfo(D).Parent;
    }
}
# ---------- end par ----------
and = GateAnd(A=save, B=icon_export)
and_2 = GateAnd(A=save, B=save_representation)
variant = GetString("0", AtLeast=0, AtMost=1, TreeAccess=False)
zoom = Button()
plot = Curve(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)
expression = Expression(x=Slider(400, range=0..1000), Expression="x/100")
expression_2 = Expression(x=Slider(350, range=0..1000), Expression="x/100")
scale = Scale(Geometry=plot, Center=Point(0, 0, 0), Factor=Slider(0.01, range=0..0.01))  # -> Geometry, Transform
floor_height_m = Number(expression_2)
floor_ground_height_m = Number(expression)
plot_2 = Curve(scale.Geometry)
panel = Panel("Parallel")  # disabled
expression_3 = Expression(x=Slider(550, range=0..1000), Expression="x/100")
m2d_rhino = Make2DRhinoView(Name=panel, Clip=True)  # disabled
number_slider = Slider(876, range=0..1000)  # disabled
view_rectangle = ViewRectangle(view=m2d_rhino)  # disabled
expression_4 = Expression(x=Slider(495, range=0..1000), Expression="x/100")
core_length_m = Number(expression_3)
expression_5 = Expression(x=Slider(475, range=0..1000), Expression="x/100")
previewplane = PreviewPlane(plane=view_rectangle, axis_length=number_slider)  # disabled
cores_setback_width_m = Number(expression_5)
core_primary_width_m = Number(core_length_m)
cores_setback_depth_m = Number(expression_4)
core_secondary_length_m = Number(core_length_m)
core_secondary_width_m = Number(core_length_m)
# 2023-2025 Ueli Saluz
# 2025 Elduane Lumpine
# 2025 Christian Hödtke
# Permission is hereby granted, free of charge, to any person obtaining a copy
# of this Grasshopper file and associated documentation files (the "Document"),
# to deal in the Document without restriction, including without limitation the
# rights to use, copy, modify, merge, publish, distribute, sublicense, and/or sell
# copies of the Document, and to permit persons to whom the Document is
# furnished to do so.
# 
# Individual clusters used inside this document might be licensed under
# different terms. This is indicated through a similar copyright notice group
# inside the cluster and otherwise in the license field of the cluster. If you
# have any question please reach out to us: license@semio-tech.com
# 
# THE DOCUMENT IS PROVIDED "AS IS", WITHOUT WARRANTY OF ANY
# KIND, EXPRESS OR IMPLIED, INCLUDING BUT NOT LIMITED TO THE
# WARRANTIES OF MERCHANTABILITY, FITNESS FOR A PARTICULAR
# PURPOSE AND NONINFRINGEMENT. IN NO EVENT SHALL THE
# AUTHORS OR COPYRIGHT HOLDERS BE LIABLE FOR ANY CLAIM,
# DAMAGES OR OTHER LIABILITY, WHETHER IN AN ACTION OF
# CONTRACT, TORT OR OTHERWISE, ARISING FROM, OUT OF OR IN
# CONNECTION WITH THE DOCUMENT OR THE USE OR OTHER
# DEALINGS IN THE DOCUMENT.
core_primary_length_m = Number(core_length_m)
expression_6 = Expression(x=Slider(560, range=0..1000), Expression="x/100")
expression_7 = Expression(x=Slider(100, range=0..100), Expression="x/100")
expression_8 = Expression(x=Slider(250, range=0..1000), Expression="x/100")
expression_9 = Expression(x=Slider(40, range=0..100), Expression="x/100")
expression_10 = Expression(x=Slider(250, range=0..1000), Expression="x/100")
expression_11 = Expression(x=Slider(100, range=0..100), Expression="x/100")
entrance_setback_m = Number(expression_11)
side_short_setback_depth_m = Number(expression_7)
entrance_hall_width_m = Number(expression_6)
nakagincapsuletowerbasefloorplan = NakaginCapsuleTowerBaseFloorplan(
    plotoutline=plot_2,
    coressetbackdepth=cores_setback_depth_m,
    coressetbackwidth=cores_setback_width_m,
    coreprimarylength=core_primary_width_m,
    coreprimarywidth=core_secondary_length_m,
    coresecondarylength=core_secondary_length_m,
    coresecondarywidth=core_secondary_width_m,
    entrancehallwidth=entrance_hall_width_m,
    sideshortsetbackdepth=side_short_setback_depth_m)  # -> sidebuilding_2, sideshort_2, sidemain_2, sidecorner_2, sidelong_2, coreprimary_2, coresecondary_2, sidemainfassadeside_2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
sidebuilding = Curve(nakagincapsuletowerbasefloorplan.sidebuilding_2)
sideshort = Curve(nakagincapsuletowerbasefloorplan.sideshort_2)
sidemain = Curve(nakagincapsuletowerbasefloorplan.sidemain_2)
sidecorner = Curve(nakagincapsuletowerbasefloorplan.sidecorner_2)
sidelong = Curve(nakagincapsuletowerbasefloorplan.sidelong_2)
coreprimary = Rectangle(nakagincapsuletowerbasefloorplan.coreprimary_2)
coresecondary = Rectangle(nakagincapsuletowerbasefloorplan.coresecondary_2)
sidemainfassadeside = Curve(nakagincapsuletowerbasefloorplan.sidemainfassadeside_2)
sidemainfassadeentrance = Curve(nakagincapsuletowerbasefloorplan.sidemainfassadeentrance_2)
sideshortfassade = Curve(nakagincapsuletowerbasefloorplan.sideshortfassade_2)
sidelongfassade = Curve(nakagincapsuletowerbasefloorplan.sidelongfassade_2)
basenoncore = Curve(nakagincapsuletowerbasefloorplan.basenoncore_2)
base = Curve(nakagincapsuletowerbasefloorplan.base_2)

Z = UnitZ(Factor=floor_ground_height_m)
base_2 = Curve(base)
Z_2 = UnitZ(Factor=floor_height_m)
move = Move(Geometry=plot_2, Motion=Z)  # -> Geometry, Transform
extr = Extrude(Base=base_2, Direction=Z)
extr_2 = Extrude(Base=move.Geometry, Direction=Z_2)
cap = CapHoles(Brep=extr)
cap_2 = CapHoles(Brep=extr_2)
floorgroundvolume1to500 = Brep(cap)
floorfirstvolume1to500 = Brep(cap_2)

eval = EvaluateCurve(Curve=reparameterize(sidemainfassadeentrance), Parameter="0.5")  # -> Point, Tangent, Angle
Z_3 = UnitZ(Factor=1)
xprod = CrossProduct(VectorA=eval.Tangent, VectorB=Z_3, Unitize=False)  # -> Vector, Length
neg = Negative(Value=xprod.Vector)
amp = Amplitude(Vector=neg, Amplitude=entrance_setback_m)
extr_3 = Extrude(Base=sidemainfassadeentrance, Direction=amp)
Z_4 = UnitZ(Factor=floor_height_m)
extr_4 = Extrude(Base=extr_3, Direction=Z_4)
cap_3 = CapHoles(Brep=extr_4)
sdiff = SolidDifference(BrepsA=floorgroundvolume1to500, BrepsB=cap_3)
groundfloorvolume1to200 = Brep(sdiff)

columns_setback_depth_m = Number(expression_8)

neg_2 = Negative(Value=columns_setback_depth_m)
offset = OffsetCurve(Curve=sidemain, Distance=neg_2, Corners=1)
offset_2 = OffsetCurve(Curve=sidelong, Distance=neg_2, Corners=1)
trim = TrimTree(Tree=offset, Depth=1)
trim_2 = TrimTree(Tree=offset_2, Depth=1)
columnsmainaxis = Curve(trim)
columnssideaxis = Curve(trim_2)

columns_width_m = Number(expression_9)

expression_12 = Expression(x=core_primary_width_m, y=columns_width_m, Expression="x-2*y")
expression_13 = Expression(x=core_secondary_length_m, y=columns_width_m, Expression="x-2*y")
subtraction = Subtraction(A=cores_setback_width_m, B=columns_width_m)
merge = Merge(
    Data1=columns_width_m,
    Data2=subtraction,
    Data3=columns_width_m,
    Data4=expression_12,
    Data5=columns_width_m,
    Data6=entrance_hall_width_m,
    Data7=columns_width_m,
    Data8=expression_13,
    Data9=columns_width_m)
ma = MassAddition(Input=merge)  # -> Result, PartialResults
eval_2 = EvaluateLength(Curve=columnsmainaxis, Length=ma.PartialResults, Normalized="False")  # -> Point, Tangent, Parameter
shatter = Shatter(Curve=columnsmainaxis, Parameters=eval_2.Parameter)
trim_3 = TrimTree(Tree=shatter, Depth=1)
Z_5 = UnitZ(Factor=floor_ground_height_m)
dispatch = Dispatch(List=trim_3, DispatchPattern=[True, False])  # -> ListA, ListB
extr_5 = Extrude(Base=dispatch.ListA, Direction=Z_5)
evalsrf = EvaluateSurface(Surface=reparameterize(extr_5), Point="0.5,0.5")  # -> Point, Normal, UDirection, VDirection, Frame
amp_2 = Amplitude(Vector=evalsrf.Normal, Amplitude=columns_width_m)
extr_6 = Extrude(Base=extr_5, Direction=amp_2)
columnsmain = Brep(extr_6)

columns_side_long_setback_width_m = Number(expression_10)

panel_2 = Panel("https://app.speckle.systems")
mime = ValueList({".stl": "model/stl", ".obj": "model/obj", ".glb": "model/gltf-binary", ".gltf": "model/gltf+json", ".3dm": "model/vnd.3dm", ".speckle": "model/vnd.speckle+json", ".png": "image/png", ".jpg": "image/jpeg", ".jpeg": "image/jpeg", ".svg": "image/svg+xml", ".pdf": "application/pdf", ".zip": "application/zip", ".json": "application/json", ".csv": "text/csv", ".txt": "text/plain"}, selected=".speckle")
concat = Concatenate(FragmentA="base", FragmentB="_", FragmentF="collider")
concat_2 = Concatenate(FragmentA="base", FragmentB="_", FragmentE="1to500")
concat_3 = Concatenate(FragmentA="base", FragmentB="_", FragmentE="1to200")
concat_4 = Concatenate(FragmentC="representations", FragmentD=sep, FragmentA=concat_2)
concat_5 = Concatenate(FragmentA=panel_2, FragmentB="/projects/", FragmentC="e7de1a2f8f", FragmentD="/models/", FragmentE="e5267da44d")
concat_6 = Concatenate(FragmentC="representations", FragmentD=sep, FragmentA="base")
concat_7 = Concatenate(FragmentC="representations", FragmentD=sep, FragmentA=concat_3)
concat_8 = Concatenate(FragmentA=concat_6, FragmentB=".3dm")
concat_9 = Concatenate(FragmentA=concat_7, FragmentB=".3dm")
concat_10 = Concatenate(FragmentA=concat_6, FragmentB=".glb")
concat_11 = Concatenate(FragmentA=panel_2, FragmentB="/projects/", FragmentC="e7de1a2f8f", FragmentD="/models/", FragmentE="b394acfd5c")
rep = ModelRepresentation(Url=concat_10)  # -> Representation, Valid, Url, Description, Tags, Qualities
concat_12 = Concatenate(FragmentC="representations", FragmentD=sep, FragmentA=concat)
concat_13 = Concatenate(FragmentA=concat_12, FragmentB=".glb")
concat_14 = Concatenate(FragmentA=concat_12, FragmentB=".3dm")
concat_15 = Concatenate(FragmentA=concat_4, FragmentB=".3dm")
rep_2 = ModelRepresentation(Url=concat_15, Tags="1to500")  # -> Representation, Valid, Url, Description, Tags, Qualities
rep_3 = ModelRepresentation(Url=concat_13, Tags="collider")  # -> Representation, Valid, Url, Description, Tags, Qualities
rep_4 = ModelRepresentation(Url=concat_9, Tags="1to200")  # -> Representation, Valid, Url, Description, Tags, Qualities
trim_4 = TrimTree(Tree=rep_2.Tags, Depth=1)
trim_5 = TrimTree(Tree=rep_4.Tags, Depth=1)
rep_5 = ModelRepresentation(Url=concat_5, Tags=[mime, trim_4])  # -> Representation, Valid, Url, Description, Tags, Qualities
rep_6 = ModelRepresentation(Url=concat_11, Tags=[mime, trim_5])  # -> Representation, Valid, Url, Description, Tags, Qualities
merge_2 = Merge(
    Data1=rep.Representation,
    Data2=rep_2.Representation,
    Data3=rep_4.Representation,
    Data4=rep_5.Representation,
    Data5=rep_6.Representation,
    Data6=rep_3.Representation)

expression_14 = Expression(x=Slider(150, range=0..1000), Expression="x/100")
expression_15 = Expression(x=Slider(40, range=0..100), Expression="x/100")
expression_16 = Expression(x=Slider(30, range=0..100), Expression="x/100")
expression_17 = Expression(x=Slider(90, range=0..100), Expression="x/100")
window_height_m = Number(expression_14)
attic_height_m = Number(expression_16)

addition = Addition(A=floor_ground_height_m, B=floor_height_m)
coresecondary_2 = Rectangle(coresecondary)
coreprimary_2 = Rectangle(coreprimary)
Z_6 = UnitZ(Factor=addition)
move_2 = Move(Geometry=coreprimary_2, Motion=Z_6)  # -> Geometry, Transform
move_3 = Move(Geometry=coresecondary_2, Motion=Z_6)  # -> Geometry, Transform
neg_3 = Negative(Value=attic_height_m)
Z_7 = UnitZ(Factor=neg_3)
merge_3 = Merge(Data1=move_2.Geometry, Data2=move_3.Geometry)
core_outline_1to500 = Geometry(merge_3)
move_4 = Move(Geometry=core_outline_1to500, Motion=Z_7)  # -> Geometry, Transform
extr_7 = Extrude(Base=core_outline_1to500, Direction=Z_7)
capex = CapHolesEx(Brep=extr_7)  # -> Brep, Caps, Solid
core_outline_1to200 = Geometry(capex.Brep)

core_outline_1to500_2 = Geometry(core_outline_1to500)

neg_4 = Negative(Value=attic_height_m)
neg_5 = Negative(Value=attic_height_m)
ext = ExtendCurve(Curve=columnssideaxis, Type=0, Start=neg_4, End=neg_5)
divide = DivideCurve(Curve=ext, Count="2", Kinks=False)  # -> Points, Tangents, Parameters
trim_6 = TrimTree(Tree=divide.Parameters, Depth=1)
eval_3 = EvaluateCurve(Curve=columnssideaxis, Parameter=trim_6)  # -> Point, Tangent, Angle
pl = ConstructPlane(Origin=eval_3.Point, XAxis=eval_3.Tangent, YAxis=Vector(0, 1, 0))
_2d = _2D(x=columns_width_m)
rectangle = Rectangle(Plane=pl, XSize=_2d, YSize=_2d, Radius=0)  # -> Rectangle, Length
Z_8 = UnitZ(Factor=floor_ground_height_m)
extr_8 = Extrude(Base=rectangle.Rectangle, Direction=Z_8)
cap_4 = CapHoles(Brep=extr_8)
columnsside = Brep(cap_4)

evalsrf_2 = EvaluateSurface(Surface=reparameterize(move_3.Geometry), Point="0.5,0.5")  # -> Point, Normal, UDirection, VDirection, Frame
evalsrf_3 = EvaluateSurface(Surface=reparameterize(move_2.Geometry), Point="0.5,0.5")  # -> Point, Normal, UDirection, VDirection, Frame
merge_4 = Merge(Data1=evalsrf_2.Point, Data2=evalsrf_3.Point)
merge_5 = Merge(Data1=evalsrf_2.Normal, Data2=evalsrf_3.Normal)
panel_3 = Panel("""0
1""")
panel_4 = Panel("""east
west""")
qal = ModelQuality(Validate=validate, Name="core", Value=panel_4)  # -> Quality, Valid, Name, Value, Unit
concat_16 = Concatenate(FragmentA="c", FragmentC=panel_3)
panel_5 = Panel("""-0.125
0.125""")
concat_17 = Concatenate(
    FragmentA="The center of the ",
    FragmentB=panel_4,
    FragmentC=" rectangular core (an elevator and a staircase around it).")
por = ModelPort(
    Validate=validate,
    Id=graft(concat_16),
    Description=graft(concat_17),
    Family=graft("core rectangular bottom"),
    CompatibleFamilies=graft("core rectangular top"),
    Point=graft(merge_4),
    Direction=graft(merge_5),
    T=graft(panel_5),
    Qualities=graft(qal.Quality))  # -> Port, Valid, Id, Description, Mandatory, Family, CompatibleFamilies, Point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
trim_7 = TrimTree(Tree=por.Port, Depth=1)

prv = PreviewPort(po=trim_7)

merge_6 = Merge(Data1=columnsmain, Data2=columnsside)
columns = Brep(merge_6)

fassade_edge_setback_m = Number(expression_15)
window_parapet_height_m = Number(expression_17)
attic_depth_m = Number(expression_16)

sidemain_2 = Curve(sidemain)
sidecorner_2 = Curve(sidecorner)
sidelong_2 = Curve(sidelong)
sideshort_2 = Curve(sideshort)
merge_7 = Merge(Data1=sideshort_2, Data2=sidemain_2, Data3=sidecorner_2, Data4=sidelong_2)
join = JoinCurves(Curves=merge_7, Preserve=False)
trim_8 = TrimTree(Tree=join, Depth=1)
move_5 = Move(Geometry=trim_8, Motion=Z)  # -> Geometry, Transform
neg_6 = Negative(Value=fassade_edge_setback_m)
neg_7 = Negative(Value=fassade_edge_setback_m)
move_6 = Move(Geometry=move_5.Geometry, Motion=Z_2)  # -> Geometry, Transform
neg_8 = Negative(Value=fassade_edge_setback_m)
Z_9 = UnitZ(Factor=neg_7)
offset_3 = OffsetCurve(Curve=move_5.Geometry, Distance=neg_6, Corners=1)
Z_10 = UnitZ(Factor=fassade_edge_setback_m)
offset_4 = OffsetCurve(Curve=move_6.Geometry, Distance=neg_8, Corners=1)
move_7 = Move(Geometry=move_5.Geometry, Motion=Z_10)  # -> Geometry, Transform
trim_9 = TrimTree(Tree=offset_3, Depth=1)
crv = Curve(trim_9)
end = EndPoints(Curve=crv)  # -> Start, End
ln = Line(StartPoint=end.Start, EndPoint=end.End)
merge_8 = Merge(Data1=crv, Data2=ln)
move_8 = Move(Geometry=move_6.Geometry, Motion=Z_9)  # -> Geometry, Transform
trim_10 = TrimTree(Tree=offset_4, Depth=1)
crv_2 = Curve(trim_10)
end_2 = EndPoints(Curve=crv_2)  # -> Start, End
ln_2 = Line(StartPoint=end_2.Start, EndPoint=end_2.End)
merge_9 = Merge(Data1=crv_2, Data2=ln_2)
join_2 = JoinCurves(Curves=merge_8, Preserve=False)
join_3 = JoinCurves(Curves=merge_9, Preserve=False)
rulesrf = RuledSurface(CurveA=trim_9, CurveB=move_7.Geometry)
rulesrf_2 = RuledSurface(CurveA=move_7.Geometry, CurveB=move_8.Geometry)
rulesrf_3 = RuledSurface(CurveA=trim_10, CurveB=move_8.Geometry)
trim_11 = TrimTree(Tree=join_2, Depth=1)
trim_12 = TrimTree(Tree=join_3, Depth=1)
neg_9 = Negative(Value=attic_depth_m)
merge_10 = Merge(Data1=rulesrf, Data2=rulesrf_2, Data3=rulesrf_3)
boundary = BoundarySurfaces(Edges=trim_11)
offset_5 = OffsetCurve(Curve=trim_12, Distance=neg_9, Corners=1)
boundary_2 = BoundarySurfaces(Edges=trim_12)
neg_10 = Negative(Value=attic_height_m)
Z_11 = UnitZ(Factor=neg_10)
trim_13 = TrimTree(Tree=offset_5, Depth=1)
fassadefirstfloor = Surface(merge_10)
rulesrf_4 = RuledSurface(CurveA=trim_12, CurveB=trim_13)
move_9 = Move(Geometry=trim_13, Motion=Z_11)  # -> Geometry, Transform
join_4 = BrepJoin(Breps=fassadefirstfloor)  # -> Breps, Closed
boundary_3 = BoundarySurfaces(Edges=move_9.Geometry)
rulesrf_5 = RuledSurface(CurveA=trim_13, CurveB=move_9.Geometry)
merge_11 = Merge(Data1=boundary, Data2=join_4.Breps, Data3=rulesrf_4, Data4=rulesrf_5, Data5=boundary_3)
move_10 = Move(Geometry=sidebuilding, Motion=Z)  # -> Geometry, Transform
Z_12 = UnitZ(Factor=floor_height_m)
join_5 = BrepJoin(Breps=merge_11)  # -> Breps, Closed
capex_2 = CapHolesEx(Brep=join_5.Breps)  # -> Brep, Caps, Solid
floorfirstvolume1to200 = Brep(capex_2.Brep)

Z_13 = UnitZ(Factor=window_parapet_height_m)
move_11 = Move(Geometry=move_5.Geometry, Motion=Z_13)  # -> Geometry, Transform
Z_14 = UnitZ(Factor=window_height_m)
move_12 = Move(Geometry=move_11.Geometry, Motion=Z_14)  # -> Geometry, Transform
rulesrf_6 = RuledSurface(CurveA=move_11.Geometry, CurveB=move_12.Geometry)
windowribbon = Surface(rulesrf_6)

concat_18 = Concatenate(FragmentA="first floor", FragmentB="::", FragmentC="windows")
concat_19 = Concatenate(FragmentA="ground floor", FragmentB="::", FragmentC="Columns")
concat_20 = Concatenate(FragmentA="first floor", FragmentB="::", FragmentC="volume")
concat_21 = Concatenate(FragmentA="ground floor", FragmentB="::", FragmentC="building")
floorgroundvolume1to500_2 = Brep(floorgroundvolume1to500)
floorfirstvolume1to500_2 = Brep(floorfirstvolume1to500)
floorfirstvolume1to200_2 = Brep(floorfirstvolume1to200)
groundfloorvolume1to200_2 = Brep(groundfloorvolume1to200)
core_outline_1to200_2 = Geometry(capex.Brep)
windowribbon_2 = Surface(windowribbon)
columnsmain_2 = Brep(columnsmain)
columnsside_2 = Brep(columnsside)
merge_12 = Merge(
    Data1=groundfloorvolume1to200_2,
    Data2=columnsmain_2,
    Data3=columnsside_2,
    Data4=floorfirstvolume1to200_2,
    Data5=windowribbon_2,
    Data6=core_outline_1to200_2)

floorgroundvolume1to500_3 = Brep(floorgroundvolume1to500)
floorfirstvolume1to500_3 = Brep(floorfirstvolume1to500)
windowribbon_3 = Surface(windowribbon)
debrep = DeconstructBrep(Brep=floorgroundvolume1to500_3)  # -> Faces, Edges, Vertices
debrep_2 = DeconstructBrep(Brep=floorfirstvolume1to500_3)  # -> Faces, Edges, Vertices
disc = Discontinuity(Curve=windowribbon_3, Level=1)  # -> Points, Parameters
groundfloorvolume1to200_3 = Brep(groundfloorvolume1to200)
debrep_3 = DeconstructBrep(Brep=columnsmain_2)  # -> Faces, Edges, Vertices
debrep_4 = DeconstructBrep(Brep=columnsside_2)  # -> Faces, Edges, Vertices
item = ListItem(List=disc.Points, Index=0, Wrap=True)  # -> Item, Item1, Item2, Item3, Item4, Item5, Item6, Item7, Item8, Item9
item_2 = ListItem(List=debrep_3.Faces, Index="5", Wrap=True)  # -> flatten(Item)
item_3 = ListItem(List=debrep_4.Faces, Index="8", Wrap=True)  # -> flatten(Item)
item_4 = ListItem(List=debrep_2.Faces, Index="5", Wrap=True)  # -> Item, Item1
cull_i = CullIndex(List=debrep_2.Faces, Indices=["5", "6"], Wrap=True)
cull_i_2 = CullIndex(List=debrep.Faces, Indices=["8", "7"], Wrap=True)
item_5 = ListItem(List=debrep.Faces, Index="8", Wrap=True)
debrep_5 = DeconstructBrep(Brep=groundfloorvolume1to200_3)  # -> Faces, Edges, Vertices
merge_13 = Merge(Data1=item_2, Data2=item_3)
srf4pt = _4PointSurface(CornerA=item.Item, CornerB=item.Item1, CornerC=item.Item2, CornerD=item.Item9)
srf4pt_2 = _4PointSurface(CornerA=item.Item2, CornerB=item.Item3, CornerC=item.Item8, CornerD=item.Item9)
srf4pt_3 = _4PointSurface(CornerA=item.Item3, CornerB=item.Item4, CornerC=item.Item7, CornerD=item.Item8)
srf4pt_4 = _4PointSurface(CornerA=item.Item4, CornerB=item.Item5, CornerC=item.Item6, CornerD=item.Item7)
item_6 = ListItem(List=debrep_5.Vertices, Index="16", Wrap=True)  # -> Item, Item1, Item2, Item3
merge_14 = Merge(Data1=srf4pt, Data2=srf4pt_2, Data3=srf4pt_3, Data4=srf4pt_4)
srf4pt_5 = _4PointSurface(CornerA=item_6.Item, CornerB=item_6.Item1, CornerC=item_6.Item2, CornerD=item_6.Item3)
merge_15 = Merge(Data1=cull_i_2, Data2=cull_i)
merge_16 = Merge(Data1=cap, Data2=floorfirstvolume1to500_2)
group = NamedGroup(Geometry=item_5, Name="Base")  # -> Group, Geometry, Name
group_2 = NamedGroup(Geometry=merge_13, Name="shades")  # -> Group, Geometry, Name
group_3 = NamedGroup(Geometry=item_4.Item, Name="roof")  # -> Group, Geometry, Name
group_4 = NamedGroup(Geometry=merge_16, Name="floors")  # -> Group, Geometry, Name
group_5 = NamedGroup(Geometry=srf4pt_5, Name="door")  # -> Group, Geometry, Name
group_6 = NamedGroup(Geometry=merge_15, Name="walls")  # -> Group, Geometry, Name
group_7 = NamedGroup(Geometry=merge_14, Name="windows")  # -> Group, Geometry, Name
group_8 = NamedGroup(Geometry=item_4.Item1, Name="slaps")  # -> Group, Geometry, Name
merge_17 = Merge(
    Data1=group_4.Group,
    Data2=group.Group,
    Data3=group_6.Group,
    Data4=group_7.Group,
    Data5=group_8.Group,
    Data6=group_5.Group,
    Data7=group_2.Group,
    Data8=group_3.Group)
group_9 = NamedGroup(Group=merge_17)  # -> Group, Geometry, Name

bbox = BoundingBox(Content=flatten(merge_12), Plane=PlaneXY(0, 0, 0), UnionBox=True)  # -> Box, Box_2
geo = PreviewGeometry(geo=merge_12, sc=1)
zoom2bb = ZoomToBoundingBox(N=["Top", "Front", "Right", "Perspective", "Parallel"], BB=bbox.Box, S=0, R=zoom)  # -> F, SBB; inputs BB: Box, R: Boolean
# ---------- zoom2bb: Python ----------
#Component Information
#--------------------------------------------------------------------------------------------
if ghenv.Component.RunCount<2:
    #General
    #--------------------------------------------------------------------------------------------
    __author__ = "Ueli Saluz"
    __version__ = "2022.05.21"
    
    ghenv.Component.Name = "ZoomToBoundingBox"
    ghenv.Component.NickName = "Zoom2BB"
    ghenv.Component.Description = "Zoom the view of a Rhino viewport to a bounding box."
    ghenv.Component.Message = "VER 1.0"
    ghenv.Component.Category = "Display"
    ghenv.Component.SubCategory = "Camera"
    
     #Inputs
    #--------------------------------------------------------------------------------------------
    inputIndex=0
    
    ghenv.Component.Params.Input[inputIndex].Name = "Name"
    ghenv.Component.Params.Input[inputIndex].NickName = "N"
    ghenv.Component.Params.Input[inputIndex].Description = "Name of the viewport"
    ghenv.Component.Params.Input[inputIndex].Optional = False
    inputIndex+=1
    
    ghenv.Component.Params.Input[inputIndex].Name = "BoundingBox"
    ghenv.Component.Params.Input[inputIndex].NickName = "BB"
    ghenv.Component.Params.Input[inputIndex].Description = ""
    ghenv.Component.Params.Input[inputIndex].Optional = False
    inputIndex+=1
    
    ghenv.Component.Params.Input[inputIndex].Name = "ScaleFactor"
    ghenv.Component.Params.Input[inputIndex].NickName = "S"
    ghenv.Component.Params.Input[inputIndex].Description = "A factor for the extension of the bounding box." \
    +"0 means 0 extension, a positive number makes the bounding box larger a negative smaller. The amount is proportional to the length."
    ghenv.Component.Params.Input[inputIndex].Optional = False
    inputIndex+=1
   
    
    ghenv.Component.Params.Input[inputIndex].Name = "Run"
    ghenv.Component.Params.Input[inputIndex].NickName = "R"
    ghenv.Component.Params.Input[inputIndex].Description = "Zoom to the given bounding box."
    ghenv.Component.Params.Input[inputIndex].Optional = False
    inputIndex+=1
    
    #Outputs
    #--------------------------------------------------------------------------------------------
    outputIndex=0
    
    ghenv.Component.Params.Output[outputIndex].Name = "Finished"
    ghenv.Component.Params.Output[outputIndex].NickName = "F"
    ghenv.Component.Params.Output[outputIndex].Description = "Sends True when finished. Just to trigger other depending components."
    outputIndex+=1
    
    ghenv.Component.Params.Output[outputIndex].Name = "ScaledBoundingBox"
    ghenv.Component.Params.Output[outputIndex].NickName = "SBB"
    ghenv.Component.Params.Output[outputIndex].Description = "The scaled bounding box."
    outputIndex+=1


#Imports
#--------------------------------------------------------------------------------------------
from Rhino import RhinoDoc
from Rhino.Geometry import Box

#Solver - Run with trees to enhance performance drastically
#--------------------------------------------------------------------------------------------
if __name__ == "__main__":
    try:
        vp = RhinoDoc.ActiveDoc.Views.Find(N, False).ActiveViewport
        if R:
            box = BB
            bb = BB.BoundingBox
            bb.Inflate(S*box.X.Length,S*box.Y.Length,S*box.Z.Length)
            vp.ZoomBoundingBox(bb)
            SBB = bb
        F = True
    except:
        pass
# ---------- end zoom2bb ----------

merge_18 = Merge(Data1=groundfloorvolume1to200_2, Data2=floorfirstvolume1to500_2)
wires = BrepWireframe(Brep=merge_18, Density=-1)
debrep_6 = DeconstructBrep(Brep=columnsmain_2)  # -> Faces, Edges, Vertices
debrep_7 = DeconstructBrep(Brep=columnsside_2)  # -> Faces, Edges, Vertices
item_7 = ListItem(List=debrep_6.Faces, Index="3", Wrap=True)
item_8 = ListItem(List=debrep_6.Faces, Index="1", Wrap=True)
edges = BrepEdges(Brep=windowribbon_2)  # -> Naked, Interior, NonManifold
item_9 = ListItem(List=debrep_7.Faces, Index="5", Wrap=True)
item_10 = ListItem(List=debrep_7.Faces, Index="4", Wrap=True)
merge_19 = Merge(Data1=item_8, Data2=item_10)
merge_20 = Merge(Data1=item_7, Data2=item_9)
area = Area(Geometry=merge_19)  # -> Area, Centroid
area_2 = Area(Geometry=merge_20)  # -> Area, Centroid
ln_3 = Line(StartPoint=area.Centroid, EndPoint=area_2.Centroid)
columnline = Data(ln_3)
merge_21 = Merge(Data1=wires, Data2=columnline, Data3=edges.Naked, Data4=core_outline_1to500_2)
lines = Data(merge_21)
merge_22 = Merge(Data1=groundfloorvolume1to200_2, Data2=lines, Data3=floorfirstvolume1to500_2)

rec = Rectangle({Plane=Plane(origin=(-1970.889691, 1937.419247, 1956.598842), x=(0.7071067812, 0.7071067812, 0), y=(0.4082482905, -0.4082482905, 0.8164965809)), Size=Domain2(u=-46.34617503..46.34617503, v=-24.69844367..24.69844367)})
m2d_parallel = Make2DParallelView(Projection=rec)
make2d = Make2D(Geometry=merge_12, View=m2d_parallel, TangentEdges="T", TangentSeams=False, AutoComputeMake2D=True)  # -> VisibleCurves, VisibleIndex, VisibleType, HiddenCurves, HiddenIndex, HiddenType
trim_14 = TrimTree(Tree=make2d.VisibleCurves, Depth=1)
shaft = Geometry(trim_14)

concat_22 = Concatenate(FragmentA="base", FragmentB="_", FragmentC="icon")
concat_23 = Concatenate(FragmentC="icons", FragmentD=sep, FragmentA="base")
expression_18 = Expression(x="shaft", y=shaft, Expression="x")
concat_24 = Concatenate(FragmentA=concat_23, FragmentB=".3dm")
concat_25 = Concatenate(FragmentA=par, FragmentB=sep, FragmentC=concat_24)
blc = ExportBlock(path=concat_25, name=concat_22, url=concat_24, geo=shaft, layer_name=expression_18, export=and)  # -> block_definition_3, path_4, exported_2

merge_23 = Merge(Data1=floorgroundvolume1to500_2, Data2=columns, Data3=floorfirstvolume1to500_2)
sunion = SolidUnion(Breps=merge_23)
jagged = SettingsSpeed()
mesh = MeshBrep(Brep=sunion, Settings=jagged)
collider = Mesh(mesh)
construction_area_factor = Number(Slider(0.2, range=0..1))
maintenance_expenses_month_eff_m² = Number(Slider(7.5, range=0..10))
construction_cost_eff_m² = Number(Slider(5500, range=0..10000))
income_month_eff_m² = Number(Slider(75, range=0..100))
heating_energy_demand_kwh_m²a = Number(Slider(25, range=0..200))
cooling_energy_demand_kwh_m²a = Number(Slider(35, range=0..200))
technical_equipment_energy_demand_kwh_m² = Number(Slider(40, range=0..200))  # "Technical Equipment Energy Demand[kWh/m²a]"
construction_global_warming_potential_kg = Number(Slider(800, range=0..2000))  # "Construction Global Warming Potential [kgCO2e/eff. m²]"

# ----
# Outputs   ->
#                 |
#                 v
concat_26 = Concatenate(FragmentA="Columns", FragmentB="Main")
concat_27 = Concatenate(FragmentA="Columns", FragmentB="Side")
group_10 = NamedGroup(Geometry=floorgroundvolume1to500_2, Name="ground floor")  # -> Group, Geometry, Name
group_11 = NamedGroup(Geometry=columnsmain_2, Name=concat_26)  # -> Group, Geometry, Name
group_12 = NamedGroup(Geometry=columnsside_2, Name=concat_27)  # -> Group, Geometry, Name
group_13 = NamedGroup(Geometry=floorfirstvolume1to500_2, Name="first floor")  # -> Group, Geometry, Name
group_14 = NamedGroup(Geometry=windowribbon_2, Name="windows")  # -> Group, Geometry, Name
group_15 = NamedGroup(Geometry=core_outline_1to500_2, Name="core area")  # -> Group, Geometry, Name
merge_24 = Merge(
    Data1=group_10.Group,
    Data2=group_11.Group,
    Data3=group_12.Group,
    Data4=group_13.Group,
    Data5=group_14.Group,
    Data6=group_15.Group)
group_16 = NamedGroup(Geometry=merge_24)  # -> Group, Geometry, Name
group_17 = NamedGroup(Geometry=groundfloorvolume1to200_2, Name="ground floor")  # -> Group, Geometry, Name
group_18 = NamedGroup(Geometry=columnsmain_2, Name=concat_26)  # -> Group, Geometry, Name
group_19 = NamedGroup(Geometry=columnsside_2, Name=concat_27)  # -> Group, Geometry, Name
group_20 = NamedGroup(Geometry=floorfirstvolume1to200_2, Name="first floor")  # -> Group, Geometry, Name
group_21 = NamedGroup(Geometry=windowribbon_2, Name="windows")  # -> Group, Geometry, Name
group_22 = NamedGroup(Geometry=core_outline_1to200_2, Name="core area")  # -> Group, Geometry, Name
merge_25 = Merge(
    Data1=group_17.Group,
    Data2=group_18.Group,
    Data3=group_19.Group,
    Data4=group_20.Group,
    Data5=group_21.Group,
    Data6=group_22.Group)
aut = ModelAuthor(Name="Ueli Saluz", Email="ueli@semio-tech.org")  # -> Author, Valid, Name, Email, Attributes
rep_7 = ModelRepresentation(Tags="1to200")  # -> Representation, Valid, Url, Description, Tags, Attributes
group_23 = NamedGroup(Geometry=merge_25)  # -> Group, Geometry, Name
path = FilePath(par)
name = Data("base")
data = Data(variant)
collider_2 = Mesh(collider)
energy_representation = Data(group_9.Group)

# ----
# https://identifier.buildingsmart.org/uri/buildingsmart/ifc/4.3/class/IfcBuildingStorey
# https://identifier.buildingsmart.org/uri/buildingsmart/ifc/4.3/prop/GrossHeight
# https://identifier.buildingsmart.org/uri/buildingsmart/ifc/4.3/prop/GrossHeight
# 
# 
# 
# https://identifier.buildingsmart.org/uri/buildingsmart/ifc/4.3/prop/NetFloorArea
# 
# https://identifier.buildingsmart.org/uri/buildingsmart/ifc/4.3/prop/EnergyConsumption
# https://identifier.buildingsmart.org/uri/buildingsmart/ifc/4.3/prop/EnergyConsumption
# https://identifier.buildingsmart.org/uri/buildingsmart/ifc/4.3/prop/EnergyConsumption
# 
# 
# https://identifier.buildingsmart.org/uri/etim/etim/9.0/prop/EF016979
maintenance_expenses_month_eff_m²_2 = Number(maintenance_expenses_month_eff_m²)
construction_global_warming_potential_kg_2 = Number(construction_global_warming_potential_kg)  # "Construction Global Warming Potential [kgCO2e/eff. m²]"
technical_equipment_energy_demand_kwh_m²_2 = Number(technical_equipment_energy_demand_kwh_m²)  # "Technical Equipment Energy Demand[kWh/m²a]"
income_month_eff_m²_2 = Number(income_month_eff_m²)
construction_area_factor_2 = Number(construction_area_factor)
cooling_energy_demand_kwh_m²a_2 = Number(cooling_energy_demand_kwh_m²a)
heating_energy_demand_kwh_m²a_2 = Number(heating_energy_demand_kwh_m²a)
area_3 = Area(Geometry=plot_2)  # -> Area, Centroid
area_4 = Area(Geometry=base)  # -> Area, Centroid
construction_cost_eff_m²_2 = Number(construction_cost_eff_m²)
expression_19 = Expression(x=construction_area_factor_2, Expression="1-x")
addition_2 = Addition(A=area_4.Area, B=area_3.Area)
multiplication = Multiplication(A=addition_2, B=expression_19)
multiplication_2 = Multiplication(A=multiplication, B=maintenance_expenses_month_eff_m²_2)
multiplication_3 = Multiplication(A=multiplication, B=income_month_eff_m²_2)
expression_20 = Expression(x=multiplication_2, Expression="x*12")
expression_21 = Expression(x=multiplication_3, Expression="x*12")
multiplication_4 = Multiplication(A=multiplication, B=construction_cost_eff_m²_2)
multiplication_5 = Multiplication(A=heating_energy_demand_kwh_m²a_2, B=multiplication)
multiplication_6 = Multiplication(A=cooling_energy_demand_kwh_m²a_2, B=multiplication)
multiplication_7 = Multiplication(A=technical_equipment_energy_demand_kwh_m²_2, B=multiplication)
multiplication_8 = Multiplication(A=multiplication, B=construction_global_warming_potential_kg_2)
roundmult = RoundToMultiple(N=multiplication, M="0.01")  # -> R; inputs N: tree, M: tree
# ---------- roundmult: Python ----------
#Component Information
#--------------------------------------------------------------------------------------------
if ghenv.Component.RunCount<2:
    #General
    #--------------------------------------------------------------------------------------------
    __author__ = "YOUR NAME"
    __version__ = "2000.00.00"
    
    ghenv.Component.Name = "Round to Multiple"
    ghenv.Component.NickName = "RoundMult"
    ghenv.Component.Description = "Rounds a number to the nearest specified multiple."
    ghenv.Component.Message = "VER 1.0"
    ghenv.Component.Category = "Math"
    ghenv.Component.SubCategory = "Arithmetic"
    
     #Inputs
    #--------------------------------------------------------------------------------------------
    inputIndex=0
    
    ghenv.Component.Params.Input[inputIndex].Name = "Number"
    ghenv.Component.Params.Input[inputIndex].NickName = "N"
    ghenv.Component.Params.Input[inputIndex].Description = "Number to round."
    ghenv.Component.Params.Input[inputIndex].Optional = False
    inputIndex+=1
    
    ghenv.Component.Params.Input[inputIndex].Name = "Multiple"
    ghenv.Component.Params.Input[inputIndex].NickName = "M"
    ghenv.Component.Params.Input[inputIndex].Description = "Multiple to round to."
    ghenv.Component.Params.Input[inputIndex].Optional = False
    inputIndex+=1
    
    #Outputs
    #--------------------------------------------------------------------------------------------
    outputIndex=0
    
    ghenv.Component.Params.Output[outputIndex].Name = "Rounded"
    ghenv.Component.Params.Output[outputIndex].NickName = "R"
    ghenv.Component.Params.Output[outputIndex].Description = "Number rounded to the nearest specified multiple."
    outputIndex+=1


#Imports
#--------------------------------------------------------------------------------------------
from System import Object
from Grasshopper import DataTree
import math


#The Component function - Business logic only (e.g. working without trees)
#--------------------------------------------------------------------------------------------
"""Function that this component is computing.
    Inputs:
        number: The number to round.
        multiple: The multiple to round to.
    Output:
        rounded: The number rounded to the nearest specified multiple."""
def RoundToMultiple(number, multiple):
    rounded = math.ceil(number / multiple) * multiple
    return rounded

#Solver - Run with trees to enhance performance drastically
#--------------------------------------------------------------------------------------------
if __name__ == "__main__":
    
    #Initialize trees
    #--------------------------------------------------------------------------------------------
    RoundedTree = DataTree[Object]()
    
    #Data matching
    #--------------------------------------------------------------------------------------------
    for path in N.Paths:
        numberBranch = N.Branch(path)
        for i, number in enumerate(numberBranch):
            multiple = M.Branch(path)[i]
            rounded = RoundToMultiple(number, multiple)
            RoundedTree.Add(rounded, path)
    
     #Assign trees to output
    #--------------------------------------------------------------------------------------------
    R = RoundedTree
# ---------- end roundmult ----------
round = Round(Number=multiplication_4)  # -> Nearest, Floor, Ceiling
round_2 = Round(Number=multiplication_5)  # -> Nearest, Floor, Ceiling
round_3 = Round(Number=multiplication_6)  # -> Nearest, Floor, Ceiling
round_4 = Round(Number=multiplication_7)  # -> Nearest, Floor, Ceiling
round_5 = Round(Number=expression_21)  # -> Nearest, Floor, Ceiling
round_6 = Round(Number=expression_20)  # -> Nearest, Floor, Ceiling
round_7 = Round(Number=multiplication_8)  # -> Nearest, Floor, Ceiling

merge_26 = Merge(
    Data1="2",
    Data2=floor_height_m,
    Data3=floor_ground_height_m,
    Data4="2",
    Data5=core_primary_length_m,
    Data6=core_primary_length_m,
    Data7=roundmult,
    Data8=round.Nearest,
    Data9=round_2.Nearest,
    Data10=round_3.Nearest,
    Data11=round_4.Nearest,
    Data12=round_5.Nearest,
    Data13=round_6.Nearest,
    Data14=round_7.Nearest)
panel_6 = Panel("""storey
floor height
ground floor height
cores
core length
core width
effective floor area
construction cost
heating energy demand
cooling energy demand
technical equipment energy demand
income
maintenance expenses
construction global warming potential""")
panel_7 = Panel(merge_26)
panel_8 = Panel("""m
m

m
m
m²
€
kWh/a
kWh/a
kWh/a
€/a
€/a
kgCO2e""")
panel_9 = Panel("A polygonal two storey office building with an entrance hall and access to the staircases and elevators of the rectangular cores on the groundfloor. It has a setback and a colonade towards the street. On the second floor are the office rooms.")
panel_10 = Panel("🏫")
aut_2 = ModelAuthor(Name="Ueli Saluz", Email="ueli@semio-tech.org")  # -> Author, Valid, Name, Email, Attributes

qal_2 = ModelQuality(Validate=validate, Name=panel_6, Value=panel_7, Unit=panel_8)  # -> Quality, Valid, Name, Value, Unit

ql = Quality(qal_2.Quality)
typ = OppinionatedType(
    path=path,
    na=name,
    description=panel_9,
    variant=data,
    de=group_16.Group,
    paper=merge_22,
    collider=collider_2,
    volume=group_16.Group,
    group=group_23.Group,
    rp=rep_7.Representation,
    po=trim_7,
    authors=aut.Author,
    qualities=ql,
    ex=and_2)  # -> ty_2, ba_2

typ_2 = ModelType(
    Validate=validate,
    Name="Base",
    Description=panel_9,
    Icon="icons/base.svg",
    Image="images/base.png",
    Variant=variant,
    Unit="m",
    Representations=merge_2,
    Ports=trim_7,
    Authors=aut_2.Author,
    Qualities=qal_2.Quality)  # -> Type, Valid, Name, Description, Icon, Image, Variant, Stock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
typ_3 = PutType(Type=typ_2.Type, Uri=par, Run=save)

typ_4 = SerializeType(Type=typ_2.Type)
txt = EncodeText(Text=typ_4, Mode=0)
type = Text(txt)
context_bake = ContextBake(Geometry=type)

# ==== cluster NakaginCapsuleTowerBaseFloorplan
sideshortsetbackdepth = ClusterInput()
plotoutline = ClusterInput()
coressetbackdepth = ClusterInput()
coressetbackwidth = ClusterInput()
coreprimarylength = ClusterInput()
coreprimarywidth = ClusterInput()
coresecondarylength = ClusterInput()
coresecondarywidth = ClusterInput()
entrancehallwidth = ClusterInput()
coressetbackdepth_2 = Number(coressetbackdepth)
coreprimarylength_2 = Number(coreprimarylength)
coreprimarywidth_2 = Number(coreprimarywidth)
coresecondarylength_2 = Number(coresecondarylength)
coressetbackwidth_2 = Number(coressetbackwidth)
plotoutline_2 = Curve(plotoutline)
coresecondarywidth_2 = Number(coresecondarywidth)
entrancehallwidth_2 = Number(entrancehallwidth)
sideshortsetbackdepth_2 = Number(sideshortsetbackdepth)
xy = XYPlane(Origin=Point(0, 0, 0))
merge = Merge(Data1=coressetbackwidth_2, Data2=coreprimarylength_2, Data3=entrancehallwidth_2, Data4=coresecondarylength_2)
neg = Negative(Value=coressetbackdepth_2)
ma = MassAddition(Input=merge)  # -> Result, PartialResults
explode = Explode(Curve=plotoutline_2, Recursive=True)  # -> Segments, Vertices
Y = UnitY(Factor=neg)
neg_2 = Negative(Value=ma.PartialResults)
trim = TrimTree(Tree=explode.Segments, Depth=1)
X = UnitX(Factor=neg_2)
move = Move(Geometry=xy, Motion=Y)  # -> Geometry, Transform
item = ListItem(List=trim, Index=0, Wrap=True)  # -> Item, Item1, Item2, Item3, Item4
move_2 = Move(Geometry=move.Geometry, Motion=X)  # -> Geometry, Transform
sidemain = Curve(item.Item2)
sidecorner = Curve(item.Item3)
sidelong = Curve(item.Item4)
sidebuilding = Curve(item.Item)
sideshort = Curve(item.Item1)
item_2 = ListItem(List=move_2.Geometry, Index=0, Wrap=True)  # -> Item, Item1, Item2, Item3
neg_3 = Negative(Value=coresecondarywidth_2)
neg_4 = Negative(Value=coreprimarywidth_2)
neg_5 = Negative(Value=entrancehallwidth_2)
sidebuilding_2 = ClusterOutput(sidebuilding)
sideshort_2 = ClusterOutput(sideshort)
sidemain_2 = ClusterOutput(sidemain)
sidecorner_2 = ClusterOutput(sidecorner)
sidelong_2 = ClusterOutput(sidelong)
rectangle = Rectangle(Plane=item_2.Item2, XSize=entrancehallwidth_2, YSize=neg_5, Radius=0)  # -> Rectangle, Length
rectangle_2 = Rectangle(Plane=item_2.Item1, XSize=coreprimarylength_2, YSize=neg_3, Radius=0)  # -> Rectangle, Length
rectangle_3 = Rectangle(Plane=item_2.Item3, XSize=coresecondarylength_2, YSize=neg_4, Radius=0)  # -> Rectangle, Length
coresecondary = Rectangle(rectangle_2.Rectangle)
coreprimary = Rectangle(rectangle_3.Rectangle)
explode_2 = Explode(Curve=rectangle.Rectangle, Recursive=True)  # -> Segments, Vertices
explode_3 = Explode(Curve=coreprimary, Recursive=True)  # -> Segments, Vertices
coreprimary_2 = ClusterOutput(coreprimary)
coresecondary_2 = ClusterOutput(coresecondary)
trim_2 = TrimTree(Tree=explode_2.Segments, Depth=1)
trim_3 = TrimTree(Tree=explode_3.Vertices, Depth=1)
item_3 = ListItem(List=trim_2, Index=0, Wrap=True)  # -> Item, Item1, Item2, Item3
item_4 = ListItem(List=trim_3, Index=0, Wrap=True)  # -> Item, Item1, Item2, Item3
neg_6 = Negative(Value=sideshortsetbackdepth_2)
offset = OffsetCurve(Curve=sideshort, Distance=neg_6, Corners=1)
trim_4 = TrimTree(Tree=offset, Depth=1)

X_2 = UnitX(Factor=1)
line = LineSDL(Start=move.Geometry, Direction=X_2, Length=1)
rotax = RotateAxis(Geometry=move.Geometry, Angle=degrees("90"), Axis=line)  # -> Geometry, Transform
pcx = CurvePlane(Curve=trim_4, Plane=rotax.Geometry)  # -> Points, ParamsC, ParamsP
trim_5 = TrimTree(Tree=pcx.Points, Depth=1)
crv_cp = CurveClosestPoint(Point=trim_5, Curve=trim_4)  # -> Point, Parameter, Distance
shatter = Shatter(Curve=trim_4, Parameters=crv_cp.Parameter)
trim_6 = TrimTree(Tree=shatter, Depth=1)
item_5 = ListItem(List=trim_6, Index=0, Wrap=True)

explode_4 = Explode(Curve=coresecondary, Recursive=True)  # -> Segments, Vertices
trim_7 = TrimTree(Tree=explode_4.Segments, Depth=1)
shift = ShiftList(List=trim_7, Shift="-2", Wrap=True)
panel = Panel("-1")
trim_8 = TrimTree(Tree=shift, Depth=1)
lito3p = ListInto3Parts(ListToSlice=trim_8, StartIndex="1")  # -> FilteredList, ItemsBefore, ItemsAfter; inputs ListToSlice: tree, StartIndex: tree of Int32, EndIndex: tree of Int32
# ---------- lito3p: Python ----------
if ghenv.Component.RunCount<2:
    __author__ = "Ueli Saluz"
    __version__ = "2020.05.28"
    
    ghenv.Component.Name = "ListInto3Parts"
    ghenv.Component.NickName = "LiTo3P"
    ghenv.Component.Description = "Slice list into 3 parts. All lists are sliced with the same indices. End index = 0 = length(list)."
    ghenv.Component.Message = "VER 1.6"

from System import Object
from Grasshopper import DataTree

def filterList(listToFilter,startIndex,endIndex):
    # Return: FilteredList, Before, After
    if (((startIndex == 0) or (startIndex is None)) and ((endIndex == 0) or (endIndex is None))) or (endIndex <= startIndex and endIndex > 0):
        return (listToFilter,None,None)
    elif (startIndex == 0) or (startIndex is None):
        return (listToFilter[:endIndex],None,listToFilter[endIndex:])
    elif (endIndex == 0) or (endIndex is None):
        print 1
        return (listToFilter[:startIndex],listToFilter[startIndex:],None)
    else:
        return (listToFilter[startIndex:endIndex],listToFilter[:startIndex],listToFilter[endIndex:])

if __name__ == "__main__":
    FilteredList = DataTree[Object]()
    ItemsBefore = DataTree[Object]()
    ItemsAfter = DataTree[Object]()
    
    for path in ListToSlice.Paths:
        listBranch = ListToSlice.Branch(path)
        pyList = list(listBranch)   #Convert .Net List to Python
        try: #terrible way of writing code but if I set the list to list access the performance decreases massivly due to many calls
            startIndex = StartIndex.Branch(path)
            startIndex = startIndex[0]
        except Exception:
            try:
                startIndex = StartIndex.Branch(0)
                startIndex = startIndex[0]
            except Exception:
                startIndex = 0
        try:
            endIndex = EndIndex.Branch(path)
            endIndex = endIndex[0]
        except Exception:
            try:
                endIndex = EndIndex.Branch(0)
                endIndex = endIndex[0]
            except Exception:
                endIndex = len(pyList)
        filtList=filterList(pyList,startIndex,endIndex)
        if filtList[0]:
            FilteredList.AddRange(filtList[0],path)
        if filtList[1]:
            ItemsBefore.AddRange(filtList[1],path)
        if filtList[2]:
            ItemsAfter.AddRange(filtList[2],path)
# ---------- end lito3p ----------

panel_2 = Panel(trim_5)
ln = Line(StartPoint=crv_cp.Point, EndPoint=item_2.Item)
ln_2 = Line(StartPoint=item_2.Item1, EndPoint=item_2.Item2)
ln_3 = Line(StartPoint=crv_cp.Point, EndPoint=item_4.Item3)
ln_4 = Line(StartPoint=item_4.Item3, EndPoint=item_4.Item)
ln_5 = Line(StartPoint=item_4.Item, EndPoint=item_4.Item1)
sidemainfassadeside = Curve(ln)
sideshortfassade = Curve(item_5)
sidemainfassadeentrance = Curve(ln_2)
sidemainfassadeentrance_2 = ClusterOutput(sidemainfassadeentrance)
sidemainfassadeside_2 = ClusterOutput(sidemainfassadeside)
sideshortfassade_2 = ClusterOutput(sideshortfassade)

xy_2 = XYPlane(Origin=Point(0, 0, 0))
rotate = Rotate(Geometry=xy_2, Angle=degrees("180"), Plane=PlaneXY(0, 0, 0))  # -> Geometry, Transform
brec = BoundingRectangle(geometry=plotoutline_2, plane=graft(rotate.Geometry))  # -> boundingrectangle_2, length_2
end = EndPoints(Curve=trim_4)  # -> Start, End
crv_cp_2 = CurveClosestPoint(Point=end.Start, Curve=sidebuilding)  # -> Point, Parameter, Distance

rec = Rectangle(brec.boundingrectangle_2)

trim_9 = TrimTree(Tree=rec, Depth=1)
drec = DeconstuctRectangle(Rectangle=trim_9)  # -> BasePlane, XInterval, YInterval
domprop = DomainProperties(I=drec.YInterval, In=True)  # -> L, M, T0, T1; inputs I: tree, In: tree of Boolean
# ---------- domprop: Python ----------
#Component Information
#--------------------------------------------------------------------------------------------
if ghenv.Component.RunCount<2:
    #General
    #--------------------------------------------------------------------------------------------
    __author__ = "Ueli Saluz"
    __version__ = "2021.11.22"
    
    ghenv.Component.Name = "DomainProperties"
    ghenv.Component.NickName = "DomProp"
    ghenv.Component.Description = "Returns some properties of a domain"
    ghenv.Component.Message = "VER 1.0"
    ghenv.Component.Category = "Maths"
    ghenv.Component.SubCategory = "Domain"
    
     #Inputs
    #--------------------------------------------------------------------------------------------
    inputIndex=0
    
    ghenv.Component.Params.Input[inputIndex].Name = "Domain"
    ghenv.Component.Params.Input[inputIndex].NickName = "I"
    ghenv.Component.Params.Input[inputIndex].Description = "Domain to evaluate"
    ghenv.Component.Params.Input[inputIndex].Optional = False
    inputIndex+=1
    
    ghenv.Component.Params.Input[inputIndex].Name = "MakeIncreasing"
    ghenv.Component.Params.Input[inputIndex].NickName = "In"
    ghenv.Component.Params.Input[inputIndex].Description = "Makes sure that the domain is increasing. If not it gets swapped."
    ghenv.Component.Params.Input[inputIndex].Optional = False
    inputIndex+=1
    
    #Outputs
    #--------------------------------------------------------------------------------------------
    outputIndex=0
    
    ghenv.Component.Params.Output[outputIndex].Name = "Length"
    ghenv.Component.Params.Output[outputIndex].NickName = "L"
    ghenv.Component.Params.Output[outputIndex].Description = "Length of the domain"
    outputIndex+=1
    
    ghenv.Component.Params.Output[outputIndex].Name = "Mid"
    ghenv.Component.Params.Output[outputIndex].NickName = "M"
    ghenv.Component.Params.Output[outputIndex].Description = "Middle of the of the domain"
    outputIndex+=1
    
    ghenv.Component.Params.Output[outputIndex].Name = "DomainStartParameter"
    ghenv.Component.Params.Output[outputIndex].NickName = "T0"
    ghenv.Component.Params.Output[outputIndex].Description = "Start parameter. Doens't have to be smaller than the end parameter."
    outputIndex+=1
    
    ghenv.Component.Params.Output[outputIndex].Name = "DomainEndParameter"
    ghenv.Component.Params.Output[outputIndex].NickName = "T1"
    ghenv.Component.Params.Output[outputIndex].Description = "End parameter. Doens't have to be bigger than the start parameter."
    outputIndex+=1
    


#Imports
#--------------------------------------------------------------------------------------------
from System import Object
from Grasshopper import DataTree

#Solver - Run with trees to enhance performance drastically
#--------------------------------------------------------------------------------------------
if __name__ == "__main__":
    
    #Initialize trees
    #--------------------------------------------------------------------------------------------
    LengthTree = DataTree[Object]()
    MidTree = DataTree[Object]()
    DomainStartParameterTree = DataTree[Object]()
    DomainEndParameterTree = DataTree[Object]()
    LengthTree = DataTree[Object]()
    
    #Data matching
    #--------------------------------------------------------------------------------------------
    for path in I.Paths:
        domainBranch = I.Branch(path)
        for i,domain in enumerate(domainBranch):
            if In==True:
                domain.MakeIncreasing()
            LengthTree.Add(domain.Length, path)
            MidTree.Add(domain.Mid, path)
            DomainStartParameterTree.Add(domain.T0, path)
            DomainEndParameterTree.Add(domain.T1, path)
    
     #Assign trees to output
    #--------------------------------------------------------------------------------------------
    L = LengthTree
    M = MidTree
    T0 = DomainStartParameterTree
    T1 = DomainEndParameterTree
# ---------- end domprop ----------
ext = ExtendCurve(Curve=item_3.Item3, Type=0, Start="0", End=domprop.L)
ccx = CurveCurve(CurveA=ext, CurveB=sidebuilding)  # -> Points, ParamsA, ParamsB
trim_10 = TrimTree(Tree=ccx.Points, Depth=1)
trim_11 = TrimTree(Tree=ccx.ParamsB, Depth=1)
merge_2 = Merge(Data1=trim_11, Data2=crv_cp_2.Parameter)
trim_12 = TrimTree(Tree=ccx.ParamsA, Depth=1)
shatter_2 = Shatter(Curve=sidebuilding, Parameters=merge_2)
shatter_3 = Shatter(Curve=ext, Parameters=trim_12)
trim_13 = TrimTree(Tree=shatter_2, Depth=1)
trim_14 = TrimTree(Tree=shatter_3, Depth=1)

item_6 = ListItem(List=trim_13, Index=0, Wrap=True)  # -> Item, Item1
item_7 = ListItem(List=trim_14, Index=0, Wrap=True)  # -> Item, Item1
ln_6 = Line(StartPoint=item_4.Item1, EndPoint=trim_10)
merge_3 = Merge(Data1=ln, Data2=lito3p.FilteredList, Data3=ln_2, Data4=item_7.Item, Data5=item_6.Item1, Data6=item_5)
merge_4 = Merge(Data1=ln_3, Data2=ln_4, Data3=ln_5, Data4=ln_6, Data5=item_6.Item1, Data6=item_5)
join = JoinCurves(Curves=merge_3, Preserve=False)
sidelongfassade = Curve(ln_6)
join_2 = JoinCurves(Curves=merge_4, Preserve=False)
trim_15 = TrimTree(Tree=join, Depth=1)
trim_16 = TrimTree(Tree=join_2, Depth=1)
end_2 = EndPoints(Curve=trim_15)  # -> Start, End
end_3 = EndPoints(Curve=trim_16)  # -> Start, End
ln_7 = Line(StartPoint=end_2.Start, EndPoint=end_2.End)
ln_8 = Line(StartPoint=end_3.Start, EndPoint=end_3.End)
merge_5 = Merge(Data1=ln_7, Data2=trim_15)
merge_6 = Merge(Data1=ln_8, Data2=trim_16)
sidelongfassade_2 = ClusterOutput(sidelongfassade)
join_3 = JoinCurves(Curves=merge_5, Preserve=False)
join_4 = JoinCurves(Curves=merge_6, Preserve=False)
trim_17 = TrimTree(Tree=join_3, Depth=1)
trim_18 = TrimTree(Tree=join_4, Depth=1)
simplify = SimplifyCurve(Curve=trim_17)  # -> Curve, Simplified
simplify_2 = SimplifyCurve(Curve=trim_18)  # -> Curve, Simplified
crv_cp_3 = CurveClosestPoint(Point=move.Geometry, Curve=simplify.Curve)  # -> Point, Parameter, Distance
crv_cp_4 = CurveClosestPoint(Point=move.Geometry, Curve=simplify_2.Curve)  # -> Point, Parameter, Distance
seam = Seam(Curve=simplify.Curve, Seam=crv_cp_3.Parameter)
seam_2 = Seam(Curve=simplify_2.Curve, Seam=crv_cp_4.Parameter)
crv_cp_5 = CurveClosestPoint(Point=crv_cp.Point, Curve=seam)  # -> Point, Parameter, Distance
crv_cp_6 = CurveClosestPoint(Point=crv_cp.Point, Curve=seam_2)  # -> Point, Parameter, Distance
seam_3 = Seam(Curve=seam, Seam=crv_cp_5.Parameter)
seam_4 = Seam(Curve=seam_2, Seam=crv_cp_6.Parameter)
flip = FlipCurve(Curve=seam_3, Guide=plotoutline_2)  # -> Curve, Flag
flip_2 = FlipCurve(Curve=seam_4, Guide=plotoutline_2)  # -> Curve, Flag
basenoncore = Curve(flip.Curve)
basenoncore_2 = ClusterOutput(basenoncore)
base = Curve(flip_2.Curve)
base_2 = ClusterOutput(base)

# ==== cluster _2D
x = ClusterInput()
expression = Expression(x=x, Expression="x/2")
neg = Negative(Value=expression)
dom = ConstructDomain(DomainStart=neg, DomainEnd=expression)
I = ClusterOutput(dom)

# ==== cluster PreviewPlane: Preview a plane with axis colors and naming.
axis_length = ClusterInput()
plane = ClusterInput()
axis_length_2 = Number(axis_length)
plane_2 = Plane(plane)
deplane = DeconstructPlane(Plane=plane_2)  # -> Origin, XAxis, YAxis, ZAxis
line = LineSDL(Start=deplane.Origin, Direction=deplane.YAxis, Length=axis_length_2)
line_2 = LineSDL(Start=deplane.Origin, Direction=deplane.XAxis, Length=axis_length_2)
line_3 = LineSDL(Start=deplane.Origin, Direction=deplane.ZAxis, Length=axis_length_2)
swatch = ColourSwatch(SwatchColor=RGB(235, 52, 79))
swatch_2 = ColourSwatch(SwatchColor=RGB(0, 166, 157))
swatch_3 = ColourSwatch(SwatchColor=RGB(240, 117, 24))
end = EndPoints(Curve=line_2)  # -> Start, End
end_2 = EndPoints(Curve=line)  # -> Start, End
end_3 = EndPoints(Curve=line_3)  # -> Start, End
tag = TextTag(Location=end.End, Text="X", Colour=swatch)
tag_2 = TextTag(Location=end_2.End, Text="Y", Colour=swatch_2)
tag_3 = TextTag(Location=end_3.End, Text="Z", Colour=swatch_3)
preview = CustomPreview(Geometry=line_2, Material=swatch)
preview_2 = CustomPreview(Geometry=line, Material=swatch_2)
preview_3 = CustomPreview(Geometry=line_3, Material=swatch_3)

# ==== cluster ViewRectangle
view = ClusterInput()
view_2 = Data(view)
nickname = NAME(view=view_2)  # -> c, x, y, z, h, w
# ---------- nickname: Python ----------
uselss, c, x, y, z = view.GetCameraFrame()
h = view.FrustumHeight
w = view.FrustumWidth
# ---------- end nickname ----------
rev = Reverse(Vector=nickname.x)
rev_2 = Reverse(Vector=nickname.y)
pl = ConstructPlane(Origin=nickname.c, XAxis=rev, YAxis=nickname.y)
_2d = _2D(x=nickname.w)
_2d_2 = _2D(x=nickname.h)
rectangle = Rectangle(Plane=pl, XSize=_2d, YSize=_2d_2, Radius=0)  # -> Rectangle, Length
rec = Rectangle(rectangle.Rectangle)
rec_2 = ClusterOutput(rec)

# ==== cluster ExportBlock: Export geometry with layer names to a file.
path = ClusterInput()
name = ClusterInput()
url = ClusterInput()
geo = ClusterInput()
layer_name = ClusterInput()
export = ClusterInput()
path_2 = FilePath(path)
name_2 = Text(name)
url_2 = Text(url)
geo_2 = Geometry(geo)
layer_name_2 = Text(layer_name)
export_2 = Boolean(export)
layer = ModelLayer(Name=layer_name_2)  # -> Layer, Name, Hidden, Locked, DisplayColour, Material, Linetype
object = ModelObject(Geometry=geo_2, Layer=layer.Layer)  # -> Object, Geometry, Name, Layer, Visibility, Display, Drafting, Render
block_definition = ModelBlockDefinition(Objects=object.Object, Name=name_2, URL=url_2)  # -> BlockDefinition, Objects, Units, Name, Notes, URL, URLDescription
export_definition = ExportModelBlockDefinition(BlockDefinition=block_definition.BlockDefinition, FilePath=path_2, Overwrite="T", Export=export_2)  # -> BlockDefinition, FilePath, Exported
block_definition_2 = ModelBlockDefinition(export_definition.BlockDefinition)
path_3 = FilePath(export_definition.FilePath)
exported = Boolean(export_definition.Exported)
path_4 = ClusterOutput(path_3)
exported_2 = ClusterOutput(exported)
block_definition_3 = ClusterOutput(block_definition_2)

# ==== cluster PreviewPort: Preview a port by showing the point and direction and if exists: id, family and compatible families.
po = ClusterInput()
sc = ClusterInput()
sc_2 = Number(sc)
po_2 = Port(po)
por = ModelPort(Port=po_2)  # -> Port, Valid, Id, Description, Mandatory, Family, CompatibleFamilies, Point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
swatch = ColourSwatch(SwatchColor=RGB(235, 52, 79))
swatch_2 = ColourSwatch(SwatchColor=RGB(250, 149, 0))
amp = Amplitude(Vector=por.Direction, Amplitude=sc_2)
lng = ListLength(List=por.CompatibleFamilies)
expression = Expression(x=por.Family, Expression="x=\"\"")
cull = CullPattern(List=por.Point, CullPattern=expression)
expression_2 = Expression(x=lng, Expression="x=0")
join = TextJoin(Text=por.CompatibleFamilies, Join=",")
merge = Merge(Data1=":")
trim = TrimTree(Tree=join, Depth=1)
trim_2 = TrimTree(Tree=expression_2, Depth=1)
item = ListItem(List=merge, Index=expression, Wrap=invert(True))
log = Logarithm(Value=sc_2)
concat = Concatenate(FragmentA="[", FragmentB=trim, FragmentC="]")
expression_3 = Expression(y=trim_2, Expression="x")
merge_2 = Merge(Data1=graft(concat), Data2=graft(expression_3))
item_2 = ListItem(List=merge_2, Index=graft(expression), Wrap=invert(True))
multiplication = Multiplication(A=log, B=Slider(2, range=0..10))
trim_3 = TrimTree(Tree=item_2, Depth=1)
concat_2 = Concatenate(FragmentA=por.Id, FragmentB=item, FragmentC=por.Family, FragmentD=trim_3)
preview = CustomPreview(Geometry=cull, Material=swatch)
tag = TextTag(Location=por.Point, Text=concat_2, Colour=swatch)
vdisex = VectorDisplayEx(Point=por.Point, Vector=amp, Colour=ColourSwatch(SwatchColor=RGB(0, 166, 157)), Width=multiplication)

# ==== cluster PreviewGeometry: Preview geometry by ungrouping everything, showing light surfaces and dark edges.
sc = ClusterInput()
geo = ClusterInput()
geo_2 = Geometry(flatten(geo))
sc_2 = Number(sc)
expression = Expression(x=sc_2, Expression="x+1")
swatch = ColourSwatch(SwatchColor=RGB(0, 0, 0))
swatch_2 = ColourSwatch(SwatchColor=RGB(255, 255, 255))
ungroup = Ungroup(Group=geo_2)
ungroup_2 = Ungroup(Group=ungroup)
ungroup_3 = Ungroup(Group=ungroup_2)
ungroup_4 = Ungroup(Group=ungroup_3)
log = Logarithm(Value=expression)
clean = CleanTree(RemoveNulls=True, RemoveInvalid=True, RemoveEmpty=invert(False), Tree=ungroup_4)  # -> flatten(Tree)
multiplication = Multiplication(A=log, B=Slider(0.05, range=0..1))
linetype = ModelLinetype(Name="semio", Width=multiplication)  # -> ModelLinetype, Name, Segments, CapStyle, JoinStyle, Width, WidthUnits, TaperWidths, TaperPositions
dispatch = CSharpScript(D=clean)  # -> P, C, B, M, R
# ---------- dispatch: C# ----------
// Grasshopper Script Instance
#region Usings
using System;
using System.Linq;
using System.Collections;
using System.Collections.Generic;
using System.Drawing;

using Rhino;
using Rhino.Geometry;

using Grasshopper;
using Grasshopper.Kernel;
using Grasshopper.Kernel.Data;
using Grasshopper.Kernel.Types;
#endregion

public class Script_Instance : GH_ScriptInstance
{
    #region Notes
    /* 
      Members:
        RhinoDoc RhinoDocument
        GH_Document GrasshopperDocument
        IGH_Component Component
        int Iteration

      Methods (Virtual & overridable):
        Print(string text)
        Print(string format, params object[] args)
        Reflect(object obj)
        Reflect(object obj, string method_name)
    */
    #endregion

    private void RunScript(
	object D,
	ref object P,
	ref object C,
	ref object B,
	ref object M,
	ref object R)
    {
        if (D is Curve) C = D; // Curve
        else if (
            D is Rhino.Geometry.Point ||
            D is PointCloud
            )
            P = D; // Point
        else if ( D is Mesh) M = D; // Mesh
        else if (
            D is Surface ||
            D is Extrusion ||
            D is SubD ||
            D is Brep
            )
            B = D; // Brep
        else R = D; // Rest
            
    }
}
# ---------- end dispatch ----------
clean_2 = CleanTree(RemoveNulls=True, RemoveInvalid=True, RemoveEmpty=False, Tree=dispatch.M)
clean_3 = CleanTree(RemoveNulls=True, RemoveInvalid=True, RemoveEmpty=False, Tree=dispatch.R)
clean_4 = CleanTree(RemoveNulls=True, RemoveInvalid=True, RemoveEmpty=False, Tree=dispatch.B)
clean_5 = CleanTree(RemoveNulls=True, RemoveInvalid=True, RemoveEmpty=False, Tree=dispatch.P)
clean_6 = CleanTree(RemoveNulls=True, RemoveInvalid=True, RemoveEmpty=False, Tree=dispatch.C)
debrep = DeconstructBrep(Brep=clean_4)  # -> Faces, Edges, Vertices
preview = CustomPreview(Geometry=flatten(clean_5), Material=swatch)
preview_2 = CustomPreview(Geometry=flatten(debrep.Faces), Material=swatch_2)
preview_3 = CustomPreview(Geometry=flatten(clean_2), Material=swatch_2)
preview_4 = CustomPreview(Geometry=flatten(clean_3), Material=swatch)
curve_preview = CustomCurvePreview(Curve=clean_6, Linetype=linetype.ModelLinetype, Colour=swatch)
curve_preview_2 = CustomCurvePreview(Curve=debrep.Edges, Linetype=linetype.ModelLinetype, Colour=swatch)

# ==== cluster OppinionatedType: Construct a type following the oppinionated conventions of semio. All representations are saved under representations folder where each representation is saved once natively (.3dm) and once exported (.glb). Further a collider representation is required. All names and file names are standardized.
emoji = Panel("")
name = Panel("Default")
abbreviation = Panel("Dft?")
nn = Panel("De")
prm = ModelParam(Na=name, NN=nn, Dc="The optional default representation geometry group.", Op=Toggle(True), Ru=Toggle(True))  # -> Param, Name, NickName, Description, Optional, Success; inputs Pr: tree, Op: Boolean, Ru: Boolean
# ---------- prm: Python ----------
#Component Information
#--------------------------------------------------------------------------------------------
if ghenv.Component.RunCount<2:
    #General
    #--------------------------------------------------------------------------------------------
    __author__ = "Ueli Saluz"
    __version__ = "2025.06.18"
    
    ghenv.Component.Name = "Model Param"
    ghenv.Component.NickName = "~Prm"
    ghenv.Component.Description = "Deconstruct or modify a param."
    ghenv.Component.Message = "VER 1.0"
    ghenv.Component.Category = "semio"
    ghenv.Component.SubCategory = "Scripting"
    
     #Inputs
    #--------------------------------------------------------------------------------------------
    inputIndex=0
    
    ghenv.Component.Params.Input[inputIndex].Name = "Param"
    ghenv.Component.Params.Input[inputIndex].NickName = "Pr"
    ghenv.Component.Params.Input[inputIndex].Description = "Connect the param to desconstruct or modify here with one wire."
    ghenv.Component.Params.Input[inputIndex].Optional = False
    inputIndex+=1

    ghenv.Component.Params.Input[inputIndex].Name = "Name"
    ghenv.Component.Params.Input[inputIndex].NickName = "Na"
    ghenv.Component.Params.Input[inputIndex].Description = "Name of the param."
    ghenv.Component.Params.Input[inputIndex].Optional = False
    inputIndex+=1
    
    ghenv.Component.Params.Input[inputIndex].Name = "NickName"
    ghenv.Component.Params.Input[inputIndex].NickName = "NN"
    ghenv.Component.Params.Input[inputIndex].Description = "Nickname of the param."
    ghenv.Component.Params.Input[inputIndex].Optional = False
    inputIndex+=1
    
    ghenv.Component.Params.Input[inputIndex].Name = "Description"
    ghenv.Component.Params.Input[inputIndex].NickName = "Dc"
    ghenv.Component.Params.Input[inputIndex].Description = "Description of the param."
    ghenv.Component.Params.Input[inputIndex].Optional = True
    inputIndex+=1
    
    ghenv.Component.Params.Input[inputIndex].Name = "Optional"
    ghenv.Component.Params.Input[inputIndex].NickName = "Op"
    ghenv.Component.Params.Input[inputIndex].Description = "Wheather the param is optional."
    ghenv.Component.Params.Input[inputIndex].Optional = True
    inputIndex+=1
    
    ghenv.Component.Params.Input[inputIndex].Name = "Run"
    ghenv.Component.Params.Input[inputIndex].NickName = "Ru"
    ghenv.Component.Params.Input[inputIndex].Description = "Modify the param."
    ghenv.Component.Params.Input[inputIndex].Optional = True
    inputIndex+=1
    
    #Outputs
    #--------------------------------------------------------------------------------------------
    outputIndex=0
    
    ghenv.Component.Params.Output[outputIndex].Name = "Param"
    ghenv.Component.Params.Output[outputIndex].NickName = "Param"
    ghenv.Component.Params.Output[outputIndex].Description = "The desconstruct or modified param"
    ghenv.Component.Params.Output[outputIndex].Optional = False
    outputIndex+=1
    
    ghenv.Component.Params.Output[outputIndex].Name = "Name"
    ghenv.Component.Params.Output[outputIndex].NickName = "Name"
    ghenv.Component.Params.Output[outputIndex].Description = "Name of the param."
    ghenv.Component.Params.Output[outputIndex].Optional = False
    outputIndex+=1
    
    ghenv.Component.Params.Output[outputIndex].Name = "NickName"
    ghenv.Component.Params.Output[outputIndex].NickName = "NickName"
    ghenv.Component.Params.Output[outputIndex].Description = "Nickname of the param."
    ghenv.Component.Params.Output[outputIndex].Optional = False
    outputIndex+=1
    
    ghenv.Component.Params.Output[outputIndex].Name = "Description"
    ghenv.Component.Params.Output[outputIndex].NickName = "Description"
    ghenv.Component.Params.Output[outputIndex].Description = "Description of the param."
    ghenv.Component.Params.Output[outputIndex].Optional = True
    outputIndex+=1
    
    ghenv.Component.Params.Output[outputIndex].Name = "Optional"
    ghenv.Component.Params.Output[outputIndex].NickName = "Optional"
    ghenv.Component.Params.Output[outputIndex].Description = "Wheather the param is optional."
    ghenv.Component.Params.Output[outputIndex].Optional = True
    outputIndex+=1
    
    ghenv.Component.Params.Output[outputIndex].Name = "Success"
    ghenv.Component.Params.Output[outputIndex].NickName = "Success"
    ghenv.Component.Params.Output[outputIndex].Description = "Wheather the operation was successful."
    ghenv.Component.Params.Output[outputIndex].Optional = False
    outputIndex+=1

input = ghenv.Component.Params.Input[0]
param = input.Sources[0]
if Ru:
    if Na:
        param.Name = Na
    if NN:
        param.NickName = NN
    if Dc:
        param.Description = Dc
    if Op:
        param.Optional = Op
    Success = True
else:
    Success = False
Param = param
Name = param.Name
NickName = param.NickName
Description = param.Description
Optional = param.Optional
# ---------- end prm ----------
concat = Concatenate(FragmentA="\"", FragmentB=prm.Description, FragmentC="\"")
merge = Merge(Data1=emoji, Data2=prm.NickName, Data3=abbreviation, Data4=prm.Name, Data5=concat)
join = TextJoin(Text=merge, Join=",")
de = ClusterInput()
paper = ClusterInput()
panel = Panel(join)
path = ClusterInput()
na = ClusterInput()
description = ClusterInput()
variant = ClusterInput()
rp = ClusterInput()
collider = ClusterInput()
volume = ClusterInput()
ex = ClusterInput()
group = ClusterInput()
po = ClusterInput()
authors = ClusterInput()
qualities = ClusterInput()
sep = Separator()  # -> S; same code as sep
path_2 = FilePath(path)
na_2 = Name(na)
description_2 = Description(description)
variant_2 = Variant(variant)
de_2 = Default(de)
rp_2 = Representation(rp)
volume_2 = Volume(volume)
group_2 = Group(group)
paper_2 = Paper(paper)
collider_2 = Collider(collider)
authors_2 = Authors(authors)
qualities_2 = Qualities(qualities)
po_2 = Port(po)
ex_2 = Export(ex)
merge_2 = Merge(Data1=de_2, Data2=paper_2, Data3=collider_2, Data4=volume_2)
rep = ModelRepresentation(Representation=rp_2)  # -> Representation, Valid, Url, Description, Tags, Qualities
rep_2 = ReplaceText(Text=variant_2, Find="/", Replace="slash", RecursiveReplace=False)
txt = NormalizeText(Text=na_2)  # -> Strict, Title, Underscore, Kebab, Pascal
split = SplitList(List=rep.Tags, Index="1")  # -> ListA, ListB
rep_3 = ReplaceText(Text=rep_2, Find="\", Replace="backslash", RecursiveReplace=False)
panel_2 = Panel(rp_2)
txt_2 = NormalizeText(Text=rep_3)  # -> Strict, Title, Underscore, Kebab, Pascal
join_2 = TextJoin(Text=split.ListB, Join="_")
panel_3 = Panel("""default
paper
collider
volume""")
concat_2 = Concatenate(FragmentA=txt.Kebab, FragmentD="_", FragmentB=txt_2.Kebab)
concat_3 = Concatenate(FragmentA="images", FragmentB=sep, FragmentC=concat_2, FragmentD=".png")
concat_4 = Concatenate(FragmentA="icons", FragmentB=sep, FragmentC=concat_2, FragmentD=".svg")
concat_5 = Concatenate(FragmentA=concat_2, FragmentB=".glb")
concat_6 = Concatenate(FragmentA=concat_2, FragmentD="_", FragmentB=join_2)
concat_7 = Concatenate(FragmentA="representations", FragmentB=sep, FragmentC=concat_2, FragmentD=".glb")
concat_8 = Concatenate(FragmentA="representations", FragmentB=sep, FragmentC=concat_2, FragmentD=".3dm")
concat_9 = Concatenate(FragmentA=concat_6, FragmentB=".glb")
concat_10 = Concatenate(FragmentA=concat_6, FragmentB=".3dm")
concat_11 = Concatenate(FragmentD=concat_2, FragmentC="_", FragmentA=panel_3, FragmentB=".3dm")
concat_12 = Concatenate(FragmentA=concat_2, FragmentC="_", FragmentB=panel_3, FragmentD=".glb")
concat_13 = Concatenate(FragmentA="representations", FragmentB=sep, FragmentC=concat_10)
concat_14 = Concatenate(FragmentA="representations", FragmentB=sep, FragmentC=concat_9)
concat_15 = Concatenate(FragmentA="representations", FragmentB=sep, FragmentC=concat_11)
concat_16 = Concatenate(FragmentA="representations", FragmentB=sep, FragmentC=concat_12)
panel_4 = Panel(concat_13)
rep_4 = ModelRepresentation(Url=concat_13, Tags=split.ListB)  # -> Representation, Valid, Url, Description, Tags, Qualities
rep_5 = ModelRepresentation(Url=graft(concat_16), Tags=graft(panel_3))  # -> Representation, Valid, Url, Description, Tags, Qualities
rep_6 = ModelRepresentation(Url=concat_14, Tags=split.ListB)  # -> Representation, Valid, Url, Description, Tags, Qualities
rep_7 = ModelRepresentation(Url=graft(concat_15), Tags=graft(panel_3))  # -> Representation, Valid, Url, Description, Tags, Qualities
rep_8 = ModelRepresentation(Url=concat_7)  # -> Representation, Valid, Url, Description, Tags, Qualities
rep_9 = ModelRepresentation(Url=concat_8)  # -> Representation, Valid, Url, Description, Tags, Qualities
trim = TrimTree(Tree=rep_4.Representation, Depth=1)
trim_2 = TrimTree(Tree=rep_6.Representation, Depth=1)
trim_3 = TrimTree(Tree=rep_7.Representation, Depth=1)
trim_4 = TrimTree(Tree=rep_5.Representation, Depth=1)
merge_3 = Merge(Data1=rep_8.Representation, Data2=rep_9.Representation, Data3=trim, Data4=trim_2, Data5=trim_4, Data6=trim_3)
concat_17 = Concatenate(FragmentA=path_2, FragmentB=sep, FragmentC=concat_16)
concat_18 = Concatenate(FragmentA=path_2, FragmentB=sep, FragmentC=concat_14)
concat_collider_glb = Concatenate(FragmentA=path_2, FragmentB=sep, FragmentC=concat_16)
cluster = Cluster(gr=merge_2)  # -> geo_2, txt_2
typ = ModelType(
    Name=txt.Title,
    Description=description_2,
    Icon=concat_4,
    Image=concat_3,
    Variant=variant_2,
    Representations=merge_3,
    Ports=po_2,
    Authors=authors_2,
    Qualities=qualities_2)  # -> Type, Valid, Name, Description, Icon, Image, Variant, Stock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
geo = ExportGeometry(F=concat_collider_glb, G=collider_2, R=ex_2)  # -> S; inputs G: tree of GeometryBase, R: Boolean
# ---------- geo: C# ----------
// Grasshopper Script Instance
#region Usings
using System;
using System.Linq;
using System.Collections;
using System.Collections.Generic;
using System.Drawing;
using System.IO;

using Rhino;
using Rhino.Geometry;

using Grasshopper;
using Grasshopper.Kernel;
using Grasshopper.Kernel.Data;
using Grasshopper.Kernel.Types;
#endregion

public class Script_Instance : GH_ScriptInstance
{
    #region Notes
    /* 
      Members:
        RhinoDoc RhinoDocument
        GH_Document GrasshopperDocument
        IGH_Component Component
        int Iteration

      Methods (Virtual & overridable):
        Print(string text)
        Print(string format, params object[] args)
        Reflect(object obj)
        Reflect(object obj, string method_name)
    */
    #endregion

    private void RunScript(object F, DataTree<GeometryBase> G, bool R, ref object S)
    {
        // inspired from https://github.com/jhorikawa/GrasshopperProgrammingTutorials/blob/master/0015%20Export%20Geometry%20with%20Grasshopper%20C%23/Export%20Geometry%20with%20Grasshopper%20C%23.gh
        if(R){
            var guids = new List<Guid>();

            for(int i = 0; i < G.BranchCount; i++){
                for(int n = 0; n < G.Branches[i].Count; n++){
                var geom = G.Branches[i][n];
                var guid = Rhino.RhinoDoc.ActiveDoc.Objects.Add(geom);
                guids.Add(guid);
                }
            }

            Rhino.RhinoDoc.ActiveDoc.Objects.Select(guids);

            string cmd = "_-Export " + "\"" + F + "\"" + " _Enter _Enter";

            Rhino.RhinoApp.RunScript(cmd, false);

            Rhino.RhinoDoc.ActiveDoc.Objects.Delete(guids, true);
            S = true;
        }
    }
}
# ---------- end geo ----------
concat_3dm = Concatenate(FragmentA=path_2, FragmentB=sep, FragmentC=concat_13)
geo_2 = ExportGeometry(F=concat_18, G=collider_2, R=ex_2)  # -> S; inputs G: tree of GeometryBase, R: Boolean; same code as geo
geo_3 = ExportGeometry(F=concat_17, G=cluster.geo_2, R=ex_2)  # -> S; inputs G: tree of GeometryBase, R: Boolean; same code as geo
geo_4 = ExportGeometry()  # -> S; inputs G: tree of GeometryBase, R: Boolean; same code as geo
ty = Type(typ.Type)
ba = Text(concat_2)
ty_2 = ClusterOutput(ty)
ba_2 = ClusterOutput(ba)
blc = ExportBlock_3(export=ex_2, ob=group_2)  # -> block_definition_3, path_4, exported_2
blc_2 = ExportBlock_2(path=path_2, gr=group_2, ty=typ.Type, rp=rp_2, export=ex_2)  # -> block_definition_3, path_4, exported_2
blc_3 = ExportBlock_2(path=path_2, export=ex_2)  # -> block_definition_3, path_4, exported_2
geo_5 = ExportGeometry(F=concat_3dm, G=group_2, R=ex_2)  # -> S; inputs G: tree of GeometryBase, R: Boolean; same code as geo

# ==== cluster BoundingRectangle: Get a bounding rectangle on a plane of individual geometry.
geometry = ClusterInput()
plane = ClusterInput()
plane_2 = Plane(plane)
geometry_2 = Geometry(geometry)
bbox = BoundingBox(Content=geometry_2, Plane=plane_2)  # -> Box, Box_2
trim = TrimTree(Tree=bbox.Box, Depth=1)
debox = DeconstructBox(Box=trim)  # -> Plane, X, Y, Z
rectangle = Rectangle(Plane=debox.Plane, XSize=debox.X, YSize=debox.Y, Radius=0)  # -> Rectangle, Length
boundingrectangle = Rectangle(rectangle.Rectangle)
length = Number(rectangle.Length)
length_2 = ClusterOutput(length)
boundingrectangle_2 = ClusterOutput(boundingrectangle)

# ==== cluster ExportBlock_2: Export geometry with layer names to a file.
gr = ClusterInput()
ty = ClusterInput()
export = ClusterInput()
rp = ClusterInput()
path = ClusterInput()
path_2 = FilePath(path)
ty_2 = Type(ty)
rp_2 = Representation(rp)
export_2 = Boolean(export)
cluster = Cluster(gr=gr)  # -> geo_2, txt_2
layer = ModelLayer(Name=cluster.txt_2)  # -> Layer, Name, Hidden, Locked, DisplayColour, Material, Linetype
object = ModelObject(Geometry=cluster.geo_2, Layer=layer.Layer)  # -> Object, Geometry, Name, Layer, Visibility, Display, Drafting, Render
typ = ModelType(Type=ty_2)  # -> Type, Valid, Name, Description, Icon, Image, Variant, Stock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
rep = ModelRepresentation(Representation=rp_2)  # -> Representation, Valid, Url, Description, Tags, Qualities
trim = TrimTree(Tree=object.Object, Depth="5")
concat = Concatenate(FragmentA=typ.Type, FragmentC=":", FragmentB=rep.Representation)
block_definition = ModelBlockDefinition(Objects=trim, Name=concat, Notes=typ.Description)  # -> BlockDefinition, Objects, Units, Name, Notes, URL, URLDescription
export_definition = ExportModelBlockDefinition(BlockDefinition=block_definition.BlockDefinition, FilePath=path_2, Overwrite="T", Export=export_2)  # -> BlockDefinition, FilePath, Exported
block_definition_2 = ModelBlockDefinition(export_definition.BlockDefinition)
path_3 = FilePath(export_definition.FilePath)
exported = Boolean(export_definition.Exported)

# ---- group: Export single files. WIP
sep = Separator()  # -> S
# ---------- sep: C# ----------
#region Usings
using System;
using System.Linq;
using System.Collections;
using System.Collections.Generic;
using System.Drawing;
using System.IO;

using Rhino;
using Rhino.Geometry;

using Grasshopper;
using Grasshopper.Kernel;
using Grasshopper.Kernel.Data;
using Grasshopper.Kernel.Types;
#endregion

public class Script_Instance : GH_ScriptInstance
{
    private void RunScript(ref object S)
    {
        S = Path.DirectorySeparatorChar;
    }
}
# ---------- end sep ----------
rep_2 = ReplaceText(Text=rep.Url, Find="/", Replace=sep, RecursiveReplace=False)
item = ListItem(List=rep.Tags, Index=0, Wrap=True)
concat_2 = Concatenate(FragmentA=path_2, FragmentB=sep, FragmentC=rep_2)
mime = Mime({".glb": "model/gltf-binary", ".gltf": "model/gltf+json", ".stl": "model/stl", ".obj": "model/obj", ".blend": "model/x-blender", ".3dm": "model/vnd.3dm", ".ifc": "model/x-ifc", ".dwg": "model/acad", ".dxf": "model/dxf", ".rvt": "model/vnd.revit"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}, selected=".3dm")
trim_2 = TrimTree(Tree=item, Depth=1)
expression = Expression(x=trim_2, y=mime, Expression="x=y")
# WIP
dispatch = Dispatch(List=concat_2, DispatchPattern=expression)  # -> ListA, ListB
dispatch_2 = Dispatch(List=concat_2, DispatchPattern=expression)  # -> ListA, ListB

# ----
exported_2 = ClusterOutput(exported)
path_4 = ClusterOutput(path_3)
block_definition_3 = ClusterOutput(block_definition_2)

# ==== cluster ExportBlock_3: Export geometry with layer names to a file.
ob = ClusterInput()
G = ClusterInput()
dc = ClusterInput()
path = ClusterInput()
name = ClusterInput()
url = ClusterInput()
layer_n = ClusterInput()
export = ClusterInput()
ob_2 = ModelObject(ob)
group = Group(Geometry=G)
path_2 = FilePath(path)
name_2 = Text(name)
url_2 = Text(url)
export_2 = Boolean(export)
layer_n_2 = Name(layer_n)
dc_2 = DisplayColour(dc)
object = ModelObject(Object=group)  # -> Object, Geometry, Name, Layer, Visibility, Display, Drafting, Render
layer = ModelLayer(Name=layer_n_2, DisplayColour=dc_2)  # -> Layer, Name, Hidden, Locked, DisplayColour, Material, Linetype, PrintColour, PrintWidth
object_2 = ModelObject(group)
group_2 = NamedGroup(Geometry=group)  # -> Group, Geometry, Name
object_3 = ModelObject(Geometry=object_2, Layer=layer.Layer)  # -> Object, Geometry, Name, Layer, Visibility, Display, Drafting, Render
object_4 = ModelObject(Object=object_2)  # -> Object, Geometry, Name, Layer, Visibility, Display, Drafting, Render
block_definition = ModelBlockDefinition(Objects=object_3.Object, Name=name_2, URL=url_2)  # -> BlockDefinition, Objects, Units, Name, Notes, URL, URLDescription
panel = Panel(object_4.Layer)
export_definition = ExportModelBlockDefinition(BlockDefinition=block_definition.BlockDefinition, FilePath=path_2, Overwrite="T", Export=export_2)  # -> BlockDefinition, FilePath, Exported
block_definition_2 = ModelBlockDefinition(export_definition.BlockDefinition)
path_3 = FilePath(export_definition.FilePath)
exported = Boolean(export_definition.Exported)
path_4 = ClusterOutput(path_3)
exported_2 = ClusterOutput(exported)
block_definition_3 = ClusterOutput(block_definition_2)

# ==== cluster Cluster
gr = ClusterInput()
gr_2 = Group(gr)
group = NamedGroup(Group=gr_2)  # -> Group, Geometry, Name
group_2 = NamedGroup(Group=group.Geometry)  # -> Group, Geometry, Name
expression = Expression(x=graft(group.Name), y=group_2.Name, Expression="x")
group_3 = NamedGroup(Group=group_2.Geometry)  # -> Group, Geometry, Name
expression_2 = Expression(x=graft(expression), y=group_3.Name, Expression="x")
expression_3 = Expression(x=graft(group_2.Name), y=group_3.Name, Expression="x")
group_4 = NamedGroup(Group=group_3.Geometry)  # -> Group, Geometry, Name
expression_4 = Expression(x=graft(expression_2), y=group_4.Name, Expression="x")
expression_5 = Expression(x=graft(expression_3), y=group_4.Name, Expression="x")
expression_6 = Expression(x=graft(group_3.Name), y=group_4.Name, Expression="x")
group_5 = NamedGroup(Group=group_4.Geometry)  # -> Group, Geometry, Name
expression_7 = Expression(x=graft(expression_4), y=group_5.Name, Expression="x")
expression_8 = Expression(x=graft(expression_5), y=group_5.Name, Expression="x")
expression_9 = Expression(x=graft(expression_6), y=group_5.Name, Expression="x")
expression_10 = Expression(x=graft(group_4.Name), y=group_5.Name, Expression="x")
group_6 = NamedGroup(Group=group_5.Geometry)  # -> Group, Geometry, Name
expression_11 = Expression(x=graft(expression_7), y=group_6.Name, Expression="x")
expression_12 = Expression(x=graft(expression_9), y=group_6.Name, Expression="x")
expression_13 = Expression(x=graft(expression_8), y=group_6.Name, Expression="x")
expression_14 = Expression(x=graft(expression_10), y=group_6.Name, Expression="x")
expression_15 = Expression(x=graft(group_5.Name), y=group_6.Name, Expression="x")
merge = Merge(
    Data1=expression_11,
    Data2=expression_13,
    Data3=expression_12,
    Data4=expression_14,
    Data5=expression_15,
    Data6=group_6.Name)
join = TextJoin(Text=merge, Join="::")
geo = Geometry(group_6.Geometry)
txt = Text(join)
geo_2 = ClusterOutput(geo)
txt_2 = ClusterOutput(txt)
