# Grasshopper definition capsule-with-balcony.gh (Grasshopper 1.0.8)
# Copyright: GNU Lesser General Public License Version 3
# plug-ins: RhinoCodePluginGH, semio

variant = Slider(0, range=0..7)
save_representation = BooleanToggle(False)
icon_export = BooleanToggle(False)
validate = BooleanToggle(False)
save = BooleanToggle(False)
panel = Panel("""\
/
q
p
J
L
s
z""")
sep = Separator()  # -> S
# ---------- sep: C# ----------
#region Usings
using System;
using System.Linq;
using System.Collections;
using System.Collections.Generic;
using System.Drawing;
using System.IO;

using Rhino;
using Rhino.Geometry;

using Grasshopper;
using Grasshopper.Kernel;
using Grasshopper.Kernel.Data;
using Grasshopper.Kernel.Types;
#endregion

public class Script_Instance : GH_ScriptInstance
{
    private void RunScript(ref object S)
    {
        S = Path.DirectorySeparatorChar;
    }
}
# ---------- end sep ----------
dir = Directory()  # -> D
# ---------- dir: C# ----------
#region Usings
using System;
using System.Linq;
using System.Collections;
using System.Collections.Generic;
using System.Drawing;
using System.IO;

using Rhino;
using Rhino.Geometry;

using Grasshopper;
using Grasshopper.Kernel;
using Grasshopper.Kernel.Data;
using Grasshopper.Kernel.Types;
#endregion

public class Script_Instance : GH_ScriptInstance
{
    private void RunScript(ref object D)
    {
        D = Path.GetDirectoryName(this.GrasshopperDocument.FilePath);
    }
}
# ---------- end dir ----------
and = GateAnd(A=save, B=save_representation)
and_2 = GateAnd(A=save, B=icon_export)
loop_slider = PythonScript(SliderToModify=variant, Min="0", Max="7", stepSize="1", Delay=Slider(0, range=0..1), Run=Toggle(False), Reset=Button())  # inputs Run: Boolean, Reset: Boolean
# ---------- loop_slider: Python ----------
import time

def updateSliderInput(inputName,min,max,value,decimalPlace=2):
    for input in ghenv.Component.Params.Input:
        for source in input.Sources:
            if input.Name == str(inputName):
                source.Slider.DecimalPlaces = decimalPlace
                source.Slider.Minimum = min
                source.Slider.Maximum = max
                source.Slider.Value = value
                source.ExpireSolution(True)

def countDecimal(number):
    string= str(number)
    return string[::-1].find('.')

if Run == True:
    if SliderToModify < Max:
        time.sleep(Delay)
        updateSliderInput("SliderToModify",Min,Max,SliderToModify+stepSize,countDecimal(stepSize))
if Reset == True:
    updateSliderInput("SliderToModify",Min,Max,Min)
# ---------- end loop_slider ----------
# ^                                    ^
#    |                                     |
# <-- Constants    Preview -->
# Parameters    External    Local -->
# <-- Meta               |
#      |                       v
#      v
par = ParentDirectory(D=dir)  # -> P; inputs D: String
# ---------- par: C# ----------
#region Usings
using System;
using System.Linq;
using System.Collections;
using System.Collections.Generic;
using System.Drawing;
using System.IO;

using Rhino;
using Rhino.Geometry;

using Grasshopper;
using Grasshopper.Kernel;
using Grasshopper.Kernel.Data;
using Grasshopper.Kernel.Types;
#endregion

public class Script_Instance : GH_ScriptInstance
{
    private void RunScript(string D, ref object P)
    {
        P = new DirectoryInfo(D).Parent;
    }
}
# ---------- end par ----------
item = ListItem(List=panel, Index=variant, Wrap=True)
panel_2 = Panel(item)
variant_2 = GetString(item, AtLeast=0, AtMost=1, TreeAccess=False)
itemindex = ItemIndex(L=panel, I=variant_2)  # -> i; inputs L: list
# ---------- itemindex: Python ----------
#Component Information
#--------------------------------------------------------------------------------------------
if ghenv.Component.RunCount<2:
    #General
    #--------------------------------------------------------------------------------------------
    __author__ = "Ueli Saluz"
    __version__ = "2022.11.18"
    
    ghenv.Component.Name = "ItemIndex"
    ghenv.Component.NickName = "ItemIndex"
    ghenv.Component.Description = "A better IdemIndex"
    ghenv.Component.Message = "VER 1.0"
    ghenv.Component.Category = "Set"
    ghenv.Component.SubCategory = "List"
    
     #Inputs
    #--------------------------------------------------------------------------------------------
    inputIndex=0
    
    ghenv.Component.Params.Input[inputIndex].Name = "List"
    ghenv.Component.Params.Input[inputIndex].NickName = "L"
    ghenv.Component.Params.Input[inputIndex].Description = "Input1 is..."
    ghenv.Component.Params.Input[inputIndex].Optional = False
    inputIndex+=1
    
    ghenv.Component.Params.Input[inputIndex].Name = "Item"
    ghenv.Component.Params.Input[inputIndex].NickName = "I"
    ghenv.Component.Params.Input[inputIndex].Description = "Input2 is..."
    ghenv.Component.Params.Input[inputIndex].Optional = False
    inputIndex+=1
    
    #Outputs
    #--------------------------------------------------------------------------------------------
    outputIndex=0
    
    ghenv.Component.Params.Output[outputIndex].Name = "Index"
    ghenv.Component.Params.Output[outputIndex].NickName = "i"
    ghenv.Component.Params.Output[outputIndex].Description = "Output1 is..."
    outputIndex+=1

i = L.index(I)
# ---------- end itemindex ----------
zoom = Button()
panel_3 = Panel("""backslash
slash
q
p
J
L
s
z""")
item_2 = ListItem(List=panel_3, Index=itemindex, Wrap=True)
merge = Merge(Data1="front", Data2="front", Data3="side", Data4="side", Data5="front", Data6="front", Data7="side", Data8="side")
merge_2 = Merge(Data1="F", Data2="T", Data3="F", Data4="T", Data5="F", Data6="T", Data7="F", Data8="T")
merge_3 = Merge(Data1="back", Data2="back", Data3="back", Data4="back", Data5="side", Data6="side", Data7="side", Data8="side")
list = ValueList({"Back": "back", "Side": "side"}, selected="Back")
item_3 = ListItem(List=merge_3, Index=itemindex, Wrap=True)
toggle = BooleanToggle(False)
item_4 = ListItem(List=merge_2, Index=itemindex, Wrap=True)
list_2 = ValueList({"Front", "Side"}, selected="Front")
item_5 = ListItem(List=merge, Index=itemindex, Wrap=True)
expression = Expression(x=Slider(420, range=0..1000), Expression="x/100")
expression_2 = Expression(x=Slider(260, range=0..1000), Expression="x/100")
expression_3 = Expression(x=Slider(250, range=0..1000), Expression="x/100")
entrance = Text(item_3)
view = Text(item_5)
mirror = Boolean(item_4)
room_width_m = Number(expression_2)
room_length_m = Number(expression)
height_m = Number(expression_3)
list_3 = ValueList({"Round": "round", "Rectangular": "rectangular"}, selected="Round")
panel_4 = Panel("""round
rectangular""")

filter = StreamFilter(Gate=mirror, Stream1=" It is mirrored compared to the normal one.")
concat = Concatenate(
    FragmentA="An apartment capsule of the variant ",
    FragmentG=variant_2,
    FragmentH=" with a balcony for one person. It has the entrance on the",
    FragmentB=entrance,
    FragmentC=" and has the view to the ",
    FragmentD=view,
    FragmentF=".",
    FragmentE=filter)

panel_5 = Panel("""front
side""")
panel_6 = Panel("""back
side""")
_2d = _2D(x=room_length_m)
_2d_2 = _2D(x=room_width_m)
expression_4 = Expression(x=Slider(20, range=0..100), Expression="x/100")
expression_5 = Expression(x=Slider(25, range=0..100), Expression="x/100")
mirrored = Boolean(mirror)
expression_6 = Expression(x=Slider(30, range=0..100), Expression="x/100")
expression_7 = Expression(x=Slider(65, range=0..100), Expression="x/100")
itemindex_2 = ItemIndex(L=panel_6, I=entrance)  # -> i; inputs L: list; same code as itemindex
itemindex_3 = ItemIndex(L=panel_5, I=view)  # -> i; inputs L: list; same code as itemindex
fillet_radius_m = Number(expression_5)
shellthickness_m = Number(expression_4)
subtraction = Subtraction(A=height_m, B=shellthickness_m)
neg = Negative(Value=shellthickness_m)
dom = ConstructDomain(DomainStart=neg, DomainEnd=subtraction)
rectangle = Rectangle(Plane=PlaneXY(0, 0, 0), XSize=_2d, YSize=_2d_2, Radius=0)  # -> Rectangle, Length
area = Area(Geometry=rectangle.Rectangle)  # -> Area, Centroid
box = DomainBox(Base=PlaneXY(0, 0, 0), X=_2d_2, Y=_2d, Z=dom)
window_offset_wall_m = Number(expression_6)
window_shape = Text(list_3)
itemindex_4 = ItemIndex(L=panel_4, I=window_shape)  # -> i; inputs L: list; same code as itemindex
window_circle_radius_m = Number(expression_7)
valueor0 = ValueOr0(value=itemindex_2)
valueor0_2 = ValueOr0(value=itemindex_3)
valueor0_3 = ValueOr0(value=itemindex_4)
volume1to500 = Box(box)
entrance_2 = Integer(valueor0)
entrance_3 = Integer(entrance_2)
multiplication = Multiplication(A=entrance_3, B="4")
windowshape = Integer(valueor0_3)
view_2 = Integer(valueor0_2)
view_3 = Integer(view_2)
multiplication_2 = Multiplication(A=view_3, B="2")
addition = Addition(A=multiplication, B=multiplication_2, C=mirrored)
variant_3 = Integer(addition)
debrep = DeconstructBrep(Brep=volume1to500)  # -> Faces, Edges, Vertices

panel_7 = Panel("""6f52c1e6b1
45ab357369
e6c366306e
f16baa9eba
9442aab847
29526c7d12
b3a9105a14
ff37b776dd
b7243eed93
5004160f7d
b8c26ca1c9
a6e1f7d736
0da1e26dff
a3b1c730a1
c696cc23a3
532cc5697c""")
dup = DuplicateData(Data="2", Number="8", Order=True)
concat_2 = Concatenate(FragmentA="https://app.speckle.systems/projects/e7de1a2f8f/models/", FragmentB=panel_7)
trim = TrimTree(Tree=dup, Depth=1)
partition = PartitionList(List=concat_2, Size=trim)
tstat = TreeStatistics(Tree=partition)  # -> Paths, Length, Count
item_6 = ListItem(List=flatten(tstat.Paths), Index=variant_3, Wrap=True)
branch = TreeBranch(Tree=partition, Path=item_6, MaintainPaths=True)
item_7 = ListItem(List=flatten(branch), Index=0, Wrap=True)  # -> Item, Item1

bool = Boolean(invert(mirror))
trim_2 = TrimTree(Tree=debrep.Edges, Depth=1)
trim_3 = TrimTree(Tree=debrep.Faces, Depth=1)
filter_2 = StreamFilter(Gate=entrance_2, Stream0=mirror, Stream1=bool)
# 2023-2025 Ueli Saluz
# 2025 Elduane Lumpine
# 2025 Christian Hötdke
# Permission is hereby granted, free of charge, to any person obtaining a copy
# of this Grasshopper file and associated documentation files (the "Document"),
# to deal in the Document without restriction, including without limitation the
# rights to use, copy, modify, merge, publish, distribute, sublicense, and/or sell
# copies of the Document, and to permit persons to whom the Document is
# furnished to do so.
# 
# Individual clusters used inside this document might be licensed under
# different terms. This is indicated through a similar copyright notice group
# inside the cluster and otherwise in the license field of the cluster. If you
# have any question please reach out to us: license@semio-tech.com
# 
# THE DOCUMENT IS PROVIDED "AS IS", WITHOUT WARRANTY OF ANY
# KIND, EXPRESS OR IMPLIED, INCLUDING BUT NOT LIMITED TO THE
# WARRANTIES OF MERCHANTABILITY, FITNESS FOR A PARTICULAR
# PURPOSE AND NONINFRINGEMENT. IN NO EVENT SHALL THE
# AUTHORS OR COPYRIGHT HOLDERS BE LIABLE FOR ANY CLAIM,
# DAMAGES OR OTHER LIABILITY, WHETHER IN AN ACTION OF
# CONTRACT, TORT OR OTHERWISE, ARISING FROM, OUT OF OR IN
# CONNECTION WITH THE DOCUMENT OR THE USE OR OTHER
# DEALINGS IN THE DOCUMENT.
expression_8 = Expression(x=Slider(150, range=70..150), Expression="x/100")
expression_9 = Expression(x=Slider(110, range=70..150), Expression="x/100")
expression_10 = Expression(x=Slider(10, range=3..10), Expression="x/100")
item_8 = ListItem(List=trim_3, Index=0, Wrap=True)  # -> Item, Item1, Item2, Item3, Item4, Item5
mirror_2 = Boolean(filter_2)
mirrored_2 = Boolean(mirror_2)
addition_2 = Addition(A=multiplication, B=multiplication_2, C=mirrored_2)
oldvariant = Integer(addition_2)
railing_count_front = Integer(Slider(3, range=0..10))
balkony_depth_m = Number(expression_8)
window_frame_m = Number(expression_10)

addition_3 = Addition(A=shellthickness_m, B=window_frame_m)
filter_3 = StreamFilter(Gate=mirror_2, Stream0=item_8.Item3, Stream1=item_8.Item1)
merge_4 = Merge(Data1=shellthickness_m, Data2=addition_3)
filter_4 = StreamFilter(Gate=view_2, Stream0=item_8.Item2, Stream1=filter_3)
neg_2 = Negative(Value=merge_4)
offset = OffsetCurve(Curve=filter_4, Distance=neg_2, Corners=1)
trim_4 = TrimTree(Tree=offset, Depth=1)
simplify = SimplifyCurve(Curve=trim_4)  # -> Curve, Simplified
loft = Loft(Curves=simplify.Curve, Options={Adjust=False, Closed=False, LoftEnds=0, LoftSimp=0, LoftType=0, Rebuild=10, Refit=0.01})
item_9 = ListItem(List=simplify.Curve, Index=0, Wrap=True)  # -> Item, Item1
window_frame_1to200 = Brep(loft)
window_1to200 = Surface(item_9.Item1)
window_1to500 = Brep(item_9.Item)

balkony_height_m = Number(expression_9)
railing_count_side = Integer(Slider(5, range=0..10))

aut = ModelAuthor(Name="Ueli Saluz", Email="ueli@semio-tech.org")  # -> Author, Valid, Name, Email

lng = ListLength(List=debrep.Edges)
series = Series(Start=0, Step=1, Count=lng)
trim_5 = TrimTree(Tree=series, Depth=1)
filedge = FilletEdge(Shape=volume1to500, Blend=0, Metric=0, Edges=trim_5, Radii=fillet_radius_m)
trim_6 = TrimTree(Tree=filedge, Depth=1)

expression_11 = Expression(x=Slider(80, range=0..100), Expression="x/100")
expression_12 = Expression(x=Slider(200, range=0..1000), Expression="x/100")
expression_13 = Expression(x=Slider(25, range=0..100), Expression="x/100")
door_width_m = Number(expression_11)
door_offset_wall_m = Number(expression_13)
door_height_m = Number(expression_12)

item_10 = ListItem(List=trim_2, Index=0, Wrap=True)  # -> Item, Item1, Item2, Item3
flip = FlipCurve(Curve=item_10.Item)  # -> Curve, Flag
filter_5 = StreamFilter(Gate=mirror_2, Stream0=flip.Curve, Stream1=item_10.Item)
filter_6 = StreamFilter(Gate=mirror_2, Stream0=item_8.Item1, Stream1=item_8.Item3)
filter_7 = StreamFilter(Gate=entrance_2, Stream0=filter_5, Stream1=item_10.Item1)
filter_8 = StreamFilter(Gate=entrance_2, Stream0=item_8.Item, Stream1=filter_6)
addition_4 = Addition(A=door_offset_wall_m, B=shellthickness_m)
eval = EvaluateLength(Curve=filter_7, Length=addition_4, Normalized=False)  # -> Point, Tangent, Parameter
srf_cp = SurfaceClosestPoint(Point=eval.Point, Surface=filter_8)  # -> Point, UVPoint, Distance
evalsrf = EvaluateSurface(Surface=filter_8, Point=srf_cp.UVPoint)  # -> Point, Normal, UDirection, VDirection, Frame
neg_3 = Negative(Value=door_width_m)
filter_9 = StreamFilter(Gate=entrance_2, Stream0=neg_3, Stream1=door_width_m)
filter_10 = StreamFilter(Gate=mirror_2, Stream0=filter_9, Stream1=door_width_m)
and_3 = GateAnd(A=entrance_2, B=mirror_2)
filter_11 = StreamFilter(Gate=and_3, Stream0=filter_10, Stream1=neg_3)
rectangle_2 = Rectangle(Plane=evalsrf.Frame, XSize=filter_11, YSize=door_height_m, Radius=0)  # -> Rectangle, Length
Z = UnitZ(Factor=shellthickness_m)
move = Move(Geometry=rectangle_2.Rectangle, Motion=Z)  # -> Geometry, Transform
door = Rectangle(move.Geometry)

flip_2 = FlipCurve(Curve=item_10.Item1)  # -> Curve, Flag
expression_14 = Expression(x=height_m, Expression="x/2")
filter_12 = StreamFilter(Gate=mirror_2, Stream0=item_10.Item3, Stream1=flip_2.Curve)
addition_5 = Addition(A=window_circle_radius_m, B=window_offset_wall_m, C=shellthickness_m)
Z_2 = UnitZ(Factor=expression_14)
filter_13 = StreamFilter(Gate=mirror_2, Stream0=item_8.Item3, Stream1=item_8.Item1)
eval_2 = EvaluateLength(Curve=filter_12, Length=addition_5, Normalized=False)  # -> Point, Tangent, Parameter
evalsrf_2 = EvaluateSurface(Surface=reparameterize(filter_13), Point="0.5,0.5")  # -> Point, Normal, UDirection, VDirection, Frame
move_2 = Move(Geometry=eval_2.Point, Motion=Z_2)  # -> Geometry, Transform
evalsrf_3 = EvaluateSurface(Surface=reparameterize(item_8.Item2), Point="0.5,0.5")  # -> Point, Normal, UDirection, VDirection, Frame
pl_origin = PlaneOrigin(Base=evalsrf_2.Frame, Origin=move_2.Geometry)
expression_15 = Expression(x=window_circle_radius_m, Expression="x*2")
filter_14 = StreamFilter(Gate=view_2, Stream0=evalsrf_3.Frame, Stream1=pl_origin)
_2d_3 = _2D(x=expression_15)
rectangle_3 = Rectangle(Plane=filter_14, XSize=_2d_3, YSize=_2d_3, Radius=0)  # -> Rectangle, Length
cir = Circle(Plane=filter_14, Radius=window_circle_radius_m)
filter_15 = StreamFilter(Gate=windowshape, Stream0=cir, Stream1=rectangle_3.Rectangle)
window = Geometry(filter_15)
windowplane = Plane(filter_14)

windowplane_2 = Plane(windowplane)
deplane = DeconstructPlane(Plane=windowplane_2)  # -> Origin, XAxis, YAxis, ZAxis
expression_16 = Expression(x=shellthickness_m, Expression="x/3")
neg_4 = Negative(Value=deplane.ZAxis)
amp = Amplitude(Vector=neg_4, Amplitude=expression_16)
extr = Extrude(Base=window, Direction=amp)
cap = CapHoles(Brep=extr)

panel_8 = Panel("Parallel")  # disabled
m2d_rhino = Make2DRhinoView(Name=panel_8, Clip=True)  # disabled
number_slider = Slider(876, range=0..1000)  # disabled
view_rectangle = ViewRectangle(view=m2d_rhino)  # disabled

srf = Surface(item_8.Item)
srf_2 = Surface(item_8.Item1)
srf_3 = Surface(item_8.Item3)
srf_4 = Surface(item_8.Item2)
srf_5 = Surface(item_8.Item4)
srf_6 = Surface(item_8.Item5)
mirrored_3 = Boolean(mirror_2)
mirrored_4 = Boolean(mirror_2)
filter_16 = StreamFilter(Gate=mirrored_3, Stream0=srf_2, Stream1=srf_3)
filter_17 = StreamFilter(Gate=mirrored_4, Stream0=srf_3, Stream1=srf_2)
merge_5 = Merge(Data1=srf_2, Data2=srf_3)
merge_6 = Merge(Data1=srf_2, Data2=srf)
merge_7 = Merge(Data1=srf, Data2=srf_4)
merge_8 = Merge(Data1=srf_2, Data2=srf_4)
merge_9 = Merge(Data1=srf_3, Data2=srf_4)
merge_10 = Merge(Data1=srf, Data2=srf_3)
entrance_4 = Integer(entrance_2)
window_2 = Integer(view_2)
filter_18 = StreamFilter(Gate=entrance_4, Stream0=srf, Stream1=filter_16)
filter_19 = StreamFilter(Gate=window_2, Stream0=srf_4, Stream1=filter_17)
filter_20 = StreamFilter(
    Gate=oldvariant,
    Stream0=merge_5,
    Stream1=merge_5,
    Stream2=merge_8,
    Stream3=merge_9,
    Stream4=merge_10,
    Stream5=merge_6,
    Stream6=merge_7,
    Stream7=merge_7)

previewplane = PreviewPlane(plane=view_rectangle, axis_length=number_slider)  # disabled
construction_area_factor = Number(Slider(0.2, range=0..1))
construction_cost_eff_m² = Number(Slider(9500, range=0..20000))
income_month_eff_m² = Number(Slider(125, range=0..200))
maintenance_expenses_month_eff_m² = Number(Slider(10, range=0..30))

door_2 = Rectangle(door)
explode = Explode(Curve=door, Recursive=True)  # -> Segments, Vertices
trim_7 = TrimTree(Tree=explode.Segments, Depth=1)
item_11 = ListItem(List=trim_7, Index=0, Wrap=True)  # -> Item, Item1, Item2, Item3
eval_3 = EvaluateCurve(Curve=reparameterize(item_11.Item), Parameter="0.5")  # -> Point, Tangent, Angle
rev = Reverse(Vector=eval_3.Tangent)
Z_3 = UnitZ(Factor=1)
xprod = CrossProduct(VectorA=eval_3.Tangent, VectorB=Z_3, Unitize=False)  # -> Vector, Length
xprod_2 = CrossProduct(VectorA=rev, VectorB=Z_3, Unitize=False)  # -> Vector, Length
pl = ConstructPlane(Origin=eval_3.Point, XAxis=eval_3.Tangent, YAxis=xprod_2.Vector)
doorentranceplane = Plane(pl)

doorentranceplane_2 = Plane(doorentranceplane)
deplane_2 = DeconstructPlane(Plane=doorentranceplane_2)  # -> Origin, XAxis, YAxis, ZAxis
amp_2 = Amplitude(Vector=deplane_2.YAxis, Amplitude=shellthickness_m)
extr_2 = Extrude(Base=door, Direction=amp_2)
move_3 = Move(Geometry=door, Motion=amp_2)  # -> Geometry, Transform
cap_2 = CapHoles(Brep=extr_2)
door_3 = Surface(move_3.Geometry)

merge_11 = Merge(Data1=cap_2, Data2=cap)
sdiff = SolidDifference(BrepsA=trim_6, BrepsB=merge_11)
volume1to200 = Brep(sdiff)
merge_12 = Merge(Data1=door, Data2=window)
merge_13 = Merge(Data1=filter_18, Data2=filter_19)
sdiff_2 = SolidDifference(BrepsA=merge_13, BrepsB=merge_12)
heating_energy_demand_kwh_m²a = Number(Slider(45, range=0..200))
cooling_energy_demand_kwh_m²a = Number(Slider(30, range=0..200))
technical_equipment_energy_demand_kwh_m² = Number(Slider(30, range=0..200))  # "Technical Equipment Energy Demand[kWh/m²a]"
construction_global_warming_potential_kg = Number(Slider(1000, range=0..2000))  # "Construction Global Warming Potential [kgCO2e/eff. m²]"
merge_14 = Merge(Data1=srf_5, Data2=filter_20, Data3=sdiff_2, Data4=srf_6)
shell = Surface(merge_14)

addition_6 = Addition(A=room_length_m, B=balkony_depth_m)
addition_7 = Addition(A=balkony_depth_m, B=room_width_m)
construction_area_factor_2 = Number(construction_area_factor)
maintenance_expenses_month_eff_m²_2 = Number(maintenance_expenses_month_eff_m²)
# Outputs   ->
#                 |
#                 v
construction_global_warming_potential_kg_2 = Number(construction_global_warming_potential_kg)  # "Construction Global Warming Potential [kgCO2e/eff. m²]"
filter_21 = StreamFilter(Gate=view_2, Stream0=room_width_m, Stream1=addition_7)
technical_equipment_energy_demand_kwh_m²_2 = Number(technical_equipment_energy_demand_kwh_m²)  # "Technical Equipment Energy Demand[kWh/m²a]"
income_month_eff_m²_2 = Number(income_month_eff_m²)
expression_17 = Expression(x=construction_area_factor_2, Expression="1-x")
heating_energy_demand_kwh_m²a_2 = Number(heating_energy_demand_kwh_m²a)
cooling_energy_demand_kwh_m²a_2 = Number(cooling_energy_demand_kwh_m²a)
construction_cost_eff_m²_2 = Number(construction_cost_eff_m²)
multiplication_3 = Multiplication(A=area.Area, B=expression_17)
multiplication_4 = Multiplication(A=multiplication_3, B=income_month_eff_m²_2)
multiplication_5 = Multiplication(A=multiplication_3, B=maintenance_expenses_month_eff_m²_2)
expression_18 = Expression(x=multiplication_4, Expression="x*12")
expression_19 = Expression(x=multiplication_5, Expression="x*12")
multiplication_6 = Multiplication(A=multiplication_3, B=construction_global_warming_potential_kg_2)
multiplication_7 = Multiplication(A=heating_energy_demand_kwh_m²a_2, B=multiplication_3)
multiplication_8 = Multiplication(A=cooling_energy_demand_kwh_m²a_2, B=multiplication_3)
multiplication_9 = Multiplication(A=multiplication_3, B=construction_cost_eff_m²_2)
multiplication_10 = Multiplication(A=technical_equipment_energy_demand_kwh_m²_2, B=multiplication_3)
round = Round(Number=multiplication_9)  # -> Nearest, Floor, Ceiling
roundmult = RoundToMultiple(N=multiplication_6, M="0.01")  # -> R; inputs N: tree, M: tree
# ---------- roundmult: Python ----------
#Component Information
#--------------------------------------------------------------------------------------------
if ghenv.Component.RunCount<2:
    #General
    #--------------------------------------------------------------------------------------------
    __author__ = "YOUR NAME"
    __version__ = "2000.00.00"
    
    ghenv.Component.Name = "Round to Multiple"
    ghenv.Component.NickName = "RoundMult"
    ghenv.Component.Description = "Rounds a number to the nearest specified multiple."
    ghenv.Component.Message = "VER 1.0"
    ghenv.Component.Category = "Math"
    ghenv.Component.SubCategory = "Arithmetic"
    
     #Inputs
    #--------------------------------------------------------------------------------------------
    inputIndex=0
    
    ghenv.Component.Params.Input[inputIndex].Name = "Number"
    ghenv.Component.Params.Input[inputIndex].NickName = "N"
    ghenv.Component.Params.Input[inputIndex].Description = "Number to round."
    ghenv.Component.Params.Input[inputIndex].Optional = False
    inputIndex+=1
    
    ghenv.Component.Params.Input[inputIndex].Name = "Multiple"
    ghenv.Component.Params.Input[inputIndex].NickName = "M"
    ghenv.Component.Params.Input[inputIndex].Description = "Multiple to round to."
    ghenv.Component.Params.Input[inputIndex].Optional = False
    inputIndex+=1
    
    #Outputs
    #--------------------------------------------------------------------------------------------
    outputIndex=0
    
    ghenv.Component.Params.Output[outputIndex].Name = "Rounded"
    ghenv.Component.Params.Output[outputIndex].NickName = "R"
    ghenv.Component.Params.Output[outputIndex].Description = "Number rounded to the nearest specified multiple."
    outputIndex+=1


#Imports
#--------------------------------------------------------------------------------------------
from System import Object
from Grasshopper import DataTree
import math


#The Component function - Business logic only (e.g. working without trees)
#--------------------------------------------------------------------------------------------
"""Function that this component is computing.
    Inputs:
        number: The number to round.
        multiple: The multiple to round to.
    Output:
        rounded: The number rounded to the nearest specified multiple."""
def RoundToMultiple(number, multiple):
    rounded = math.ceil(number / multiple) * multiple
    return rounded

#Solver - Run with trees to enhance performance drastically
#--------------------------------------------------------------------------------------------
if __name__ == "__main__":
    
    #Initialize trees
    #--------------------------------------------------------------------------------------------
    RoundedTree = DataTree[Object]()
    
    #Data matching
    #--------------------------------------------------------------------------------------------
    for path in N.Paths:
        numberBranch = N.Branch(path)
        for i, number in enumerate(numberBranch):
            multiple = M.Branch(path)[i]
            rounded = RoundToMultiple(number, multiple)
            RoundedTree.Add(rounded, path)
    
     #Assign trees to output
    #--------------------------------------------------------------------------------------------
    R = RoundedTree
# ---------- end roundmult ----------
round_2 = Round(Number=multiplication_7)  # -> Nearest, Floor, Ceiling
round_3 = Round(Number=multiplication_8)  # -> Nearest, Floor, Ceiling
round_4 = Round(Number=multiplication_10)  # -> Nearest, Floor, Ceiling
round_5 = Round(Number=expression_18)  # -> Nearest, Floor, Ceiling
round_6 = Round(Number=expression_19)  # -> Nearest, Floor, Ceiling
panel_9 = Panel("""https://search.bsdd.buildingsmart.org/uri/buildingsmart/ifc/4.3/prop/Length
https://search.bsdd.buildingsmart.org/uri/buildingsmart/ifc/4.3/prop/Width
https://search.bsdd.buildingsmart.org/uri/buildingsmart/ifc/4.3/prop/Height

https://identifier.buildingsmart.org/uri/buildingsmart/ifc/4.3/prop/NetFloorArea

https://identifier.buildingsmart.org/uri/buildingsmart/ifc/4.3/prop/EnergyConsumption
https://identifier.buildingsmart.org/uri/buildingsmart/ifc/4.3/prop/EnergyConsumption
https://identifier.buildingsmart.org/uri/buildingsmart/ifc/4.3/prop/EnergyConsumption


https://identifier.buildingsmart.org/uri/etim/etim/9.0/prop/EF016979 """)
panel_10 = Panel("""entrance
view
length
width
heigth
window shape
effective floor area
construction cost
heating energy demand
cooling energy demand
technical equipment energy demand
income
maintenance expenses
construction global warming potential""")
panel_11 = Panel("""m
m
m

m²
€
kWh/a
kWh/a
kWh/a
€/a
€/a
kgCO2e""")
filter_22 = StreamFilter(Gate=mirror, Stream1="mirrored")

filter_23 = StreamFilter(Gate=view_2, Stream0=addition_6, Stream1=room_length_m)

mime = ValueList({".stl": "model/stl", ".obj": "model/obj", ".glb": "model/gltf-binary", ".gltf": "model/gltf+json", ".3dm": "model/vnd.3dm", ".speckle": "model/vnd.speckle+json", ".png": "image/png", ".jpg": "image/jpeg", ".jpeg": "image/jpeg", ".svg": "image/svg+xml", ".pdf": "application/pdf", ".zip": "application/zip", ".json": "application/json", ".csv": "text/csv", ".txt": "text/plain"}, selected=".speckle")
concat_3 = Concatenate(FragmentC="capsule-with-balcony", FragmentD="_", FragmentA=item_2)
concat_4 = Concatenate(FragmentA=concat_3, FragmentB="_", FragmentE="1to500")
concat_5 = Concatenate(FragmentA=concat_3, FragmentB="_", FragmentE="1to200")
concat_6 = Concatenate(FragmentC="representations", FragmentD=sep, FragmentA=concat_3)
concat_7 = Concatenate(FragmentC="representations", FragmentD=sep, FragmentA=concat_4)
concat_8 = Concatenate(FragmentC="representations", FragmentD=sep, FragmentA=concat_5)
concat_9 = Concatenate(FragmentA=concat_6, FragmentB=".glb")
concat_10 = Concatenate(FragmentA=concat_7, FragmentB=".3dm")
concat_11 = Concatenate(FragmentA=concat_8, FragmentB=".3dm")
rep = ModelRepresentation(Validate=validate, Url=concat_9)  # -> Representation, Valid, Url, Description, Tags, Qualities
rep_2 = ModelRepresentation(Validate=validate, Url=concat_10, Tags="1to500")  # -> Representation, Valid, Url, Description, Tags, Qualities
rep_3 = ModelRepresentation(Validate=validate, Url=concat_11, Tags="1to200")  # -> Representation, Valid, Url, Description, Tags, Qualities
trim_8 = TrimTree(Tree=rep_2.Tags, Depth=1)
trim_9 = TrimTree(Tree=rep_3.Tags, Depth=1)
rep_4 = ModelRepresentation(Validate=validate, Url=item_7.Item, Tags=[trim_8, mime])  # -> Representation, Valid, Url, Description, Tags, Qualities
rep_5 = ModelRepresentation(Validate=validate, Url=item_7.Item1, Tags=[trim_9, mime])  # -> Representation, Valid, Url, Description, Tags, Qualities

concat_12 = Concatenate(FragmentA=concat_3, FragmentB="_", FragmentE="collider")

concat_13 = Concatenate(FragmentC="representations", FragmentD=sep, FragmentA=concat_12)
concat_14 = Concatenate(FragmentA=concat_13, FragmentB=".3dm")
concat_15 = Concatenate(FragmentA=concat_13, FragmentB=".glb")
rep_6 = ModelRepresentation(Validate=validate, Url=concat_15, Tags="collider")  # -> Representation, Valid, Url, Description, Tags, Qualities
merge_15 = Merge(
    Data1=rep.Representation,
    Data2=rep_2.Representation,
    Data3=rep_3.Representation,
    Data4=rep_4.Representation,
    Data5=rep_5.Representation,
    Data6=rep_6.Representation)

concat_16 = Concatenate(FragmentA="icons/", FragmentB=concat_3, FragmentC=".svg")

expression_20 = Expression(x=room_length_m, Expression="x/2")
expression_21 = Expression(x=room_width_m, Expression="x/2")
expression_22 = Expression(x=height_m, Expression="x/2")
expression_23 = Expression(x=shellthickness_m, Expression="x/2")
filter_24 = StreamFilter(Gate=view_2, Stream0=expression_21, Stream1=expression_20)
filter_25 = StreamFilter(Gate=view_2, Stream0=evalsrf_3.Frame, Stream1=evalsrf_2.Frame)
expression_24 = Expression(x=balkony_depth_m, Expression="x/2")
addition_8 = Addition(A=expression_24, B=expression_23)
deplane_3 = DeconstructPlane(Plane=filter_25)  # -> Origin, XAxis, YAxis, ZAxis
box_2 = CenterBox(Base=filter_25, X=filter_24, Y=expression_22, Z=expression_24)
box_3 = CenterBox(Base=filter_25, X=filter_24, Y=expression_22, Z=addition_8)
amp_3 = Amplitude(Vector=deplane_3.ZAxis, Amplitude=addition_8)
amp_4 = Amplitude(Vector=deplane_3.ZAxis, Amplitude=expression_24)
amp_5 = Amplitude(Vector=deplane_3.ZAxis, Amplitude=expression_24)
move_4 = Move(Geometry=box_3, Motion=amp_3)  # -> Geometry, Transform
move_5 = Move(Geometry=box_2, Motion=amp_4)  # -> Geometry, Transform
debrep_2 = DeconstructBrep(Brep=move_5.Geometry)  # -> Faces, Edges, Vertices
trim_10 = TrimTree(Tree=debrep_2.Vertices, Depth=1)
item_12 = ListItem(List=trim_10, Index=0, Wrap=True)  # -> Item, Item1, Item2, Item3, Item4, Item5

merge_16 = Merge(Data1=volume1to500, Data2=move_4.Geometry)
sunion = SolidUnion(Breps=merge_16)
neg_5 = Negative(Value=shellthickness_m)
offsetbox = OffsetBox(box=sunion, length=neg_5)

jagged = SettingsSpeed()

neg_6 = Negative(Value=shellthickness_m)
expression_25 = Expression(x=fillet_radius_m, Expression="x/2")
neg_7 = Negative(Value=expression_25)

addition_9 = Addition(A=shellthickness_m, B=balkony_height_m, C=expression_25)

subtraction_2 = Subtraction(A=height_m, B=addition_9)
expression_26 = Expression(x=addition_9, Expression="x/2")
expression_27 = Expression(x=subtraction_2, Expression="x/2")
box_4 = CenterBox(Base=filter_25, X=filter_24, Y=expression_26, Z=expression_24)
amp_6 = Amplitude(Vector=deplane_3.YAxis, Amplitude=expression_27)
rev_2 = Reverse(Vector=amp_6)
move_6 = Move(Geometry=box_4, Motion=amp_5)  # -> Geometry, Transform
move_7 = Move(Geometry=move_6.Geometry, Motion=rev_2)  # -> Geometry, Transform
debrep_3 = DeconstructBrep(Brep=move_7.Geometry)  # -> Faces, Edges, Vertices
trim_11 = TrimTree(Tree=debrep_3.Vertices, Depth=1)
item_13 = ListItem(List=trim_11, Index=0, Wrap=True)  # -> Item2, Item1, Item
merge_17 = Merge(Data1=item_12.Item, Data2=item_12.Item3, Data3=item_13.Item1, Data4=item_12.Item4)
merge_18 = Merge(Data1=item_12.Item1, Data2=item_12.Item2, Data3=item_13.Item2, Data4=item_12.Item5)
pline = PolyLine(Vertices=merge_17, Closed=invert(False))
pline_2 = PolyLine(Vertices=merge_18, Closed=invert(False))
rulesrf = RuledSurface(CurveA=pline_2, CurveB=pline)
cap_3 = CapHoles(Brep=rulesrf)

merge_19 = Merge(Data1=cap_3, Data2=volume1to500)
sunion_2 = SolidUnion(Breps=merge_19)
fmerge = MergeFaces(Brep=sunion_2)  # -> Breps, Before, After
sdiff_3 = SolidDifference(BrepsA=fmerge.Breps, BrepsB=offsetbox)
sdiff_4 = SolidDifference(BrepsA=sdiff_3, BrepsB=cap_2)
shell_1to500 = Geometry(sdiff_4)

debrep_4 = DeconstructBrep(Brep=fmerge.Breps)  # -> Faces, Edges, Vertices
trim_12 = TrimTree(Tree=debrep_4.Edges, Depth=1)
lng_2 = ListLength(List=trim_12)
series_2 = Series(Start=0, Step=1, Count=lng_2)
trim_13 = TrimTree(Tree=series_2, Depth=1)
filedge_2 = FilletEdge(Shape=fmerge.Breps, Blend=0, Metric=0, Edges=trim_13, Radii=fillet_radius_m)
sdiff_5 = SolidDifference(BrepsA=filedge_2, BrepsB=offsetbox)
sdiff_6 = SolidDifference(BrepsA=sdiff_5, BrepsB=cap_2)
shell_1to200 = Geometry(sdiff_6)

mesh = MeshBrep(Brep=fmerge.Breps, Settings=jagged)
collider = Mesh(mesh)

extendbox = ExtendBox(boxe=move_7.Geometry, length=shellthickness_m, dimension="1")
extendbox_2 = ExtendBox(boxe=extendbox, length=shellthickness_m, dimension="2")
offsetbox_2 = OffsetBox(box=extendbox_2, length=neg_6)
extendbox_3 = ExtendBox(boxe=offsetbox_2, length=neg_7, dimension="1")
debrep_5 = DeconstructBrep(Brep=extendbox_3)  # -> Faces, Edges, Vertices
trim_14 = TrimTree(Tree=debrep_5.Faces, Depth=1)
item_14 = ListItem(List=trim_14, Index=0, Wrap=True)  # -> Item1, Item
railing_1to500 = Surface(item_14.Item1)

edges = BrepEdges(Brep=railing_1to500)  # -> Naked, Interior, NonManifold
trim_15 = TrimTree(Tree=edges.Naked, Depth=1)
filter_26 = StreamFilter(Gate=view_2, Stream0=railing_count_front, Stream1=railing_count_side)
item_15 = ListItem(List=trim_15, Index=0, Wrap=True)  # -> Item, Item1
divide = DivideCurve(Curve=item_15.Item, Count=filter_26, Kinks=False)  # -> Points, Tangents, Parameters
len = Length(Curve=item_15.Item1)
len_2 = Length(Curve=item_15.Item)
trim_16 = TrimTree(Tree=divide.Points, Depth=1)
Z_4 = UnitZ(Factor=1)
line = LineSDL(Start=trim_16, Direction=Z_4, Length=len)
srfsplit = SurfaceSplit(Surface=railing_1to500, Curves=line)
trim_17 = TrimTree(Tree=srfsplit, Depth=1)
railing_1to200 = Surface(trim_17)

mrg_a = MergeSeperatlyAppend(x=shell_1to500, u=door_3, y=window_1to500, z=railing_1to500)  # -> Mrgd; inputs x: tree, u: tree, y: tree, z: tree
# ---------- mrg_a: Python ----------
if ghenv.Component.RunCount<2:
    __author__ = "Ueli Saluz"
    __version__ = "2020.05.28"
    
    ghenv.Component.Name = "MergeSeperatly(Append)"
    ghenv.Component.NickName = "Mrg(A)"
    ghenv.Component.Description = "Merge inputs seperatly on a new path. Append index of input parameter for distincting."
    ghenv.Component.Message = "VER 1.0"

from System import Object
from Grasshopper import DataTree
from Grasshopper.Kernel import GH_ParamAccess as Access

if __name__ == "__main__":
    Mrgd = DataTree[Object]()
    access = Access()
    
    for input in ghenv.Component.Params.Input:  #set all Inputaccess to Tree Access
        input.Access = access.tree
    
    for i,input in enumerate(ghenv.Component.Params.Input):
        for j,source in enumerate(input.Sources):
            for path in source.VolatileData.Paths:
                Mrgd.AddRange(source.VolatileData[path],path.AppendElement(i))
# ---------- end mrg_a ----------
mrg_a_2 = MergeSeperatlyAppend(x=shell_1to200, u=door_3, y=window_frame_1to200, z=window_1to200, v=railing_1to200)  # -> Mrgd; inputs x: tree, u: tree, y: tree, z: tree, v: tree; same code as mrg_a
geometry_1to500 = Geometry(mrg_a)
geometry_1to200 = Geometry(mrg_a_2)

bbox = BoundingBox(Content=flatten(geometry_1to200), Plane=PlaneXY(0, 0, 0), UnionBox=True)  # -> Box, Box_2
geo = PreviewGeometry(geo=geometry_1to200, sc=1)
zoom2bb = ZoomToBoundingBox(N=["Top", "Front", "Right", "Perspective", "Parallel"], BB=bbox.Box, S=0, R=zoom)  # -> F, SBB; inputs BB: Box, R: Boolean
# ---------- zoom2bb: Python ----------
#Component Information
#--------------------------------------------------------------------------------------------
if ghenv.Component.RunCount<2:
    #General
    #--------------------------------------------------------------------------------------------
    __author__ = "Ueli Saluz"
    __version__ = "2022.05.21"
    
    ghenv.Component.Name = "ZoomToBoundingBox"
    ghenv.Component.NickName = "Zoom2BB"
    ghenv.Component.Description = "Zoom the view of a Rhino viewport to a bounding box."
    ghenv.Component.Message = "VER 1.1"
    ghenv.Component.Category = "Display"
    ghenv.Component.SubCategory = "Camera"
    
     #Inputs
    #--------------------------------------------------------------------------------------------
    inputIndex=0
    
    ghenv.Component.Params.Input[inputIndex].Name = "Name"
    ghenv.Component.Params.Input[inputIndex].NickName = "N"
    ghenv.Component.Params.Input[inputIndex].Description = "Name of the viewport"
    ghenv.Component.Params.Input[inputIndex].Optional = False
    inputIndex+=1
    
    ghenv.Component.Params.Input[inputIndex].Name = "BoundingBox"
    ghenv.Component.Params.Input[inputIndex].NickName = "BB"
    ghenv.Component.Params.Input[inputIndex].Description = ""
    ghenv.Component.Params.Input[inputIndex].Optional = False
    inputIndex+=1
    
    ghenv.Component.Params.Input[inputIndex].Name = "ScaleFactor"
    ghenv.Component.Params.Input[inputIndex].NickName = "S"
    ghenv.Component.Params.Input[inputIndex].Description = "A factor for the extension of the bounding box." \
    +"0 means 0 extension, a positive number makes the bounding box larger a negative smaller. The amount is proportional to the length."
    ghenv.Component.Params.Input[inputIndex].Optional = False
    inputIndex+=1
   
    
    ghenv.Component.Params.Input[inputIndex].Name = "Run"
    ghenv.Component.Params.Input[inputIndex].NickName = "R"
    ghenv.Component.Params.Input[inputIndex].Description = "Zoom to the given bounding box."
    ghenv.Component.Params.Input[inputIndex].Optional = False
    inputIndex+=1
    
    #Outputs
    #--------------------------------------------------------------------------------------------
    outputIndex=0
    
    ghenv.Component.Params.Output[outputIndex].Name = "Finished"
    ghenv.Component.Params.Output[outputIndex].NickName = "F"
    ghenv.Component.Params.Output[outputIndex].Description = "Sends True when finished. Just to trigger other depending components."
    outputIndex+=1
    
    ghenv.Component.Params.Output[outputIndex].Name = "ScaledBoundingBox"
    ghenv.Component.Params.Output[outputIndex].NickName = "SBB"
    ghenv.Component.Params.Output[outputIndex].Description = "The scaled bounding box."
    outputIndex+=1


#Imports
#--------------------------------------------------------------------------------------------
from Rhino import RhinoDoc
from Rhino.Geometry import Box

#Solver - Run with trees to enhance performance drastically
#--------------------------------------------------------------------------------------------
if __name__ == "__main__":
    try:
        vp = RhinoDoc.ActiveDoc.Views.Find(N, False).ActiveViewport
        if R:
            box = BB
            bb = BB.BoundingBox
            bb.Inflate(S*box.X.Length,S*box.Y.Length,S*box.Z.Length)
            vp.ZoomBoundingBox(bb)
            SBB = bb
        F = True
    except:
        pass
# ---------- end zoom2bb ----------

door_4 = Surface(door_3)
railing_1to500_2 = Surface(railing_1to500)
shell_1to200_2 = Geometry(shell_1to200)
window_1to200_2 = Surface(window_1to200)
window_frame_1to200_2 = Brep(window_frame_1to200)
window_1to500_2 = Brep(window_1to500)
railing_1to200_2 = Surface(railing_1to200)
shell_1to500_2 = Geometry(shell_1to500)
expression_28 = Expression(x="window", y=window_1to200_2, Expression="x")
expression_29 = Expression(x="shell", y=shell_1to500_2, Expression="x")
expression_30 = Expression(x="shell", y=shell_1to200_2, Expression="x")
expression_31 = Expression(x="door", y=door_4, Expression="x")
expression_32 = Expression(x="window::frame", y=window_frame_1to200_2, Expression="x")
expression_33 = Expression(x="door", y=door_4, Expression="x")
expression_34 = Expression(x="window", y=window_1to500_2, Expression="x")
expression_35 = Expression(x="railing", y=railing_1to200_2, Expression="x")
expression_36 = Expression(x="railing", y=railing_1to500_2, Expression="x")
swatch = ColourSwatch(SwatchColor=RGB(255, 255, 255))
merge_20 = Merge(Data1=expression_29, Data2=expression_33, Data3=expression_34, Data4=expression_36)
merge_21 = Merge(Data1=shell_1to500_2, Data2=door_4, Data3=window_1to500_2, Data4=railing_1to500_2)
merge_22 = Merge(Data1=shell_1to200_2, Data2=door_4, Data3=window_1to200_2, Data4=window_frame_1to200_2, Data5=railing_1to200_2)
merge_23 = Merge(Data1=expression_30, Data2=expression_31, Data3=expression_28, Data4=expression_32, Data5=expression_35)
concat_17 = Concatenate(FragmentA=par, FragmentB=sep, FragmentC=concat_10)
concat_18 = Concatenate(FragmentA=par, FragmentB=sep, FragmentC=concat_11)
concat_19 = Concatenate(FragmentA=par, FragmentB=sep, FragmentC=concat_14)
concat_20 = Concatenate(FragmentA=par, FragmentB=sep, FragmentC=concat_15)
rep_7 = ModelRepresentation(Url=concat_14)  # -> Representation, Valid, Url, Description, Tags, Qualities
blc = ExportBlock(path=concat_18, name=concat_5, url=concat_11, geo=merge_22, layer_n=merge_23, dc=swatch, export=and)  # -> block_definition_3, path_4, exported_2
blc_2 = ExportBlock(path=concat_17, name=concat_4, url=concat_10, geo=merge_21, layer_n=concat_4, dc=swatch, export=and)  # -> block_definition_3, path_4, exported_2
blc_3 = ExportBlock(path=concat_19, name=concat_12, url=rep_7.Url, geo=collider, layer_n="collider", dc=swatch, export=and)  # -> block_definition_3, path_4, exported_2
geo_2 = ExportGeometry(F=concat_20, G=collider, R=and)  # -> S; inputs G: tree of GeometryBase, R: Boolean
# ---------- geo_2: C# ----------
// Grasshopper Script Instance
#region Usings
using System;
using System.Linq;
using System.Collections;
using System.Collections.Generic;
using System.Drawing;
using System.IO;

using Rhino;
using Rhino.Geometry;

using Grasshopper;
using Grasshopper.Kernel;
using Grasshopper.Kernel.Data;
using Grasshopper.Kernel.Types;
#endregion

public class Script_Instance : GH_ScriptInstance
{
    #region Notes
    /* 
      Members:
        RhinoDoc RhinoDocument
        GH_Document GrasshopperDocument
        IGH_Component Component
        int Iteration

      Methods (Virtual & overridable):
        Print(string text)
        Print(string format, params object[] args)
        Reflect(object obj)
        Reflect(object obj, string method_name)
    */
    #endregion

    private void RunScript(object F, DataTree<GeometryBase> G, bool R, ref object S)
    {
        // inspired from https://github.com/jhorikawa/GrasshopperProgrammingTutorials/blob/master/0015%20Export%20Geometry%20with%20Grasshopper%20C%23/Export%20Geometry%20with%20Grasshopper%20C%23.gh
        if(R){
            var guids = new List<Guid>();

            for(int i = 0; i < G.BranchCount; i++){
                for(int n = 0; n < G.Branches[i].Count; n++){
                var geom = G.Branches[i][n];
                var guid = Rhino.RhinoDoc.ActiveDoc.Objects.Add(geom);
                guids.Add(guid);
                }
            }

            Rhino.RhinoDoc.ActiveDoc.Objects.Select(guids);

            string cmd = "_-Export " + "\"" + F + "\"" + " _Enter _Enter";

            Rhino.RhinoApp.RunScript(cmd, false);

            Rhino.RhinoDoc.ActiveDoc.Objects.Delete(guids, true);
            S = true;
        }
    }
}
# ---------- end geo_2 ----------

rec = Rectangle({Plane=Plane(origin=(15.60693884, 14.69292436, 15.6245417), x=(0.7071067812, -0.7071067812, 0), y=(-0.4082482905, -0.4082482905, 0.8164965809)), Size=Domain2(u=-24.40970167..24.40970167, v=-18.06498235..18.06498235)})
m2d_parallel = Make2DParallelView(Projection=rec)
make2d = Make2D(Geometry=flatten(geometry_1to200), View=m2d_parallel, TangentEdges="T", TangentSeams=False, AutoComputeMake2D=True)  # -> VisibleCurves, VisibleIndex, VisibleType, HiddenCurves, HiddenIndex, HiddenType
trim_18 = TrimTree(Tree=make2d.VisibleCurves, Depth=1)
trim_19 = TrimTree(Tree=make2d.HiddenCurves, Depth=1)
hidden = Curve(trim_19)
visible = Curve(trim_18)

expression_37 = Expression(x="visible", y=visible, Expression="x")
expression_38 = Expression(x="hidden", y=hidden, Expression="x")
merge_24 = Merge(Data1=visible, Data2=hidden)
merge_25 = Merge(Data1=expression_37, Data2=expression_38)
concat_21 = Concatenate(FragmentA=concat_3, FragmentB="_", FragmentC="icon")
concat_22 = Concatenate(FragmentC="icons", FragmentD=sep, FragmentA=concat_3)
concat_23 = Concatenate(FragmentA=concat_22, FragmentB=".3dm")
concat_24 = Concatenate(FragmentA=par, FragmentB=sep, FragmentC=concat_23)
blc_4 = ExportBlock(path=concat_24, name=concat_21, url=concat_23, geo=merge_24, export=and_2)  # -> block_definition_3, path_4, exported_2

area_2 = Area(Geometry=item_14.Item)  # -> Area, Centroid

expression_39 = Expression(x=area_2.Area, Expression="x/2")
addition_10 = Addition(A=expression_39, B=multiplication_3)

roundmult_2 = RoundToMultiple(N=addition_10, M="0.01")  # -> R; inputs N: tree, M: tree; same code as roundmult
merge_26 = Merge(
    Data1=entrance,
    Data2=view,
    Data3=filter_23,
    Data4=filter_21,
    Data5=height_m,
    Data6=window_shape,
    Data7=roundmult_2,
    Data8=round.Nearest,
    Data9=round_2.Nearest,
    Data10=round_3.Nearest,
    Data11=round_4.Nearest,
    Data12=round_5.Nearest,
    Data13=round_6.Nearest,
    Data14=roundmult)
panel_12 = Panel(merge_26)

qal = ModelQuality(Validate=validate, Name=panel_10, Value=panel_12, Unit=panel_11, Definition=panel_9)  # -> Quality, Valid, Name, Value, Unit, Definition

merge_27 = Merge(Data1=qal.Quality, Data2=filter_22)

panel_13 = Panel("""east
west""")
panel_14 = Panel("""east
west""")
item_16 = ListItem(List=panel_13, Index=mirror, Wrap=True)
item_17 = ListItem(List=panel_14, Index=mirror, Wrap=True)
panel_15 = Panel("The middle of the main entrance door of the upper entrance floor.")
concat_25 = Concatenate(FragmentA="door tambour", FragmentC=" ", FragmentB=item_17)
concat_26 = Concatenate(FragmentA="door capsule", FragmentC=" ", FragmentB=item_16)
por = ModelPort(
    Description=panel_15,
    Family=concat_26,
    CompatibleFamilies=concat_25,
    Point=eval_3.Point,
    Direction=xprod.Vector,
    Qualities="entrance")  # -> Port, Valid, Id, Description, Mandatory, Family, CompatibleFamilies, Point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

prv = PreviewPort(po=por.Port)
concat_27 = Concatenate(FragmentA="images/", FragmentB=concat_3, FragmentC=".png")

typ = ModelType(
    Validate=validate,
    Name="Capsule with Balcony",
    Description=concat,
    Icon=concat_16,
    Image=concat_27,
    Variant=variant_2,
    Unit="m",
    Representations=merge_15,
    Ports=por.Port,
    Authors=aut.Author,
    Qualities=merge_27)  # -> Type, Valid, Name, Description, Icon, Image, Variant, Stock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

typ_2 = SerializeType(Type=typ.Type)
txt = EncodeText(Text=typ_2, Mode=0)
type = Text(txt)
context_bake = ContextBake(Geometry=type)
typ_3 = PutType(Type=typ.Type, Uri=par, Run=save)

# ==== cluster _2D
x = ClusterInput()
expression = Expression(x=x, Expression="x/2")
neg = Negative(Value=expression)
dom = ConstructDomain(DomainStart=neg, DomainEnd=expression)
I = ClusterOutput(dom)

# ==== cluster ValueOr0
value = ClusterInput()
value_2 = Number(value)
null = NullItem(Item=value_2)  # -> NullFlags, InvalidFlags, Description
filter = StreamFilter(Gate=null.NullFlags, Stream0=value_2, Stream1="0")
valueor0 = Number(filter)
valueor0_2 = ClusterOutput(valueor0)

# ==== cluster PreviewPlane: Preview a plane with axis colors and naming.
axis_length = ClusterInput()
plane = ClusterInput()
axis_length_2 = Number(axis_length)
plane_2 = Plane(plane)
deplane = DeconstructPlane(Plane=plane_2)  # -> Origin, XAxis, YAxis, ZAxis
line = LineSDL(Start=deplane.Origin, Direction=deplane.YAxis, Length=axis_length_2)
line_2 = LineSDL(Start=deplane.Origin, Direction=deplane.XAxis, Length=axis_length_2)
line_3 = LineSDL(Start=deplane.Origin, Direction=deplane.ZAxis, Length=axis_length_2)
swatch = ColourSwatch(SwatchColor=RGB(235, 52, 79))
swatch_2 = ColourSwatch(SwatchColor=RGB(0, 166, 157))
swatch_3 = ColourSwatch(SwatchColor=RGB(240, 117, 24))
end = EndPoints(Curve=line_2)  # -> Start, End
end_2 = EndPoints(Curve=line)  # -> Start, End
end_3 = EndPoints(Curve=line_3)  # -> Start, End
tag = TextTag(Location=end.End, Text="X", Colour=swatch)
tag_2 = TextTag(Location=end_2.End, Text="Y", Colour=swatch_2)
tag_3 = TextTag(Location=end_3.End, Text="Z", Colour=swatch_3)
preview = CustomPreview(Geometry=line_2, Material=swatch)
preview_2 = CustomPreview(Geometry=line, Material=swatch_2)
preview_3 = CustomPreview(Geometry=line_3, Material=swatch_3)

# ==== cluster ViewRectangle
view = ClusterInput()
view_2 = Data(view)
nickname = NAME(view=view_2)  # -> c, x, y, z, h, w
# ---------- nickname: Python ----------
uselss, c, x, y, z = view.GetCameraFrame()
h = view.FrustumHeight
w = view.FrustumWidth
# ---------- end nickname ----------
rev = Reverse(Vector=nickname.x)
rev_2 = Reverse(Vector=nickname.y)
pl = ConstructPlane(Origin=nickname.c, XAxis=rev, YAxis=nickname.y)
_2d = _2D(x=nickname.w)
_2d_2 = _2D(x=nickname.h)
rectangle = Rectangle(Plane=pl, XSize=_2d, YSize=_2d_2, Radius=0)  # -> Rectangle, Length
rec = Rectangle(rectangle.Rectangle)
rec_2 = ClusterOutput(rec)

# ==== cluster ExportBlock: Export geometry with layer names to a file.
dc = ClusterInput()
layer_n = ClusterInput()
path = ClusterInput()
name = ClusterInput()
url = ClusterInput()
geo = ClusterInput()
export = ClusterInput()
path_2 = FilePath(path)
name_2 = Text(name)
url_2 = Text(url)
geo_2 = Geometry(geo)
export_2 = Boolean(export)
layer_n_2 = Name(layer_n)
dc_2 = DisplayColour(dc)
layer = ModelLayer(Name=layer_n_2, DisplayColour=dc_2)  # -> Layer, Name, Hidden, Locked, DisplayColour, Material, Linetype, PrintColour, PrintWidth
object = ModelObject(Geometry=geo_2, Layer=layer.Layer)  # -> Object, Geometry, Name, Layer, Visibility, Display, Drafting, Render
block_definition = ModelBlockDefinition(Objects=object.Object, Name=name_2, URL=url_2)  # -> BlockDefinition, Objects, Units, Name, Notes, URL, URLDescription
export_definition = ExportModelBlockDefinition(BlockDefinition=block_definition.BlockDefinition, FilePath=path_2, Overwrite="T", Export=export_2)  # -> BlockDefinition, FilePath, Exported
block_definition_2 = ModelBlockDefinition(export_definition.BlockDefinition)
path_3 = FilePath(export_definition.FilePath)
exported = Boolean(export_definition.Exported)
path_4 = ClusterOutput(path_3)
exported_2 = ClusterOutput(exported)
block_definition_3 = ClusterOutput(block_definition_2)

# ==== cluster OffsetBox: Offset a box by a certain length.
length = ClusterInput()
box = ClusterInput()
length_2 = Number(length)
box_2 = Box(box)
debox = DeconstructBox(Box=box_2)  # -> Plane, X, Y, Z
cluster = D(I=debox.X, length=length_2)
cluster_2 = D(I=debox.Y, length=length_2)
cluster_3 = D(I=debox.Z, length=length_2)
box_3 = DomainBox(Base=debox.Plane, X=cluster, Y=cluster_2, Z=cluster_3)
adjust_box = Box(box_3)
adjust_box_2 = ClusterOutput(adjust_box)

# ==== cluster ExtendBox: Extend (or trim) a box by a certain length in a certain dimension
length = ClusterInput()
dimension = ClusterInput()
boxe = ClusterInput()
dimension_2 = Integer(dimension)
length_2 = Number(length)
boxe_2 = Box(boxe)
debox = DeconstructBox(Box=boxe_2)  # -> Plane, X, Y, Z
filter = StreamFilter(Gate=dimension_2, Stream0=debox.X, Stream1=debox.Y, Stream2=debox.Z)
domprop = DomainProperties(I=filter, In=True)  # -> L, M, T0, T1; inputs I: tree, In: tree of Boolean; same code as domprop
addition = Addition(A=domprop.T1, B=length_2)
dom = ConstructDomain(DomainStart=domprop.T0, DomainEnd=addition)
gate = StreamGate(Stream=dom, Gate=dimension_2)  # -> Target0, Target1, Target2
filter_2 = StreamFilter(Gate=dimension_2, Stream0=debox.Y, Stream1=gate.Target1, Stream2=debox.Y)
filter_3 = StreamFilter(Gate=dimension_2, Stream0=debox.Z, Stream1=debox.Z, Stream2=gate.Target2)
filter_4 = StreamFilter(Gate=dimension_2, Stream0=gate.Target0, Stream1=debox.X, Stream2=debox.X)
box = DomainBox(Base=debox.Plane, X=filter_4, Y=filter_2, Z=filter_3)
adjusted_boxes = Box(box)
adjusted_boxes_2 = ClusterOutput(adjusted_boxes)

# ==== cluster PreviewGeometry: Preview geometry by ungrouping everything, showing light surfaces and dark edges.
sc = ClusterInput()
geo = ClusterInput()
geo_2 = Geometry(flatten(geo))
sc_2 = Number(sc)
expression = Expression(x=sc_2, Expression="x+1")
swatch = ColourSwatch(SwatchColor=RGB(0, 0, 0))
swatch_2 = ColourSwatch(SwatchColor=RGB(255, 255, 255))
ungroup = Ungroup(Group=geo_2)
ungroup_2 = Ungroup(Group=ungroup)
ungroup_3 = Ungroup(Group=ungroup_2)
ungroup_4 = Ungroup(Group=ungroup_3)
log = Logarithm(Value=expression)
clean = CleanTree(RemoveNulls=True, RemoveInvalid=True, RemoveEmpty=invert(False), Tree=ungroup_4)  # -> flatten(Tree)
multiplication = Multiplication(A=log, B=Slider(0.05, range=0..1))
linetype = ModelLinetype(Name="semio", Width=multiplication)  # -> ModelLinetype, Name, Segments, CapStyle, JoinStyle, Width, WidthUnits, TaperWidths, TaperPositions
dispatch = CSharpScript(D=clean)  # -> P, C, B, M, R
# ---------- dispatch: C# ----------
// Grasshopper Script Instance
#region Usings
using System;
using System.Linq;
using System.Collections;
using System.Collections.Generic;
using System.Drawing;

using Rhino;
using Rhino.Geometry;

using Grasshopper;
using Grasshopper.Kernel;
using Grasshopper.Kernel.Data;
using Grasshopper.Kernel.Types;
#endregion

public class Script_Instance : GH_ScriptInstance
{
    #region Notes
    /* 
      Members:
        RhinoDoc RhinoDocument
        GH_Document GrasshopperDocument
        IGH_Component Component
        int Iteration

      Methods (Virtual & overridable):
        Print(string text)
        Print(string format, params object[] args)
        Reflect(object obj)
        Reflect(object obj, string method_name)
    */
    #endregion

    private void RunScript(
	object D,
	ref object P,
	ref object C,
	ref object B,
	ref object M,
	ref object R)
    {
        if (D is Curve) C = D; // Curve
        else if (
            D is Rhino.Geometry.Point ||
            D is PointCloud
            )
            P = D; // Point
        else if ( D is Mesh) M = D; // Mesh
        else if (
            D is Surface ||
            D is Extrusion ||
            D is SubD ||
            D is Brep
            )
            B = D; // Brep
        else R = D; // Rest
            
    }
}
# ---------- end dispatch ----------
clean_2 = CleanTree(RemoveNulls=True, RemoveInvalid=True, RemoveEmpty=False, Tree=dispatch.M)
clean_3 = CleanTree(RemoveNulls=True, RemoveInvalid=True, RemoveEmpty=False, Tree=dispatch.R)
clean_4 = CleanTree(RemoveNulls=True, RemoveInvalid=True, RemoveEmpty=False, Tree=dispatch.B)
clean_5 = CleanTree(RemoveNulls=True, RemoveInvalid=True, RemoveEmpty=False, Tree=dispatch.P)
clean_6 = CleanTree(RemoveNulls=True, RemoveInvalid=True, RemoveEmpty=False, Tree=dispatch.C)
debrep = DeconstructBrep(Brep=clean_4)  # -> Faces, Edges, Vertices
preview = CustomPreview(Geometry=flatten(clean_5), Material=swatch)
preview_2 = CustomPreview(Geometry=flatten(debrep.Faces), Material=swatch_2)
preview_3 = CustomPreview(Geometry=flatten(clean_2), Material=swatch_2)
preview_4 = CustomPreview(Geometry=flatten(clean_3), Material=swatch)
curve_preview = CustomCurvePreview(Curve=clean_6, Linetype=linetype.ModelLinetype, Colour=swatch)
curve_preview_2 = CustomCurvePreview(Curve=debrep.Edges, Linetype=linetype.ModelLinetype, Colour=swatch)

# ==== cluster PreviewPort: Preview a port by showing the point and direction and if exists: id, family and compatible families.
po = ClusterInput()
sc = ClusterInput()
sc_2 = Number(sc)
po_2 = Port(po)
por = ModelPort(Port=po_2)  # -> Port, Valid, Id, Description, Mandatory, Family, CompatibleFamilies, Point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
swatch = ColourSwatch(SwatchColor=RGB(235, 52, 79))
swatch_2 = ColourSwatch(SwatchColor=RGB(250, 149, 0))
amp = Amplitude(Vector=por.Direction, Amplitude=sc_2)
lng = ListLength(List=por.CompatibleFamilies)
expression = Expression(x=por.Family, Expression="x=\"\"")
cull = CullPattern(List=por.Point, CullPattern=expression)
expression_2 = Expression(x=lng, Expression="x=0")
join = TextJoin(Text=por.CompatibleFamilies, Join=",")
merge = Merge(Data1=":")
trim = TrimTree(Tree=join, Depth=1)
trim_2 = TrimTree(Tree=expression_2, Depth=1)
item = ListItem(List=merge, Index=expression, Wrap=invert(True))
log = Logarithm(Value=sc_2)
concat = Concatenate(FragmentA="[", FragmentB=trim, FragmentC="]")
expression_3 = Expression(y=trim_2, Expression="x")
merge_2 = Merge(Data1=graft(concat), Data2=graft(expression_3))
item_2 = ListItem(List=merge_2, Index=graft(expression), Wrap=invert(True))
multiplication = Multiplication(A=log, B=Slider(2, range=0..10))
trim_3 = TrimTree(Tree=item_2, Depth=1)
concat_2 = Concatenate(FragmentA=por.Id, FragmentB=item, FragmentC=por.Family, FragmentD=trim_3)
preview = CustomPreview(Geometry=cull, Material=swatch)
tag = TextTag(Location=por.Point, Text=concat_2, Colour=swatch)
vdisex = VectorDisplayEx(Point=por.Point, Vector=amp, Colour=ColourSwatch(SwatchColor=RGB(0, 166, 157)), Width=multiplication)

# ==== cluster D
length = ClusterInput()
I = ClusterInput()
length_2 = Number(length)
domprop = DomainProperties(I=I, In=True)  # -> L, M, T0, T1; inputs I: tree, In: tree of Boolean
# ---------- domprop: Python ----------
#Component Information
#--------------------------------------------------------------------------------------------
if ghenv.Component.RunCount<2:
    #General
    #--------------------------------------------------------------------------------------------
    __author__ = "Ueli Saluz"
    __version__ = "2021.11.22"
    
    ghenv.Component.Name = "DomainProperties"
    ghenv.Component.NickName = "DomProp"
    ghenv.Component.Description = "Returns some properties of a domain"
    ghenv.Component.Message = "VER 1.0"
    ghenv.Component.Category = "Maths"
    ghenv.Component.SubCategory = "Domain"
    
     #Inputs
    #--------------------------------------------------------------------------------------------
    inputIndex=0
    
    ghenv.Component.Params.Input[inputIndex].Name = "Domain"
    ghenv.Component.Params.Input[inputIndex].NickName = "I"
    ghenv.Component.Params.Input[inputIndex].Description = "Domain to evaluate"
    ghenv.Component.Params.Input[inputIndex].Optional = False
    inputIndex+=1
    
    ghenv.Component.Params.Input[inputIndex].Name = "MakeIncreasing"
    ghenv.Component.Params.Input[inputIndex].NickName = "In"
    ghenv.Component.Params.Input[inputIndex].Description = "Makes sure that the domain is increasing. If not it gets swapped."
    ghenv.Component.Params.Input[inputIndex].Optional = False
    inputIndex+=1
    
    #Outputs
    #--------------------------------------------------------------------------------------------
    outputIndex=0
    
    ghenv.Component.Params.Output[outputIndex].Name = "Length"
    ghenv.Component.Params.Output[outputIndex].NickName = "L"
    ghenv.Component.Params.Output[outputIndex].Description = "Length of the domain"
    outputIndex+=1
    
    ghenv.Component.Params.Output[outputIndex].Name = "Mid"
    ghenv.Component.Params.Output[outputIndex].NickName = "M"
    ghenv.Component.Params.Output[outputIndex].Description = "Middle of the of the domain"
    outputIndex+=1
    
    ghenv.Component.Params.Output[outputIndex].Name = "DomainStartParameter"
    ghenv.Component.Params.Output[outputIndex].NickName = "T0"
    ghenv.Component.Params.Output[outputIndex].Description = "Start parameter. Doens't have to be smaller than the end parameter."
    outputIndex+=1
    
    ghenv.Component.Params.Output[outputIndex].Name = "DomainEndParameter"
    ghenv.Component.Params.Output[outputIndex].NickName = "T1"
    ghenv.Component.Params.Output[outputIndex].Description = "End parameter. Doens't have to be bigger than the start parameter."
    outputIndex+=1
    


#Imports
#--------------------------------------------------------------------------------------------
from System import Object
from Grasshopper import DataTree

#Solver - Run with trees to enhance performance drastically
#--------------------------------------------------------------------------------------------
if __name__ == "__main__":
    
    #Initialize trees
    #--------------------------------------------------------------------------------------------
    LengthTree = DataTree[Object]()
    MidTree = DataTree[Object]()
    DomainStartParameterTree = DataTree[Object]()
    DomainEndParameterTree = DataTree[Object]()
    LengthTree = DataTree[Object]()
    
    #Data matching
    #--------------------------------------------------------------------------------------------
    for path in I.Paths:
        domainBranch = I.Branch(path)
        for i,domain in enumerate(domainBranch):
            if In==True:
                domain.MakeIncreasing()
            LengthTree.Add(domain.Length, path)
            MidTree.Add(domain.Mid, path)
            DomainStartParameterTree.Add(domain.T0, path)
            DomainEndParameterTree.Add(domain.T1, path)
    
     #Assign trees to output
    #--------------------------------------------------------------------------------------------
    L = LengthTree
    M = MidTree
    T0 = DomainStartParameterTree
    T1 = DomainEndParameterTree
# ---------- end domprop ----------
addition = Addition(A=domprop.T1, B=length_2)
subtraction = Subtraction(A=domprop.T0, B=length_2)
dom = ConstructDomain(DomainStart=subtraction, DomainEnd=addition)
I_2 = ClusterOutput(dom)
