# Grasshopper definition ellipsoid-capsule.gh (Grasshopper 1.0.8)
# Copyright: GNU Lesser General Public License Version 3
# plug-ins: RhinoCodePluginGH, semio

variant = Slider(0, range=0..7)
save_representation = BooleanToggle(False)
icon_export = BooleanToggle(False)
validate = BooleanToggle(False)
save = BooleanToggle(False)
panel = Panel("""\
/
q
p
J
L
s
z""")
sep = Separator()  # -> S
# ---------- sep: C# ----------
#region Usings
using System;
using System.Linq;
using System.Collections;
using System.Collections.Generic;
using System.Drawing;
using System.IO;

using Rhino;
using Rhino.Geometry;

using Grasshopper;
using Grasshopper.Kernel;
using Grasshopper.Kernel.Data;
using Grasshopper.Kernel.Types;
#endregion

public class Script_Instance : GH_ScriptInstance
{
    private void RunScript(ref object S)
    {
        S = Path.DirectorySeparatorChar;
    }
}
# ---------- end sep ----------
dir = Directory()  # -> D
# ---------- dir: C# ----------
#region Usings
using System;
using System.Linq;
using System.Collections;
using System.Collections.Generic;
using System.Drawing;
using System.IO;

using Rhino;
using Rhino.Geometry;

using Grasshopper;
using Grasshopper.Kernel;
using Grasshopper.Kernel.Data;
using Grasshopper.Kernel.Types;
#endregion

public class Script_Instance : GH_ScriptInstance
{
    private void RunScript(ref object D)
    {
        D = Path.GetDirectoryName(this.GrasshopperDocument.FilePath);
    }
}
# ---------- end dir ----------
and = GateAnd(A=save, B=save_representation)
and_2 = GateAnd(A=save, B=icon_export)
loop_slider = PythonScript(SliderToModify=variant, Min="0", Max="7", stepSize="1", Delay=Slider(0, range=0..1), Run=Toggle(False), Reset=Button())  # inputs Run: Boolean, Reset: Boolean
# ---------- loop_slider: Python ----------
import time

def updateSliderInput(inputName,min,max,value,decimalPlace=2):
    for input in ghenv.Component.Params.Input:
        for source in input.Sources:
            if input.Name == str(inputName):
                source.Slider.DecimalPlaces = decimalPlace
                source.Slider.Minimum = min
                source.Slider.Maximum = max
                source.Slider.Value = value
                source.ExpireSolution(True)

def countDecimal(number):
    string= str(number)
    return string[::-1].find('.')

if Run == True:
    if SliderToModify < Max:
        time.sleep(Delay)
        updateSliderInput("SliderToModify",Min,Max,SliderToModify+stepSize,countDecimal(stepSize))
if Reset == True:
    updateSliderInput("SliderToModify",Min,Max,Min)
# ---------- end loop_slider ----------
# ^                                    ^
#    |                                     |
# <-- Constants    Preview -->
# Parameters    External    Local -->
# <-- Meta               |
#      |                       v
#      v
par = ParentDirectory(D=dir)  # -> P; inputs D: String
# ---------- par: C# ----------
#region Usings
using System;
using System.Linq;
using System.Collections;
using System.Collections.Generic;
using System.Drawing;
using System.IO;

using Rhino;
using Rhino.Geometry;

using Grasshopper;
using Grasshopper.Kernel;
using Grasshopper.Kernel.Data;
using Grasshopper.Kernel.Types;
#endregion

public class Script_Instance : GH_ScriptInstance
{
    private void RunScript(string D, ref object P)
    {
        P = new DirectoryInfo(D).Parent;
    }
}
# ---------- end par ----------
item = ListItem(List=panel, Index=variant, Wrap=True)
panel_2 = Panel(item)
variant_2 = GetString(item, AtLeast=0, AtMost=1, TreeAccess=False)
itemindex = ItemIndex(L=panel, I=variant_2)  # -> i; inputs L: list
# ---------- itemindex: Python ----------
#Component Information
#--------------------------------------------------------------------------------------------
if ghenv.Component.RunCount<2:
    #General
    #--------------------------------------------------------------------------------------------
    __author__ = "Ueli Saluz"
    __version__ = "2022.11.18"
    
    ghenv.Component.Name = "ItemIndex"
    ghenv.Component.NickName = "ItemIndex"
    ghenv.Component.Description = "A better IdemIndex"
    ghenv.Component.Message = "VER 1.0"
    ghenv.Component.Category = "Set"
    ghenv.Component.SubCategory = "List"
    
     #Inputs
    #--------------------------------------------------------------------------------------------
    inputIndex=0
    
    ghenv.Component.Params.Input[inputIndex].Name = "List"
    ghenv.Component.Params.Input[inputIndex].NickName = "L"
    ghenv.Component.Params.Input[inputIndex].Description = "Input1 is..."
    ghenv.Component.Params.Input[inputIndex].Optional = False
    inputIndex+=1
    
    ghenv.Component.Params.Input[inputIndex].Name = "Item"
    ghenv.Component.Params.Input[inputIndex].NickName = "I"
    ghenv.Component.Params.Input[inputIndex].Description = "Input2 is..."
    ghenv.Component.Params.Input[inputIndex].Optional = False
    inputIndex+=1
    
    #Outputs
    #--------------------------------------------------------------------------------------------
    outputIndex=0
    
    ghenv.Component.Params.Output[outputIndex].Name = "Index"
    ghenv.Component.Params.Output[outputIndex].NickName = "i"
    ghenv.Component.Params.Output[outputIndex].Description = "Output1 is..."
    outputIndex+=1

i = L.index(I)
# ---------- end itemindex ----------
zoom = Button()
panel_3 = Panel("""backslash
slash
q
p
J
L
s
z""")
item_2 = ListItem(List=panel_3, Index=itemindex, Wrap=True)
merge = Merge(Data1="front", Data2="front", Data3="side", Data4="side", Data5="front", Data6="front", Data7="side", Data8="side")
merge_2 = Merge(Data1="F", Data2="T", Data3="F", Data4="T", Data5="F", Data6="T", Data7="F", Data8="T")
merge_3 = Merge(Data1="back", Data2="back", Data3="back", Data4="back", Data5="side", Data6="side", Data7="side", Data8="side")
list = ValueList({"Back": "back", "Side": "side"}, selected="Back")
item_3 = ListItem(List=merge_3, Index=itemindex, Wrap=True)
toggle = BooleanToggle(False)
item_4 = ListItem(List=merge_2, Index=itemindex, Wrap=True)
list_2 = ValueList({"Front", "Side"}, selected="Front")
item_5 = ListItem(List=merge, Index=itemindex, Wrap=True)
expression = Expression(x=Slider(260, range=0..1000), Expression="x/100")
expression_2 = Expression(x=Slider(360, range=0..1000), Expression="x/100")
expression_3 = Expression(x=Slider(400, range=0..1000), Expression="x/100")
entrance = Text(item_3)
view = Text(item_5)
mirror = Boolean(item_4)
length_m = Number(expression_2)
height_m = Number(expression)
width_m = Number(expression_3)
panel_4 = Panel("""round
rectangular""")
panel_5 = Panel("""front
side""")
mirrored = Boolean(mirror)
panel_6 = Panel("""back
side""")
shell_thickness_m = Number(Slider(20, range=0..100))
_2d = _2D(x=width_m)
_2d_2 = _2D(x=length_m)
itemindex_2 = ItemIndex(L=panel_6, I=entrance)  # -> i; inputs L: list; same code as itemindex
itemindex_3 = ItemIndex(L=panel_5, I=view)  # -> i; inputs L: list; same code as itemindex
expression_4 = Expression(x=shell_thickness_m, Expression="x/100")
subtraction = Subtraction(A=height_m, B=expression_4)
neg = Negative(Value=expression_4)
dom = ConstructDomain(DomainStart=neg, DomainEnd=subtraction)
box = DomainBox(Base=PlaneXY(0, 0, 0), X=_2d, Y=_2d_2, Z=dom)
rectangle = Rectangle(Plane=PlaneXY(0, 0, 0), XSize=_2d_2, YSize=_2d, Radius=0)  # -> Rectangle, Length
valueor0 = ValueOr0(value=itemindex_2)
valueor0_2 = ValueOr0(value=itemindex_3)
volume1to500 = Box(box)
list_3 = ValueList({"Round": "round", "Rectangular": "rectangular"}, selected="Round")
entrance_2 = Integer(valueor0)
entrance_3 = Integer(entrance_2)
multiplication = Multiplication(A=entrance_3, B="4")
view_2 = Integer(valueor0_2)
view_3 = Integer(view_2)
multiplication_2 = Multiplication(A=view_3, B="2")
addition = Addition(A=multiplication, B=multiplication_2, C=mirrored)

panel_7 = Panel("""08abe6efbe
f8a0750f34
2a87d1fb6f
d7c20e7ea4
d6ddf1d05d
58af8da8c8
0c53ae86dc
80ad44ffe9
19c41d4361
22564f1ee2
fa19ddafc5
c35e56f23a
bfdbce0be1
c5306eb015
ba36f367e7
ada7ff222e""")
dup = DuplicateData(Data="2", Number="8", Order=True)
concat = Concatenate(FragmentA="https://app.speckle.systems/projects/e7de1a2f8f/models/", FragmentB=panel_7)
trim = TrimTree(Tree=dup, Depth=1)
partition = PartitionList(List=concat, Size=trim)
tstat = TreeStatistics(Tree=partition)  # -> Paths, Length, Count
item_6 = ListItem(List=flatten(tstat.Paths), Index=addition, Wrap=True)
branch = TreeBranch(Tree=partition, Path=item_6, MaintainPaths=True)
item_7 = ListItem(List=flatten(branch), Index=0, Wrap=True)  # -> Item, Item1, Item2

debrep = DeconstructBrep(Brep=volume1to500)  # -> Faces, Edges, Vertices
bool = Boolean(invert(mirror))
trim_2 = TrimTree(Tree=debrep.Edges, Depth=1)
trim_3 = TrimTree(Tree=debrep.Faces, Depth=1)
expression_5 = Expression(x=Slider(30, range=0..100), Expression="x/100")
expression_6 = Expression(x=Slider(65, range=0..100), Expression="x/100")
windowshape = Text(list_3)
itemindex_4 = ItemIndex(L=panel_4, I=windowshape)  # -> i; inputs L: list; same code as itemindex
valueor0_3 = ValueOr0(value=itemindex_4)
windowshape_2 = Integer(valueor0_3)
filter = StreamFilter(Gate=entrance_2, Stream0=mirror, Stream1=bool)
item_8 = ListItem(List=trim_3, Index=0, Wrap=True)  # -> Item, Item1, Item2, Item3, Item4, Item5
window_circle_radius_m = Number(expression_6)
window_offset_wall_m = Number(expression_5)
mirror_2 = Boolean(filter)
mirrored_2 = Boolean(mirror_2)
addition_2 = Addition(A=multiplication, B=multiplication_2, C=mirrored_2)
oldvariant = Integer(addition_2)

aut = ModelAuthor(Name="Ueli Saluz", Email="ueli@semio-tech.org")  # -> Author, Valid, Name, Email

panel_8 = Panel("An ellipsoid sleeping capsule for one person. It has the entrance on the ")
filter_2 = StreamFilter(Gate=mirror, Stream1=" It is mirrored compared to the normal one.")
concat_2 = Concatenate(FragmentA=panel_8, FragmentC=" and has the view to the ", FragmentF=".", FragmentE=filter_2)

# ----
# 2023-2025 Ueli Saluz
# 2025 Elduane Lumpine
# 2025 Christian Hötdke
# Permission is hereby granted, free of charge, to any person obtaining a copy
# of this Grasshopper file and associated documentation files (the "Document"),
# to deal in the Document without restriction, including without limitation the
# rights to use, copy, modify, merge, publish, distribute, sublicense, and/or sell
# copies of the Document, and to permit persons to whom the Document is
# furnished to do so.
# 
# Individual clusters used inside this document might be licensed under
# different terms. This is indicated through a similar copyright notice group
# inside the cluster and otherwise in the license field of the cluster. If you
# have any question please reach out to us: license@semio-tech.com
# 
# THE DOCUMENT IS PROVIDED "AS IS", WITHOUT WARRANTY OF ANY
# KIND, EXPRESS OR IMPLIED, INCLUDING BUT NOT LIMITED TO THE
# WARRANTIES OF MERCHANTABILITY, FITNESS FOR A PARTICULAR
# PURPOSE AND NONINFRINGEMENT. IN NO EVENT SHALL THE
# AUTHORS OR COPYRIGHT HOLDERS BE LIABLE FOR ANY CLAIM,
# DAMAGES OR OTHER LIABILITY, WHETHER IN AN ACTION OF
# CONTRACT, TORT OR OTHERWISE, ARISING FROM, OUT OF OR IN
# CONNECTION WITH THE DOCUMENT OR THE USE OR OTHER
# DEALINGS IN THE DOCUMENT.
number_slider = Slider(80, range=0..100)
expression_7 = Expression(x=number_slider, Expression="x/100")
expression_8 = Expression(x=Slider(200, range=0..1000), Expression="x/100")
expression_9 = Expression(x=Slider(53, range=0..100), Expression="x/100")
door_width_m = Number(expression_7)
door_height_m = Number(expression_8)
door_offset_wall_m = Number(expression_9)

item_9 = ListItem(List=trim_2, Index=0, Wrap=True)  # -> Item, Item1, Item2, Item3
flip = FlipCurve(Curve=item_9.Item)  # -> Curve, Flag
filter_3 = StreamFilter(Gate=mirror_2, Stream0=flip.Curve, Stream1=item_9.Item)
filter_4 = StreamFilter(Gate=mirror_2, Stream0=item_8.Item1, Stream1=item_8.Item3)
filter_5 = StreamFilter(Gate=entrance_2, Stream0=filter_3, Stream1=item_9.Item1)
filter_6 = StreamFilter(Gate=entrance_2, Stream0=item_8.Item, Stream1=filter_4)
addition_3 = Addition(A=door_offset_wall_m, B=expression_4)
eval = EvaluateLength(Curve=filter_5, Length=addition_3, Normalized=False)  # -> Point, Tangent, Parameter
srf_cp = SurfaceClosestPoint(Point=eval.Point, Surface=filter_6)  # -> Point, UVPoint, Distance
evalsrf = EvaluateSurface(Surface=filter_6, Point=srf_cp.UVPoint)  # -> Point, Normal, UDirection, VDirection, Frame
neg_2 = Negative(Value=door_width_m)
filter_7 = StreamFilter(Gate=entrance_2, Stream0=neg_2, Stream1=door_width_m)
filter_8 = StreamFilter(Gate=mirror_2, Stream0=filter_7, Stream1=door_width_m)
and_3 = GateAnd(A=entrance_2, B=mirror_2)
filter_9 = StreamFilter(Gate=and_3, Stream0=filter_8, Stream1=neg_2)
rectangle_2 = Rectangle(Plane=evalsrf.Frame, XSize=filter_9, YSize=door_height_m, Radius=0)  # -> Rectangle, Length
Z = UnitZ(Factor=expression_4)
move = Move(Geometry=rectangle_2.Rectangle, Motion=Z)  # -> Geometry, Transform
door = Rectangle(move.Geometry)

flip_2 = FlipCurve(Curve=item_9.Item1)  # -> Curve, Flag
expression_10 = Expression(x=height_m, Expression="x/2")
filter_10 = StreamFilter(Gate=mirror_2, Stream0=item_9.Item3, Stream1=flip_2.Curve)
addition_4 = Addition(A=window_circle_radius_m, B=window_offset_wall_m, C=expression_4)
Z_2 = UnitZ(Factor=expression_10)
filter_11 = StreamFilter(Gate=mirror_2, Stream0=item_8.Item3, Stream1=item_8.Item1)
eval_2 = EvaluateLength(Curve=filter_10, Length=addition_4, Normalized=False)  # -> Point, Tangent, Parameter
evalsrf_2 = EvaluateSurface(Surface=reparameterize(filter_11), Point="0.5,0.5")  # -> Point, Normal, UDirection, VDirection, Frame
move_2 = Move(Geometry=eval_2.Point, Motion=Z_2)  # -> Geometry, Transform
evalsrf_3 = EvaluateSurface(Surface=reparameterize(item_8.Item2), Point="0.5,0.5")  # -> Point, Normal, UDirection, VDirection, Frame
pl_origin = PlaneOrigin(Base=evalsrf_2.Frame, Origin=move_2.Geometry)
expression_11 = Expression(x=window_circle_radius_m, Expression="x*2")
filter_12 = StreamFilter(Gate=view_2, Stream0=evalsrf_3.Frame, Stream1=pl_origin)
_2d_3 = _2D(x=expression_11)
rectangle_3 = Rectangle(Plane=filter_12, XSize=_2d_3, YSize=_2d_3, Radius=0)  # -> Rectangle, Length
cir = Circle(Plane=filter_12, Radius=window_circle_radius_m)
filter_13 = StreamFilter(Gate=windowshape_2, Stream0=cir, Stream1=rectangle_3.Rectangle)
windowplane = Plane(filter_12)
window = Geometry(filter_13)

panel_9 = Panel("Parallel")  # disabled
m2d_rhino = Make2DRhinoView(Name=panel_9, Clip=True)  # disabled
number_slider_2 = Slider(876, range=0..1000)  # disabled
view_rectangle = ViewRectangle(view=m2d_rhino)  # disabled
expression_12 = Expression(x=Slider(25, range=0..100), Expression="x/100")
expression_13 = Expression(x=Slider(4, range=0..10), Expression="x/100")
expression_14 = Expression(x=Slider(1, range=0..10), Expression="x/100")
previewplane = PreviewPlane(plane=view_rectangle, axis_length=number_slider_2)  # disabled
contour_distance_m = Number(expression_12)
bolts_diameter_m = Number(expression_13)
bolts_offset_m = Number(expression_14)
expression_15 = Expression(x=expression_4, Expression="x/3")

door_2 = Rectangle(door)
explode = Explode(Curve=door, Recursive=True)  # -> Segments, Vertices
trim_4 = TrimTree(Tree=explode.Segments, Depth=1)
item_10 = ListItem(List=trim_4, Index=0, Wrap=True)  # -> Item, Item1, Item2, Item3
eval_3 = EvaluateCurve(Curve=reparameterize(item_10.Item), Parameter="0.5")  # -> Point, Tangent, Angle
Z_3 = UnitZ(Factor=1)
rev = Reverse(Vector=eval_3.Tangent)
xprod = CrossProduct(VectorA=rev, VectorB=Z_3, Unitize=False)  # -> Vector, Length
xprod_2 = CrossProduct(VectorA=eval_3.Tangent, VectorB=Z_3, Unitize=False)  # -> Vector, Length
pl = ConstructPlane(Origin=eval_3.Point, XAxis=eval_3.Tangent, YAxis=xprod.Vector)
doorentranceplane = Plane(pl)

panel_10 = Panel("""east
west""")
panel_11 = Panel("""east
west""")
item_11 = ListItem(List=panel_10, Index=mirror, Wrap=True)
item_12 = ListItem(List=panel_11, Index=mirror, Wrap=True)
panel_12 = Panel("The middle of the main entrance door of the upper entrance floor.")
concat_3 = Concatenate(FragmentA="door capsule", FragmentC=" ", FragmentB=item_11)
concat_4 = Concatenate(FragmentA="door tambour", FragmentC=" ", FragmentB=item_12)
por = ModelPort(
    Validate=validate,
    Description=panel_12,
    Family=concat_3,
    CompatibleFamilies=concat_4,
    Point=eval_3.Point,
    Direction=xprod_2.Vector,
    Qualities="entrance")  # -> Port, Valid, Id, Description, Mandatory, Family, CompatibleFamilies, Point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

prv = PreviewPort(po=por.Port)

box_to_ellipsoid = BoxToEllipsoid(
    length=length_m,
    width=width_m,
    entrance=entrance_2,
    view=view_2,
    mirror=mirror_2,
    door=door,
    capsule=volume1to500,
    windowplane=windowplane,
    entranceplane=evalsrf.Frame,
    windowsurface=window,
    window_offset_wall=expression_15,
    contourdistance=contour_distance_m,
    boltsdiameter=bolts_diameter_m,
    boltsoffset=bolts_offset_m)  # -> capsule1500_2, door_4, srf_2, capsule1200_2, contours1to200_2, bolts_2, boltplanes_2
merge_4 = Merge(Data1=box_to_ellipsoid.capsule1500_2, Data2=box_to_ellipsoid.door_4, Data3=box_to_ellipsoid.srf_2)
merge_5 = Merge(Data1=box_to_ellipsoid.capsule1200_2, Data2=box_to_ellipsoid.door_4)
sunion = SolidUnion(Breps=merge_4)
sunion_2 = SolidUnion(Breps=merge_5)

construction_area_factor = Number(Slider(0.2, range=0..1))
construction_cost_eff_m² = Number(Slider(11500, range=0..20000))
income_month_eff_m² = Number(Slider(300, range=0..500))
maintenance_expenses_month_eff_m² = Number(Slider(20, range=0..30))

srf = Surface(item_8.Item)
srf_2 = Surface(item_8.Item3)
srf_3 = Surface(item_8.Item2)
srf_4 = Surface(item_8.Item4)
srf_5 = Surface(item_8.Item1)
srf_6 = Surface(item_8.Item5)
mirrored_3 = Boolean(mirror_2)
mirrored_4 = Boolean(mirror_2)
filter_14 = StreamFilter(Gate=mirrored_3, Stream0=srf_5, Stream1=srf_2)
filter_15 = StreamFilter(Gate=mirrored_4, Stream0=srf_2, Stream1=srf_5)
merge_6 = Merge(Data1=srf_5, Data2=srf_2)
merge_7 = Merge(Data1=srf_5, Data2=srf)
merge_8 = Merge(Data1=srf, Data2=srf_3)
merge_9 = Merge(Data1=srf_5, Data2=srf_3)
merge_10 = Merge(Data1=srf_2, Data2=srf_3)
merge_11 = Merge(Data1=srf, Data2=srf_2)
entrance_4 = Integer(entrance_2)
window_2 = Integer(view_2)
filter_16 = StreamFilter(Gate=entrance_4, Stream0=srf, Stream1=filter_14)
filter_17 = StreamFilter(Gate=window_2, Stream0=srf_3, Stream1=filter_15)
filter_18 = StreamFilter(
    Gate=oldvariant,
    Stream0=merge_6,
    Stream1=merge_6,
    Stream2=merge_9,
    Stream3=merge_10,
    Stream4=merge_11,
    Stream5=merge_7,
    Stream6=merge_8,
    Stream7=merge_8)

heating_energy_demand_kwh_m²a = Number(Slider(40, range=0..200))
technical_equipment_energy_demand_kwh_m² = Number(Slider(35, range=0..200))  # "Technical Equipment Energy Demand[kWh/m²a]"
cooling_energy_demand_kwh_m²a = Number(Slider(25, range=0..200))

jagged = SettingsSpeed()
mesh = MeshBrep(Brep=sunion, Settings=jagged)
collider = Mesh(mesh)

construction_global_warming_potential_kg = Number(Slider(1200, range=0..2000))  # "Construction Global Warming Potential [kgCO2e/eff. m²]"

maintenance_expenses_month_eff_m²_2 = Number(maintenance_expenses_month_eff_m²)
# Outputs   ->
#                 |
#                 v
construction_global_warming_potential_kg_2 = Number(construction_global_warming_potential_kg)  # "Construction Global Warming Potential [kgCO2e/eff. m²]"
oval_factor = Slider(0.6, range=0..1)
construction_area_factor_2 = Number(construction_area_factor)
technical_equipment_energy_demand_kwh_m²_2 = Number(technical_equipment_energy_demand_kwh_m²)  # "Technical Equipment Energy Demand[kWh/m²a]"
income_month_eff_m²_2 = Number(income_month_eff_m²)
heating_energy_demand_kwh_m²a_2 = Number(heating_energy_demand_kwh_m²a)
cooling_energy_demand_kwh_m²a_2 = Number(cooling_energy_demand_kwh_m²a)
area = Area(Geometry=rectangle.Rectangle)  # -> Area, Centroid
construction_cost_eff_m²_2 = Number(construction_cost_eff_m²)
expression_16 = Expression(x=construction_area_factor_2, Expression="1-x")
multiplication_3 = Multiplication(A=area.Area, B=oval_factor)
multiplication_4 = Multiplication(A=multiplication_3, B=expression_16)
multiplication_5 = Multiplication(A=multiplication_4, B=income_month_eff_m²_2)
multiplication_6 = Multiplication(A=multiplication_4, B=maintenance_expenses_month_eff_m²_2)
expression_17 = Expression(x=multiplication_5, Expression="x*12")
expression_18 = Expression(x=multiplication_6, Expression="x*12")
multiplication_7 = Multiplication(B=construction_global_warming_potential_kg_2)
multiplication_8 = Multiplication(A=heating_energy_demand_kwh_m²a_2, B=multiplication_4)
multiplication_9 = Multiplication(A=cooling_energy_demand_kwh_m²a_2, B=multiplication_4)
multiplication_10 = Multiplication(A=multiplication_4, B=construction_cost_eff_m²_2)
multiplication_11 = Multiplication(A=technical_equipment_energy_demand_kwh_m²_2, B=multiplication_4)
roundmult = RoundToMultiple(N=multiplication_4, M="0.01")  # -> R; inputs N: tree, M: tree
# ---------- roundmult: Python ----------
#Component Information
#--------------------------------------------------------------------------------------------
if ghenv.Component.RunCount<2:
    #General
    #--------------------------------------------------------------------------------------------
    __author__ = "YOUR NAME"
    __version__ = "2000.00.00"
    
    ghenv.Component.Name = "Round to Multiple"
    ghenv.Component.NickName = "RoundMult"
    ghenv.Component.Description = "Rounds a number to the nearest specified multiple."
    ghenv.Component.Message = "VER 1.0"
    ghenv.Component.Category = "Math"
    ghenv.Component.SubCategory = "Arithmetic"
    
     #Inputs
    #--------------------------------------------------------------------------------------------
    inputIndex=0
    
    ghenv.Component.Params.Input[inputIndex].Name = "Number"
    ghenv.Component.Params.Input[inputIndex].NickName = "N"
    ghenv.Component.Params.Input[inputIndex].Description = "Number to round."
    ghenv.Component.Params.Input[inputIndex].Optional = False
    inputIndex+=1
    
    ghenv.Component.Params.Input[inputIndex].Name = "Multiple"
    ghenv.Component.Params.Input[inputIndex].NickName = "M"
    ghenv.Component.Params.Input[inputIndex].Description = "Multiple to round to."
    ghenv.Component.Params.Input[inputIndex].Optional = False
    inputIndex+=1
    
    #Outputs
    #--------------------------------------------------------------------------------------------
    outputIndex=0
    
    ghenv.Component.Params.Output[outputIndex].Name = "Rounded"
    ghenv.Component.Params.Output[outputIndex].NickName = "R"
    ghenv.Component.Params.Output[outputIndex].Description = "Number rounded to the nearest specified multiple."
    outputIndex+=1


#Imports
#--------------------------------------------------------------------------------------------
from System import Object
from Grasshopper import DataTree
import math


#The Component function - Business logic only (e.g. working without trees)
#--------------------------------------------------------------------------------------------
"""Function that this component is computing.
    Inputs:
        number: The number to round.
        multiple: The multiple to round to.
    Output:
        rounded: The number rounded to the nearest specified multiple."""
def RoundToMultiple(number, multiple):
    rounded = math.ceil(number / multiple) * multiple
    return rounded

#Solver - Run with trees to enhance performance drastically
#--------------------------------------------------------------------------------------------
if __name__ == "__main__":
    
    #Initialize trees
    #--------------------------------------------------------------------------------------------
    RoundedTree = DataTree[Object]()
    
    #Data matching
    #--------------------------------------------------------------------------------------------
    for path in N.Paths:
        numberBranch = N.Branch(path)
        for i, number in enumerate(numberBranch):
            multiple = M.Branch(path)[i]
            rounded = RoundToMultiple(number, multiple)
            RoundedTree.Add(rounded, path)
    
     #Assign trees to output
    #--------------------------------------------------------------------------------------------
    R = RoundedTree
# ---------- end roundmult ----------
round = Round(Number=multiplication_10)  # -> Nearest, Floor, Ceiling
roundmult_2 = RoundToMultiple(N=multiplication_7, M="0.01")  # -> R; inputs N: tree, M: tree; same code as roundmult
round_2 = Round(Number=multiplication_8)  # -> Nearest, Floor, Ceiling
round_3 = Round(Number=multiplication_9)  # -> Nearest, Floor, Ceiling
round_4 = Round(Number=multiplication_11)  # -> Nearest, Floor, Ceiling
round_5 = Round(Number=expression_17)  # -> Nearest, Floor, Ceiling
round_6 = Round(Number=expression_18)  # -> Nearest, Floor, Ceiling
merge_12 = Merge(
    Data1=entrance,
    Data2=view,
    Data3=length_m,
    Data4=width_m,
    Data5=height_m,
    Data6=windowshape,
    Data7=roundmult,
    Data8=round.Nearest,
    Data9=round_2.Nearest,
    Data10=round_3.Nearest,
    Data11=round_4.Nearest,
    Data12=round_5.Nearest,
    Data13=round_6.Nearest,
    Data14=roundmult_2)
panel_13 = Panel("""https://search.bsdd.buildingsmart.org/uri/buildingsmart/ifc/4.3/prop/Length
https://search.bsdd.buildingsmart.org/uri/buildingsmart/ifc/4.3/prop/Width
https://search.bsdd.buildingsmart.org/uri/buildingsmart/ifc/4.3/prop/Height

https://identifier.buildingsmart.org/uri/buildingsmart/ifc/4.3/prop/NetFloorArea

https://identifier.buildingsmart.org/uri/buildingsmart/ifc/4.3/prop/EnergyConsumption
https://identifier.buildingsmart.org/uri/buildingsmart/ifc/4.3/prop/EnergyConsumption
https://identifier.buildingsmart.org/uri/buildingsmart/ifc/4.3/prop/EnergyConsumption


https://identifier.buildingsmart.org/uri/etim/etim/9.0/prop/EF016979""")
panel_14 = Panel("""entrance
view
length
width
heigth
window shape
effective floor area
construction cost
heating energy demand
cooling energy demand
technical equipment energy demand
income
maintenance expenses
construction global warming potential""")
panel_15 = Panel(merge_12)
panel_16 = Panel("""m
m
m

m²
€
kWh/a
kWh/a
kWh/a
€/a
€/a
kgCO2e""")
qal = ModelQuality(Validate=validate, Name=panel_14, Value=panel_15, Unit=panel_16, Definition=panel_13)  # -> Quality, Valid, Name, Value, Unit, Definition
filter_19 = StreamFilter(Gate=mirror, Stream1="mirrored")
merge_13 = Merge(Data1=qal.Quality, Data2=filter_19)

mime = ValueList({".stl": "model/stl", ".obj": "model/obj", ".glb": "model/gltf-binary", ".gltf": "model/gltf+json", ".3dm": "model/vnd.3dm", ".speckle": "model/vnd.speckle+json", ".png": "image/png", ".jpg": "image/jpeg", ".jpeg": "image/jpeg", ".svg": "image/svg+xml", ".pdf": "application/pdf", ".zip": "application/zip", ".json": "application/json", ".csv": "text/csv", ".txt": "text/plain"}, selected=".speckle")
concat_5 = Concatenate(FragmentC="ellipsoid-capsule", FragmentD="_", FragmentA=item_2)
concat_6 = Concatenate(FragmentA=concat_5, FragmentB="_", FragmentE="1to200")
concat_7 = Concatenate(FragmentA=concat_5, FragmentB="_", FragmentE="1to500")
concat_8 = Concatenate(FragmentC="representations", FragmentD=sep, FragmentA=concat_5)
concat_9 = Concatenate(FragmentC="representations", FragmentD=sep, FragmentA=concat_7)
concat_10 = Concatenate(FragmentC="representations", FragmentD=sep, FragmentA=concat_6)
concat_11 = Concatenate(FragmentA=concat_8, FragmentB=".glb")
concat_12 = Concatenate(FragmentA=concat_9, FragmentB=".3dm")
concat_13 = Concatenate(FragmentA=concat_10, FragmentB=".3dm")
rep = ModelRepresentation(Validate=validate, Url=concat_11)  # -> Representation, Valid, Url, Description, Tags, Qualities
rep_2 = ModelRepresentation(Validate=validate, Url=concat_12, Tags="1to500")  # -> Representation, Valid, Url, Description, Tags, Qualities
rep_3 = ModelRepresentation(Validate=validate, Url=concat_13, Tags="1to200")  # -> Representation, Valid, Url, Description, Tags, Qualities
trim_5 = TrimTree(Tree=rep_2.Tags, Depth=1)
trim_6 = TrimTree(Tree=rep_3.Tags, Depth=1)
rep_4 = ModelRepresentation(Validate=validate, Url=item_7.Item2, Tags=[mime, trim_6])  # -> Representation, Valid, Url, Description, Tags, Qualities
rep_5 = ModelRepresentation(Validate=validate, Url=item_7.Item1, Tags=[trim_5, mime])  # -> Representation, Valid, Url, Description, Tags, Qualities

concat_14 = Concatenate(FragmentA=concat_5, FragmentB="_", FragmentE="collider")

concat_15 = Concatenate(FragmentC="representations", FragmentD=sep, FragmentA=concat_14)
concat_16 = Concatenate(FragmentA=concat_15, FragmentB=".glb")
concat_17 = Concatenate(FragmentA=concat_15, FragmentB=".3dm")
rep_6 = ModelRepresentation(Url=concat_16, Tags="collider")  # -> Representation, Valid, Url, Description, Tags, Qualities
merge_14 = Merge(
    Data1=rep.Representation,
    Data2=rep_2.Representation,
    Data3=rep_3.Representation,
    Data4=rep_5.Representation,
    Data5=rep_4.Representation,
    Data6=rep_6.Representation)

concat_18 = Concatenate(FragmentA="images/", FragmentC=concat_5, FragmentB=".png")

volume1to500_2 = Brep(sunion)
volume1to200 = Brep(sunion_2)
bolts = Circle(flatten(box_to_ellipsoid.bolts_2))
expression_19 = Expression(x="bolts", y=bolts, Expression="x")
door_3 = Brep(box_to_ellipsoid.door_4)
window_3 = Surface(box_to_ellipsoid.srf_2)
expression_20 = Expression(x="shell", y=volume1to500_2, Expression="x")
merge_15 = Merge(Data1=volume1to500_2, Data2=window_3, Data3=door_3)
merge_16 = Merge(Data1="shell", Data2="window", Data3="door")
rep_7 = ModelRepresentation(Url=concat_17)  # -> Representation, Valid, Url, Description, Tags, Qualities
merge_17 = Merge(Data1=volume1to200, Data2=door_3, Data3=bolts)
merge_18 = Merge(Data1="shell", Data2="door", Data3=expression_19)
concat_19 = Concatenate(FragmentA=par, FragmentB=sep, FragmentC=concat_13)
concat_20 = Concatenate(FragmentA=par, FragmentB=sep, FragmentC=concat_17)
concat_21 = Concatenate(FragmentA=par, FragmentB=sep, FragmentC=concat_12)
concat_22 = Concatenate(FragmentA=par, FragmentB=sep, FragmentC=concat_16)
blc = ExportBlock(path=concat_21, name=concat_7, url=concat_12, geo=merge_15, layer_name=merge_16, export=and)  # -> block_definition_3, path_4, exported_2
blc_2 = ExportBlock(path=concat_19, name=concat_6, url=concat_13, geo=merge_17, layer_name=merge_18, export=and)  # -> block_definition_3, path_4, exported_2
blc_3 = ExportBlock_2(
    path=concat_20,
    name=concat_14,
    url=rep_7.Url,
    geo=collider,
    layer_n="collider",
    dc=ColourSwatch(SwatchColor=RGB(255, 255, 255)),
    export=and)  # -> block_definition_3, path_4, exported_2
geo = ExportGeometry(F=concat_22, G=collider, R=and)  # -> S; inputs G: tree of GeometryBase, R: Boolean
# ---------- geo: C# ----------
// Grasshopper Script Instance
#region Usings
using System;
using System.Linq;
using System.Collections;
using System.Collections.Generic;
using System.Drawing;
using System.IO;

using Rhino;
using Rhino.Geometry;

using Grasshopper;
using Grasshopper.Kernel;
using Grasshopper.Kernel.Data;
using Grasshopper.Kernel.Types;
#endregion

public class Script_Instance : GH_ScriptInstance
{
    #region Notes
    /* 
      Members:
        RhinoDoc RhinoDocument
        GH_Document GrasshopperDocument
        IGH_Component Component
        int Iteration

      Methods (Virtual & overridable):
        Print(string text)
        Print(string format, params object[] args)
        Reflect(object obj)
        Reflect(object obj, string method_name)
    */
    #endregion

    private void RunScript(object F, DataTree<GeometryBase> G, bool R, ref object S)
    {
        // inspired from https://github.com/jhorikawa/GrasshopperProgrammingTutorials/blob/master/0015%20Export%20Geometry%20with%20Grasshopper%20C%23/Export%20Geometry%20with%20Grasshopper%20C%23.gh
        if(R){
            var guids = new List<Guid>();

            for(int i = 0; i < G.BranchCount; i++){
                for(int n = 0; n < G.Branches[i].Count; n++){
                var geom = G.Branches[i][n];
                var guid = Rhino.RhinoDoc.ActiveDoc.Objects.Add(geom);
                guids.Add(guid);
                }
            }

            Rhino.RhinoDoc.ActiveDoc.Objects.Select(guids);

            string cmd = "_-Export " + "\"" + F + "\"" + " _Enter _Enter";

            Rhino.RhinoApp.RunScript(cmd, false);

            Rhino.RhinoDoc.ActiveDoc.Objects.Delete(guids, true);
            S = true;
        }
    }
}
# ---------- end geo ----------

bbox = BoundingBox(Content=flatten(merge_17), Plane=PlaneXY(0, 0, 0), UnionBox=True)  # -> Box, Box_2
geo_2 = PreviewGeometry(geo=merge_17, sc=1)
zoom2bb = ZoomToBoundingBox(N=["Top", "Front", "Right", "Perspective", "Parallel"], BB=bbox.Box, S=0, R=zoom)  # -> F, SBB; inputs BB: Box, R: Boolean
# ---------- zoom2bb: Python ----------
#Component Information
#--------------------------------------------------------------------------------------------
if ghenv.Component.RunCount<2:
    #General
    #--------------------------------------------------------------------------------------------
    __author__ = "Ueli Saluz"
    __version__ = "2022.05.21"
    
    ghenv.Component.Name = "ZoomToBoundingBox"
    ghenv.Component.NickName = "Zoom2BB"
    ghenv.Component.Description = "Zoom the view of a Rhino viewport to a bounding box."
    ghenv.Component.Message = "VER 1.1"
    ghenv.Component.Category = "Display"
    ghenv.Component.SubCategory = "Camera"
    
     #Inputs
    #--------------------------------------------------------------------------------------------
    inputIndex=0
    
    ghenv.Component.Params.Input[inputIndex].Name = "Name"
    ghenv.Component.Params.Input[inputIndex].NickName = "N"
    ghenv.Component.Params.Input[inputIndex].Description = "Name of the viewport"
    ghenv.Component.Params.Input[inputIndex].Optional = False
    inputIndex+=1
    
    ghenv.Component.Params.Input[inputIndex].Name = "BoundingBox"
    ghenv.Component.Params.Input[inputIndex].NickName = "BB"
    ghenv.Component.Params.Input[inputIndex].Description = ""
    ghenv.Component.Params.Input[inputIndex].Optional = False
    inputIndex+=1
    
    ghenv.Component.Params.Input[inputIndex].Name = "ScaleFactor"
    ghenv.Component.Params.Input[inputIndex].NickName = "S"
    ghenv.Component.Params.Input[inputIndex].Description = "A factor for the extension of the bounding box." \
    +"0 means 0 extension, a positive number makes the bounding box larger a negative smaller. The amount is proportional to the length."
    ghenv.Component.Params.Input[inputIndex].Optional = False
    inputIndex+=1
   
    
    ghenv.Component.Params.Input[inputIndex].Name = "Run"
    ghenv.Component.Params.Input[inputIndex].NickName = "R"
    ghenv.Component.Params.Input[inputIndex].Description = "Zoom to the given bounding box."
    ghenv.Component.Params.Input[inputIndex].Optional = False
    inputIndex+=1
    
    #Outputs
    #--------------------------------------------------------------------------------------------
    outputIndex=0
    
    ghenv.Component.Params.Output[outputIndex].Name = "Finished"
    ghenv.Component.Params.Output[outputIndex].NickName = "F"
    ghenv.Component.Params.Output[outputIndex].Description = "Sends True when finished. Just to trigger other depending components."
    outputIndex+=1
    
    ghenv.Component.Params.Output[outputIndex].Name = "ScaledBoundingBox"
    ghenv.Component.Params.Output[outputIndex].NickName = "SBB"
    ghenv.Component.Params.Output[outputIndex].Description = "The scaled bounding box."
    outputIndex+=1


#Imports
#--------------------------------------------------------------------------------------------
from Rhino import RhinoDoc
from Rhino.Geometry import Box

#Solver - Run with trees to enhance performance drastically
#--------------------------------------------------------------------------------------------
if __name__ == "__main__":
    try:
        vp = RhinoDoc.ActiveDoc.Views.Find(N, False).ActiveViewport
        if R:
            box = BB
            bb = BB.BoundingBox
            bb.Inflate(S*box.X.Length,S*box.Y.Length,S*box.Z.Length)
            vp.ZoomBoundingBox(bb)
            SBB = bb
        F = True
    except:
        pass
# ---------- end zoom2bb ----------

rec = Rectangle({Plane=Plane(origin=(15.60693884, 14.69292436, 15.6245417), x=(0.7071067812, -0.7071067812, 0), y=(-0.4082482905, -0.4082482905, 0.8164965809)), Size=Domain2(u=-24.40970167..24.40970167, v=-18.06498235..18.06498235)})
merge_19 = Merge(Data1=volume1to200)
m2d_parallel = Make2DParallelView(Projection=rec)
make2d = Make2D(Geometry=merge_19, View=m2d_parallel, TangentEdges="T", TangentSeams=False, AutoComputeMake2D=True)  # -> VisibleCurves, VisibleIndex, VisibleType, HiddenCurves, HiddenIndex, HiddenType
make2d_2 = Make2D(Geometry=box_to_ellipsoid.srf_2, View=m2d_parallel, TangentEdges="T", TangentSeams=False, AutoComputeMake2D=True)  # -> VisibleCurves, VisibleIndex, VisibleType, HiddenCurves, HiddenIndex, HiddenType
trim_7 = TrimTree(Tree=make2d.VisibleCurves, Depth=1)
trim_8 = TrimTree(Tree=make2d_2.VisibleCurves, Depth=1)
shell = Geometry(trim_7)
window_4 = Geometry(trim_8)

expression_21 = Expression(x="window", y=window_4, Expression="x")
expression_22 = Expression(x="shell", y=shell, Expression="x")
merge_20 = Merge(Data1=expression_22, Data2=expression_21)
merge_21 = Merge(Data1=shell, Data2=window_4)
concat_23 = Concatenate(FragmentA=concat_5, FragmentB="_", FragmentC="icon")
concat_24 = Concatenate(FragmentC="icons", FragmentD=sep, FragmentA=concat_5)
concat_25 = Concatenate(FragmentA=concat_24, FragmentB=".3dm")
concat_26 = Concatenate(FragmentA=par, FragmentB=sep, FragmentC=concat_25)
blc_4 = ExportBlock(path=concat_26, name=concat_23, url=concat_25, geo=merge_21, layer_name=merge_20, export=and_2)  # -> block_definition_3, path_4, exported_2

concat_27 = Concatenate(FragmentA=concat_24, FragmentB=".svg")

typ = ModelType(
    Validate=validate,
    Name="Ellipsoid Capsule",
    Description=concat_2,
    Icon=concat_27,
    Image=concat_18,
    Variant=variant_2,
    Unit="m",
    Representations=merge_14,
    Ports=por.Port,
    Authors=aut.Author,
    Qualities=merge_13)  # -> Type, Valid, Name, Description, Icon, Image, Variant, Stock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
typ_2 = PutType(Type=typ.Type, Uri=par, Run=save)

typ_3 = SerializeType(Type=typ.Type)
txt = EncodeText(Text=typ_3, Mode=0)
type = Text(txt)
context_bake = ContextBake(Geometry=type)

# ==== cluster _2D
x = ClusterInput()
expression = Expression(x=x, Expression="x/2")
neg = Negative(Value=expression)
dom = ConstructDomain(DomainStart=neg, DomainEnd=expression)
I = ClusterOutput(dom)

# ==== cluster ValueOr0
value = ClusterInput()
value_2 = Number(value)
null = NullItem(Item=value_2)  # -> NullFlags, InvalidFlags, Description
filter = StreamFilter(Gate=null.NullFlags, Stream0=value_2, Stream1="0")
valueor0 = Number(filter)
valueor0_2 = ClusterOutput(valueor0)

# ==== cluster PreviewPlane: Preview a plane with axis colors and naming.
axis_length = ClusterInput()
plane = ClusterInput()
axis_length_2 = Number(axis_length)
plane_2 = Plane(plane)
deplane = DeconstructPlane(Plane=plane_2)  # -> Origin, XAxis, YAxis, ZAxis
line = LineSDL(Start=deplane.Origin, Direction=deplane.YAxis, Length=axis_length_2)
line_2 = LineSDL(Start=deplane.Origin, Direction=deplane.XAxis, Length=axis_length_2)
line_3 = LineSDL(Start=deplane.Origin, Direction=deplane.ZAxis, Length=axis_length_2)
swatch = ColourSwatch(SwatchColor=RGB(235, 52, 79))
swatch_2 = ColourSwatch(SwatchColor=RGB(0, 166, 157))
swatch_3 = ColourSwatch(SwatchColor=RGB(240, 117, 24))
end = EndPoints(Curve=line_2)  # -> Start, End
end_2 = EndPoints(Curve=line)  # -> Start, End
end_3 = EndPoints(Curve=line_3)  # -> Start, End
tag = TextTag(Location=end.End, Text="X", Colour=swatch)
tag_2 = TextTag(Location=end_2.End, Text="Y", Colour=swatch_2)
tag_3 = TextTag(Location=end_3.End, Text="Z", Colour=swatch_3)
preview = CustomPreview(Geometry=line_2, Material=swatch)
preview_2 = CustomPreview(Geometry=line, Material=swatch_2)
preview_3 = CustomPreview(Geometry=line_3, Material=swatch_3)

# ==== cluster ViewRectangle
view = ClusterInput()
view_2 = Data(view)
nickname = NAME(view=view_2)  # -> c, x, y, z, h, w
# ---------- nickname: Python ----------
uselss, c, x, y, z = view.GetCameraFrame()
h = view.FrustumHeight
w = view.FrustumWidth
# ---------- end nickname ----------
rev = Reverse(Vector=nickname.x)
rev_2 = Reverse(Vector=nickname.y)
pl = ConstructPlane(Origin=nickname.c, XAxis=rev, YAxis=nickname.y)
_2d = _2D(x=nickname.w)
_2d_2 = _2D(x=nickname.h)
rectangle = Rectangle(Plane=pl, XSize=_2d, YSize=_2d_2, Radius=0)  # -> Rectangle, Length
rec = Rectangle(rectangle.Rectangle)
rec_2 = ClusterOutput(rec)

# ==== cluster ExportBlock: Export geometry with layer names to a file.
path = ClusterInput()
name = ClusterInput()
url = ClusterInput()
geo = ClusterInput()
layer_name = ClusterInput()
export = ClusterInput()
path_2 = FilePath(path)
name_2 = Text(name)
url_2 = Text(url)
geo_2 = Geometry(geo)
layer_name_2 = Text(layer_name)
export_2 = Boolean(export)
layer = ModelLayer(Name=layer_name_2)  # -> Layer, Name, Hidden, Locked, DisplayColour, Material, Linetype
object = ModelObject(Geometry=geo_2, Layer=layer.Layer)  # -> Object, Geometry, Name, Layer, Visibility, Display, Drafting, Render
block_definition = ModelBlockDefinition(Objects=object.Object, Name=name_2, URL=url_2)  # -> BlockDefinition, Objects, Units, Name, Notes, URL, URLDescription
export_definition = ExportModelBlockDefinition(BlockDefinition=block_definition.BlockDefinition, FilePath=path_2, Overwrite="T", Export=export_2)  # -> BlockDefinition, FilePath, Exported
block_definition_2 = ModelBlockDefinition(export_definition.BlockDefinition)
path_3 = FilePath(export_definition.FilePath)
exported = Boolean(export_definition.Exported)
path_4 = ClusterOutput(path_3)
exported_2 = ClusterOutput(exported)
block_definition_3 = ClusterOutput(block_definition_2)

# ==== cluster BoxToEllipsoid
boltsdiameter = ClusterInput()
length = ClusterInput()
width = ClusterInput()
entrance = ClusterInput()
view = ClusterInput()
mirror = ClusterInput()
door = ClusterInput()
capsule = ClusterInput()
windowplane = ClusterInput()
entranceplane = ClusterInput()
windowsurface = ClusterInput()
window_offset_wall = ClusterInput()
contourdistance = ClusterInput()
boltsoffset = ClusterInput()
boltsoffset_2 = Number(boltsoffset)
contourdistance_2 = Number(contourdistance)
boltsdiameter_2 = Number(boltsdiameter)
length_2 = Number(length)
entrance_2 = Integer(entrance)
mirror_2 = Number(mirror)
windowsurface_2 = Surface(windowsurface)
window_offset_wall_2 = Number(window_offset_wall)
width_2 = Number(width)
view_2 = Integer(view)
door_2 = Rectangle(door)
capsule_2 = Box(capsule)
windowplane_2 = Plane(windowplane)
entranceplane_2 = Plane(entranceplane)

box_subd = BoxSubD(box=capsule_2)
deplane = DeconstructPlane(Plane=windowplane_2)  # -> Origin, XAxis, YAxis, ZAxis
rev = Reverse(Vector=deplane.ZAxis)
brep = Brep(box_subd)
project = Project(Curve=windowsurface_2, Brep=brep, Direction=rev)
trim = TrimTree(Tree=project, Depth=1)
item = ListItem(List=trim, Index=0, Wrap=True)  # -> Item, Item1
filter = StreamFilter(Gate=mirror_2, Stream0=item.Item1, Stream1=item.Item)
filter_2 = StreamFilter(Gate=entrance_2, Stream0=item.Item1, Stream1=filter)
not = GateNot(A=view_2)
filter_3 = StreamFilter(Gate=view_2, Stream0=filter_2, Stream1=filter)
and = GateAnd(A=entrance_2, B=not, C=mirror_2)
filter_4 = StreamFilter(Gate=and, Stream0=filter_3, Stream1=item.Item1)

filter_5 = StreamFilter(Gate=entrance_2, Stream0=length_2, Stream1=width_2)
deplane_2 = DeconstructPlane(Plane=entranceplane_2)  # -> Origin, XAxis, YAxis, ZAxis
expression = Expression(x=filter_5, Expression="x/2")
rev_2 = Reverse(Vector=deplane_2.ZAxis)
amp = Amplitude(Vector=rev_2, Amplitude=expression)
extr = Extrude(Base=door_2, Direction=amp)
entrance_3 = Box(extr)

divide = DivideCurve(Curve=filter_4, Count="12", Kinks=False)  # -> Points, Tangents, Parameters
trim_2 = TrimTree(Tree=divide.Points, Depth=1)
panel = Panel("""True
False
False
False""")
cull = CullPattern(List=trim_2, CullPattern=panel)
item_2 = ListItem(List=cull, Index=0, Wrap=True)  # -> Item, Item1, Item2
centroid = Centroid(PointA=item_2.Item, PointB=item_2.Item1, PointC=item_2.Item2)  # -> Centroid, MedianAB, MedianBC, MedianCA
pl_3pt = Plane3Pt(PointA=centroid.Centroid, PointB=item_2.Item, PointC=item_2.Item1)
sec = BrepPlane(Brep=brep, Plane=pl_3pt)  # -> Curves, Points
trim_3 = TrimTree(Tree=sec.Curves, Depth=1)
boundary = BoundarySurfaces(Edges=trim_3)
split = SplitBrep(Brep=brep, Cutter=boundary)
trim_4 = TrimTree(Tree=split, Depth=1)
item_3 = ListItem(List=trim_4, Index=0, Wrap=True)  # -> Item, Item1
cap = CapHoles(Brep=item_3.Item)
window = Surface(item_3.Item1)
crv = Curve(window)
capsule1500 = Brep(cap)
srf = Surface(crv)
sdiff = SolidDifference(BrepsA=entrance_3, BrepsB=capsule1500)
door_3 = Brep(sdiff)
capsule1500_2 = ClusterOutput(capsule1500)
door_4 = ClusterOutput(door_3)
srf_2 = ClusterOutput(srf)

evalsrf = EvaluateSurface(Surface=reparameterize(srf), Point="0.5,0.5")  # -> Point, Normal, UDirection, VDirection, Frame
rev_3 = Reverse(Vector=evalsrf.Normal)
amp_2 = Amplitude(Vector=rev_3, Amplitude=window_offset_wall_2)
extr_2 = Extrude(Base=srf, Direction=amp_2)
Y = UnitY(Factor=1)
X = UnitX(Factor=1)
sdiff_2 = SolidDifference(BrepsA=capsule1500, BrepsB=extr_2)
contour = Contour(Shape=sdiff_2, Point=Point(0, 0, 0), Direction=Y, Distance=contourdistance_2)
contour_2 = Contour(Shape=sdiff_2, Point=Point(0, 0, 0), Direction=X, Distance=contourdistance_2)
capsule1200 = Brep(sdiff_2)
trim_5 = TrimTree(Tree=contour, Depth=1)
trim_6 = TrimTree(Tree=contour_2, Depth=1)
capsule1200_2 = ClusterOutput(capsule1200)
merge = Merge(Data1=trim_5, Data2=trim_6)
contours1to200 = Curve(merge)
contours1to200_2 = ClusterOutput(contours1to200)

explode = Explode(Curve=merge, Recursive=True)  # -> Segments, Vertices
join = JoinCurves(Curves=explode.Segments, Preserve=False)
trim_7 = TrimTree(Tree=join, Depth=1)
trim_8 = TrimTree(Tree=trim_7, Depth=1)
ccx = CurveCurve(CurveA=trim_8, CurveB=graft(trim_8))  # -> Points, ParamsA, ParamsB
trim_9 = TrimTree(Tree=ccx.Points, Depth=1)
trim_10 = TrimTree(Tree=trim_9, Depth=1)
cullpt = CullDuplicates(Points=trim_10, Tolerance="0.01", CullMode=3)  # -> Points, Indices, Valence
srf_cp = SurfaceClosestPoint(Point=cullpt.Points, Surface=srf)  # -> Point, UVPoint, Distance
smaller = SmallerThan(FirstNumber=srf_cp.Distance, SecondNumber="0.001")  # -> SmallerThan, OrEqualTo
dispatch = Dispatch(List=cullpt.Points, DispatchPattern=smaller.SmallerThan)  # -> ListA, ListB
brep_cp = BrepClosestPoint(Point=dispatch.ListB, Brep=capsule1200)  # -> Point, Normal, Distance
trim_11 = TrimTree(Tree=brep_cp.Normal, Depth=1)
trim_12 = TrimTree(Tree=brep_cp.Point, Depth=1)
amp_3 = Amplitude(Vector=trim_11, Amplitude=boltsoffset_2)
move = Move(Geometry=trim_12, Motion=amp_3)  # -> Geometry, Transform
expression_2 = Expression(x=boltsdiameter_2, Expression="x/2")
pl = PlaneNormal(Origin=move.Geometry, ZAxis=trim_11)
cir = Circle(Plane=pl, Radius=expression_2)
boltplanes = Plane(pl)
bolts = Circle(cir)
bolts_2 = ClusterOutput(bolts)
boltplanes_2 = ClusterOutput(boltplanes)

# ==== cluster ExportBlock_2: Export geometry with layer names to a file.
dc = ClusterInput()
layer_n = ClusterInput()
path = ClusterInput()
name = ClusterInput()
url = ClusterInput()
geo = ClusterInput()
export = ClusterInput()
path_2 = FilePath(path)
name_2 = Text(name)
url_2 = Text(url)
geo_2 = Geometry(geo)
export_2 = Boolean(export)
layer_n_2 = Name(layer_n)
dc_2 = DisplayColour(dc)
layer = ModelLayer(Name=layer_n_2, DisplayColour=dc_2)  # -> Layer, Name, Hidden, Locked, DisplayColour, Material, Linetype, PrintColour, PrintWidth
object = ModelObject(Geometry=geo_2, Layer=layer.Layer)  # -> Object, Geometry, Name, Layer, Visibility, Display, Drafting, Render
block_definition = ModelBlockDefinition(Objects=object.Object, Name=name_2, URL=url_2)  # -> BlockDefinition, Objects, Units, Name, Notes, URL, URLDescription
export_definition = ExportModelBlockDefinition(BlockDefinition=block_definition.BlockDefinition, FilePath=path_2, Overwrite="T", Export=export_2)  # -> BlockDefinition, FilePath, Exported
block_definition_2 = ModelBlockDefinition(export_definition.BlockDefinition)
path_3 = FilePath(export_definition.FilePath)
exported = Boolean(export_definition.Exported)
path_4 = ClusterOutput(path_3)
exported_2 = ClusterOutput(exported)
block_definition_3 = ClusterOutput(block_definition_2)

# ==== cluster PreviewPort: Preview a port by showing the point and direction and if exists: id, family and compatible families.
po = ClusterInput()
sc = ClusterInput()
sc_2 = Number(sc)
po_2 = Port(po)
por = ModelPort(Port=po_2)  # -> Port, Valid, Id, Description, Mandatory, Family, CompatibleFamilies, Point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
swatch = ColourSwatch(SwatchColor=RGB(235, 52, 79))
swatch_2 = ColourSwatch(SwatchColor=RGB(250, 149, 0))
amp = Amplitude(Vector=por.Direction, Amplitude=sc_2)
lng = ListLength(List=por.CompatibleFamilies)
expression = Expression(x=por.Family, Expression="x=\"\"")
cull = CullPattern(List=por.Point, CullPattern=expression)
expression_2 = Expression(x=lng, Expression="x=0")
join = TextJoin(Text=por.CompatibleFamilies, Join=",")
merge = Merge(Data1=":")
trim = TrimTree(Tree=join, Depth=1)
trim_2 = TrimTree(Tree=expression_2, Depth=1)
item = ListItem(List=merge, Index=expression, Wrap=invert(True))
log = Logarithm(Value=sc_2)
concat = Concatenate(FragmentA="[", FragmentB=trim, FragmentC="]")
expression_3 = Expression(y=trim_2, Expression="x")
merge_2 = Merge(Data1=graft(concat), Data2=graft(expression_3))
item_2 = ListItem(List=merge_2, Index=graft(expression), Wrap=invert(True))
multiplication = Multiplication(A=log, B=Slider(2, range=0..10))
trim_3 = TrimTree(Tree=item_2, Depth=1)
concat_2 = Concatenate(FragmentA=por.Id, FragmentB=item, FragmentC=por.Family, FragmentD=trim_3)
preview = CustomPreview(Geometry=cull, Material=swatch)
tag = TextTag(Location=por.Point, Text=concat_2, Colour=swatch)
vdisex = VectorDisplayEx(Point=por.Point, Vector=amp, Colour=ColourSwatch(SwatchColor=RGB(0, 166, 157)), Width=multiplication)

# ==== cluster PreviewGeometry: Preview geometry by ungrouping everything, showing light surfaces and dark edges.
sc = ClusterInput()
geo = ClusterInput()
geo_2 = Geometry(flatten(geo))
sc_2 = Number(sc)
expression = Expression(x=sc_2, Expression="x+1")
swatch = ColourSwatch(SwatchColor=RGB(0, 0, 0))
swatch_2 = ColourSwatch(SwatchColor=RGB(255, 255, 255))
ungroup = Ungroup(Group=geo_2)
ungroup_2 = Ungroup(Group=ungroup)
ungroup_3 = Ungroup(Group=ungroup_2)
ungroup_4 = Ungroup(Group=ungroup_3)
log = Logarithm(Value=expression)
clean = CleanTree(RemoveNulls=True, RemoveInvalid=True, RemoveEmpty=invert(False), Tree=ungroup_4)  # -> flatten(Tree)
multiplication = Multiplication(A=log, B=Slider(0.05, range=0..1))
linetype = ModelLinetype(Name="semio", Width=multiplication)  # -> ModelLinetype, Name, Segments, CapStyle, JoinStyle, Width, WidthUnits, TaperWidths, TaperPositions
dispatch = CSharpScript(D=clean)  # -> P, C, B, M, R
# ---------- dispatch: C# ----------
// Grasshopper Script Instance
#region Usings
using System;
using System.Linq;
using System.Collections;
using System.Collections.Generic;
using System.Drawing;

using Rhino;
using Rhino.Geometry;

using Grasshopper;
using Grasshopper.Kernel;
using Grasshopper.Kernel.Data;
using Grasshopper.Kernel.Types;
#endregion

public class Script_Instance : GH_ScriptInstance
{
    #region Notes
    /* 
      Members:
        RhinoDoc RhinoDocument
        GH_Document GrasshopperDocument
        IGH_Component Component
        int Iteration

      Methods (Virtual & overridable):
        Print(string text)
        Print(string format, params object[] args)
        Reflect(object obj)
        Reflect(object obj, string method_name)
    */
    #endregion

    private void RunScript(
	object D,
	ref object P,
	ref object C,
	ref object B,
	ref object M,
	ref object R)
    {
        if (D is Curve) C = D; // Curve
        else if (
            D is Rhino.Geometry.Point ||
            D is PointCloud
            )
            P = D; // Point
        else if ( D is Mesh) M = D; // Mesh
        else if (
            D is Surface ||
            D is Extrusion ||
            D is SubD ||
            D is Brep
            )
            B = D; // Brep
        else R = D; // Rest
            
    }
}
# ---------- end dispatch ----------
clean_2 = CleanTree(RemoveNulls=True, RemoveInvalid=True, RemoveEmpty=False, Tree=dispatch.M)
clean_3 = CleanTree(RemoveNulls=True, RemoveInvalid=True, RemoveEmpty=False, Tree=dispatch.R)
clean_4 = CleanTree(RemoveNulls=True, RemoveInvalid=True, RemoveEmpty=False, Tree=dispatch.B)
clean_5 = CleanTree(RemoveNulls=True, RemoveInvalid=True, RemoveEmpty=False, Tree=dispatch.P)
clean_6 = CleanTree(RemoveNulls=True, RemoveInvalid=True, RemoveEmpty=False, Tree=dispatch.C)
debrep = DeconstructBrep(Brep=clean_4)  # -> Faces, Edges, Vertices
preview = CustomPreview(Geometry=flatten(clean_5), Material=swatch)
preview_2 = CustomPreview(Geometry=flatten(debrep.Faces), Material=swatch_2)
preview_3 = CustomPreview(Geometry=flatten(clean_2), Material=swatch_2)
preview_4 = CustomPreview(Geometry=flatten(clean_3), Material=swatch)
curve_preview = CustomCurvePreview(Curve=clean_6, Linetype=linetype.ModelLinetype, Colour=swatch)
curve_preview_2 = CustomCurvePreview(Curve=debrep.Edges, Linetype=linetype.ModelLinetype, Colour=swatch)

# ==== cluster BoxSubD
box = ClusterInput()
box_2 = Box(box)
mesh = MeshBrep(
    Brep=box_2,
    Settings={GridMaxCount=0, GridMinCount=16, JaggedSeams=False, MaxEdgeLength=0, MinEdgeLength=0.0001, MinTolerance=0, Refine=True, RefineAngle=0, RelativeTolerance=0.65, SimplePlanes=True, Tolerance=0})
subdmesh = SubDFromMesh(Mesh=mesh, Creases=1, Corners=1, Interpolate=Toggle(False))
bbox = BoundingBox(Content=subdmesh, Plane=PlaneXY(0, 0, 0))  # -> Box, Box_2
trim = TrimTree(Tree=bbox.Box, Depth=1)
boxmap = BoxMapping(Geometry=subdmesh, Source=trim, Target=box_2)  # -> Geometry, Transform
subd = SubD(boxmap.Geometry)
subd_2 = ClusterOutput(subd)
