# Grasshopper definition external-stair.gh (Grasshopper 1.0.8)
# Copyright: GNU Lesser General Public License Version 3
# plug-ins: RhinoCodePluginGH, semio

txt = NormalizeText(Text="external stair")  # -> Strict, Title, Underscore, Kebab, Pascal
panel = Panel("""Platform Top
Platform Top Double
Platform Top Double Open""")
number_slider = Slider(3, range=0..3)
save_representation = BooleanToggle(False)
icon_export = BooleanToggle(False)
validate = BooleanToggle(False)
save = BooleanToggle(False)
dir = Directory()  # -> D, F
# ---------- dir: C# ----------
#region Usings
using System;
using System.Linq;
using System.Collections;
using System.Collections.Generic;
using System.Drawing;
using System.IO;

using Rhino;
using Rhino.Geometry;

using Grasshopper;
using Grasshopper.Kernel;
using Grasshopper.Kernel.Data;
using Grasshopper.Kernel.Types;
#endregion

public class Script_Instance : GH_ScriptInstance
{
    private void RunScript(ref object D, ref object F)
    {
        F = this.GrasshopperDocument.FilePath;
        D = Path.GetDirectoryName((string)F);
    }
}
# ---------- end dir ----------
sep = Separator()  # -> S; same code as sep
concat = Concatenate(FragmentC=dir.D, FragmentA=sep, FragmentD=txt.Kebab, FragmentB=".3dm")
import = ImportContent(FilePath=concat, Import=Toggle(True))  # -> ModelTransform, Objects, Layers, Linetypes, HatchPatterns, AnnotationStyles, Materials, BlockDefinitions
object = ModelObject(Object=import.Objects)  # -> Object, Geometry, Name, Layer, Visibility, Display, Drafting, Render
layer = ModelLayer(Layer=import.Layers)  # -> Layer, Name, Hidden, Locked, DisplayColour, Material, Linetype
panel_2 = Panel("""_platform-top
_platform-top-double
_platform-top-double-open""")
loop_slider = PythonScript(
    SliderToModify=number_slider,
    Min="0",
    Max="3",
    stepSize="1",
    Delay=Slider(0, range=0..1),
    Run=Toggle(False),
    Reset=Button())  # inputs Run: Boolean, Reset: Boolean
# ---------- loop_slider: Python ----------
import time

def updateSliderInput(inputName,min,max,value,decimalPlace=2):
    for input in ghenv.Component.Params.Input:
        for source in input.Sources:
            if input.Name == str(inputName):
                source.Slider.DecimalPlaces = decimalPlace
                source.Slider.Minimum = min
                source.Slider.Maximum = max
                source.Slider.Value = value
                source.ExpireSolution(True)

def countDecimal(number):
    string= str(number)
    return string[::-1].find('.')

if Run == True:
    if SliderToModify < Max:
        time.sleep(Delay)
        updateSliderInput("SliderToModify",Min,Max,SliderToModify+stepSize,countDecimal(stepSize))
if Reset == True:
    updateSliderInput("SliderToModify",Min,Max,Min)
# ---------- end loop_slider ----------
par = ParentDirectory(D=dir.D)  # -> P; inputs D: String
# ---------- par: C# ----------
#region Usings
using System;
using System.Linq;
using System.Collections;
using System.Collections.Generic;
using System.Drawing;
using System.IO;

using Rhino;
using Rhino.Geometry;

using Grasshopper;
using Grasshopper.Kernel;
using Grasshopper.Kernel.Data;
using Grasshopper.Kernel.Types;
#endregion

public class Script_Instance : GH_ScriptInstance
{
    private void RunScript(string D, ref object P)
    {
        P = new DirectoryInfo(D).Parent;
    }
}
# ---------- end par ----------
item = ListItem(List=panel, Index=number_slider, Wrap=True)
panel_3 = Panel(item)
and = GateAnd(A=save, B=save_representation)
and_2 = GateAnd(A=save, B=icon_export)

# ----
# For sloped terrain
list = ValueList({"Default": "", "Last Storey"}, selected="Default")
list_2 = ValueList({"Default": "", "Last Storey"}, selected="Last Storey")
list_3 = ValueList({"Default": "", "First Storey", "Last Storey"}, selected="First Storey")
# 2023-2025 Ueli Saluz
# 2025 Elduane Lumpine
# 2025 Christian Hötdke
# Permission is hereby granted, free of charge, to any person obtaining a copy
# of this Grasshopper file and associated documentation files (the "Document"),
# to deal in the Document without restriction, including without limitation the
# rights to use, copy, modify, merge, publish, distribute, sublicense, and/or sell
# copies of the Document, and to permit persons to whom the Document is
# furnished to do so.
# 
# Individual clusters used inside this document might be licensed under
# different terms. This is indicated through a similar copyright notice group
# inside the cluster and otherwise in the license field of the cluster. If you
# have any question please reach out to us: license@semio-tech.com
# 
# THE DOCUMENT IS PROVIDED "AS IS", WITHOUT WARRANTY OF ANY
# KIND, EXPRESS OR IMPLIED, INCLUDING BUT NOT LIMITED TO THE
# WARRANTIES OF MERCHANTABILITY, FITNESS FOR A PARTICULAR
# PURPOSE AND NONINFRINGEMENT. IN NO EVENT SHALL THE
# AUTHORS OR COPYRIGHT HOLDERS BE LIABLE FOR ANY CLAIM,
# DAMAGES OR OTHER LIABILITY, WHETHER IN AN ACTION OF
# CONTRACT, TORT OR OTHERWISE, ARISING FROM, OUT OF OR IN
# CONNECTION WITH THE DOCUMENT OR THE USE OR OTHER
# DEALINGS IN THE DOCUMENT.
stair = Stair(variant=list)  # -> ty_2, geo_2
stair_2 = Stair(variant=list_3)  # -> ty_2, geo_2
stair_3 = Stair(variant=list_2)  # -> ty_2, geo_2

brep = Brep(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)
panel_4 = Panel("""s
p-w
p-e
p-s""")
panel_5 = Panel("""s
p-w
p-e""")
variant = GetString(item, AtLeast=0, AtMost=1, TreeAccess=False)
panel_6 = Panel("""s
e""")
panel_7 = Panel("""s
p-w""")
panel_8 = Panel("An external stair with no platform on the beginning and a platform on the end.")
panel_9 = Panel("An external stair with no platform on the beginning and a double-sized platform with an opening for another stair on the end.")
panel_10 = Panel("An external stair with no platform on the beginning and a double-sized platform on the end.")

panel_11 = Panel("""f9222724e5
b27c179b7d
89d6e55762
c5850e2821
53dc156694
345fa2173d
73566dc911
8965b08c83""")  # disabled
panel_12 = Panel("https://app.speckle.systems/projects/e7de1a2f8f/models/")  # disabled
panel_13 = Panel("2")  # disabled
panel_14 = Panel("4")  # disabled
dup = DuplicateData(Data=panel_13, Number=panel_14, Order=True)  # disabled
concat_2 = Concatenate(FragmentA=panel_12, FragmentB=panel_11)  # disabled
trim = TrimTree(Tree=dup, Depth=1)  # disabled
partition = PartitionList(List=concat_2, Size=trim)  # disabled
tstat = TreeStatistics(Tree=partition)  # -> Paths, Length, Count; disabled
item_2 = ListItem(List=flatten(tstat.Paths), Index=0, Wrap=True)  # disabled
branch = TreeBranch(Tree=partition, Path=item_2, MaintainPaths=True)  # disabled
item_3 = ListItem(List=flatten(branch), Index=0, Wrap=True)  # -> Item, Item1; disabled

pt = Point([Point(0, 0, 0), Point(3.90222032, 0, 1.681818)])
band = Brep([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])

steps_surface = Brep(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)
lower_band = Brep([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])
steps_volume = Brep([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])
upper_band = Brep([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])
stairs_volume = Brep(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)
railing_posts = Brep([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])
handrailing = Brep([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])
collider = Mesh(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)
platform_modules = Brep([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])
walking_volume = Brep(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)
merge = Merge(Data1=stairs_volume, Data2=band)
merge_2 = Merge(Data1=stairs_volume, Data2=band, Data3=railing_posts, Data4=handrailing)
band_2 = Brep([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])
railing_posts_2 = Brep([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])
handrailing_2 = Brep([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])
collider_2 = Mesh(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)
platform = Brep(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)
railing_posts_3 = Brep([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])
handrailing_3 = Brep([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])
walking_volume_2 = Brep(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)
merge_3 = Merge(Data1=walking_volume_2, Data2=band_2)
merge_4 = Merge(Data1=walking_volume_2, Data2=band_2, Data3=railing_posts_2, Data4=handrailing_2)
band_3 = Brep([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])
collider_3 = Mesh(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)
merge_5 = Merge(Data1=walking_volume, Data2=band_3)
merge_6 = Merge(Data1=walking_volume, Data2=band_3, Data3=railing_posts_3, Data4=handrailing_3)
railing_posts_4 = Brep([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])
band_4 = Brep([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])
handrailing_4 = Brep([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])
merge_7 = Merge(Data1=walking_volume, Data2=band_4)
merge_8 = Merge(Data1=walking_volume, Data2=band_4, Data3=railing_posts_4, Data4=handrailing_4)
default = Geometry(merge)
platform_top_double = Geometry(merge_5)
platform_top_double_open = Geometry(merge_7)
platform_top = Geometry(merge_3)
default_2 = Geometry(merge_2)
platform_top_2 = Geometry(merge_4)
platform_top_double_2 = Geometry(merge_6)
platform_top_double_open_2 = Geometry(merge_8)

vec = Vector([Vector(-1, 0, 0), Vector(1, 0, 0)])
itemindex = ItemIndex(L=panel, I=variant)  # -> i; inputs L: list; same code as itemindex
item_4 = ListItem(List=panel_2, Index=itemindex, Wrap=True)

mime = ValueList({".stl": "model/stl", ".obj": "model/obj", ".glb": "model/gltf-binary", ".gltf": "model/gltf+json", ".3dm": "model/vnd.3dm", ".speckle": "model/vnd.speckle+json", ".png": "image/png", ".jpg": "image/jpeg", ".jpeg": "image/jpeg", ".svg": "image/svg+xml", ".pdf": "application/pdf", ".zip": "application/zip", ".json": "application/json", ".csv": "text/csv", ".txt": "text/plain"}, selected=".speckle")
concat_3 = Concatenate(FragmentA="tambour", FragmentB=item_4)
concat_4 = Concatenate(FragmentA=concat_3, FragmentB="_", FragmentE="1to500")
concat_5 = Concatenate(FragmentA=concat_3, FragmentB="_", FragmentE="collider")
concat_6 = Concatenate(FragmentA=concat_3, FragmentB="_", FragmentE="1to200")
concat_7 = Concatenate(FragmentC="representations", FragmentA=concat_3)
concat_8 = Concatenate(FragmentC="representations", FragmentA=concat_4)
concat_9 = Concatenate(FragmentC="representations", FragmentA=concat_5)
concat_10 = Concatenate(FragmentC="representations", FragmentA=concat_6)
concat_11 = Concatenate(FragmentA=concat_7, FragmentB=".glb")
concat_12 = Concatenate(FragmentA=concat_8, FragmentB=".3dm")
concat_13 = Concatenate(FragmentA=concat_10, FragmentB=".3dm")
concat_14 = Concatenate(FragmentA=concat_9, FragmentB=".glb")
concat_15 = Concatenate(FragmentA=concat_9, FragmentB=".3dm")
rep = ModelRepresentation(Url=concat_11)  # -> Representation, Valid, Url, Description, Tags, Qualities
rep_2 = ModelRepresentation(Url=concat_13, Tags="1to200")  # -> Representation, Valid, Url, Description, Tags, Qualities
rep_3 = ModelRepresentation(Url=concat_14, Tags="collider")  # -> Representation, Valid, Url, Description, Tags, Qualities
rep_4 = ModelRepresentation(Url=concat_12)  # -> Representation, Valid, Url, Description, Tags, Qualities
trim_2 = TrimTree(Tree=rep_2.Tags, Depth=1)
trim_3 = TrimTree(Tree=rep_4.Tags, Depth=1)
rep_5 = ModelRepresentation(Url=item_3.Item, Tags=[trim_3, mime])  # -> Representation, Valid, Url, Description, Tags, Qualities
rep_6 = ModelRepresentation(Url=item_3.Item1, Tags=[trim_2, mime])  # -> Representation, Valid, Url, Description, Tags, Qualities
merge_9 = Merge(
    Data1=rep.Representation,
    Data2=rep_4.Representation,
    Data3=rep_2.Representation,
    Data4=rep_5.Representation,
    Data5=rep_6.Representation,
    Data6=rep_3.Representation)

band_5 = Brep()
pt_2 = Point([Point(0, 0, 0), Point(5.40222032, 0, 1.681818)])
vec_2 = Vector([Vector(-1, 0, 0), Vector(1, 0, 0)])
vec_3 = Vector([Vector(-1, 0, 0), Vector(1, 0, 0), Vector(1, 0, 0)])
save_representation_2 = BooleanToggle(False)
band_6 = Brep()
pt_3 = Point([Point(0, 0, 0), Point(5.40222032, 0, 1.681818), Point(5.40222032, -1.668820631, 1.681818)])
icon_export_2 = BooleanToggle(False)
validate_2 = BooleanToggle(False)
save_2 = BooleanToggle(False)
band_7 = Brep()
pt_4 = Point([Point(0, 0, 0), Point(5.40222032, 0, 1.681818), Point(5.40222032, -1.668820631, 1.681818), Point(3.90222032, -1.668820631, 1.681818)])
vec_4 = Vector([Vector(-1, 0, 0), Vector(1, 0, 0), Vector(1, 0, 0), Vector(-1, 0, 0)])
sep_2 = Separator()  # -> S; same code as sep
dir_2 = Directory()  # -> D
# ---------- dir_2: C# ----------
#region Usings
using System;
using System.Linq;
using System.Collections;
using System.Collections.Generic;
using System.Drawing;
using System.IO;

using Rhino;
using Rhino.Geometry;

using Grasshopper;
using Grasshopper.Kernel;
using Grasshopper.Kernel.Data;
using Grasshopper.Kernel.Types;
#endregion

public class Script_Instance : GH_ScriptInstance
{
    private void RunScript(ref object D)
    {
        D = Path.GetDirectoryName(this.GrasshopperDocument.FilePath);
    }
}
# ---------- end dir_2 ----------
panel_15 = Panel("""stair start
stair end""")
# stair start
# platform west
# platform east
# stair start
# platform west
# platform east
# platform stair
panel_16 = Panel("""stair start
platform west""")
# ^                                    ^
#    |                                     |
# <-- Constants    Preview -->
# Parameters    External    Local -->
# <-- Meta               |
#      |                       v
#      v
par_2 = ParentDirectory(D=dir_2)  # -> P; inputs D: String; same code as par
and_3 = GateAnd(A=save_2, B=icon_export_2)
and_4 = GateAnd(A=save_2, B=save_representation_2)
# stair start
# platform west
# platform east
# stair start
# platform west
# platform east
# platform stair
panel_18 = Panel("""stair start
platform west""")

subtraction = Subtraction()
filter = StreamFilter(Gate=0, Stream0=subtraction)
filter_2 = StreamFilter(Gate=0, Stream1="0")
Z = UnitZ(Factor=1)
rev = Reverse(Vector=Z)
pt_5 = ConstructPoint(XCoordinate=0, YCoordinate=0, ZCoordinate=filter)
pt_6 = ConstructPoint(XCoordinate=0, YCoordinate=0, ZCoordinate=filter_2)

variant_2 = GetString("", AtLeast=0, AtMost=1, TreeAccess=False)
filter_3 = StreamFilter(Gate=itemindex, Stream0=default, Stream1=platform_top, Stream2=platform_top_double, Stream3=platform_top_double_open)
filter_4 = StreamFilter(
    Gate=itemindex,
    Stream0=default_2,
    Stream1=platform_top_2,
    Stream2=platform_top_double_2,
    Stream3=platform_top_double_open_2)
filter_5 = StreamFilter(Gate=itemindex, Stream0=collider, Stream1=collider_2, Stream2=collider_3, Stream3=collider_3)
filter_6 = StreamFilter(Gate=itemindex, Stream0=pt, Stream1=pt_2, Stream2=pt_3, Stream3=pt_4)
filter_7 = StreamFilter(Gate=itemindex, Stream0=vec, Stream1=vec_2, Stream2=vec_3, Stream3=vec_4)
filter_8 = StreamFilter(Gate=itemindex, Stream0=panel_6, Stream1=panel_7, Stream2=panel_5, Stream3=panel_4)
filter_9 = StreamFilter(Gate=itemindex, Stream0="An external stair with no platforms", Stream1=panel_8, Stream2=panel_10, Stream3=panel_9)
filter_10 = StreamFilter(Gate=itemindex, Stream0=brep, Stream1=platform_top, Stream2=platform_top_double, Stream3=platform_top_double_open)
paper = Geometry(filter_10)
_1to500 = Geometry(filter_3)
_1to200 = Geometry(filter_4)
geo = PreviewGeometry(geo=_1to200, sc=1)
collider_4 = Mesh(filter_5)
pt_7 = Point(filter_6)
vec_5 = Vector(filter_7)
id = Id(filter_8)
description = Description(filter_9)
panel_19 = Panel(collider_4)
aut = ModelAuthor(Name="Ueli Saluz", Email="ueli@semio-tech.org")  # -> Author, Valid, Name, Email
concat_16 = Concatenate(FragmentA="icons/", FragmentB=concat_3, FragmentC=".svg")
concat_17 = Concatenate(FragmentA="images/", FragmentB=concat_3, FragmentC=".svg")
typ = ModelType(Name="Tambour", Icon=concat_16, Image=concat_17, Unit="m", Representations=merge_9, Authors=aut.Author)  # -> Type, Valid, Name, Description, Icon, Image, Variant, Stock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
por = ModelPort(Id=id, Description=description, Point=pt_7, Direction=vec_5)  # -> Port, Valid, Id, Description, Mandatory, Family, CompatibleFamilies, Point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
aut_2 = ModelAuthor(Name="Ueli Saluz", Email="ueli@semio-tech.com")  # -> Author, Valid, Name, Email
entwine = Entwine(Branch00=_1to500, Branch01=_1to200, FlattenInputs=True)
panel_20 = Panel("""1to500
1to200""")
typ_2 = PutType(Type=typ.Type, Run=False)
typ_3 = OppinionatedType(
    path=par,
    na="external stair",
    description=description,
    variant=variant,
    default=_1to500,
    collider=collider_4,
    O=entwine,
    tags=graft(panel_20),
    po=por.Port,
    authors=aut_2.Author,
    export=Toggle(False))  # -> ty_2, ba_2, us_2, S_2
prv = PreviewPort(po=por.Port)
panel_21 = Panel(typ_3.ty_2)
panel_22 = Panel(typ_3.ba_2)
maintenance_expenses_month_eff_m² = Number(Slider(5, range=0..10))
construction_cost_eff_m² = Number(Slider(4500, range=0..10000))

panel_23 = Panel("https://app.speckle.systems")  # disabled
mime_2 = ValueList({".stl": "model/stl", ".obj": "model/obj", ".glb": "model/gltf-binary", ".gltf": "model/gltf+json", ".3dm": "model/vnd.3dm", ".speckle": "model/vnd.speckle+json", ".png": "image/png", ".jpg": "image/jpeg", ".jpeg": "image/jpeg", ".svg": "image/svg+xml", ".pdf": "application/pdf", ".zip": "application/zip", ".json": "application/json", ".csv": "text/csv", ".txt": "text/plain"}, selected=".speckle")  # disabled
panel_24 = Panel("/projects/")  # disabled
panel_25 = Panel("e7de1a2f8f")  # disabled
panel_26 = Panel("/models/")  # disabled
concat_18 = Concatenate(FragmentA="external-stair", FragmentB="_", FragmentE="collider")
concat_19 = Concatenate(FragmentA="external-stair", FragmentB="_", FragmentE="1to200")
concat_20 = Concatenate(FragmentA="external-stair", FragmentB="_", FragmentE="1to500")
panel_27 = Panel("833a270493")  # disabled
panel_28 = Panel("c7c924a1d6")  # disabled
concat_21 = Concatenate(FragmentC="representations", FragmentD=sep_2, FragmentA="external-stair")
concat_22 = Concatenate(FragmentC="representations", FragmentD=sep_2, FragmentA=concat_19)
concat_23 = Concatenate(FragmentC="representations", FragmentD=sep_2, FragmentA=concat_20)
concat_24 = Concatenate(FragmentA=panel_23, FragmentB=panel_24, FragmentC=panel_25, FragmentD=panel_26, FragmentE=panel_27)
concat_25 = Concatenate(FragmentA=concat_21, FragmentB=".glb")
concat_26 = Concatenate(FragmentA=concat_23, FragmentB=".3dm")
concat_27 = Concatenate(FragmentA=concat_22, FragmentB=".3dm")
concat_28 = Concatenate(FragmentA=panel_23, FragmentB=panel_24, FragmentC=panel_25, FragmentD=panel_26, FragmentE=panel_28)
rep_7 = ModelRepresentation(Validate=validate_2, Url=concat_25)  # -> Representation, Valid, Url, Description, Tags, Qualities
concat_29 = Concatenate(FragmentC="representations", FragmentD=sep_2, FragmentA=concat_18)
rep_8 = ModelRepresentation(Validate=validate_2, Url=concat_26, Tags="1to500")  # -> Representation, Valid, Url, Description, Tags, Qualities
rep_9 = ModelRepresentation(Validate=validate_2, Url=concat_27, Tags="1to200")  # -> Representation, Valid, Url, Description, Tags, Qualities
concat_30 = Concatenate(FragmentA=concat_29, FragmentB=".glb")
concat_31 = Concatenate(FragmentA=concat_29, FragmentB=".3dm")
rep_10 = ModelRepresentation(Validate=validate_2, Url=concat_30, Tags="collider")  # -> Representation, Valid, Url, Description, Tags, Qualities
trim_4 = TrimTree(Tree=rep_8.Tags, Depth=1)
trim_5 = TrimTree(Tree=rep_9.Tags, Depth=1)
rep_11 = ModelRepresentation(Validate=validate_2, Url=concat_24, Tags=[trim_4, mime_2])  # -> Representation, Valid, Url, Description, Tags, Qualities; disabled
rep_12 = ModelRepresentation(Validate=validate_2, Url=concat_28, Tags=[trim_5, mime_2])  # -> Representation, Valid, Url, Description, Tags, Qualities; disabled
merge_10 = Merge(
    Data1=rep_7.Representation,
    Data2=rep_8.Representation,
    Data3=rep_11.Representation,
    Data4=rep_9.Representation,
    Data5=rep_12.Representation,
    Data6=rep_10.Representation)

panel_29 = Panel("metal plate")
panel_30 = Panel("railing")
concat_32 = Concatenate(FragmentA=par_2, FragmentB=sep_2, FragmentC=rep_8.Url)
concat_33 = Concatenate(FragmentA=par_2, FragmentB=sep_2, FragmentC=rep_9.Url)
panel_31 = Panel("base")
metalplate = Brep()
# Outputs   ->
#                 |
#                 v
rods = Brep()
expression = Expression(x="rods", y=rods, Expression="x")
concat_34 = Concatenate(FragmentA=par_2, FragmentB=sep_2, FragmentC=concat_26)
concat_35 = Concatenate(FragmentA=par_2, FragmentB=sep_2, FragmentC=concat_27)
concat_36 = Concatenate(FragmentA=par_2, FragmentB=sep_2, FragmentC=concat_30)
blc = ExportBlock(path=concat_34, name=concat_20, url=concat_23, export=and_4)  # -> block_definition_3, path_4, exported_2
blc_2 = ExportBlock(path=concat_35, name=concat_19, url=concat_19, export=and_4)  # -> block_definition_3, path_4, exported_2
geo_2 = ExportGeometry(F=concat_36, R=and_4)  # -> S; inputs G: tree of GeometryBase, R: Boolean; same code as geo

concat_37 = Concatenate(FragmentA=par_2, FragmentB=sep_2, FragmentC=concat_31)
blc_3 = ExportBlock(path=concat_37, name=concat_18, url=concat_31, layer_name="collider", export=and_4)  # -> block_definition_3, path_4, exported_2

concat_38 = Concatenate(FragmentA="external-stair", FragmentB="_", FragmentC="icon")
concat_39 = Concatenate(FragmentC="icons", FragmentD=sep_2, FragmentA="external-stair")
expression_2 = Expression(x="bridge", Expression="x")
concat_40 = Concatenate(FragmentA=concat_39, FragmentB=".3dm")
concat_41 = Concatenate(FragmentA=par_2, FragmentB=sep_2, FragmentC=concat_40)
blc_4 = ExportBlock(path=concat_41, name=concat_38, url=concat_40, layer_name=expression_2, export=and_3)  # -> block_definition_3, path_4, exported_2

panel_32 = Panel("""platform east
platform west""")
expression_3 = Expression(Expression="x/2")
neg = Negative(Value=expression_3)
panel_33 = Panel("""door tambour west
door tambour east""")
X = UnitX(Factor=1)
pt_8 = ConstructPoint(XCoordinate=0, YCoordinate=0, ZCoordinate=0)
Y = UnitY(Factor=neg)
addition = Addition(B=X)
move = Move(Geometry=pt_8, Motion=Y)  # -> Geometry, Transform
X_2 = UnitX(Factor=1)
panel_34 = Panel("""0.25
0.75""")
rev_2 = Reverse(Vector=X_2)
move_2 = Move(Geometry=move.Geometry, Motion=addition)  # -> Geometry, Transform
merge_11 = Merge(Data1=move_2.Geometry, Data2=move.Geometry)
merge_12 = Merge(Data1=X_2, Data2=rev_2)
panel_35 = Panel("""east
west""")
concat_42 = Concatenate(FragmentA="The middle of the ", FragmentC=panel_35, FragmentB=" side of the plattform.")
panel_36 = Panel("""e
w""")
por_2 = ModelPort(
    Validate=validate_2,
    Id=graft(panel_36),
    Description=graft(concat_42),
    Family=graft(panel_32),
    CompatibleFamilies=graft(panel_33),
    Point=graft(merge_11),
    Direction=graft(merge_12),
    T=graft(panel_34),
    Qualities=graft(panel_35))  # -> Port, Valid, Id, Description, Mandatory, Family, CompatibleFamilies, Point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
trim_6 = TrimTree(Tree=por_2.Port, Depth=1)

prv_2 = PreviewPort(po=trim_6)
construction_global_warming_potential_kg = Number(Slider(400, range=0..2000))  # "Construction Global Warming Potential [kgCO2e/eff. m²]"

panel_37 = Panel("https://identifier.buildingsmart.org/uri/etim/etim/9.0/prop/EF016979")
panel_38 = Panel("""construction cost
maintenance expenses
construction global warming potential""")
panel_39 = Panel("""5000
500
200""")
panel_40 = Panel("""€
€/a
kgCO2e""")
qal = ModelQuality(Validate=validate_2, Name=panel_38, Value=panel_39, Unit=panel_40, Definition=panel_37)  # -> Quality, Valid, Name, Value, Unit, Definition

panel_41 = Panel("A bridge with two segments an addition on the west along the main path.")
aut_3 = ModelAuthor(Name="Ueli Saluz", Email="ueli@semio-tech.org")  # -> Author, Valid, Name, Email
typ_4 = ModelType(
    Validate=validate_2,
    Name="Bridge",
    Description=panel_41,
    Icon="🌉",
    Image="images/bridge.png",
    Variant=variant_2,
    Unit="m",
    Representations=merge_10,
    Ports=trim_6,
    Authors=aut_3.Author,
    Qualities=qal.Quality)  # -> Type, Valid, Name, Description, Icon, Image, Variant, Stock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
typ_5 = PutType(Type=typ_4.Type, Uri=par_2, Run=save_2)

typ_6 = SerializeType(Type=typ_4.Type)
txt_2 = EncodeText(Text=typ_6, Mode=0)
type = Text(txt_2)
context_bake = ContextBake(Geometry=type)

# ==== cluster ExportBlock: Export geometry with layer names to a file.
path = ClusterInput()
name = ClusterInput()
url = ClusterInput()
geo = ClusterInput()
layer_name = ClusterInput()
export = ClusterInput()
path_2 = FilePath(path)
name_2 = Text(name)
url_2 = Text(url)
geo_2 = Geometry(geo)
layer_name_2 = Text(layer_name)
export_2 = Boolean(export)
layer = ModelLayer(Name=layer_name_2)  # -> Layer, Name, Hidden, Locked, DisplayColour, Material, Linetype
object = ModelObject(Geometry=geo_2, Layer=layer.Layer)  # -> Object, Geometry, Name, Layer, Visibility, Display, Drafting, Render
block_definition = ModelBlockDefinition(Objects=object.Object, Name=name_2, URL=url_2)  # -> BlockDefinition, Objects, Units, Name, Notes, URL, URLDescription
export_definition = ExportModelBlockDefinition(BlockDefinition=block_definition.BlockDefinition, FilePath=path_2, Overwrite="T", Export=export_2)  # -> BlockDefinition, FilePath, Exported
block_definition_2 = ModelBlockDefinition(export_definition.BlockDefinition)
path_3 = FilePath(export_definition.FilePath)
exported = Boolean(export_definition.Exported)
path_4 = ClusterOutput(path_3)
exported_2 = ClusterOutput(exported)
block_definition_3 = ClusterOutput(block_definition_2)

# ==== cluster OppinionatedType: Construct a type following the oppinionated conventions of semio. All representations are saved under representations folder where each representation is saved once natively (.3dm) and once exported (.glb). Further a collider representation is required. All names and file names are standardized.
path = ClusterInput()
na = ClusterInput()
description = ClusterInput()
variant = ClusterInput()
default = ClusterInput()
collider = ClusterInput()
O = ClusterInput()
tags = ClusterInput()
po = ClusterInput()
authors = ClusterInput()
qualities = ClusterInput()
export = ClusterInput()
path_2 = FilePath(path)
na_2 = Name(na)
description_2 = Description(description)
default_2 = ModelObject(default)
collider_2 = Mesh(collider)
O_2 = ModelObject(O)
tags_2 = Tags(tags)
po_2 = Port(po)
authors_2 = Authors(authors)
qualities_2 = Qualities(qualities)
export_2 = Boolean(export)
variant_2 = Variant(variant)
txt = NormalizeText(Text=na_2)  # -> Strict, Title, Underscore, Kebab, Pascal
sep = Separator()  # -> S
# ---------- sep: C# ----------
#region Usings
using System;
using System.Linq;
using System.Collections;
using System.Collections.Generic;
using System.Drawing;
using System.IO;

using Rhino;
using Rhino.Geometry;

using Grasshopper;
using Grasshopper.Kernel;
using Grasshopper.Kernel.Data;
using Grasshopper.Kernel.Types;
#endregion

public class Script_Instance : GH_ScriptInstance
{
    private void RunScript(ref object S)
    {
        S = Path.DirectorySeparatorChar;
    }
}
# ---------- end sep ----------
rep = ReplaceText(Text=variant_2, Find="/", Replace="slash", RecursiveReplace=False)
na_3 = Name(txt.Title)
expression = Expression(x=variant_2, Expression="x=\"\"")
rep_2 = ReplaceText(Text=rep, Find="\", Replace="backslash", RecursiveReplace=False)
txt_2 = NormalizeText(Text=rep_2)  # -> Strict, Title, Underscore, Kebab, Pascal
filter = StreamFilter(Gate=expression, Stream0="_")
join = TextJoin(Text=tags_2, Join="_")
concat = Concatenate(FragmentA=txt.Kebab, FragmentD=filter, FragmentB=txt_2.Kebab)
concat_2 = Concatenate(FragmentA="images", FragmentB=sep, FragmentC=concat, FragmentD=".png")
concat_3 = Concatenate(FragmentA="icons", FragmentB=sep, FragmentC=concat, FragmentD=".svg")
concat_4 = Concatenate(FragmentA=concat, FragmentB=".glb")
concat_5 = Concatenate(FragmentA=concat, FragmentB=".3dm")
concat_6 = Concatenate(FragmentA=concat, FragmentD="_", FragmentB=join)
concat_7 = Concatenate(FragmentA="representations", FragmentB=sep, FragmentC=concat, FragmentD=".glb")
concat_8 = Concatenate(FragmentA=concat, FragmentB=sep, FragmentC=concat, FragmentD=".3dm")
concat_9 = Concatenate(FragmentA=concat_6, FragmentB=".3dm")
concat_10 = Concatenate(FragmentA=concat, FragmentC="_", FragmentB="collider", FragmentD=".glb")
concat_11 = Concatenate(FragmentA=concat_6, FragmentB=".glb")
concat_12 = Concatenate(FragmentA="representations", FragmentB=sep, FragmentC=concat_9)
concat_13 = Concatenate(FragmentA="representations", FragmentB=sep, FragmentC=concat_11)
panel = Panel(concat_13)
concat_14 = Concatenate(FragmentA="representations", FragmentB=sep, FragmentC=concat_10)
rep_3 = ModelRepresentation(Url=concat_7)  # -> Representation, Valid, Url, Description, Tags, Qualities
rep_4 = ModelRepresentation(Url=concat_8)  # -> Representation, Valid, Url, Description, Tags, Qualities
rep_5 = ModelRepresentation(Url=concat_13, Tags=tags_2)  # -> Representation, Valid, Url, Description, Tags, Qualities
rep_6 = ModelRepresentation(Url=concat_12, Tags=tags_2)  # -> Representation, Valid, Url, Description, Tags, Qualities
rep_7 = ModelRepresentation(Url=concat_14, Tags="collider")  # -> Representation, Valid, Url, Description, Tags, Qualities
panel_2 = Panel(concat_10)
merge = Merge(Data1=rep_3.Representation, Data2=rep_4.Representation, Data3=rep_7.Representation)
merge_2 = Merge(Data1=rep_5.Representation, Data2=rep_6.Representation, Data3=rep_7.Representation)
concat_15 = Concatenate(FragmentA=path_2, FragmentB=sep, FragmentC=concat_3)
concat_16 = Concatenate(FragmentA=path_2, FragmentB=sep, FragmentC=concat_2)
concat_17 = Concatenate(FragmentA=path_2, FragmentB=sep, FragmentC=concat_10)
concat_18 = Concatenate(FragmentA=path_2, FragmentB=sep, FragmentC=concat_8)
concat_19 = Concatenate(FragmentA=path_2, FragmentB=sep, FragmentC=concat_12)
concat_20 = Concatenate(FragmentA=path_2, FragmentB=sep, FragmentC=concat_13)
concat_21 = Concatenate(FragmentA=path_2, FragmentB=sep, FragmentC=concat_14)
entwine = Entwine(Branch00=merge, Branch01=merge_2, FlattenInputs=True)  # -> flatten(Result)
geo = ExportGeometry(F=concat_21, G=collider_2)  # -> S; inputs G: tree of GeometryBase, R: Boolean
# ---------- geo: C# ----------
// Grasshopper Script Instance
#region Usings
using System;
using System.Linq;
using System.Collections;
using System.Collections.Generic;
using System.Drawing;
using System.IO;

using Rhino;
using Rhino.Geometry;

using Grasshopper;
using Grasshopper.Kernel;
using Grasshopper.Kernel.Data;
using Grasshopper.Kernel.Types;
#endregion

public class Script_Instance : GH_ScriptInstance
{
    #region Notes
    /* 
      Members:
        RhinoDoc RhinoDocument
        GH_Document GrasshopperDocument
        IGH_Component Component
        int Iteration

      Methods (Virtual & overridable):
        Print(string text)
        Print(string format, params object[] args)
        Reflect(object obj)
        Reflect(object obj, string method_name)
    */
    #endregion

    private void RunScript(object F, DataTree<GeometryBase> G, bool R, ref object S)
    {
        // inspired from https://github.com/jhorikawa/GrasshopperProgrammingTutorials/blob/master/0015%20Export%20Geometry%20with%20Grasshopper%20C%23/Export%20Geometry%20with%20Grasshopper%20C%23.gh
        if(R){
            var guids = new List<Guid>();

            for(int i = 0; i < G.BranchCount; i++){
                for(int n = 0; n < G.Branches[i].Count; n++){
                var geom = G.Branches[i][n];
                var guid = Rhino.RhinoDoc.ActiveDoc.Objects.Add(geom);
                guids.Add(guid);
                }
            }

            Rhino.RhinoDoc.ActiveDoc.Objects.Select(guids);

            string cmd = "_-Export " + "\"" + F + "\"" + " _Enter _Enter";

            Rhino.RhinoApp.RunScript(cmd, false);

            Rhino.RhinoDoc.ActiveDoc.Objects.Delete(guids, true);
            S = true;
        }
    }
}
# ---------- end geo ----------
blc = ExportBlock_2(path=concat_18, export=export_2)  # -> block_definition_3, path_4, exported_2
geo_2 = Geometry(default_2)
typ = ModelType(
    Name=na_3,
    Description=description_2,
    Icon=concat_3,
    Image=concat_2,
    Variant=variant_2,
    Representations=entwine,
    Ports=po_2,
    Authors=authors_2,
    Qualities=qualities_2)  # -> Type, Valid, Name, Description, Icon, Image, Variant, Stock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
geo_3 = ExportGeometry(F=concat_17, G=geo_2, R=export_2)  # -> S; inputs G: tree of GeometryBase, R: Boolean; same code as geo
mm = MassMultiplication(Input=flatten(geo_3))  # -> Result, PartialResults
typ_2 = PutType(Type=typ.Type, Uri=path_2, Run=export_2)
and = GateAnd(A=typ_2, B=mm.Result, C=blc.exported_2)
panel_3 = Panel("Parallel")  # disabled

rec = Rectangle({Plane=Plane(origin=(-1970.889691, 1937.419247, 1956.598842), x=(0.7071067812, 0.7071067812, 0), y=(0.4082482905, -0.4082482905, 0.8164965809)), Size=Domain2(u=-46.34617503..46.34617503, v=-24.69844367..24.69844367)})
m2d_parallel = Make2DParallelView(Projection=rec)
make2d = Make2D(Geometry=default_2, View=m2d_parallel, TangentEdges="T", TangentSeams=False, AutoComputeMake2D=True)  # -> VisibleCurves, VisibleIndex, VisibleType, HiddenCurves, HiddenIndex, HiddenType
trim = TrimTree(Tree=make2d.VisibleCurves, Depth=1)
bridge = Geometry(trim)

merge_3 = Merge(Data1=concat_15, Data2=concat_16)
null = NullItem(Item=and)  # -> NullFlags, InvalidFlags, Description
m2d_rhino = Make2DRhinoView(Name=panel_3, Clip=True)  # disabled
number_slider = Slider(876, range=0..1000)  # disabled
filter_2 = StreamFilter(Gate=null.NullFlags, Stream0=and, Stream1="F")
view_rectangle = ViewRectangle(view=m2d_rhino)  # disabled
ty = Type(typ.Type)
ba = Text(concat)
us = FilePath(merge_3)
S = Boolean(filter_2)
previewplane = PreviewPlane(plane=view_rectangle, axis_length=number_slider)  # disabled
ty_2 = ClusterOutput(ty)
ba_2 = ClusterOutput(ba)
us_2 = ClusterOutput(us)
S_2 = ClusterOutput(S)

# ==== cluster Stair
variant = ClusterInput()
panel = Panel("""_first-storey
_last-storey""")
panel_2 = Panel("""First Storey
Last Storey""")
panel_3 = Panel("""s
p-d-0
p-d-1""")
panel_4 = Panel("""s
p-s
p-d-0
p-d-1""")
variant_2 = Text(variant)
panel_5 = Panel("An external stair with no platform on the beginning and a double-sized platform with an opening for another stair on the end.")
panel_6 = Panel("An external stair with no platform on the beginning and a double-sized platform on the end.")
itemindex = ItemIndex(L=panel_2, I=variant_2)  # -> i; inputs L: list
# ---------- itemindex: Python ----------
#Component Information
#--------------------------------------------------------------------------------------------
if ghenv.Component.RunCount<2:
    #General
    #--------------------------------------------------------------------------------------------
    __author__ = "Ueli Saluz"
    __version__ = "2022.11.18"
    
    ghenv.Component.Name = "ItemIndex"
    ghenv.Component.NickName = "ItemIndex"
    ghenv.Component.Description = "A better IdemIndex"
    ghenv.Component.Message = "VER 1.0"
    ghenv.Component.Category = "Set"
    ghenv.Component.SubCategory = "List"
    
     #Inputs
    #--------------------------------------------------------------------------------------------
    inputIndex=0
    
    ghenv.Component.Params.Input[inputIndex].Name = "List"
    ghenv.Component.Params.Input[inputIndex].NickName = "L"
    ghenv.Component.Params.Input[inputIndex].Description = "Input1 is..."
    ghenv.Component.Params.Input[inputIndex].Optional = False
    inputIndex+=1
    
    ghenv.Component.Params.Input[inputIndex].Name = "Item"
    ghenv.Component.Params.Input[inputIndex].NickName = "I"
    ghenv.Component.Params.Input[inputIndex].Description = "Input2 is..."
    ghenv.Component.Params.Input[inputIndex].Optional = False
    inputIndex+=1
    
    #Outputs
    #--------------------------------------------------------------------------------------------
    outputIndex=0
    
    ghenv.Component.Params.Output[outputIndex].Name = "Index"
    ghenv.Component.Params.Output[outputIndex].NickName = "i"
    ghenv.Component.Params.Output[outputIndex].Description = "Output1 is..."
    outputIndex+=1

i = L.index(I)
# ---------- end itemindex ----------
item = ListItem(List=panel, Index=itemindex, Wrap=True)
concat = Concatenate(FragmentA="representations/external-stair", FragmentB=item, FragmentC=".3dm")
division = Division(A=Slider(1.38, range=0..10), B=Slider(1.09, range=0..10))
brep = Brep(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)
brep_2 = Brep(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)
brep_3 = Brep(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)
pt = Point([Point(0, 0, 0), Point(2.16748275, -1.668820631, 1.085001312), Point(3.732226217, 0, 1.085001312), Point(3.732226217, -1.668820631, 1.085000523)])
vec = Vector([Vector(-1, 0, 0), Vector(-1, 0, 0), Vector(1, 0, 0), Vector(1, 0, 0)])
pt_2 = Point([Point(0, 0, 0), Point(1.238561571, -1.668820631, 0.62000075), Point(2.803305038, 0, 0.62000075), Point(2.803305038, -1.668820631, 0.61999996)])
pt_3 = Point([Point(0, 0, 0), Point(3.732226217, 0, 1.085001312), Point(3.732226217, -1.668820631, 1.085000523)])
vec_2 = Vector([Vector(-1, 0, 0), Vector(1, 0, 0), Vector(1, 0, 0)])
filter = StreamFilter(Gate=itemindex, Stream0=panel_5, Stream1=panel_5, Stream2=panel_6)
filter_2 = StreamFilter(Gate=itemindex, Stream0=brep_2, Stream1=brep_3, Stream2=brep)
filter_3 = StreamFilter(Gate=itemindex, Stream0=vec, Stream1=vec, Stream2=vec_2)
filter_4 = StreamFilter(Gate=itemindex, Stream0=panel_4, Stream1=panel_4, Stream2=panel_3)
filter_5 = StreamFilter(Gate=itemindex, Stream0=pt, Stream1=pt_2, Stream2=pt_3)
scale_nu = ScaleNU(Geometry=filter_2, Plane=PlaneXY(0, 0, 0), ScaleX=1, ScaleY=1, ScaleZ=division)  # -> Geometry, Transform
scale_nu_2 = ScaleNU(Geometry=filter_3, Plane=PlaneXY(0, 0, 0), ScaleX=1, ScaleY=1, ScaleZ=division)  # -> Geometry, Transform
scale_nu_3 = ScaleNU(Geometry=filter_5, Plane=PlaneXY(0, 0, 0), ScaleX=1, ScaleY=1, ScaleZ=division)  # -> Geometry, Transform
pt_4 = Point(scale_nu_3.Geometry)
dr = Direction(scale_nu_2.Geometry)
id = Id(filter_4)
description = Description(filter)
rep = ModelRepresentation(Url=concat, Tags="1to200")  # -> Representation, Valid, Url, Description, Tags, Qualities
por = ModelPort(Id=id, Point=pt_4, Direction=dr)  # -> Port, Valid, Id, Description, Mandatory, Family, CompatibleFamilies, Point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
qal = ModelQuality()  # -> Quality, Valid, Name, Value, Unit, Definition
typ = ModelType(Name="External Stair", Description=description, Variant=variant_2, Representations=rep.Representation, Ports=por.Port)  # -> Type, Valid, Name, Description, Icon, Image, Variant, Stock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
prv = PreviewPort(po=por.Port)
ty = Type(typ.Type)
geo = Geometry(scale_nu.Geometry)
ty_2 = ClusterOutput(ty)
geo_2 = ClusterOutput(geo)

# ==== cluster PreviewGeometry: Preview geometry by ungrouping everything, showing light surfaces and dark edges.
sc = ClusterInput()
geo = ClusterInput()
geo_2 = Geometry(flatten(geo))
sc_2 = Number(sc)
expression = Expression(x=sc_2, Expression="x+1")
swatch = ColourSwatch(SwatchColor=RGB(0, 0, 0))
swatch_2 = ColourSwatch(SwatchColor=RGB(255, 255, 255))
ungroup = Ungroup(Group=geo_2)
ungroup_2 = Ungroup(Group=ungroup)
ungroup_3 = Ungroup(Group=ungroup_2)
ungroup_4 = Ungroup(Group=ungroup_3)
log = Logarithm(Value=expression)
clean = CleanTree(RemoveNulls=True, RemoveInvalid=True, RemoveEmpty=invert(False), Tree=ungroup_4)  # -> flatten(Tree)
multiplication = Multiplication(A=log, B=Slider(0.05, range=0..1))
linetype = ModelLinetype(Name="semio", Width=multiplication)  # -> ModelLinetype, Name, Segments, CapStyle, JoinStyle, Width, WidthUnits, TaperWidths, TaperPositions
dispatch = CSharpScript(D=clean)  # -> P, C, B, M, R
# ---------- dispatch: C# ----------
// Grasshopper Script Instance
#region Usings
using System;
using System.Linq;
using System.Collections;
using System.Collections.Generic;
using System.Drawing;

using Rhino;
using Rhino.Geometry;

using Grasshopper;
using Grasshopper.Kernel;
using Grasshopper.Kernel.Data;
using Grasshopper.Kernel.Types;
#endregion

public class Script_Instance : GH_ScriptInstance
{
    #region Notes
    /* 
      Members:
        RhinoDoc RhinoDocument
        GH_Document GrasshopperDocument
        IGH_Component Component
        int Iteration

      Methods (Virtual & overridable):
        Print(string text)
        Print(string format, params object[] args)
        Reflect(object obj)
        Reflect(object obj, string method_name)
    */
    #endregion

    private void RunScript(
	object D,
	ref object P,
	ref object C,
	ref object B,
	ref object M,
	ref object R)
    {
        if (D is Curve) C = D; // Curve
        else if (
            D is Rhino.Geometry.Point ||
            D is PointCloud
            )
            P = D; // Point
        else if ( D is Mesh) M = D; // Mesh
        else if (
            D is Surface ||
            D is Extrusion ||
            D is SubD ||
            D is Brep
            )
            B = D; // Brep
        else R = D; // Rest
            
    }
}
# ---------- end dispatch ----------
clean_2 = CleanTree(RemoveNulls=True, RemoveInvalid=True, RemoveEmpty=False, Tree=dispatch.M)
clean_3 = CleanTree(RemoveNulls=True, RemoveInvalid=True, RemoveEmpty=False, Tree=dispatch.R)
clean_4 = CleanTree(RemoveNulls=True, RemoveInvalid=True, RemoveEmpty=False, Tree=dispatch.B)
clean_5 = CleanTree(RemoveNulls=True, RemoveInvalid=True, RemoveEmpty=False, Tree=dispatch.P)
clean_6 = CleanTree(RemoveNulls=True, RemoveInvalid=True, RemoveEmpty=False, Tree=dispatch.C)
debrep = DeconstructBrep(Brep=clean_4)  # -> Faces, Edges, Vertices
preview = CustomPreview(Geometry=flatten(clean_5), Material=swatch)
preview_2 = CustomPreview(Geometry=flatten(debrep.Faces), Material=swatch_2)
preview_3 = CustomPreview(Geometry=flatten(clean_2), Material=swatch_2)
preview_4 = CustomPreview(Geometry=flatten(clean_3), Material=swatch)
curve_preview = CustomCurvePreview(Curve=clean_6, Linetype=linetype.ModelLinetype, Colour=swatch)
curve_preview_2 = CustomCurvePreview(Curve=debrep.Edges, Linetype=linetype.ModelLinetype, Colour=swatch)

# ==== cluster ExportBlock_2: Export geometry with layer names to a file.
dc = ClusterInput()
layer_n = ClusterInput()
path = ClusterInput()
name = ClusterInput()
url = ClusterInput()
geo = ClusterInput()
export = ClusterInput()
path_2 = FilePath(path)
name_2 = Text(name)
url_2 = Text(url)
geo_2 = Geometry(geo)
export_2 = Boolean(export)
layer_n_2 = Name(layer_n)
dc_2 = DisplayColour(dc)
layer = ModelLayer(Name=layer_n_2, DisplayColour=dc_2)  # -> Layer, Name, Hidden, Locked, DisplayColour, Material, Linetype, PrintColour, PrintWidth
object = ModelObject(Geometry=geo_2, Layer=layer.Layer)  # -> Object, Geometry, Name, Layer, Visibility, Display, Drafting, Render
block_definition = ModelBlockDefinition(Objects=object.Object, Name=name_2, URL=url_2)  # -> BlockDefinition, Objects, Units, Name, Notes, URL, URLDescription
export_definition = ExportModelBlockDefinition(BlockDefinition=block_definition.BlockDefinition, FilePath=path_2, Overwrite="T", Export=export_2)  # -> BlockDefinition, FilePath, Exported
block_definition_2 = ModelBlockDefinition(export_definition.BlockDefinition)
path_3 = FilePath(export_definition.FilePath)
exported = Boolean(export_definition.Exported)
path_4 = ClusterOutput(path_3)
exported_2 = ClusterOutput(exported)
block_definition_3 = ClusterOutput(block_definition_2)

# ==== cluster PreviewPlane: Preview a plane with axis colors and naming.
axis_length = ClusterInput()
plane = ClusterInput()
axis_length_2 = Number(axis_length)
plane_2 = Plane(plane)
deplane = DeconstructPlane(Plane=plane_2)  # -> Origin, XAxis, YAxis, ZAxis
line = LineSDL(Start=deplane.Origin, Direction=deplane.YAxis, Length=axis_length_2)
line_2 = LineSDL(Start=deplane.Origin, Direction=deplane.XAxis, Length=axis_length_2)
line_3 = LineSDL(Start=deplane.Origin, Direction=deplane.ZAxis, Length=axis_length_2)
swatch = ColourSwatch(SwatchColor=RGB(235, 52, 79))
swatch_2 = ColourSwatch(SwatchColor=RGB(0, 166, 157))
swatch_3 = ColourSwatch(SwatchColor=RGB(240, 117, 24))
end = EndPoints(Curve=line_2)  # -> Start, End
end_2 = EndPoints(Curve=line)  # -> Start, End
end_3 = EndPoints(Curve=line_3)  # -> Start, End
tag = TextTag(Location=end.End, Text="X", Colour=swatch)
tag_2 = TextTag(Location=end_2.End, Text="Y", Colour=swatch_2)
tag_3 = TextTag(Location=end_3.End, Text="Z", Colour=swatch_3)
preview = CustomPreview(Geometry=line_2, Material=swatch)
preview_2 = CustomPreview(Geometry=line, Material=swatch_2)
preview_3 = CustomPreview(Geometry=line_3, Material=swatch_3)

# ==== cluster ViewRectangle
view = ClusterInput()
view_2 = Data(view)
nickname = NAME(view=view_2)  # -> c, x, y, z, h, w
# ---------- nickname: Python ----------
uselss, c, x, y, z = view.GetCameraFrame()
h = view.FrustumHeight
w = view.FrustumWidth
# ---------- end nickname ----------
rev = Reverse(Vector=nickname.x)
rev_2 = Reverse(Vector=nickname.y)
pl = ConstructPlane(Origin=nickname.c, XAxis=rev, YAxis=nickname.y)
_2d = _2D(x=nickname.w)
_2d_2 = _2D(x=nickname.h)
rectangle = Rectangle(Plane=pl, XSize=_2d, YSize=_2d_2, Radius=0)  # -> Rectangle, Length
rec = Rectangle(rectangle.Rectangle)
rec_2 = ClusterOutput(rec)

# ==== cluster PreviewPort: Preview a port by showing the point and direction and if exists: id, family and compatible families.
po = ClusterInput()
sc = ClusterInput()
sc_2 = Number(sc)
po_2 = Port(po)
por = ModelPort(Port=po_2)  # -> Port, Valid, Id, Description, Mandatory, Family, CompatibleFamilies, Point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
swatch = ColourSwatch(SwatchColor=RGB(235, 52, 79))
swatch_2 = ColourSwatch(SwatchColor=RGB(250, 149, 0))
amp = Amplitude(Vector=por.Direction, Amplitude=sc_2)
lng = ListLength(List=por.CompatibleFamilies)
expression = Expression(x=por.Family, Expression="x=\"\"")
cull = CullPattern(List=por.Point, CullPattern=expression)
expression_2 = Expression(x=lng, Expression="x=0")
join = TextJoin(Text=por.CompatibleFamilies, Join=",")
merge = Merge(Data1=":")
trim = TrimTree(Tree=join, Depth=1)
trim_2 = TrimTree(Tree=expression_2, Depth=1)
item = ListItem(List=merge, Index=expression, Wrap=invert(True))
log = Logarithm(Value=sc_2)
concat = Concatenate(FragmentA="[", FragmentB=trim, FragmentC="]")
expression_3 = Expression(y=trim_2, Expression="x")
merge_2 = Merge(Data1=graft(concat), Data2=graft(expression_3))
item_2 = ListItem(List=merge_2, Index=graft(expression), Wrap=invert(True))
multiplication = Multiplication(A=log, B=Slider(2, range=0..10))
trim_3 = TrimTree(Tree=item_2, Depth=1)
concat_2 = Concatenate(FragmentA=por.Id, FragmentB=item, FragmentC=por.Family, FragmentD=trim_3)
preview = CustomPreview(Geometry=cull, Material=swatch)
tag = TextTag(Location=por.Point, Text=concat_2, Colour=swatch)
vdisex = VectorDisplayEx(Point=por.Point, Vector=amp, Colour=ColourSwatch(SwatchColor=RGB(0, 166, 157)), Width=multiplication)

# ==== cluster _2D
x = ClusterInput()
expression = Expression(x=x, Expression="x/2")
neg = Negative(Value=expression)
dom = ConstructDomain(DomainStart=neg, DomainEnd=expression)
I = ClusterOutput(dom)
