# Grasshopper definition tambour.gh (Grasshopper 1.0.8)
# Copyright: GNU Lesser General Public License Version 3
# Copyright: GNU Lesser General Public License v3.0 or later
# plug-ins: RhinoCodePluginGH, semio

number_slider = Slider(0, range=0..3)
panel = Panel("""First Storey
Last Storey
Single Storey""")
save_representation = BooleanToggle(False)
icon_export = BooleanToggle(False)
validate = BooleanToggle(False)
save = BooleanToggle(False)
sep = Separator()  # -> S; same code as sep
dir = Directory()  # -> D
# ---------- dir: C# ----------
#region Usings
using System;
using System.Linq;
using System.Collections;
using System.Collections.Generic;
using System.Drawing;
using System.IO;

using Rhino;
using Rhino.Geometry;

using Grasshopper;
using Grasshopper.Kernel;
using Grasshopper.Kernel.Data;
using Grasshopper.Kernel.Types;
#endregion

public class Script_Instance : GH_ScriptInstance
{
    private void RunScript(ref object D)
    {
        D = Path.GetDirectoryName(this.GrasshopperDocument.FilePath);
    }
}
# ---------- end dir ----------
loop_slider = PythonScript(
    SliderToModify=number_slider,
    Min="0",
    Max="3",
    stepSize="1",
    Delay=Slider(0, range=0..1),
    Run=Toggle(False),
    Reset=Button())  # inputs Run: Boolean, Reset: Boolean
# ---------- loop_slider: Python ----------
import time

def updateSliderInput(inputName,min,max,value,decimalPlace=2):
    for input in ghenv.Component.Params.Input:
        for source in input.Sources:
            if input.Name == str(inputName):
                source.Slider.DecimalPlaces = decimalPlace
                source.Slider.Minimum = min
                source.Slider.Maximum = max
                source.Slider.Value = value
                source.ExpireSolution(True)

def countDecimal(number):
    string= str(number)
    return string[::-1].find('.')

if Run == True:
    if SliderToModify < Max:
        time.sleep(Delay)
        updateSliderInput("SliderToModify",Min,Max,SliderToModify+stepSize,countDecimal(stepSize))
if Reset == True:
    updateSliderInput("SliderToModify",Min,Max,Min)
# ---------- end loop_slider ----------
# ^                                    ^
#    |                                     |
# <-- Constants    Preview -->
# Parameters    External    Local -->
# <-- Meta               |
#      |                       v
#      v
par = ParentDirectory(D=dir)  # -> P; inputs D: String
# ---------- par: C# ----------
#region Usings
using System;
using System.Linq;
using System.Collections;
using System.Collections.Generic;
using System.Drawing;
using System.IO;

using Rhino;
using Rhino.Geometry;

using Grasshopper;
using Grasshopper.Kernel;
using Grasshopper.Kernel.Data;
using Grasshopper.Kernel.Types;
#endregion

public class Script_Instance : GH_ScriptInstance
{
    private void RunScript(string D, ref object P)
    {
        P = new DirectoryInfo(D).Parent;
    }
}
# ---------- end par ----------
item = ListItem(List=panel, Index=number_slider, Wrap=True)
panel_2 = Panel(item)
and = GateAnd(A=save, B=save_representation)
and_2 = GateAnd(A=save, B=icon_export)

panel_3 = Panel("""west
east
west
east
west
east
west
east""")
panel_4 = Panel("""east
west
east
west
east
west
east
west""")
concat = Concatenate(FragmentC="door tambour ", FragmentD=panel_3)
concat_2 = Concatenate(FragmentC="door capsule ", FragmentD=panel_4)
concat_3 = Concatenate(FragmentA="platform ", FragmentB=panel_3)
merge = Merge(Data1=graft(concat_2), Data2=graft(concat_3))

variant = GetString(item, AtLeast=0, AtMost=1, TreeAccess=False)
itemindex = ItemIndex(L=panel, I=variant)  # -> i; inputs L: list
# ---------- itemindex: Python ----------
#Component Information
#--------------------------------------------------------------------------------------------
if ghenv.Component.RunCount<2:
    #General
    #--------------------------------------------------------------------------------------------
    __author__ = "Ueli Saluz"
    __version__ = "2022.11.18"
    
    ghenv.Component.Name = "ItemIndex"
    ghenv.Component.NickName = "ItemIndex"
    ghenv.Component.Description = "A better IdemIndex"
    ghenv.Component.Message = "VER 1.0"
    ghenv.Component.Category = "Set"
    ghenv.Component.SubCategory = "List"
    
     #Inputs
    #--------------------------------------------------------------------------------------------
    inputIndex=0
    
    ghenv.Component.Params.Input[inputIndex].Name = "List"
    ghenv.Component.Params.Input[inputIndex].NickName = "L"
    ghenv.Component.Params.Input[inputIndex].Description = "Input1 is..."
    ghenv.Component.Params.Input[inputIndex].Optional = False
    inputIndex+=1
    
    ghenv.Component.Params.Input[inputIndex].Name = "Item"
    ghenv.Component.Params.Input[inputIndex].NickName = "I"
    ghenv.Component.Params.Input[inputIndex].Description = "Input2 is..."
    ghenv.Component.Params.Input[inputIndex].Optional = False
    inputIndex+=1
    
    #Outputs
    #--------------------------------------------------------------------------------------------
    outputIndex=0
    
    ghenv.Component.Params.Output[outputIndex].Name = "Index"
    ghenv.Component.Params.Output[outputIndex].NickName = "i"
    ghenv.Component.Params.Output[outputIndex].Description = "Output1 is..."
    outputIndex+=1

i = L.index(I)
# ---------- end itemindex ----------
panel_5 = Panel("""_first-storey
_last-storey
_single-storey""")
panel_6 = Panel("""F
T
F
T""")
panel_7 = Panel("""F
F
T
T""")
zoom = Button()
bbox = BoundingBox(Plane=PlaneXY(0, 0, 0), UnionBox=True)  # -> Box, Box_2
item_2 = ListItem(List=panel_6, Index=itemindex, Wrap=True)
item_3 = ListItem(List=panel_7, Index=itemindex, Wrap=True)
item_4 = ListItem(List=panel, Index=itemindex, Wrap=True)
zoom2bb = ZoomToBoundingBox(N=["Top", "Front", "Right", "Perspective", "Parallel"], BB=bbox.Box, S=0, R=zoom)  # -> F, SBB; inputs BB: Box, R: Boolean
# ---------- zoom2bb: Python ----------
#Component Information
#--------------------------------------------------------------------------------------------
if ghenv.Component.RunCount<2:
    #General
    #--------------------------------------------------------------------------------------------
    __author__ = "Ueli Saluz"
    __version__ = "2022.05.21"
    
    ghenv.Component.Name = "ZoomToBoundingBox"
    ghenv.Component.NickName = "Zoom2BB"
    ghenv.Component.Description = "Zoom the view of a Rhino viewport to a bounding box."
    ghenv.Component.Message = "VER 1.1"
    ghenv.Component.Category = "Display"
    ghenv.Component.SubCategory = "Camera"
    
     #Inputs
    #--------------------------------------------------------------------------------------------
    inputIndex=0
    
    ghenv.Component.Params.Input[inputIndex].Name = "Name"
    ghenv.Component.Params.Input[inputIndex].NickName = "N"
    ghenv.Component.Params.Input[inputIndex].Description = "Name of the viewport"
    ghenv.Component.Params.Input[inputIndex].Optional = False
    inputIndex+=1
    
    ghenv.Component.Params.Input[inputIndex].Name = "BoundingBox"
    ghenv.Component.Params.Input[inputIndex].NickName = "BB"
    ghenv.Component.Params.Input[inputIndex].Description = ""
    ghenv.Component.Params.Input[inputIndex].Optional = False
    inputIndex+=1
    
    ghenv.Component.Params.Input[inputIndex].Name = "ScaleFactor"
    ghenv.Component.Params.Input[inputIndex].NickName = "S"
    ghenv.Component.Params.Input[inputIndex].Description = "A factor for the extension of the bounding box." \
    +"0 means 0 extension, a positive number makes the bounding box larger a negative smaller. The amount is proportional to the length."
    ghenv.Component.Params.Input[inputIndex].Optional = False
    inputIndex+=1
   
    
    ghenv.Component.Params.Input[inputIndex].Name = "Run"
    ghenv.Component.Params.Input[inputIndex].NickName = "R"
    ghenv.Component.Params.Input[inputIndex].Description = "Zoom to the given bounding box."
    ghenv.Component.Params.Input[inputIndex].Optional = False
    inputIndex+=1
    
    #Outputs
    #--------------------------------------------------------------------------------------------
    outputIndex=0
    
    ghenv.Component.Params.Output[outputIndex].Name = "Finished"
    ghenv.Component.Params.Output[outputIndex].NickName = "F"
    ghenv.Component.Params.Output[outputIndex].Description = "Sends True when finished. Just to trigger other depending components."
    outputIndex+=1
    
    ghenv.Component.Params.Output[outputIndex].Name = "ScaledBoundingBox"
    ghenv.Component.Params.Output[outputIndex].NickName = "SBB"
    ghenv.Component.Params.Output[outputIndex].Description = "The scaled bounding box."
    outputIndex+=1


#Imports
#--------------------------------------------------------------------------------------------
from Rhino import RhinoDoc
from Rhino.Geometry import Box

#Solver - Run with trees to enhance performance drastically
#--------------------------------------------------------------------------------------------
if __name__ == "__main__":
    try:
        vp = RhinoDoc.ActiveDoc.Views.Find(N, False).ActiveViewport
        if R:
            box = BB
            bb = BB.BoundingBox
            bb.Inflate(S*box.X.Length,S*box.Y.Length,S*box.Z.Length)
            vp.ZoomBoundingBox(bb)
            SBB = bb
        F = True
    except:
        pass
# ---------- end zoom2bb ----------
# Permission is hereby granted, free of charge, to any person obtaining a copy
# of this Grasshopper file and associated documentation files (the "Document"),
# to deal in the Document without restriction, including without limitation the
# rights to use, copy, modify, merge, publish, distribute, sublicense, and/or sell
# copies of the Document, and to permit persons to whom the Document is
# furnished to do so.
# 
# Individual clusters used inside this document might be licensed under
# different terms. This is indicated through a similar copyright notice group
# inside the cluster and otherwise in the license field of the cluster. If you
# have any question please reach out to us: license@semio-tech.com
# 
# THE DOCUMENT IS PROVIDED "AS IS", WITHOUT WARRANTY OF ANY
# KIND, EXPRESS OR IMPLIED, INCLUDING BUT NOT LIMITED TO THE
# WARRANTIES OF MERCHANTABILITY, FITNESS FOR A PARTICULAR
# PURPOSE AND NONINFRINGEMENT. IN NO EVENT SHALL THE
# AUTHORS OR COPYRIGHT HOLDERS BE LIABLE FOR ANY CLAIM,
# DAMAGES OR OTHER LIABILITY, WHETHER IN AN ACTION OF
# CONTRACT, TORT OR OTHERWISE, ARISING FROM, OUT OF OR IN
# CONNECTION WITH THE DOCUMENT OR THE USE OR OTHER
# DEALINGS IN THE DOCUMENT.
number_slider_2 = Slider(1, range=0..20)
expression = Expression(x=Slider(550, range=0..1000), Expression="x/100")
expression_2 = Expression(x=Slider(275, range=0..1000), Expression="x/100")
list = ValueList({"North": "north", "East": "east", "South": "south", "West": "west"}, selected="North")
expression_3 = Expression(x=Slider(20, range=0..100), Expression="x/100")
slab_thickness_m = Number(expression_3)
floors = Integer(number_slider_2)

series = Series(Start="1", Step=1, Count="2")
dup = DuplicateData(Data="0", Number="4", Order=True)
trim = TrimTree(Tree=series, Depth=1)  # -> graft(Tree)
trim_2 = TrimTree(Tree=dup, Depth=1)
dup_2 = DuplicateData(Data=trim, Number="2", Order=True)  # -> flatten(Data)
merge_2 = Merge(Data1=trim_2, Data2=dup_2)
dup_3 = DuplicateData(Data=merge_2, Number=floors, Order=True)
trim_3 = TrimTree(Tree=dup_3, Depth=1)
concat_4 = Concatenate(FragmentA="sl", FragmentC=trim_3)
qal = ModelQuality(Name="split level", Value=trim_3)  # -> Quality, Valid, Name, Value, Unit

equals = Equality(FirstNumber=trim_3, SecondNumber="0")  # -> Equality, Inequality
panel_8 = Panel("""main
side""")
item_5 = ListItem(List=panel_8, Index=equals.Equality, Wrap=True)
qal_2 = ModelQuality(Validate=validate, Name="platform", Value=item_5)  # -> Quality, Valid, Name, Value, Unit

width_m = Number(expression)
include_top = Boolean(item_3)
int = Integer(include_top)
platform = Text(list)
include_bottom = Boolean(item_2)
int_2 = Integer(include_bottom)
concat_5 = Concatenate(FragmentA=int, FragmentB=int_2)
b2d = BinaryToDecimal(Binary=concat_5)  # -> Decimal
# ---------- b2d: Python ----------
if ghenv.Component.RunCount<2:
    __author__ = "Ueli Saluz"
    __version__ = "2021.11.14"
    
    ghenv.Component.Name = "BinaryToDecimal"
    ghenv.Component.NickName = "B2D"
    ghenv.Component.Description = "Converts a number in binary representation to a number in decimal representation."
    ghenv.Component.Message = "VER 1.0"
    
    ghenv.Component.Params.Input[0].NickName = "Binary"
    
    ghenv.Component.Params.Input[0].Description = "Binary representation of a number."
    
    ghenv.Component.Params.Output[0].NickName = "Decimal"
    
    ghenv.Component.Params.Output[0].Description = "Converted decimal representation of the same number."

if __name__ == "__main__":
    Decimal = int(Binary,2)
# ---------- end b2d ----------

panel_9 = Panel("""f9222724e5
b27c179b7d
89d6e55762
c5850e2821
53dc156694
345fa2173d
73566dc911
8965b08c83""")
dup_4 = DuplicateData(Data="2", Number="4", Order=True)
concat_6 = Concatenate(FragmentA="https://app.speckle.systems/projects/e7de1a2f8f/models/", FragmentB=panel_9)
trim_4 = TrimTree(Tree=dup_4, Depth=1)
partition = PartitionList(List=concat_6, Size=trim_4)
tstat = TreeStatistics(Tree=partition)  # -> Paths, Length, Count
item_6 = ListItem(List=flatten(tstat.Paths), Index=b2d, Wrap=True)
branch = TreeBranch(Tree=partition, Path=item_6, MaintainPaths=True)
item_7 = ListItem(List=flatten(branch), Index=0, Wrap=True)  # -> Item, Item1

item_8 = ListItem(List=panel_5, Index=b2d, Wrap=True)
floor_height_m = Number(expression_2)

rec = Rectangle({Plane=Plane(origin=(853.3612491, 852.5312947, 866.3069427), x=(0.7071067812, -0.7071067812, 0), y=(-0.4082482905, -0.4082482905, 0.8164965809)), Size=Domain2(u=-52.32632723..52.32632723, v=-27.88533994..27.88533994)})
merge_3 = Merge()
m2d_parallel = Make2DParallelView(Projection=rec)
make2d = Make2D(Geometry=merge_3, View=m2d_parallel, TangentEdges="T", TangentSeams=False, AutoComputeMake2D=True)  # -> VisibleCurves, VisibleIndex, VisibleType, HiddenCurves, HiddenIndex, HiddenType
trim_5 = TrimTree(Tree=make2d.VisibleCurves, Depth=1)
trim_6 = TrimTree(Tree=make2d.HiddenCurves, Depth=1)

panel_10 = Panel("An efficient one storey tambour for a rectangular shaft core with an elevator in the center, the main platform on the ")
panel_11 = Panel(""", and on the other corners sides platforms with two doors. There is a stair between 
every platform. The doors are spiraling around.""")
concat_7 = Concatenate(FragmentA=panel_10, FragmentB=platform, FragmentC=panel_11)

expression_4 = Expression(x=Slider(120, range=0..1000), Expression="x/100")
expression_5 = Expression(x=Slider(30, range=0..100), Expression="x/100")
expression_6 = Expression(x=Slider(80, range=0..200), Expression="x/100")
expression_7 = Expression(x=Slider(200, range=0..1000), Expression="x/100")
expression_8 = Expression(x=Slider(115, range=0..1000), Expression="x/100")
concat_8 = Concatenate(FragmentA="icons/", FragmentC=".svg")
concat_9 = Concatenate(FragmentA="images/", FragmentC=".svg")
wall_thickness_m = Number(expression_5)
door_height_m = Number(expression_7)
core_radius_m = Number(expression_4)
door_width_m = Number(expression_6)
door_offset_m = Number(expression_8)
maintenance_expenses_month_eff_m² = Slider(3.5, range=0..10)
construction_area_factor = Slider(0.2, range=0..1)
construction_cost_eff_m² = Slider(9000, range=0..10000)

expression_9 = Expression(x="visible", y=trim_5, Expression="x")
expression_10 = Expression(x="hidden", y=trim_5, Expression="x")
concat_10 = Concatenate(FragmentC="icons", FragmentD=sep)
concat_11 = Concatenate(FragmentC="icon")
concat_12 = Concatenate(FragmentA=concat_10)
merge_4 = Merge(Data1=trim_5, Data2=trim_6)
merge_5 = Merge(Data1=expression_9, Data2=expression_10)
concat_13 = Concatenate(FragmentA=par, FragmentB=sep, FragmentC=concat_12)
blc = ExportBlock(path=concat_13, name=concat_11, url=concat_12, geo=merge_4, layer_name=merge_5, export=and_2)  # -> block_definition_3, path_4, exported_2

panel_12 = Panel("Parallel")  # disabled
panel_13 = Panel(concat_7)
m2d_rhino = Make2DRhinoView(Name=panel_12, Clip=True)  # disabled
number_slider_3 = Slider(876, range=0..1000)  # disabled
view_rectangle = ViewRectangle(view=m2d_rhino)  # disabled
stair_depth = Panel("1")
stair_count = Panel("4")
maintenance_expenses_month_eff_m²_2 = Number(maintenance_expenses_month_eff_m²)
construction_area_factor_2 = Number(construction_area_factor)
construction_cost_eff_m²_2 = Number(construction_cost_eff_m²)
previewplane = PreviewPlane(plane=view_rectangle, axis_length=number_slider_3)  # disabled
circulation_living_floor_area = Data()
outdoor_seating_floor_area = Data("0")
storage_living_floor_area = Data("0")
living_room_floor_area = Data()
sleeping_floor_area = Data()
sanitary_floor_area = Data()
division = Division(A=width_m, B="2")
division_2 = Division(A=stair_depth, B=stair_count)
kitchen_floor_area = Data()
pt = ConstructPoint(XCoordinate=0, YCoordinate=0, ZCoordinate=0)
series_2 = Series(Start=0, Step=division_2, Count=stair_count)
addition = Addition(
    A=living_room_floor_area,
    B=kitchen_floor_area,
    C=sanitary_floor_area,
    D=circulation_living_floor_area,
    E=outdoor_seating_floor_area,
    F=storage_living_floor_area,
    G=sleeping_floor_area)
common_room_floor_area = Data("0")
detention_room_floor_area = Data("0")
technology_room_floor_area = Data("0")
supervision_room_floor_area = Data("0")
other_office_work_floor_area = Data("0")
waiting_room_floor_area = Data("0")
dining_room_floor_area = Data("0")
counter_room_floor_area = Data("0")
break_room_floor_area = Data("0")
meeting_room_floor_area = Data("0")
control_room_floor_area = Data("0")
design_room_floor_area = Data("0")
office_room_floor_area = Data("0")
open_office_floor_area = Data("0")
cooling_energy_demand_kwh_m²a = Number(Slider(10, range=0..200))
heating_energy_demand_kwh_m²a = Number(Slider(20, range=0..200))
technical_equipment_energy_demand_kwh_m² = Number(Slider(20, range=0..200))  # "Technical Equipment Energy Demand[kWh/m²a]"
construction_global_warming_potential_kg = Number(Slider(1500, range=0..2000))  # "Construction Global Warming Potential [kgCO2e/eff. m²]"
living_floor_area = Data(addition)
Z = UnitZ(Factor=1)
addition_2 = Addition(
    A=office_room_floor_area,
    B=open_office_floor_area,
    C=meeting_room_floor_area,
    D=design_room_floor_area,
    E=counter_room_floor_area,
    F=control_room_floor_area,
    G=supervision_room_floor_area,
    H=technology_room_floor_area,
    I=other_office_work_floor_area)
addition_3 = Addition(
    A=living_floor_area,
    B=common_room_floor_area,
    C=break_room_floor_area,
    D=waiting_room_floor_area,
    E=dining_room_floor_area,
    F=detention_room_floor_area)
Z_2 = UnitZ(Factor=1)
production_experiments_work_floor_area = Data("0")
education_culture_instruction_floor_are = Data("0")
storage_distribution_sales_floor_area = Data("0")
living_and_staying_floor_area = Data(addition_3)
healing_and_care_floor_area = Data("0")
office_work_floor_area = Data(addition_2)
other_usable_floor_are = Data("0")
exerior_wall_floor_area = Data()
neg = Negative(Value="0.1")
wall_area_bath = Data()
addition_4 = Addition(A=core_radius_m, B="0.1")
neg_2 = Negative(Value=core_radius_m)
addition_5 = Addition(
    A=living_and_staying_floor_area,
    B=office_work_floor_area,
    C=production_experiments_work_floor_area,
    D=storage_distribution_sales_floor_area,
    E=education_culture_instruction_floor_are,
    F=healing_and_care_floor_area,
    G=other_usable_floor_are)
Z_3 = UnitZ(Factor=1)
exterior_wall_construction_floor_area = Data(exerior_wall_floor_area)
interior_wall_construction_floor_area = Data(wall_area_bath)
other_construction_floor_area = Data("0")
dom = ConstructDomain(DomainStart=core_radius_m, DomainEnd=neg_2)
dom_2 = ConstructDomain(DomainStart=addition_4, DomainEnd=neg_2)
partition_wall_floor_area = Data("0")
circulation_floor_area = Data("0")
technical_floor_area = Data("0")
column_floor_area = Data("0")
usable_floor_area = Data(addition_5)
beam_floor_area = Data("0")
shaft_floor_area = Data("0")
interiorwall_1 = Data()
interiorwall_1_2 = Data()
living_room_1 = Data()
living_room_2 = Data()
exteriorwall = Data()
circulation = Data()
kitchen_1 = Data()
sleeping = Data()
sanitary = Data()
merge_6 = Merge(Data1=sleeping, Data2=living_room_1, Data3=sanitary, Data4=kitchen_1, Data5=circulation, Data6=living_room_2)  # -> flatten(Result)
merge_7 = Merge(Data1=interiorwall_1, Data2=interiorwall_1_2, Data3=exteriorwall)  # -> flatten(Result)
addition_6 = Addition(A=usable_floor_area, B=technical_floor_area, C=circulation_floor_area)
addition_7 = Addition(
    A=exterior_wall_construction_floor_area,
    B=interior_wall_construction_floor_area,
    C=partition_wall_floor_area,
    D=column_floor_area,
    E=shaft_floor_area,
    F=beam_floor_area,
    G=other_construction_floor_area)
net_floor_area = Data(addition_6)
construction_floor_area = Data(addition_7)
all_surfaces_for_the_net_floor_area = Data(merge_6)
all_surfaces_for_construction_floor_area = Data(merge_7)
addition_8 = Addition(A=net_floor_area, B=construction_floor_area)  # -> flatten(Result)
gross_floor_area = Data()
gross_floor_area_2 = Data(addition_8)
series_3 = Series(Start=0, Step="90", Count="4")
X = UnitX(Factor=Slider(0, range=-1..0))
Y = UnitY(Factor=Slider(0.072, range=0..1))
data = Data(slab_thickness_m)
neg_3 = Negative(Value=data)
Z_4 = UnitZ(Factor=data)
Z_5 = UnitZ(Factor=neg_3)
number_slider_4 = Slider(39, range=0..135)
Z_6 = UnitZ(Factor=data)
Z_7 = UnitZ(Factor="-1")
Z_8 = UnitZ(Factor="5")

series_4 = Series(Start=0, Step=1, Count="4")
series_5 = Series(Start=0, Step=1, Count="2")
trim_7 = TrimTree(Tree=series_4, Depth=1)
trim_8 = TrimTree(Tree=series_5, Depth=1)
merge_8 = Merge(Data1=trim_7, Data2=trim_8, Data3=trim_8)

panel_14 = Panel("""east
north
north
west
west
south
south
east""")

# ----
# https://identifier.buildingsmart.org/uri/buildingsmart/ifc/4.3/prop/Width
# https://identifier.buildingsmart.org/uri/buildingsmart/ifc/4.3/class/IfcBuildingStorey
# https://identifier.buildingsmart.org/uri/buildingsmart/ifc/4.3/prop/GrossHeight
# 
# 
# 
# 
# https://identifier.buildingsmart.org/uri/buildingsmart/ifc/4.3/prop/NetFloorArea
# 
# https://identifier.buildingsmart.org/uri/buildingsmart/ifc/4.3/prop/EnergyConsumption
# https://identifier.buildingsmart.org/uri/buildingsmart/ifc/4.3/prop/EnergyConsumption
# https://identifier.buildingsmart.org/uri/buildingsmart/ifc/4.3/prop/EnergyConsumption
# 
# https://identifier.buildingsmart.org/uri/etim/etim/9.0/prop/EF016979
maintenance_expenses_month_eff_m²_3 = Number(maintenance_expenses_month_eff_m²_2)
# Outputs   ->
#                 |
#                 v
construction_global_warming_potential_kg_2 = Number(construction_global_warming_potential_kg)  # "Construction Global Warming Potential [kgCO2e/eff. m²]"
technical_equipment_energy_demand_kwh_m²_2 = Number(technical_equipment_energy_demand_kwh_m²)  # "Technical Equipment Energy Demand[kWh/m²a]"
construction_area_factor_3 = Number(construction_area_factor_2)
heating_energy_demand_kwh_m²a_2 = Number(heating_energy_demand_kwh_m²a)
cooling_energy_demand_kwh_m²a_2 = Number(cooling_energy_demand_kwh_m²a)
construction_cost_eff_m²_3 = Number(construction_cost_eff_m²_2)
expression_11 = Expression(x=construction_area_factor_3, Expression="1-x")
multiplication = Multiplication(B=construction_global_warming_potential_kg_2)
round = Round(Number=multiplication)  # -> Nearest, Floor, Ceiling
panel_15 = Panel("""width
storeys
floor height
platform
door width
door height
door offset
effective floor area
construction cost
heating energy demand
cooling energy demand
technical equipment energy demand
maintenance expenses
construction global warming potential""")
panel_16 = Panel("""m

m

m
m
m
m²
€
kWh/a
kWh/a
kWh/a
€/a
kgCO2e""")

number_slider_5 = Slider(0.05, range=0..1)
series_6 = Series(Start=0, Step="0.25", Count="4")
trim_9 = TrimTree(Tree=series_6, Depth=1)
addition_9 = Addition(A=trim_9, B=number_slider_5)
subtraction = Subtraction(A=trim_9, B=number_slider_5)
merge_9 = Merge(Data1=graft(subtraction), Data2=graft(addition_9))
trim_10 = TrimTree(Tree=merge_9, Depth=1)
shift = ShiftList(List=trim_10, Shift="2", Wrap=True)
trim_11 = TrimTree(Tree=shift, Depth=1)

panel_17 = Panel("""tambour rectangular bottom
core rectangular top
tambour rectangular bottom
core rectangular top""")
panel_18 = Panel("""tambour rectangular top
core rectangular bottom
tambour rectangular top
core rectangular bottom""")
qal_3 = ModelQuality(Name="wasp rotation", Value="180")  # -> Quality, Valid, Name, Value, Unit
item_9 = ListItem(List=panel_18, Index=itemindex, Wrap=True)
item_10 = ListItem(List=panel_17, Index=itemindex, Wrap=True)
merge_10 = Merge(Data1="bottom", Data2=qal_3.Quality)

expression_12 = Expression(x=floors, Expression="x+1")
int_3 = Integer(expression_12)
expression_13 = Expression(x=int_3, Expression="(x-1)*4")

panel_19 = Panel("""north
east
south
west""")
itemindex_2 = ItemIndex(L=panel_19, I=platform)  # -> i; inputs L: list; same code as itemindex
valueor0 = ValueOr0(value=itemindex_2)
expression_14 = Expression(x=valueor0, Expression="-((x+2)*90)%360")
_2d = _2D(x=width_m)
rectangle = Rectangle(Plane=PlaneXY(0, 0, 0), XSize=_2d, YSize=_2d, Radius=0)  # -> Rectangle, Length
expression_15 = Expression(x=width_m, Expression="x/2")
expression_16 = Expression(x=door_width_m, Expression="x/2")
subtraction_2 = Subtraction(A=expression_15, B=expression_16, C=door_offset_m, D=wall_thickness_m)

area = Area(Geometry=rectangle.Rectangle)  # -> Area, Centroid
multiplication_2 = Multiplication(A=area.Area, B=floors)
multiplication_3 = Multiplication(A=multiplication_2, B=expression_11)
multiplication_4 = Multiplication(A=multiplication_3, B=maintenance_expenses_month_eff_m²_3)
expression_17 = Expression(x=multiplication_4, Expression="x*12")
multiplication_5 = Multiplication(A=heating_energy_demand_kwh_m²a_2, B=multiplication_3)
multiplication_6 = Multiplication(A=cooling_energy_demand_kwh_m²a_2, B=multiplication_3)
multiplication_7 = Multiplication(A=multiplication_3, B=construction_cost_eff_m²_3)
multiplication_8 = Multiplication(A=technical_equipment_energy_demand_kwh_m²_2, B=multiplication_3)
roundmult = RoundToMultiple(N=multiplication_3, M="0.01")  # -> R; inputs N: tree, M: tree
# ---------- roundmult: Python ----------
#Component Information
#--------------------------------------------------------------------------------------------
if ghenv.Component.RunCount<2:
    #General
    #--------------------------------------------------------------------------------------------
    __author__ = "YOUR NAME"
    __version__ = "2000.00.00"
    
    ghenv.Component.Name = "Round to Multiple"
    ghenv.Component.NickName = "RoundMult"
    ghenv.Component.Description = "Rounds a number to the nearest specified multiple."
    ghenv.Component.Message = "VER 1.0"
    ghenv.Component.Category = "Math"
    ghenv.Component.SubCategory = "Arithmetic"
    
     #Inputs
    #--------------------------------------------------------------------------------------------
    inputIndex=0
    
    ghenv.Component.Params.Input[inputIndex].Name = "Number"
    ghenv.Component.Params.Input[inputIndex].NickName = "N"
    ghenv.Component.Params.Input[inputIndex].Description = "Number to round."
    ghenv.Component.Params.Input[inputIndex].Optional = False
    inputIndex+=1
    
    ghenv.Component.Params.Input[inputIndex].Name = "Multiple"
    ghenv.Component.Params.Input[inputIndex].NickName = "M"
    ghenv.Component.Params.Input[inputIndex].Description = "Multiple to round to."
    ghenv.Component.Params.Input[inputIndex].Optional = False
    inputIndex+=1
    
    #Outputs
    #--------------------------------------------------------------------------------------------
    outputIndex=0
    
    ghenv.Component.Params.Output[outputIndex].Name = "Rounded"
    ghenv.Component.Params.Output[outputIndex].NickName = "R"
    ghenv.Component.Params.Output[outputIndex].Description = "Number rounded to the nearest specified multiple."
    outputIndex+=1


#Imports
#--------------------------------------------------------------------------------------------
from System import Object
from Grasshopper import DataTree
import math


#The Component function - Business logic only (e.g. working without trees)
#--------------------------------------------------------------------------------------------
"""Function that this component is computing.
    Inputs:
        number: The number to round.
        multiple: The multiple to round to.
    Output:
        rounded: The number rounded to the nearest specified multiple."""
def RoundToMultiple(number, multiple):
    rounded = math.ceil(number / multiple) * multiple
    return rounded

#Solver - Run with trees to enhance performance drastically
#--------------------------------------------------------------------------------------------
if __name__ == "__main__":
    
    #Initialize trees
    #--------------------------------------------------------------------------------------------
    RoundedTree = DataTree[Object]()
    
    #Data matching
    #--------------------------------------------------------------------------------------------
    for path in N.Paths:
        numberBranch = N.Branch(path)
        for i, number in enumerate(numberBranch):
            multiple = M.Branch(path)[i]
            rounded = RoundToMultiple(number, multiple)
            RoundedTree.Add(rounded, path)
    
     #Assign trees to output
    #--------------------------------------------------------------------------------------------
    R = RoundedTree
# ---------- end roundmult ----------
round_2 = Round(Number=multiplication_7)  # -> Nearest, Floor, Ceiling
round_3 = Round(Number=multiplication_5)  # -> Nearest, Floor, Ceiling
round_4 = Round(Number=multiplication_6)  # -> Nearest, Floor, Ceiling
round_5 = Round(Number=multiplication_8)  # -> Nearest, Floor, Ceiling
round_6 = Round(Number=expression_17)  # -> Nearest, Floor, Ceiling
merge_11 = Merge(
    Data1=width_m,
    Data2=floors,
    Data3=floor_height_m,
    Data4=platform,
    Data5=door_width_m,
    Data6=door_height_m,
    Data7=door_offset_m,
    Data8=roundmult,
    Data9=round_2.Nearest,
    Data10=round_3.Nearest,
    Data11=round_4.Nearest,
    Data12=round_5.Nearest,
    Data13=round_6.Nearest,
    Data14=round.Nearest)
panel_20 = Panel(merge_11)
qal_4 = ModelQuality(Validate=validate, Name=panel_15, Value=panel_20, Unit=panel_16)  # -> Quality, Valid, Name, Value, Unit

expression_18 = Expression(x=valueor0, Expression="(-x)*2")
shift_2 = ShiftList(List=panel_14, Shift=expression_18, Wrap=True)

shift_3 = ShiftList(List=trim_11, Shift=expression_18, Wrap=True)
trim_12 = TrimTree(Tree=shift_3, Depth=1)

expression_19 = Expression(x=floor_height_m, Expression="x*(2/3)")
_2d_2 = _2D(x=width_m)
expression_20 = Expression(x=width_m, Expression="x/2")
neg_4 = Negative(Value=expression_20)
nand = GateNand(A=include_bottom, B=include_top)

addition_10 = Addition(A=floor_height_m, B=expression_19)
coreheight = Number(addition_10)
dom_3 = ConstructDomain(DomainStart=0, DomainEnd=coreheight)
box = DomainBox(Base=PlaneXY(0, 0, 0), X=_2d, Y=_2d, Z=dom_3)
corevolume = Box(box)
debrep = DeconstructBrep(Brep=corevolume)  # -> Faces, Edges, Vertices
trim_13 = TrimTree(Tree=debrep.Faces, Depth=1)
item_11 = ListItem(List=trim_13, Index=0, Wrap=True)  # -> Item, Item1, Item2, Item3, Item4
base = Surface(item_11.Item4)
explode = Explode(Curve=base, Recursive=True)  # -> Segments, Vertices
trim_14 = TrimTree(Tree=explode.Segments, Depth=1)
join = JoinCurves(Curves=explode.Segments, Preserve=False)
trim_15 = TrimTree(Tree=join, Depth=1)
curvepoint = PointOnCurve(trim_14, parameter=0.5)
crv_cp = CurveClosestPoint(Point=curvepoint, Curve=trim_14)  # -> Point, Parameter, Distance
addition_11 = Addition(A=crv_cp.Parameter, B=subtraction_2)
subtraction_3 = Subtraction(A=crv_cp.Parameter, B=subtraction_2)
eval = EvaluateCurve(Curve=trim_14, Parameter=addition_11)  # -> Point, Tangent, Angle
eval_2 = EvaluateCurve(Curve=trim_14, Parameter=subtraction_3)  # -> Point, Tangent, Angle
shift_4 = ShiftList(List=eval_2.Point, Shift=1, Wrap=True)
trim_16 = TrimTree(Tree=shift_4, Depth=1)
merge_12 = Merge(Data1=graft(eval.Point), Data2=graft(trim_16))

expression_21 = Expression(x=floor_height_m, Expression="x/3")
lng = ListLength(List=trim_14)
dup_5 = DuplicateData(Data=expression_21, Number=lng, Order=True)
trim_17 = TrimTree(Tree=dup_5, Depth=1)
replace = ReplaceItems(List=trim_17, Item="0", Indices="1", Wrap=False)
repeat = RepeatData(Data=replace, Length=expression_13)
trim_18 = TrimTree(Tree=repeat, Depth=1)
ma = MassAddition(Input=trim_18)  # -> Result, PartialResults
flip = FlipMatrix(Data=ma.PartialResults)
doorheights = Number(flip)
Z_9 = UnitZ(Factor=doorheights)
trim_19 = TrimTree(Tree=Z_9, Depth=1)
cset = CreateSet(List=trim_19)  # -> Set, graft(Map)
path = ConstructPath(Indices=cset.Map)
trim_20 = TrimTree(Tree=path, Depth=1)

l2o = List2Object(L=merge_12)  # -> O; inputs L: tree
# ---------- l2o: Python ----------
#Component Information
#--------------------------------------------------------------------------------------------
if ghenv.Component.RunCount<2:
    #General
    #--------------------------------------------------------------------------------------------
    __author__ = "Ueli Saluz"
    __version__ = "2022.04.24"
    
    ghenv.Component.Name = "List2Object"
    ghenv.Component.NickName = "L2O"
    ghenv.Component.Description = "Wraps a list of objects into a list object."
    ghenv.Component.Message = "VER 1.0"
    ghenv.Component.Category = "Sets"
    ghenv.Component.SubCategory = "Tree"
    
     #Inputs
    #--------------------------------------------------------------------------------------------
    inputIndex=0
    
    ghenv.Component.Params.Input[inputIndex].Name = "List"
    ghenv.Component.Params.Input[inputIndex].NickName = "L"
    ghenv.Component.Params.Input[inputIndex].Description = "Tree with lists to wrap."
    ghenv.Component.Params.Input[inputIndex].Optional = False
    inputIndex+=1
    

    #Outputs
    #--------------------------------------------------------------------------------------------
    outputIndex=0
    
    ghenv.Component.Params.Output[outputIndex].Name =  "ListObject" 
    ghenv.Component.Params.Output[outputIndex].NickName = "O"
    ghenv.Component.Params.Output[outputIndex].Description = "Python list object as single item."
    outputIndex+=1


#Imports
#--------------------------------------------------------------------------------------------
from System import Object
from Grasshopper import DataTree

#Solver - Run with trees to enhance performance drastically
#--------------------------------------------------------------------------------------------
if __name__ == "__main__":
    
    #Initialize trees
    #--------------------------------------------------------------------------------------------
    TreeToWrap = DataTree[Object]()
    
    #Data matching
    #--------------------------------------------------------------------------------------------
    for path in L.Paths:
        listBranch = L.Branch(path)
        TreeToWrap.Add(listBranch,path)
    
     #Assign trees to output
    #--------------------------------------------------------------------------------------------
    O = TreeToWrap
# ---------- end l2o ----------
trim_21 = TrimTree(Tree=l2o, Depth=1)
repeat_2 = RepeatData(Data=trim_21, Length=expression_13)
trim_22 = TrimTree(Tree=repeat_2, Depth=1)
o2l = Object2List(O=trim_22)  # -> L; inputs O: tree
# ---------- o2l: Python ----------
#Component Information
#--------------------------------------------------------------------------------------------
if ghenv.Component.RunCount<2:
    #General
    #--------------------------------------------------------------------------------------------
    __author__ = "Ueli Saluz"
    __version__ = "2022.04.24"
    
    ghenv.Component.Name = "Object2List"
    ghenv.Component.NickName = "O2L"
    ghenv.Component.Description = "Unwraps a list of objects into a list object."
    ghenv.Component.Message = "VER 1.0"
    ghenv.Component.Category = "Sets"
    ghenv.Component.SubCategory = "Tree"
    
     #Inputs
    #--------------------------------------------------------------------------------------------
    inputIndex=0
    
    ghenv.Component.Params.Input[inputIndex].Name = "ListObject"
    ghenv.Component.Params.Input[inputIndex].NickName = "O"
    ghenv.Component.Params.Input[inputIndex].Description = "A python list object that will be unwrapped into a Grasshopper list."
    ghenv.Component.Params.Input[inputIndex].Optional = False
    inputIndex+=1
    

    #Outputs
    #--------------------------------------------------------------------------------------------
    outputIndex=0
    
    ghenv.Component.Params.Output[outputIndex].Name =  "List"
    ghenv.Component.Params.Output[outputIndex].NickName = "L"
    ghenv.Component.Params.Output[outputIndex].Description = "The unwrapped list."
    outputIndex+=1


#Imports
#--------------------------------------------------------------------------------------------
from System import Object
from Grasshopper import DataTree

#Solver - Run with trees to enhance performance drastically
#--------------------------------------------------------------------------------------------
if __name__ == "__main__":
    
    #Initialize trees
    #--------------------------------------------------------------------------------------------
    OriginalTree = DataTree[Object]()
    
    #Data matching
    #--------------------------------------------------------------------------------------------
    for path in O.Paths:
        listBranch = O.Branch(path)
        for i,listItem in enumerate(listBranch):
            OriginalTree.AddRange(list(listItem),path.AppendElement(i))
    
     #Assign trees to output
    #--------------------------------------------------------------------------------------------
    L = OriginalTree
# ---------- end o2l ----------
match = MatchTree(Tree=Z_9, Guide=o2l)
move = Move(Geometry=o2l, Motion=match)  # -> Geometry, Transform
crv_cp_2 = CurveClosestPoint(Point=move.Geometry, Curve=trim_15)  # -> Point, Parameter, Distance
eval_3 = EvaluateCurve(Curve=trim_15, Parameter=crv_cp_2.Parameter)  # -> Point, Tangent, Angle
rev = Reverse(Vector=eval_3.Tangent)
line = LineSDL(Start=eval_3.Point, Direction=Vector(0, 0, 1), Length=1)
vrot = Rotate(Vector=rev, Axis=line, Angle=degrees("90"))
pl = ConstructPlane(Origin=eval_3.Point, XAxis=rev, YAxis=vrot)
move_2 = Move(Geometry=pl, Motion=Z_9)  # -> Geometry, Transform
rotate = Rotate(Geometry=move_2.Geometry, Angle=degrees(expression_14), Plane=PlaneXY(0, 0, 0))  # -> Geometry, Transform
neg_5 = Negative(Value=expression_21)
relblbrch = RelabelBranches(TreeToMatch=rotate.Geometry, ListOfPaths=trim_20)  # -> RelabeledTree; inputs TreeToMatch: tree, ListOfPaths: list
# ---------- relblbrch: Python ----------
if ghenv.Component.RunCount<2:
    __author__ = "Your name"
    __version__ = "2000.00.00"
    
    ghenv.Component.Name = "RelabelBranches"
    ghenv.Component.NickName = "ReLblBrch"
    ghenv.Component.Description = "Relabel all the paths of the branches with a list of new paths. The amount of branches must match with the size of the list of pahts"
    ghenv.Component.Message = "VER 1.0"
    
    ghenv.Component.Params.Input[0].NickName = "TreeToMatch"
    ghenv.Component.Params.Input[1].NickName = "ListOfPaths"
    
    ghenv.Component.Params.Input[0].Description = "Tree that should be relabeled."
    ghenv.Component.Params.Input[1].Description = "List of paths to use for new branch paths."
    
    ghenv.Component.Params.Output[0].NickName = "RelabeledTree"
    ghenv.Component.Params.Output[0].Description = "Relabeled tree where all the paths of the branches have been replaced with new paths."

from System import Object
from Grasshopper import DataTree

def relabelBranchesWithLstOfPths (tree, paths):
    newTree = DataTree[Object]()
    for i,path in enumerate(tree.Paths):
        items = tree.Branch(path)
        for data in items:
            newTree.Add(data,paths[i])
    return newTree

if __name__ == "__main__":
    RelabeledTree = relabelBranchesWithLstOfPths(TreeToMatch,ListOfPaths)
# ---------- end relblbrch ----------
addition_12 = Addition(A=neg_5, B=slab_thickness_m)
Z_10 = UnitZ(Factor=addition_12)
move_3 = Move(Geometry=relblbrch, Motion=Z_10)  # -> Geometry, Transform
entranceplanes = Plane(move_3.Geometry)

lng_2 = ListLength(List=flatten(entranceplanes))
repeat_3 = RepeatData(Data=merge_8, Length=lng_2)
trim_23 = TrimTree(Tree=repeat_3, Depth=1)
concat_14 = Concatenate(FragmentA="d", FragmentC=trim_23)
qal_5 = ModelQuality(Validate=validate, Name="door", Value=trim_23)  # -> Quality, Valid, Name, Value, Unit

addition_13 = Addition(A=floor_height_m, B=expression_21)
addition_14 = Addition(A=addition_13, B=expression_21)
dom_4 = ConstructDomain(DomainStart=expression_21, DomainEnd=expression_19)
dom_5 = ConstructDomain(DomainStart=addition_13, DomainEnd=addition_14)
dom_6 = ConstructDomain(DomainStart=floor_height_m, DomainEnd=coreheight)
box_2 = DomainBox(Base=PlaneXY(0, 0, 0), X=_2d_2, Y=expression_20, Z=expression_21)
box_3 = DomainBox(Base=PlaneXY(0, 0, 0), X=neg_4, Y=expression_20, Z=dom_4)
box_4 = DomainBox(Base=PlaneXY(0, 0, 0), X=expression_20, Y=expression_20, Z=dom_5)
box_5 = DomainBox(Base=PlaneXY(0, 0, 0), X=_2d_2, Y=neg_4, Z=dom_6)
rotate_2 = Rotate(Geometry=box_2, Angle=degrees(expression_14), Plane=PlaneXY(0, 0, 0))  # -> Geometry, Transform
rotate_3 = Rotate(Geometry=box_3, Angle=degrees(expression_14), Plane=PlaneXY(0, 0, 0))  # -> Geometry, Transform
rotate_4 = Rotate(Geometry=box_4, Angle=degrees(expression_14), Plane=PlaneXY(0, 0, 0))  # -> Geometry, Transform
rotate_5 = Rotate(Geometry=box_5, Angle=degrees(expression_14), Plane=PlaneXY(0, 0, 0))  # -> Geometry, Transform
merge_13 = Merge(Data1=rotate_2.Geometry, Data2=rotate_3.Geometry)
merge_14 = Merge(Data1=rotate_4.Geometry, Data2=rotate_5.Geometry)
sunion = SolidUnion(Breps=merge_13)
sunion_2 = SolidUnion(Breps=merge_14)
filter = StreamFilter(Gate=include_top, Stream0=sunion_2)
filter_2 = StreamFilter(Gate=include_bottom, Stream0=sunion)
merge_15 = Merge(Data1=filter_2, Data2=filter)
area_2 = Area(Geometry=merge_15)  # -> Area, Centroid
scale = Scale(Geometry=merge_15, Center=area_2.Centroid, Factor="1.1")  # -> Geometry, Transform
sdiff = SolidDifference(BrepsA=corevolume, BrepsB=merge_15)
sdiff_2 = SolidDifference(BrepsA=corevolume, BrepsB=scale.Geometry)
filter_3 = StreamFilter(Gate=nand, Stream0=corevolume, Stream1=sdiff)

subtraction_4 = Subtraction(A=coreheight, B=expression_21)
filter_4 = StreamFilter(Gate=include_top, Stream0=subtraction_4, Stream1=coreheight)
filter_5 = StreamFilter(Gate=include_bottom, Stream0=expression_21, Stream1="0")
Z_11 = UnitZ(Factor=1)
rev_2 = Reverse(Vector=Z_11)
pt_2 = ConstructPoint(XCoordinate=0, YCoordinate=0, ZCoordinate=filter_4)
pt_3 = ConstructPoint(XCoordinate=0, YCoordinate=0, ZCoordinate=filter_5)

por = ModelPort(
    Validate=validate,
    Id="b",
    Description="The bottom system center of the elevator.",
    Family=item_10,
    CompatibleFamilies=item_9,
    Point=pt_3,
    Direction=rev_2,
    T="0.5",
    Qualities=merge_10)  # -> Port, Valid, Id, Description, Mandatory, Family, CompatibleFamilies, Point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

panel_21 = Panel("""tambour rectangular bottom
tambourrectangular  bottom
roof rectangular top
roof rectangular top""")
panel_22 = Panel("""tambour rectangular top
tambour rectangular top
roof rectangular bottom
roof rectangular bottom""")
item_12 = ListItem(List=panel_22, Index=itemindex, Wrap=True)
item_13 = ListItem(List=panel_21, Index=itemindex, Wrap=True)
por_2 = ModelPort(
    Validate=validate,
    Id="t",
    Description="The top system center of the elevator.",
    Family=item_12,
    CompatibleFamilies=item_13,
    Point=pt_2,
    Direction=Z_11,
    T="0",
    Qualities="top")  # -> Port, Valid, Id, Description, Mandatory, Family, CompatibleFamilies, Point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

filter_6 = StreamFilter(Gate=nand, Stream0=corevolume, Stream1=sdiff_2)

jagged = SettingsSpeed()
mesh = MeshBrep(Brep=filter_6, Settings=jagged)
collider = Mesh(mesh)

deplane = DeconstructPlane(Plane=entranceplanes)  # -> Origin, XAxis, YAxis, ZAxis
pl_2 = ConstructPlane(Origin=deplane.Origin, XAxis=deplane.XAxis, YAxis=deplane.ZAxis)
_2d_3 = _2D(x=door_width_m)
rectangle_2 = Rectangle(Plane=pl_2, XSize=_2d_3, YSize=door_height_m, Radius=0)  # -> Rectangle, Length
doors = Rectangle(flatten(rectangle_2.Rectangle))

door_tree = Data(doors)
lng_3 = ListLength(List=flatten(door_tree))
repeat_4 = RepeatData(Data=flatten(shift_2), Length=lng_3)
trim_24 = TrimTree(Tree=repeat_4, Depth=1)
tstat_2 = TreeStatistics(Tree=door_tree)  # -> Paths, Length, Count
partition_2 = PartitionList(List=trim_24, Size=tstat_2.Length)
match_2 = MatchTree(Tree=partition_2, Guide=door_tree)  # -> flatten(Tree)
qal_6 = ModelQuality(Validate=validate, Name="facade", Value=match_2)  # -> Quality, Valid, Name, Value, Unit

panel_23 = Panel("""first
second
third
fourth""")
item_14 = ListItem(List=panel_23, Index=trim_23, Wrap=True)
concat_15 = Concatenate(
    FragmentG="The ",
    FragmentF=item_14,
    FragmentA=" door of the ",
    FragmentB=item_5,
    FragmentC=" plattform in the ",
    FragmentD=match_2,
    FragmentE=" facade.")

merge_16 = Merge(Data1=graft(qal.Quality), Data2=graft(qal_5.Quality), Data3=graft(qal_6.Quality), Data4=graft(qal_2.Quality))
entranceplanes_2 = Plane(flatten(entranceplanes))
concat_16 = Concatenate(FragmentC=concat_4, FragmentD="_", FragmentE=concat_14)
panel_24 = Panel("""0.2
0.05
0.95
0.8
0.7
0.55
0.45
0.3""")
por_3 = ModelPort(
    Port=graft(entranceplanes_2),
    Validate=validate,
    Id=graft(concat_16),
    Description=graft(concat_15),
    Family=graft(concat),
    CompatibleFamilies=merge,
    T=graft(panel_24))  # -> Port, Valid, Id, Description, Mandatory, Family, CompatibleFamilies, Point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
trim_25 = TrimTree(Tree=por_3.Port, Depth=1)

merge_17 = Merge(Data1=por.Port, Data2=por_2.Port, Data3=trim_25)
prv = PreviewPort(po=merge_17, sc=1)

aut = ModelAuthor(Name="Ueli Saluz", Email="ueli@semio-tech.org")  # -> Author, Valid, Name, Email, Attributes
typ = ModelType(
    Validate=validate,
    Name="Tambour",
    Description=concat_7,
    Icon=concat_8,
    Image=concat_9,
    Variant=item_4,
    Unit="m",
    Ports=merge_17,
    Authors=aut.Author,
    Qualities=qal_4.Quality)  # -> Type, Valid, Name, Description, Icon, Image, Variant, Stock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
typ_2 = PutType(Type=typ.Type, Uri=par, Run=save)

typ_3 = SerializeType(Type=typ.Type)
txt = EncodeText(Text=typ_3, Mode=0)
type = Text(txt)
context_bake = ContextBake(Geometry=type)
data_2 = Data(expression_21)
division_3 = Division(A=data_2, B="5")
series_7 = Series(Start=0, Step=division_3, Count=stair_count)
pt_4 = ConstructPoint(XCoordinate=division, YCoordinate=division_2, ZCoordinate=division_3)
pt_5 = ConstructPoint(XCoordinate=0, YCoordinate=series_2, ZCoordinate=series_7)
box_6 = Box2Pt(PointA=pt, PointB=pt_4, Plane=PlaneXY(0, 0, 0))
vec2pt = Vector2Pt(PointA=pt, PointB=pt_5, Unitize=False)  # -> Vector, Length
move_4 = Move(Geometry=box_6, Motion=vec2pt.Vector)  # -> Geometry, Transform
sunion_3 = SolidUnion(Breps=move_4.Geometry)
area_3 = Area(Geometry=sunion_3)  # -> Area, Centroid
edges = BrepEdges(Brep=merge_15)  # -> Naked, flatten(Interior), NonManifold

# ---- group: For normal Tambour
vec = Vector(edges.Interior)
devec = DeconstructVector(Vector=vec)  # -> XComponent, YComponent, ZComponent
larger = LargerThan(FirstNumber=devec.ZComponent, SecondNumber="0.01")  # -> LargerThan, OrEqualTo
larger_2 = LargerThan(FirstNumber=devec.ZComponent, SecondNumber="-0.01")  # -> LargerThan, OrEqualTo
number_slider_6 = Slider(15, range=0..50)
and_3 = GateAnd(A=larger.LargerThan, B=larger_2.LargerThan)
dispatch = Dispatch(List=edges.Interior, DispatchPattern=and_3)  # -> ListA, ListB
panel_25 = Panel("""4
5
6""")
panel_26 = Panel("""0
1
2""")
panel_27 = Panel("""8
15
10
11""")
panel_28 = Panel("""12
14
15""")
item_15 = ListItem(List=dispatch.ListA, Index=panel_25, Wrap=True)
item_16 = ListItem(List=dispatch.ListA, Index=panel_28, Wrap=True)
item_17 = ListItem(List=dispatch.ListA, Index=panel_27, Wrap=True)
item_18 = ListItem(List=dispatch.ListA, Index=panel_26, Wrap=True)
item_19 = ListItem(List=item_16, Index=0, Wrap=True)  # -> Item, Item1, Item2
end = EndPoints(Curve=item_16)  # -> Start, End
end_2 = EndPoints(Curve=item_17)  # -> Start, End
item_20 = ListItem(List=item_17, Index=0, Wrap=True)  # -> Item, Item1, Item2, Item3
item_21 = ListItem(List=item_15, Index=0, Wrap=True)  # -> Item, Item1, Item2
item_22 = ListItem(List=item_18, Index=0, Wrap=True)  # -> Item, Item1, Item2
end_3 = EndPoints(Curve=item_15)  # -> Start, End
end_4 = EndPoints(Curve=item_18)  # -> Start, End
data_3 = Data(end.Start)
data_4 = Data(end_2.Start)
data_5 = Data(end_4.Start)
merge_18 = Merge(Data1=item_20.Item1, Data2=item_20.Item2)
data_6 = Data(end_3.Start)
item_23 = ListItem(List=data_3, Index=0, Wrap=True)  # -> Item, Item1, Item2
item_24 = ListItem(List=data_4, Index=0, Wrap=True)  # -> Item, Item1, Item2, Item3
item_25 = ListItem(List=data_5, Index=0, Wrap=True)  # -> Item, Item1, Item2
join_2 = JoinCurves(Curves=merge_18, Preserve=False)  # -> flatten(Curves)
item_26 = ListItem(List=data_6, Index=0, Wrap=True)  # -> Item, Item1, Item2
vec2pt_2 = Vector2Pt(PointA=item_25.Item1, PointB=item_25.Item, Unitize=False)  # -> Vector, Length
vec2pt_3 = Vector2Pt(PointA=item_25.Item1, PointB=item_25.Item2, Unitize=False)  # -> Vector, Length
vec2pt_4 = Vector2Pt(PointA=item_26.Item1, PointB=item_26.Item2, Unitize=False)  # -> Vector, Length
vec2pt_5 = Vector2Pt(PointA=item_26.Item, PointB=item_26.Item1, Unitize=False)  # -> Vector, Length
vec2pt_6 = Vector2Pt(PointA=item_24.Item3, PointB=item_24.Item, Unitize=False)  # -> Vector, Length
vec2pt_7 = Vector2Pt(PointA=item_24.Item3, PointB=item_24.Item2, Unitize=False)  # -> Vector, Length
vec2pt_8 = Vector2Pt(PointA=item_23.Item2, PointB=item_23.Item, Unitize=False)  # -> Vector, Length
vec2pt_9 = Vector2Pt(PointA=item_23.Item1, PointB=item_23.Item2, Unitize=False)  # -> Vector, Length
amp = Amplitude(Vector=vec2pt_5.Vector, Amplitude="6")
amp_2 = Amplitude(Vector=vec2pt_4.Vector, Amplitude="6")
amp_3 = Amplitude(Vector=vec2pt_9.Vector, Amplitude="6")
amp_4 = Amplitude(Vector=vec2pt_8.Vector, Amplitude="6")
amp_5 = Amplitude(Vector=vec2pt_7.Vector, Amplitude="6")
amp_6 = Amplitude(Vector=vec2pt_6.Vector, Amplitude="6")
amp_7 = Amplitude(Vector=vec2pt_3.Vector, Amplitude="6")
amp_8 = Amplitude(Vector=vec2pt_2.Vector, Amplitude="6")
move_5 = Move(Geometry=item_21.Item1, Motion=amp)  # -> Geometry, Transform
neg_6 = Negative(Value=amp)
move_6 = Move(Geometry=item_19.Item2, Motion=amp_3)  # -> Geometry, Transform
move_7 = Move(Geometry=join_2, Motion=amp_5)  # -> Geometry, Transform
neg_7 = Negative(Value=amp_5)
move_8 = Move(Geometry=item_22.Item2, Motion=amp_7)  # -> Geometry, Transform
move_9 = Move(Geometry=item_21.Item, Motion=neg_6)  # -> Geometry, Transform
loft = Loft(
    Curves=[move_5.Geometry, item_21.Item],
    Options={Adjust=False, Closed=False, LoftEnds=0, LoftSimp=0, LoftType=0, Rebuild=10, Refit=0.01})
loft_2 = Loft(
    Curves=[move_6.Geometry, item_19.Item1],
    Options={Adjust=False, Closed=False, LoftEnds=0, LoftSimp=0, LoftType=0, Rebuild=10, Refit=0.01})
move_10 = Move(Geometry=item_20.Item3, Motion=neg_7)  # -> Geometry, Transform
loft_3 = Loft(
    Curves=[move_7.Geometry, item_20.Item3],
    Options={Adjust=False, Closed=False, LoftEnds=0, LoftSimp=0, LoftType=0, Rebuild=10, Refit=0.01})
loft_4 = Loft(
    Curves=[move_8.Geometry, item_22.Item1],
    Options={Adjust=False, Closed=False, LoftEnds=0, LoftSimp=0, LoftType=0, Rebuild=10, Refit=0.01})
loft_5 = Loft(
    Curves=[move_9.Geometry, item_21.Item],
    Options={Adjust=False, Closed=False, LoftEnds=0, LoftSimp=0, LoftType=0, Rebuild=10, Refit=0.01})
loft_6 = Loft(
    Curves=[item_20.Item3, move_10.Geometry],
    Options={Adjust=False, Closed=False, LoftEnds=0, LoftSimp=0, LoftType=0, Rebuild=10, Refit=0.01})
extr = Extrude(Base=loft, Direction=amp_2)
extr_2 = Extrude(Base=loft_5, Direction=amp_2)
extr_3 = Extrude(Base=loft_3, Direction=amp_6)
extr_4 = Extrude(Base=loft_6, Direction=amp_6)
extr_5 = Extrude(Base=loft_4, Direction=amp_8)
join_3 = BrepJoin(Breps=[extr_2, extr])  # -> Breps, Closed
join_4 = BrepJoin(Breps=[extr_4, extr_3])  # -> Breps, Closed
extr_6 = Extrude(Base=loft_2, Direction=amp_4)
merge_19 = Merge(Data1=extr_5, Data2=join_3.Breps, Data3=join_4.Breps, Data4=extr_6)

# ----
sort_surfaces = SortSurfacesByOrientation(B=filter_3)  # -> base_2, roof_2, walls_2
extr_7 = Extrude(Base=sort_surfaces.base_2, Direction=Z_4)  # -> flatten(Extrusion)
extr_8 = Extrude(Base=sort_surfaces.roof_2, Direction=Z_5)  # -> flatten(Extrusion)
merge_20 = Merge(Data1=extr_7, Data2=extr_8)
slaps = Brep(graft(merge_20))
data_7 = Data(merge_15)

doors_2 = Data(doors)
volume = Data(filter_3)
debrep_2 = DeconstructBrep(Brep=volume)  # -> flatten(Faces), Edges, Vertices
facen = FaceNormals(Mesh=debrep_2.Faces)  # -> simplify(Centers), simplify(Normals)
item_27 = ListItem(List=facen.Normals, Index=0, Wrap=True)  # -> flatten(Item)
volume_2 = Data(volume)
group = NamedGroup(Geometry=volume_2, Name="floors")  # -> Group, Geometry, Name
devec_2 = DeconstructVector(Vector=item_27)  # -> XComponent, YComponent, ZComponent
group_2 = NamedGroup(Geometry=volume_2, Name="Volume")  # -> Group, Geometry, Name
smaller = SmallerThan(FirstNumber=devec_2.ZComponent, SecondNumber="0.01")  # -> SmallerThan, OrEqualTo
smaller_2 = SmallerThan(FirstNumber=devec_2.ZComponent, SecondNumber="-0.01")  # -> SmallerThan, OrEqualTo
larger_3 = LargerThan(FirstNumber=devec_2.ZComponent, SecondNumber="0.01")  # -> LargerThan, OrEqualTo
larger_4 = LargerThan(FirstNumber=devec_2.ZComponent, SecondNumber="-0.01")  # -> LargerThan, OrEqualTo
and_4 = GateAnd(A=smaller.SmallerThan, B=smaller_2.SmallerThan)
and_5 = GateAnd(A=smaller.SmallerThan, B=larger_4.LargerThan)
cull = CullPattern(List=debrep_2.Faces, CullPattern=and_4)
cull_2 = CullPattern(List=debrep_2.Faces, CullPattern=larger_3.LargerThan)
cull_3 = CullPattern(List=debrep_2.Faces, CullPattern=and_5)
wires = BrepWireframe(Brep=volume_2, Density=-1)  # -> flatten(Wireframe)
roof = Surface(cull_2)
group_3 = NamedGroup(Geometry=roof, Name="roof")  # -> flatten(Group), Geometry, Name
base_2 = Surface(cull)
group_4 = NamedGroup(Geometry=base_2, Name="Base")  # -> flatten(Group), Geometry, Name
walls = Surface(cull_3)
group_5 = NamedGroup(Geometry=walls, Name="walls")  # -> flatten(Group), Geometry, Name
merge_21 = Merge(Data1=volume_2, Data2=wires, Data3=doors_2)
data_8 = Data(concat_7)
data_9 = Data(variant)
collider_2 = Mesh(collider)
ql = Quality(qal_4.Quality)
po = Port(merge_17)
au = Author(aut.Author)
rep = ModelRepresentation(Tags="1 to 200")  # -> Representation, Valid, Url, Description, Tags, Attributes

bbox_2 = BoundingBox(Content=volume_2, Plane=PlaneXY(0, 0, 0))  # -> Box, Box_2
sort_surfaces_2 = SortSurfacesByOrientation(B=bbox_2.Box)  # -> base_2, roof_2, walls_2
debox = DeconstructBox(Box=bbox_2.Box)  # -> Plane, X, Y, Z
dedomain = DeconstructDomain(Domain=debox.X)  # -> Start, End
dedomain_2 = DeconstructDomain(Domain=debox.Z)  # -> Start, End
Z_12 = UnitZ(Factor=dedomain_2.End)
area_4 = Area(Geometry=sort_surfaces_2.base_2)  # -> Area, Centroid
edges_2 = BrepEdges(Brep=sort_surfaces_2.base_2)  # -> Naked, Interior, NonManifold
subtraction_5 = Subtraction(A=dedomain.End, B="0.33")
division_4 = Division(A=dedomain_2.End, B="2")
midpt = CurveMiddle(Curve=edges_2.Naked)
box_7 = CenterBox(Base=debox.Plane, X=subtraction_5, Y=subtraction_5, Z=division_4)
Z_13 = UnitZ(Factor=division_4)
area_5 = Area(Geometry=sort_surfaces_2.base_2)  # -> Area, Centroid
move_11 = Move(Geometry=midpt, Motion=Z_12)  # -> Geometry, Transform
facen_2 = FaceNormals(Mesh=sort_surfaces_2.walls_2)  # -> Centers, Normals
move_12 = Move(Geometry=box_7, Motion=Z_13)  # -> Geometry, Transform
ln = Line(StartPoint=move_11.Geometry, EndPoint=midpt)  # -> simplify(graft(Line))
move_13 = Move(Geometry=area_5.Centroid, Motion=Z)  # -> Geometry, Transform
amp_9 = Amplitude(Vector=facen_2.Normals, Amplitude="2.3")
ln_2 = Line(StartPoint=area_5.Centroid, EndPoint=move_13.Geometry)
item_28 = ListItem(List=midpt, Index=0, Wrap=True)  # -> Item, Item1, Item2, Item3
move_14 = Move(Geometry=ln, Motion=amp_9)  # -> simplify(graft(Geometry)), Transform
loft_7 = Loft(
    Curves=[move_14.Geometry, ln],
    Options={Adjust=False, Closed=False, LoftEnds=0, LoftSimp=0, LoftType=0, Rebuild=10, Refit=0.01})  # -> flatten(Loft)
move_15 = Move(Geometry=item_28.Item2, Motion=Z_2)  # -> Geometry, Transform
group_6 = NamedGroup(Geometry=doors_2, Name="door")  # -> Group, Geometry, Name
pl_3pt = Plane3Pt(PointA=item_28.Item, PointB=item_28.Item2, PointC=move_15.Geometry)
ln_3 = Line(StartPoint=item_28.Item1, EndPoint=item_28.Item3)
facen_3 = FaceNormals(Mesh=loft_7)  # -> Centers, Normals
amp_10 = Amplitude(Vector=facen_3.Normals, Amplitude=[neg, "0.1"])
ln_4 = Line(StartPoint=item_28.Item, EndPoint=item_28.Item2)
merge_22 = Merge(Data1=group_6.Group, Data2=group_2.Group)
extr_9 = Extrude(Base=graft(loft_7), Direction=amp_10)  # -> flatten(Extrusion)
extr_10 = Extrude(Base=ln_4, Direction=Z_3)
group_7 = NamedGroup(Geometry=merge_22)  # -> Group, Geometry, Name
split = SplitWithBrep(Curve=ln_3, Brep=extr_10)  # -> Curve, Points
sunion_4 = SolidUnion(Breps=extr_9)
box_8 = DomainBox(Base=PlaneXY(0, 0, 0), X=dom, Y=dom_2, Z=debox.Z)
item_29 = ListItem(List=split.Curve, Index=0, Wrap=True)
edges_3 = BrepEdges(Brep=box_8)  # -> Naked, Interior, NonManifold
midpt_2 = CurveMiddle(Curve=item_29)
disc = Discontinuity(Curve=edges_3.Interior, Level=1)  # -> flatten(Points), Parameters
vec2pt_10 = Vector2Pt(PointA=area_3.Centroid, PointB=midpt_2, Unitize=False)  # -> Vector, Length
volume_indoor = Data(move_12.Geometry)

debrep_3 = DeconstructBrep(Brep=volume_indoor)  # -> Faces, Edges, Vertices
item_30 = ListItem(List=debrep_3.Vertices, Index=0, Wrap=True)
pdecon = Deconstruct(Point=item_30)  # -> XComponent, YComponent, ZComponent
addition_15 = Addition(A="1", B=pdecon.XComponent)
addition_16 = Addition(A=pdecon.YComponent, B="1")
pt_6 = ConstructPoint(XCoordinate=addition_15, YCoordinate=addition_16, ZCoordinate=dedomain_2.End)
box_9 = Box2Pt(PointA=item_30, PointB=pt_6, Plane=item_30)
debrep_4 = DeconstructBrep(Brep=box_9)  # -> Faces, Edges, Vertices
abs = Absolute(Value="-0.1")
item_31 = ListItem(List=debrep_4.Vertices, Index=0, Wrap=True)  # -> Item, Item1, Item2, Item3
ln_5 = Line(StartPoint=item_31.Item1, EndPoint=item_31.Item3)
Z_14 = UnitZ(Factor=dedomain_2.End)
extr_11 = Extrude(Base=ln_5, Direction=Z_14)
split_2 = SplitBrep(Brep=box_9, Cutter=extr_11)
item_32 = ListItem(List=split_2, Index=0, Wrap=True)  # -> flatten(Item)
cap = CapHoles(Brep=item_32)
sort_surfaces_3 = SortSurfacesByOrientation(B=cap)  # -> base_2, roof_2, walls_2
facen_4 = FaceNormals(Mesh=sort_surfaces_3.walls_2)  # -> Centers, flatten(Normals)
amp_11 = Amplitude(Vector=facen_4.Normals, Amplitude="-0.1")
amp_12 = Amplitude(Vector=facen_4.Normals, Amplitude=abs)
extr_12 = Extrude(Base=sort_surfaces_3.walls_2, Direction=amp_11)
extr_13 = Extrude(Base=sort_surfaces_3.walls_2, Direction=amp_12)
sdiff_3 = SolidDifference(BrepsA=extr_12, BrepsB=extr_13)
sunion_5 = SolidUnion(Breps=sdiff_3)
series_8 = Series(Start=0, Step="90", Count="4")
rotax = RotateAxis(Geometry=sunion_5, Angle=degrees(series_8), Axis=ln_2)  # -> Geometry, Transform

cullpt = CullDuplicates(Points=disc.Points, Tolerance=0.1, CullMode=3)  # -> Points, Indices, Valence
move_16 = Move(Geometry=sunion_3, Motion=vec2pt_10.Vector)  # -> Geometry, Transform
sdiff_4 = SolidDifference(BrepsA=bbox_2.Box, BrepsB=volume_indoor)
item_33 = ListItem(List=cullpt.Points, Index=0, Wrap=True)
mirror = Mirror(Geometry=move_16.Geometry, Plane=pl_3pt)  # -> Geometry, Transform
lnln = LineLine(LineA=ln_3, LineB=ln_2)
box_10 = CenterBox(Base=item_33, X="0.15", Y="1", Z=dedomain_2.End)
mirror_2 = Mirror(Geometry=mirror.Geometry, Plane=lnln)  # -> Geometry, Transform
rotax_2 = RotateAxis(Geometry=move_16.Geometry, Angle=degrees("-90"), Axis=ln_2)  # -> Geometry, Transform
rotate_6 = Rotate(Geometry=box_10, Angle=degrees("45"), Plane=item_33)  # -> Geometry, Transform
rotax_3 = RotateAxis(Geometry=rotate_6.Geometry, Angle=degrees(series_3), Axis=ln_2)  # -> Geometry, Transform
item_34 = ListItem(List=rotax_3.Geometry, Index="1", Wrap=True)  # -> Item, Item1, Item2
move_17 = Move(Geometry=[item_34.Item, item_34.Item1], Motion=X)  # -> Geometry, Transform
item_35 = ListItem(List=move_17.Geometry, Index=0, Wrap=True)  # -> Item1, Item
move_18 = Move(Geometry=[item_35.Item1, item_34.Item2], Motion=Y)  # -> Geometry, Transform
merge_23 = Merge(Data1=move_18.Geometry, Data2=item_35.Item, Data3=rotate_6.Geometry)
sdiff_5 = SolidDifference(BrepsA=box_8, BrepsB=merge_23)  # -> flatten(Result)
elevator_volume = Data(sdiff_5)
sdiff_6 = SolidDifference(BrepsA=elevator_volume, BrepsB=merge_15)
group_8 = NamedGroup(Geometry=sdiff_6, Name="Elevator Volume")  # -> Group, Geometry, Name
srf = Surface(doors_2)
shafts = Brep(rotax.Geometry)
exterior_walls = Brep(sdiff_4)
merge_24 = Merge(Data1=elevator_volume, Data2=exterior_walls, Data3=shafts)  # -> flatten(Result)
sdiff_7 = SolidDifference(BrepsA=slaps, BrepsB=merge_24)
item_36 = ListItem(List=sdiff_7, Index=0, Wrap=True)  # -> flatten(Item)
facen_5 = FaceNormals(Mesh=srf)  # -> Centers, flatten(Normals)
sdiff_8 = SolidDifference(BrepsA=shafts, BrepsB=data_7)  # -> flatten(Result)
sdiff_9 = SolidDifference(BrepsA=exterior_walls, BrepsB=data_7)
amp_13 = Amplitude(Vector=facen_5.Normals, Amplitude="0.33")
sdiff_10 = SolidDifference(BrepsA=sunion_4, BrepsB=merge_19)
extr_14 = Extrude(Base=srf, Direction=amp_13)
fmerge = MergeFaces(Brep=sdiff_10)  # -> Breps, Before, After
sdiff_11 = SolidDifference(BrepsA=sdiff_9, BrepsB=extr_14)  # -> flatten(Result)
construction_panel = Brep(fmerge.Breps)
shafts_2 = Brep(sdiff_8)
exterior_walls_2 = Brep(sdiff_11)

group_9 = NamedGroup(Geometry=srf, Name="door")  # -> Group, Geometry, Name
merge_25 = Merge(Data1=group.Group, Data2=group_4.Group, Data3=group_5.Group, Data5=group_9.Group, Data6=group_3.Group)
group_10 = NamedGroup(Geometry=merge_25)  # -> Group, Geometry, Name
group_11 = NamedGroup(Geometry=srf, Name="door")  # -> Group, Geometry, Name
group_12 = NamedGroup(Geometry=exterior_walls_2, Name="Exterior Walls")  # -> Group, Geometry, Name
group_13 = NamedGroup(Geometry=construction_panel, Name="Construction panels")  # -> Group, Geometry, Name
group_14 = NamedGroup(Geometry=shafts_2, Name="Shafts")  # -> Group, Geometry, Name
merge_26 = Merge(Data1=group_11.Group, Data2=group_2.Group, Data3=group_8.Group)
group_15 = NamedGroup(Geometry=merge_26)  # -> Group, Geometry, Name
energy_representation = Data(group_10.Group)

explode_2 = ExplodeObject(Object=sdiff_5, Recursive=False)  # -> flatten(Objects)
panel_29 = Panel("""4
9""")
cull_i = CullIndex(List=explode_2, Indices=panel_29, Wrap=True)  # -> flatten(List)
Z_15 = UnitZ(Factor=1)
merge_27 = Merge(Data1=rotax_2.Geometry, Data2=mirror_2.Geometry, Data3=move_16.Geometry)  # -> flatten(Result)
facen_6 = FaceNormals(Mesh=cull_i)  # -> Centers, Normals
neg_8 = Negative(Value=Z_15)
item_37 = ListItem(List=facen_6.Normals, Index=0, Wrap=True)
amp_14 = Amplitude(Vector=item_37, Amplitude="-0.15")
extr_15 = Extrude(Base=graft(cull_i), Direction=amp_14)  # -> flatten(Extrusion)
sunion_6 = SolidUnion(Breps=extr_15)
merge_28 = Merge(Data1=sunion_6, Data2=sdiff_4)  # -> flatten(Result)
move_19 = Move(Geometry=merge_28, Motion=neg_8)  # -> Geometry, Transform
trim_26 = TrimSolid(Shape=graft(merge_27), Cutters=move_19.Geometry)
data_10 = Data(division_3)
item_38 = ListItem(List=trim_26, Index="1", Wrap=True)  # -> flatten(Item)
multiplication_9 = Multiplication(A=data_10, B="2")
data_11 = Data(expression_21)
addition_17 = Addition(A=data_11, B=multiplication_9)
item_39 = ListItem(List=item_38, Index=0, Wrap=True)  # -> Item, Item1, Item2
Z_16 = UnitZ(Factor=multiplication_9)
addition_18 = Addition(A=addition_17, B=data_11)
move_20 = Move(Geometry=item_39.Item1, Motion=Z_16)  # -> Geometry, Transform
Z_17 = UnitZ(Factor=addition_18)
Z_18 = UnitZ(Factor=addition_17)
move_21 = Move(Geometry=item_39.Item2, Motion=Z_17)  # -> Geometry, Transform
move_22 = Move(Geometry=item_39.Item, Motion=Z_18)  # -> Geometry, Transform
move_23 = Move(Geometry=item_39.Item1, Motion=Z_16)  # -> Geometry, Transform
merge_29 = Merge(Data1=move_21.Geometry, Data2=move_22.Geometry, Data3=move_23.Geometry)

capex = CapHolesEx(Brep=merge_29)  # -> Brep, Caps, Solid

move_24 = Move(Geometry=capex.Brep, Motion=Z_6)  # -> flatten(Geometry), Transform

debrep_5 = DeconstructBrep(Brep=move_24.Geometry)  # -> Faces, Edges, Vertices
item_40 = ListItem(List=debrep_5.Edges, Index="39", Wrap=True)  # -> flatten(Item)
elevator_shaft = Data(sunion_6)
extr_16 = Extrude(Base=item_40, Direction=Z_8)
sdiff_12 = SolidDifference(BrepsA=elevator_shaft, BrepsB=data_7)  # -> flatten(Result)
move_25 = Move(Geometry=extr_16, Motion=Z_7)  # -> Geometry, Transform
facen_7 = FaceNormals(Mesh=move_25.Geometry)  # -> Centers, flatten(Normals)
amp_15 = Amplitude(Vector=facen_7.Normals, Amplitude=stair_depth)
neg_9 = Negative(Value=amp_15)
extr_17 = Extrude(Base=move_25.Geometry, Direction=neg_9)
trim_27 = TrimSolid(Shape=item_36, Cutters=extr_17)  # -> flatten(Result)
cap_2 = CapHoles(Brep=trim_27)  # -> flatten(Brep)
elevator_shaft_2 = Data(sdiff_12)
stairs = Brep(move_24.Geometry)
slaps_2 = Brep(cap_2)

group_16 = NamedGroup(Geometry=stairs, Name="Stairs")  # -> Group, Geometry, Name
group_17 = NamedGroup(Geometry=elevator_shaft_2, Name="Elevator Shaft")  # -> Group, Geometry, Name
group_18 = NamedGroup(Geometry=slaps_2, Name="slaps")  # -> Group, Geometry, Name
merge_30 = Merge(
    Data1=group_12.Group,
    Data2=group_13.Group,
    Data3=group_14.Group,
    Data4=group_17.Group,
    Data5=group_16.Group,
    Data6=group_18.Group)
group_19 = NamedGroup(Geometry=merge_30)  # -> Group, Geometry, Name
typ_4 = OppinionatedType(
    path=dir,
    na="Tambour",
    description=data_8,
    variant=data_9,
    de=group_15.Group,
    paper=merge_21,
    collider=collider_2,
    volume=group_7.Group,
    group=group_19.Group,
    rp=rep.Representation,
    po=po,
    authors=au,
    qualities=ql)  # -> ty_2, ba_2

# ----
# 2023-2025 Ueli Saluz
# 2025 Elduane Lumpine
# 2025 Christian Hödtke
geo = PreviewGeometry(geo=group_19.Group, sc=1)

# ==== cluster _2D
x = ClusterInput()
expression = Expression(x=x, Expression="x/2")
neg = Negative(Value=expression)
dom = ConstructDomain(DomainStart=neg, DomainEnd=expression)
I = ClusterOutput(dom)

# ==== cluster ValueOr0
value = ClusterInput()
value_2 = Number(value)
null = NullItem(Item=value_2)  # -> NullFlags, InvalidFlags, Description
filter = StreamFilter(Gate=null.NullFlags, Stream0=value_2, Stream1="0")
valueor0 = Number(filter)
valueor0_2 = ClusterOutput(valueor0)

# ==== cluster PreviewPlane: Preview a plane with axis colors and naming.
axis_length = ClusterInput()
plane = ClusterInput()
axis_length_2 = Number(axis_length)
plane_2 = Plane(plane)
deplane = DeconstructPlane(Plane=plane_2)  # -> Origin, XAxis, YAxis, ZAxis
line = LineSDL(Start=deplane.Origin, Direction=deplane.YAxis, Length=axis_length_2)
line_2 = LineSDL(Start=deplane.Origin, Direction=deplane.XAxis, Length=axis_length_2)
line_3 = LineSDL(Start=deplane.Origin, Direction=deplane.ZAxis, Length=axis_length_2)
swatch = ColourSwatch(SwatchColor=RGB(235, 52, 79))
swatch_2 = ColourSwatch(SwatchColor=RGB(0, 166, 157))
swatch_3 = ColourSwatch(SwatchColor=RGB(240, 117, 24))
end = EndPoints(Curve=line_2)  # -> Start, End
end_2 = EndPoints(Curve=line)  # -> Start, End
end_3 = EndPoints(Curve=line_3)  # -> Start, End
tag = TextTag(Location=end.End, Text="X", Colour=swatch)
tag_2 = TextTag(Location=end_2.End, Text="Y", Colour=swatch_2)
tag_3 = TextTag(Location=end_3.End, Text="Z", Colour=swatch_3)
preview = CustomPreview(Geometry=line_2, Material=swatch)
preview_2 = CustomPreview(Geometry=line, Material=swatch_2)
preview_3 = CustomPreview(Geometry=line_3, Material=swatch_3)

# ==== cluster ViewRectangle
view = ClusterInput()
view_2 = Data(view)
nickname = NAME(view=view_2)  # -> c, x, y, z, h, w
# ---------- nickname: Python ----------
uselss, c, x, y, z = view.GetCameraFrame()
h = view.FrustumHeight
w = view.FrustumWidth
# ---------- end nickname ----------
rev = Reverse(Vector=nickname.x)
rev_2 = Reverse(Vector=nickname.y)
pl = ConstructPlane(Origin=nickname.c, XAxis=rev, YAxis=nickname.y)
_2d = _2D(x=nickname.w)
_2d_2 = _2D(x=nickname.h)
rectangle = Rectangle(Plane=pl, XSize=_2d, YSize=_2d_2, Radius=0)  # -> Rectangle, Length
rec = Rectangle(rectangle.Rectangle)
rec_2 = ClusterOutput(rec)

# ==== cluster ExportBlock: Export geometry with layer names to a file.
path = ClusterInput()
name = ClusterInput()
url = ClusterInput()
geo = ClusterInput()
layer_name = ClusterInput()
export = ClusterInput()
path_2 = FilePath(path)
name_2 = Text(name)
url_2 = Text(url)
geo_2 = Geometry(geo)
layer_name_2 = Text(layer_name)
export_2 = Boolean(export)
layer = ModelLayer(Name=layer_name_2)  # -> Layer, Name, Hidden, Locked, DisplayColour, Material, Linetype
object = ModelObject(Geometry=geo_2, Layer=layer.Layer)  # -> Object, Geometry, Name, Layer, Visibility, Display, Drafting, Render
block_definition = ModelBlockDefinition(Objects=object.Object, Name=name_2, URL=url_2)  # -> BlockDefinition, Objects, Units, Name, Notes, URL, URLDescription
export_definition = ExportModelBlockDefinition(BlockDefinition=block_definition.BlockDefinition, FilePath=path_2, Overwrite="T", Export=export_2)  # -> BlockDefinition, FilePath, Exported
block_definition_2 = ModelBlockDefinition(export_definition.BlockDefinition)
path_3 = FilePath(export_definition.FilePath)
exported = Boolean(export_definition.Exported)
path_4 = ClusterOutput(path_3)
exported_2 = ClusterOutput(exported)
block_definition_3 = ClusterOutput(block_definition_2)

# ==== cluster PreviewGeometry: Preview geometry by ungrouping everything, showing light surfaces and dark edges.
sc = ClusterInput()
geo = ClusterInput()
geo_2 = Geometry(flatten(geo))
sc_2 = Number(sc)
expression = Expression(x=sc_2, Expression="x+1")
swatch = ColourSwatch(SwatchColor=RGB(0, 0, 0))
swatch_2 = ColourSwatch(SwatchColor=RGB(255, 255, 255))
ungroup = Ungroup(Group=geo_2)
ungroup_2 = Ungroup(Group=ungroup)
ungroup_3 = Ungroup(Group=ungroup_2)
ungroup_4 = Ungroup(Group=ungroup_3)
log = Logarithm(Value=expression)
clean = CleanTree(RemoveNulls=True, RemoveInvalid=True, RemoveEmpty=invert(False), Tree=ungroup_4)  # -> flatten(Tree)
multiplication = Multiplication(A=log, B=Slider(0.05, range=0..1))
linetype = ModelLinetype(Name="semio", Width=multiplication)  # -> ModelLinetype, Name, Segments, CapStyle, JoinStyle, Width, WidthUnits, TaperWidths, TaperPositions
dispatch = CSharpScript(D=clean)  # -> P, C, B, M, R
# ---------- dispatch: C# ----------
// Grasshopper Script Instance
#region Usings
using System;
using System.Linq;
using System.Collections;
using System.Collections.Generic;
using System.Drawing;

using Rhino;
using Rhino.Geometry;

using Grasshopper;
using Grasshopper.Kernel;
using Grasshopper.Kernel.Data;
using Grasshopper.Kernel.Types;
#endregion

public class Script_Instance : GH_ScriptInstance
{
    #region Notes
    /* 
      Members:
        RhinoDoc RhinoDocument
        GH_Document GrasshopperDocument
        IGH_Component Component
        int Iteration

      Methods (Virtual & overridable):
        Print(string text)
        Print(string format, params object[] args)
        Reflect(object obj)
        Reflect(object obj, string method_name)
    */
    #endregion

    private void RunScript(
	object D,
	ref object P,
	ref object C,
	ref object B,
	ref object M,
	ref object R)
    {
        if (D is Curve) C = D; // Curve
        else if (
            D is Rhino.Geometry.Point ||
            D is PointCloud
            )
            P = D; // Point
        else if ( D is Mesh) M = D; // Mesh
        else if (
            D is Surface ||
            D is Extrusion ||
            D is SubD ||
            D is Brep
            )
            B = D; // Brep
        else R = D; // Rest
            
    }
}
# ---------- end dispatch ----------
clean_2 = CleanTree(RemoveNulls=True, RemoveInvalid=True, RemoveEmpty=False, Tree=dispatch.M)
clean_3 = CleanTree(RemoveNulls=True, RemoveInvalid=True, RemoveEmpty=False, Tree=dispatch.R)
clean_4 = CleanTree(RemoveNulls=True, RemoveInvalid=True, RemoveEmpty=False, Tree=dispatch.B)
clean_5 = CleanTree(RemoveNulls=True, RemoveInvalid=True, RemoveEmpty=False, Tree=dispatch.P)
clean_6 = CleanTree(RemoveNulls=True, RemoveInvalid=True, RemoveEmpty=False, Tree=dispatch.C)
debrep = DeconstructBrep(Brep=clean_4)  # -> Faces, Edges, Vertices
preview = CustomPreview(Geometry=flatten(clean_5), Material=swatch)
preview_2 = CustomPreview(Geometry=flatten(debrep.Faces), Material=swatch_2)
preview_3 = CustomPreview(Geometry=flatten(clean_2), Material=swatch_2)
preview_4 = CustomPreview(Geometry=flatten(clean_3), Material=swatch)
curve_preview = CustomCurvePreview(Curve=clean_6, Linetype=linetype.ModelLinetype, Colour=swatch)
curve_preview_2 = CustomCurvePreview(Curve=debrep.Edges, Linetype=linetype.ModelLinetype, Colour=swatch)

# ==== cluster PreviewPort: Preview a port by showing the point and direction and if exists: id, family and compatible families.
po = ClusterInput()
sc = ClusterInput()
sc_2 = Number(sc)
po_2 = Port(po)
por = ModelPort(Port=po_2)  # -> Port, Valid, Id, Description, Mandatory, Family, CompatibleFamilies, Point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
swatch = ColourSwatch(SwatchColor=RGB(235, 52, 79))
swatch_2 = ColourSwatch(SwatchColor=RGB(250, 149, 0))
amp = Amplitude(Vector=por.Direction, Amplitude=sc_2)
lng = ListLength(List=por.CompatibleFamilies)
expression = Expression(x=por.Family, Expression="x=\"\"")
cull = CullPattern(List=por.Point, CullPattern=expression)
expression_2 = Expression(x=lng, Expression="x=0")
join = TextJoin(Text=por.CompatibleFamilies, Join=",")
expression_3 = Expression(x=sc_2, Expression="x+1")
merge = Merge(Data1=":")
trim = TrimTree(Tree=join, Depth=1)
trim_2 = TrimTree(Tree=expression_2, Depth=1)
log = Logarithm(Value=expression_3)
item = ListItem(List=merge, Index=expression, Wrap=invert(True))
concat = Concatenate(FragmentA="[", FragmentB=trim, FragmentC="]")
expression_4 = Expression(y=trim_2, Expression="x")
merge_2 = Merge(Data1=graft(concat), Data2=graft(expression_4))
item_2 = ListItem(List=merge_2, Index=graft(expression), Wrap=invert(True))
multiplication = Multiplication(A=log, B=Slider(2, range=0..10))
trim_3 = TrimTree(Tree=item_2, Depth=1)
concat_2 = Concatenate(FragmentA=por.Id, FragmentB=item, FragmentC=por.Family, FragmentD=trim_3)
preview = CustomPreview(Geometry=cull, Material=swatch)
tag = TextTag(Location=por.Point, Text=concat_2, Colour=swatch)
vdisex = VectorDisplayEx(Point=por.Point, Vector=amp, Colour=ColourSwatch(SwatchColor=RGB(0, 166, 157)), Width=multiplication)

# ==== cluster OppinionatedType: Construct a type following the oppinionated conventions of semio. All representations are saved under representations folder where each representation is saved once natively (.3dm) and once exported (.glb). Further a collider representation is required. All names and file names are standardized.
emoji = Panel("")
name = Panel("Default")
abbreviation = Panel("Dft?")
nn = Panel("De")
prm = ModelParam(Na=name, NN=nn, Dc="The optional default representation geometry group.", Op=Toggle(True), Ru=Toggle(True))  # -> Param, Name, NickName, Description, Optional, Success; inputs Pr: tree, Op: Boolean, Ru: Boolean
# ---------- prm: Python ----------
#Component Information
#--------------------------------------------------------------------------------------------
if ghenv.Component.RunCount<2:
    #General
    #--------------------------------------------------------------------------------------------
    __author__ = "Ueli Saluz"
    __version__ = "2025.06.18"
    
    ghenv.Component.Name = "Model Param"
    ghenv.Component.NickName = "~Prm"
    ghenv.Component.Description = "Deconstruct or modify a param."
    ghenv.Component.Message = "VER 1.0"
    ghenv.Component.Category = "semio"
    ghenv.Component.SubCategory = "Scripting"
    
     #Inputs
    #--------------------------------------------------------------------------------------------
    inputIndex=0
    
    ghenv.Component.Params.Input[inputIndex].Name = "Param"
    ghenv.Component.Params.Input[inputIndex].NickName = "Pr"
    ghenv.Component.Params.Input[inputIndex].Description = "Connect the param to desconstruct or modify here with one wire."
    ghenv.Component.Params.Input[inputIndex].Optional = False
    inputIndex+=1

    ghenv.Component.Params.Input[inputIndex].Name = "Name"
    ghenv.Component.Params.Input[inputIndex].NickName = "Na"
    ghenv.Component.Params.Input[inputIndex].Description = "Name of the param."
    ghenv.Component.Params.Input[inputIndex].Optional = False
    inputIndex+=1
    
    ghenv.Component.Params.Input[inputIndex].Name = "NickName"
    ghenv.Component.Params.Input[inputIndex].NickName = "NN"
    ghenv.Component.Params.Input[inputIndex].Description = "Nickname of the param."
    ghenv.Component.Params.Input[inputIndex].Optional = False
    inputIndex+=1
    
    ghenv.Component.Params.Input[inputIndex].Name = "Description"
    ghenv.Component.Params.Input[inputIndex].NickName = "Dc"
    ghenv.Component.Params.Input[inputIndex].Description = "Description of the param."
    ghenv.Component.Params.Input[inputIndex].Optional = True
    inputIndex+=1
    
    ghenv.Component.Params.Input[inputIndex].Name = "Optional"
    ghenv.Component.Params.Input[inputIndex].NickName = "Op"
    ghenv.Component.Params.Input[inputIndex].Description = "Wheather the param is optional."
    ghenv.Component.Params.Input[inputIndex].Optional = True
    inputIndex+=1
    
    ghenv.Component.Params.Input[inputIndex].Name = "Run"
    ghenv.Component.Params.Input[inputIndex].NickName = "Ru"
    ghenv.Component.Params.Input[inputIndex].Description = "Modify the param."
    ghenv.Component.Params.Input[inputIndex].Optional = True
    inputIndex+=1
    
    #Outputs
    #--------------------------------------------------------------------------------------------
    outputIndex=0
    
    ghenv.Component.Params.Output[outputIndex].Name = "Param"
    ghenv.Component.Params.Output[outputIndex].NickName = "Param"
    ghenv.Component.Params.Output[outputIndex].Description = "The desconstruct or modified param"
    ghenv.Component.Params.Output[outputIndex].Optional = False
    outputIndex+=1
    
    ghenv.Component.Params.Output[outputIndex].Name = "Name"
    ghenv.Component.Params.Output[outputIndex].NickName = "Name"
    ghenv.Component.Params.Output[outputIndex].Description = "Name of the param."
    ghenv.Component.Params.Output[outputIndex].Optional = False
    outputIndex+=1
    
    ghenv.Component.Params.Output[outputIndex].Name = "NickName"
    ghenv.Component.Params.Output[outputIndex].NickName = "NickName"
    ghenv.Component.Params.Output[outputIndex].Description = "Nickname of the param."
    ghenv.Component.Params.Output[outputIndex].Optional = False
    outputIndex+=1
    
    ghenv.Component.Params.Output[outputIndex].Name = "Description"
    ghenv.Component.Params.Output[outputIndex].NickName = "Description"
    ghenv.Component.Params.Output[outputIndex].Description = "Description of the param."
    ghenv.Component.Params.Output[outputIndex].Optional = True
    outputIndex+=1
    
    ghenv.Component.Params.Output[outputIndex].Name = "Optional"
    ghenv.Component.Params.Output[outputIndex].NickName = "Optional"
    ghenv.Component.Params.Output[outputIndex].Description = "Wheather the param is optional."
    ghenv.Component.Params.Output[outputIndex].Optional = True
    outputIndex+=1
    
    ghenv.Component.Params.Output[outputIndex].Name = "Success"
    ghenv.Component.Params.Output[outputIndex].NickName = "Success"
    ghenv.Component.Params.Output[outputIndex].Description = "Wheather the operation was successful."
    ghenv.Component.Params.Output[outputIndex].Optional = False
    outputIndex+=1

input = ghenv.Component.Params.Input[0]
param = input.Sources[0]
if Ru:
    if Na:
        param.Name = Na
    if NN:
        param.NickName = NN
    if Dc:
        param.Description = Dc
    if Op:
        param.Optional = Op
    Success = True
else:
    Success = False
Param = param
Name = param.Name
NickName = param.NickName
Description = param.Description
Optional = param.Optional
# ---------- end prm ----------
concat = Concatenate(FragmentA="\"", FragmentB=prm.Description, FragmentC="\"")
merge = Merge(Data1=emoji, Data2=prm.NickName, Data3=abbreviation, Data4=prm.Name, Data5=concat)
join = TextJoin(Text=merge, Join=",")
de = ClusterInput()
paper = ClusterInput()
panel = Panel(join)
path = ClusterInput()
na = ClusterInput()
description = ClusterInput()
variant = ClusterInput()
rp = ClusterInput()
collider = ClusterInput()
volume = ClusterInput()
ex = ClusterInput()
group = ClusterInput()
po = ClusterInput()
authors = ClusterInput()
qualities = ClusterInput()
sep = Separator()  # -> S; same code as sep
path_2 = FilePath(path)
na_2 = Name(na)
description_2 = Description(description)
variant_2 = Variant(variant)
de_2 = Default(de)
rp_2 = Representation(rp)
volume_2 = Volume(volume)
group_2 = Group(group)
paper_2 = Paper(paper)
collider_2 = Collider(collider)
authors_2 = Authors(authors)
qualities_2 = Qualities(qualities)
po_2 = Port(po)
ex_2 = Export(ex)
merge_2 = Merge(Data1=de_2, Data2=paper_2, Data3=collider_2, Data4=volume_2)
rep = ModelRepresentation(Representation=rp_2)  # -> Representation, Valid, Url, Description, Tags, Qualities
rep_2 = ReplaceText(Text=variant_2, Find="/", Replace="slash", RecursiveReplace=False)
txt = NormalizeText(Text=na_2)  # -> Strict, Title, Underscore, Kebab, Pascal
split = SplitList(List=rep.Tags, Index="1")  # -> ListA, ListB
rep_3 = ReplaceText(Text=rep_2, Find="\", Replace="backslash", RecursiveReplace=False)
panel_2 = Panel(rp_2)
txt_2 = NormalizeText(Text=rep_3)  # -> Strict, Title, Underscore, Kebab, Pascal
join_2 = TextJoin(Text=split.ListB, Join="_")
panel_3 = Panel("""default
paper
collider
volume""")
concat_2 = Concatenate(FragmentA=txt.Kebab, FragmentD="_", FragmentB=txt_2.Kebab)
concat_3 = Concatenate(FragmentA="images", FragmentB=sep, FragmentC=concat_2, FragmentD=".png")
concat_4 = Concatenate(FragmentA="icons", FragmentB=sep, FragmentC=concat_2, FragmentD=".svg")
concat_5 = Concatenate(FragmentA=concat_2, FragmentB=".glb")
concat_6 = Concatenate(FragmentA=concat_2, FragmentD="_", FragmentB=join_2)
concat_7 = Concatenate(FragmentA="representations", FragmentB=sep, FragmentC=concat_2, FragmentD=".glb")
concat_8 = Concatenate(FragmentA="representations", FragmentB=sep, FragmentC=concat_2, FragmentD=".3dm")
concat_9 = Concatenate(FragmentA=concat_6, FragmentB=".glb")
concat_10 = Concatenate(FragmentA=concat_6, FragmentB=".3dm")
concat_11 = Concatenate(FragmentD=concat_2, FragmentC="_", FragmentA=panel_3, FragmentB=".3dm")
concat_12 = Concatenate(FragmentA=concat_2, FragmentC="_", FragmentB=panel_3, FragmentD=".glb")
concat_13 = Concatenate(FragmentA="representations", FragmentB=sep, FragmentC=concat_10)
concat_14 = Concatenate(FragmentA="representations", FragmentB=sep, FragmentC=concat_9)
concat_15 = Concatenate(FragmentA="representations", FragmentB=sep, FragmentC=concat_11)
concat_16 = Concatenate(FragmentA="representations", FragmentB=sep, FragmentC=concat_12)
panel_4 = Panel(concat_13)
rep_4 = ModelRepresentation(Url=concat_13, Tags=split.ListB)  # -> Representation, Valid, Url, Description, Tags, Qualities
rep_5 = ModelRepresentation(Url=graft(concat_16), Tags=graft(panel_3))  # -> Representation, Valid, Url, Description, Tags, Qualities
rep_6 = ModelRepresentation(Url=concat_14, Tags=split.ListB)  # -> Representation, Valid, Url, Description, Tags, Qualities
rep_7 = ModelRepresentation(Url=graft(concat_15), Tags=graft(panel_3))  # -> Representation, Valid, Url, Description, Tags, Qualities
rep_8 = ModelRepresentation(Url=concat_7)  # -> Representation, Valid, Url, Description, Tags, Qualities
rep_9 = ModelRepresentation(Url=concat_8)  # -> Representation, Valid, Url, Description, Tags, Qualities
trim = TrimTree(Tree=rep_4.Representation, Depth=1)
trim_2 = TrimTree(Tree=rep_6.Representation, Depth=1)
trim_3 = TrimTree(Tree=rep_7.Representation, Depth=1)
trim_4 = TrimTree(Tree=rep_5.Representation, Depth=1)
merge_3 = Merge(Data1=rep_8.Representation, Data2=rep_9.Representation, Data3=trim, Data4=trim_2, Data5=trim_4, Data6=trim_3)
concat_17 = Concatenate(FragmentA=path_2, FragmentB=sep, FragmentC=concat_16)
concat_18 = Concatenate(FragmentA=path_2, FragmentB=sep, FragmentC=concat_14)
concat_collider_glb = Concatenate(FragmentA=path_2, FragmentB=sep, FragmentC=concat_16)
cluster = Cluster(gr=merge_2)  # -> geo_2, txt_2
typ = ModelType(
    Name=txt.Title,
    Description=description_2,
    Icon=concat_4,
    Image=concat_3,
    Variant=variant_2,
    Representations=merge_3,
    Ports=po_2,
    Authors=authors_2,
    Qualities=qualities_2)  # -> Type, Valid, Name, Description, Icon, Image, Variant, Stock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
geo = ExportGeometry(F=concat_collider_glb, G=collider_2, R=ex_2)  # -> S; inputs G: tree of GeometryBase, R: Boolean
# ---------- geo: C# ----------
// Grasshopper Script Instance
#region Usings
using System;
using System.Linq;
using System.Collections;
using System.Collections.Generic;
using System.Drawing;
using System.IO;

using Rhino;
using Rhino.Geometry;

using Grasshopper;
using Grasshopper.Kernel;
using Grasshopper.Kernel.Data;
using Grasshopper.Kernel.Types;
#endregion

public class Script_Instance : GH_ScriptInstance
{
    #region Notes
    /* 
      Members:
        RhinoDoc RhinoDocument
        GH_Document GrasshopperDocument
        IGH_Component Component
        int Iteration

      Methods (Virtual & overridable):
        Print(string text)
        Print(string format, params object[] args)
        Reflect(object obj)
        Reflect(object obj, string method_name)
    */
    #endregion

    private void RunScript(object F, DataTree<GeometryBase> G, bool R, ref object S)
    {
        // inspired from https://github.com/jhorikawa/GrasshopperProgrammingTutorials/blob/master/0015%20Export%20Geometry%20with%20Grasshopper%20C%23/Export%20Geometry%20with%20Grasshopper%20C%23.gh
        if(R){
            var guids = new List<Guid>();

            for(int i = 0; i < G.BranchCount; i++){
                for(int n = 0; n < G.Branches[i].Count; n++){
                var geom = G.Branches[i][n];
                var guid = Rhino.RhinoDoc.ActiveDoc.Objects.Add(geom);
                guids.Add(guid);
                }
            }

            Rhino.RhinoDoc.ActiveDoc.Objects.Select(guids);

            string cmd = "_-Export " + "\"" + F + "\"" + " _Enter _Enter";

            Rhino.RhinoApp.RunScript(cmd, false);

            Rhino.RhinoDoc.ActiveDoc.Objects.Delete(guids, true);
            S = true;
        }
    }
}
# ---------- end geo ----------
concat_3dm = Concatenate(FragmentA=path_2, FragmentB=sep, FragmentC=concat_13)
geo_2 = ExportGeometry(F=concat_18, G=collider_2, R=ex_2)  # -> S; inputs G: tree of GeometryBase, R: Boolean; same code as geo
geo_3 = ExportGeometry(F=concat_17, G=cluster.geo_2, R=ex_2)  # -> S; inputs G: tree of GeometryBase, R: Boolean; same code as geo
geo_4 = ExportGeometry()  # -> S; inputs G: tree of GeometryBase, R: Boolean; same code as geo
ty = Type(typ.Type)
ba = Text(concat_2)
ty_2 = ClusterOutput(ty)
ba_2 = ClusterOutput(ba)
blc = ExportBlock_3(export=ex_2, ob=group_2)  # -> block_definition_3, path_4, exported_2
blc_2 = ExportBlock_2(path=path_2, gr=group_2, ty=typ.Type, rp=rp_2, export=ex_2)  # -> block_definition_3, path_4, exported_2
blc_3 = ExportBlock_2(path=path_2, export=ex_2)  # -> block_definition_3, path_4, exported_2
geo_5 = ExportGeometry(F=concat_3dm, G=group_2, R=ex_2)  # -> S; inputs G: tree of GeometryBase, R: Boolean; same code as geo

# ==== cluster SortSurfacesByOrientation
B = ClusterInput()
debrep = DeconstructBrep(Brep=B)  # -> flatten(Faces), Edges, Vertices
facen = FaceNormals(Mesh=debrep.Faces)  # -> simplify(Centers), simplify(Normals)
item = ListItem(List=facen.Normals, Index=0, Wrap=True)  # -> flatten(Item)
devec = DeconstructVector(Vector=item)  # -> XComponent, YComponent, ZComponent
smaller = SmallerThan(FirstNumber=devec.ZComponent, SecondNumber="0.01")  # -> SmallerThan, OrEqualTo
smaller_2 = SmallerThan(FirstNumber=devec.ZComponent, SecondNumber="-0.01")  # -> SmallerThan, OrEqualTo
larger = LargerThan(FirstNumber=devec.ZComponent, SecondNumber="0.01")  # -> LargerThan, OrEqualTo
larger_2 = LargerThan(FirstNumber=devec.ZComponent, SecondNumber="-0.01")  # -> LargerThan, OrEqualTo
and = GateAnd(A=smaller.SmallerThan, B=smaller_2.SmallerThan)
and_2 = GateAnd(A=smaller.SmallerThan, B=larger_2.LargerThan)
cull = CullPattern(List=debrep.Faces, CullPattern=and)
cull_2 = CullPattern(List=debrep.Faces, CullPattern=larger.LargerThan)
cull_3 = CullPattern(List=debrep.Faces, CullPattern=and_2)
base = Surface(cull)
roof = Surface(cull_2)
walls = Surface(cull_3)
base_2 = ClusterOutput(base)
roof_2 = ClusterOutput(roof)
walls_2 = ClusterOutput(walls)

# ==== cluster ExportBlock_2: Export geometry with layer names to a file.
gr = ClusterInput()
ty = ClusterInput()
export = ClusterInput()
rp = ClusterInput()
path = ClusterInput()
path_2 = FilePath(path)
ty_2 = Type(ty)
rp_2 = Representation(rp)
export_2 = Boolean(export)
cluster = Cluster(gr=gr)  # -> geo_2, txt_2
layer = ModelLayer(Name=cluster.txt_2)  # -> Layer, Name, Hidden, Locked, DisplayColour, Material, Linetype
object = ModelObject(Geometry=cluster.geo_2, Layer=layer.Layer)  # -> Object, Geometry, Name, Layer, Visibility, Display, Drafting, Render
typ = ModelType(Type=ty_2)  # -> Type, Valid, Name, Description, Icon, Image, Variant, Stock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
rep = ModelRepresentation(Representation=rp_2)  # -> Representation, Valid, Url, Description, Tags, Qualities
trim = TrimTree(Tree=object.Object, Depth="5")
concat = Concatenate(FragmentA=typ.Type, FragmentC=":", FragmentB=rep.Representation)
block_definition = ModelBlockDefinition(Objects=trim, Name=concat, Notes=typ.Description)  # -> BlockDefinition, Objects, Units, Name, Notes, URL, URLDescription
export_definition = ExportModelBlockDefinition(BlockDefinition=block_definition.BlockDefinition, FilePath=path_2, Overwrite="T", Export=export_2)  # -> BlockDefinition, FilePath, Exported
block_definition_2 = ModelBlockDefinition(export_definition.BlockDefinition)
path_3 = FilePath(export_definition.FilePath)
exported = Boolean(export_definition.Exported)

# ---- group: Export single files. WIP
sep = Separator()  # -> S
# ---------- sep: C# ----------
#region Usings
using System;
using System.Linq;
using System.Collections;
using System.Collections.Generic;
using System.Drawing;
using System.IO;

using Rhino;
using Rhino.Geometry;

using Grasshopper;
using Grasshopper.Kernel;
using Grasshopper.Kernel.Data;
using Grasshopper.Kernel.Types;
#endregion

public class Script_Instance : GH_ScriptInstance
{
    private void RunScript(ref object S)
    {
        S = Path.DirectorySeparatorChar;
    }
}
# ---------- end sep ----------
rep_2 = ReplaceText(Text=rep.Url, Find="/", Replace=sep, RecursiveReplace=False)
item = ListItem(List=rep.Tags, Index=0, Wrap=True)
concat_2 = Concatenate(FragmentA=path_2, FragmentB=sep, FragmentC=rep_2)
mime = Mime({".glb": "model/gltf-binary", ".gltf": "model/gltf+json", ".stl": "model/stl", ".obj": "model/obj", ".blend": "model/x-blender", ".3dm": "model/vnd.3dm", ".ifc": "model/x-ifc", ".dwg": "model/acad", ".dxf": "model/dxf", ".rvt": "model/vnd.revit"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}, selected=".3dm")
trim_2 = TrimTree(Tree=item, Depth=1)
expression = Expression(x=trim_2, y=mime, Expression="x=y")
# WIP
dispatch = Dispatch(List=concat_2, DispatchPattern=expression)  # -> ListA, ListB
dispatch_2 = Dispatch(List=concat_2, DispatchPattern=expression)  # -> ListA, ListB

# ----
exported_2 = ClusterOutput(exported)
path_4 = ClusterOutput(path_3)
block_definition_3 = ClusterOutput(block_definition_2)

# ==== cluster ExportBlock_3: Export geometry with layer names to a file.
ob = ClusterInput()
G = ClusterInput()
dc = ClusterInput()
path = ClusterInput()
name = ClusterInput()
url = ClusterInput()
layer_n = ClusterInput()
export = ClusterInput()
ob_2 = ModelObject(ob)
group = Group(Geometry=G)
path_2 = FilePath(path)
name_2 = Text(name)
url_2 = Text(url)
export_2 = Boolean(export)
layer_n_2 = Name(layer_n)
dc_2 = DisplayColour(dc)
object = ModelObject(Object=group)  # -> Object, Geometry, Name, Layer, Visibility, Display, Drafting, Render
layer = ModelLayer(Name=layer_n_2, DisplayColour=dc_2)  # -> Layer, Name, Hidden, Locked, DisplayColour, Material, Linetype, PrintColour, PrintWidth
object_2 = ModelObject(group)
group_2 = NamedGroup(Geometry=group)  # -> Group, Geometry, Name
object_3 = ModelObject(Geometry=object_2, Layer=layer.Layer)  # -> Object, Geometry, Name, Layer, Visibility, Display, Drafting, Render
object_4 = ModelObject(Object=object_2)  # -> Object, Geometry, Name, Layer, Visibility, Display, Drafting, Render
block_definition = ModelBlockDefinition(Objects=object_3.Object, Name=name_2, URL=url_2)  # -> BlockDefinition, Objects, Units, Name, Notes, URL, URLDescription
panel = Panel(object_4.Layer)
export_definition = ExportModelBlockDefinition(BlockDefinition=block_definition.BlockDefinition, FilePath=path_2, Overwrite="T", Export=export_2)  # -> BlockDefinition, FilePath, Exported
block_definition_2 = ModelBlockDefinition(export_definition.BlockDefinition)
path_3 = FilePath(export_definition.FilePath)
exported = Boolean(export_definition.Exported)
path_4 = ClusterOutput(path_3)
exported_2 = ClusterOutput(exported)
block_definition_3 = ClusterOutput(block_definition_2)

# ==== cluster Cluster
gr = ClusterInput()
gr_2 = Group(gr)
group = NamedGroup(Group=gr_2)  # -> Group, Geometry, Name
group_2 = NamedGroup(Group=group.Geometry)  # -> Group, Geometry, Name
expression = Expression(x=graft(group.Name), y=group_2.Name, Expression="x")
group_3 = NamedGroup(Group=group_2.Geometry)  # -> Group, Geometry, Name
expression_2 = Expression(x=graft(expression), y=group_3.Name, Expression="x")
expression_3 = Expression(x=graft(group_2.Name), y=group_3.Name, Expression="x")
group_4 = NamedGroup(Group=group_3.Geometry)  # -> Group, Geometry, Name
expression_4 = Expression(x=graft(expression_2), y=group_4.Name, Expression="x")
expression_5 = Expression(x=graft(expression_3), y=group_4.Name, Expression="x")
expression_6 = Expression(x=graft(group_3.Name), y=group_4.Name, Expression="x")
group_5 = NamedGroup(Group=group_4.Geometry)  # -> Group, Geometry, Name
expression_7 = Expression(x=graft(expression_4), y=group_5.Name, Expression="x")
expression_8 = Expression(x=graft(expression_5), y=group_5.Name, Expression="x")
expression_9 = Expression(x=graft(expression_6), y=group_5.Name, Expression="x")
expression_10 = Expression(x=graft(group_4.Name), y=group_5.Name, Expression="x")
group_6 = NamedGroup(Group=group_5.Geometry)  # -> Group, Geometry, Name
expression_11 = Expression(x=graft(expression_7), y=group_6.Name, Expression="x")
expression_12 = Expression(x=graft(expression_9), y=group_6.Name, Expression="x")
expression_13 = Expression(x=graft(expression_8), y=group_6.Name, Expression="x")
expression_14 = Expression(x=graft(expression_10), y=group_6.Name, Expression="x")
expression_15 = Expression(x=graft(group_5.Name), y=group_6.Name, Expression="x")
merge = Merge(
    Data1=expression_11,
    Data2=expression_13,
    Data3=expression_12,
    Data4=expression_14,
    Data5=expression_15,
    Data6=group_6.Name)
join = TextJoin(Text=merge, Join="::")
geo = Geometry(group_6.Geometry)
txt = Text(join)
geo_2 = ClusterOutput(geo)
txt_2 = ClusterOutput(txt)
